# Grasshopper definition FlowRatetest.gh (Grasshopper 0.9.76)
# plug-ins: VirtualWindTunnel

panel = Panel("""-0.927115,-0.605374,0.0134573
-1.04663,-0.713905,0.00891933
-1.00876,-0.733181,0.00771436
-1.09905,-0.811946,0.00444105
-1.08676,-0.849971,0.0032158
-1.04725,-0.87129,0.00269734
-0.992095,-0.847339,0.00319938
-0.580232,-0.155356,-0.00227963
-0.675163,-0.246533,0.00621932
-0.707792,-0.335547,0.01485
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""")
brep = Brep(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)
number_slider = Slider(0.83, range=0..1)
custom_mesh_settings = SettingsCustom(
    StitchSeams=True,
    SimplePlanes=False,
    Refine=True,
    MinCount=16,
    MaxCount=400,
    AspectRatio=20,
    MaxDistance=0,
    MaxAngle=20,
    MinEdge=number_slider,
    MaxEdge=number_slider)
mesh = MeshBrep(Brep=brep, Settings=custom_mesh_settings)
demesh = DeconstructMesh(Mesh=mesh)  # -> Vertices, Faces, Colours, Normals
brep_2 = Brep(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)
brep_3 = Brep(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)
vec = Vector(panel)
area = Area(Geometry=mesh)  # -> Area, Centroid
pt = Point(demesh.Vertices)
mesh_2 = MeshBrep(Brep=brep_2, Settings=custom_mesh_settings)
mesh_3 = MeshBrep(Brep=brep_3, Settings=custom_mesh_settings)
flowrate = ComputeFlowRate(CpValuesVelocityVectors=vec, Mesh=mesh)  # -> Result, Min, Max
flowratecp = ComputeFlowRateFromCp(Cp1=Slider(6, range=0..10), Cp2=Slider(0, range=0..10), Mesh1=mesh_2, Mesh2=mesh_3)
panel_2 = Panel(area.Area)
panel_3 = Panel(flowrate.Result)
panel_4 = Panel(flowratecp)
