# Grasshopper definition Pu.gh (Grasshopper 0.9.76)
# plug-ins: Python Interpreter, VirtualWindTunnel

# 40
number_slider = Slider(0.066, range=0..0.4)  # disabled
# 10
number_slider_2 = Slider(0.264, range=0..1)  # disabled
# 20
number_slider_3 = Slider(0.132, range=0..1)  # disabled
# 80
number_slider_4 = Slider(0.033, range=0..0.1)  # disabled
panel = Panel("C:\MeshingPaper\Pu\")  # disabled
panel_5 = Panel("C:\MeshingPaper\take2\cyl\level_const\coarse\")  # disabled
panel_6 = Panel("C:\MeshingPaper\take2\cyl\level_const\very_coarse\")  # disabled
panel_7 = Panel("C:\MeshingPaper\take2\cyl\level_const\normal\")  # disabled
panel_8 = Panel("C:\MeshingPaper\take2\cyl\level_const\fine\")  # disabled
number_slider_5 = Slider(0.095, range=0..1)  # disabled
number_slider_6 = Slider(0.5, range=0..1)  # disabled
number_slider_7 = Slider(1, range=0..1)  # disabled
number_slider_8 = Slider(0.095, range=0..1)  # disabled
number_slider_9 = Slider(0.095, range=0..1)  # disabled
number_slider_10 = Slider(1, range=0..1)  # disabled
number_slider_11 = Slider(1, range=0..1)  # disabled
toggle = BooleanToggle(True)  # disabled
number_slider_12 = Slider(0.095, range=0..1)  # disabled
wind_dir = ControlKnob(Decimals=0, Limit=True, Maximum=359, Minimum=0, Range=360, Value=0)  # disabled
toggle_2 = BooleanToggle(True)  # disabled
toggle_3 = BooleanToggle(True)  # disabled
panel_9 = Panel("27")  # disabled
number_slider_13 = Slider(1, range=0..1)  # disabled
wind_dir_2 = ControlKnob(Decimals=0, Limit=True, Maximum=359, Minimum=0, Range=360, Value=0)  # disabled
wind_dir_3 = ControlKnob(Decimals=0, Limit=True, Maximum=359, Minimum=0, Range=360, Value=0)  # disabled
panel_10 = Panel("10")  # disabled
panel_11 = Panel("60")  # disabled
toggle_4 = BooleanToggle(True)  # disabled
wind_dir_4 = ControlKnob(Decimals=0, Limit=True, Maximum=359, Minimum=0, Range=360, Value=0)  # disabled
geo = Geometry(<mesh referenced from the Rhino model>)  # disabled
panel_12 = Panel("127")  # disabled
geo_2 = Geometry(<mesh referenced from the Rhino model>)  # disabled
geo_3 = Geometry(<mesh referenced from the Rhino model>)  # disabled
button = Button()  # disabled
button_2 = Button()  # disabled
button_3 = Button()  # disabled
geo_4 = Geometry(<mesh referenced from the Rhino model>)  # disabled
button_4 = Button()  # disabled
domaincyl = DomainCyl(
    Geometry=geo,
    Directory=panel_5,
    WindDir=wind_dir,
    DivisionsOuterCirc=panel_9,
    DivisionsZ=10,
    ScaleInnerR=number_slider_3,
    RAM=number_slider_7,
    CPUs=number_slider_7,
    Run=toggle)  # -> Out, Domain, Cyl; disabled
domaincyl_2 = DomainCyl(
    Geometry=geo_3,
    Directory=panel_7,
    WindDir=wind_dir_2,
    DivisionsOuterCirc=panel_11,
    DivisionsZ=10,
    ScaleInnerR=number_slider,
    RAM=number_slider_10,
    CPUs=number_slider_10,
    Run=toggle_3)  # -> Out, Domain, Cyl; disabled
domaincyl_3 = DomainCyl(
    Geometry=geo_2,
    Directory=panel_6,
    WindDir=wind_dir_3,
    DivisionsOuterCirc=panel_10,
    DivisionsZ=10,
    ScaleInnerR=number_slider_2,
    RAM=number_slider_11,
    CPUs=number_slider_11,
    Run=toggle_2)  # -> Out, Domain, Cyl; disabled
domaincyl_4 = DomainCyl(
    Geometry=geo_4,
    Directory=panel_8,
    WindDir=wind_dir_4,
    DivisionsOuterCirc=panel_12,
    DivisionsZ=10,
    ScaleInnerR=number_slider_4,
    RAM=number_slider_13,
    CPUs=number_slider_13,
    Run=toggle_4)  # -> Out, Domain, Cyl; disabled
panel_13 = Panel("0.0256232426078395")  # disabled
panel_14 = Panel("0.00625")  # disabled
clean = Clean(Dir=panel_5, Run=button)  # disabled
panel_15 = Panel("0.025")  # disabled
panel_16 = Panel("0.00625")  # disabled
clean_2 = Clean(Dir=panel_6, Run=button_3)  # disabled
clean_3 = Clean(Dir=panel_7, Run=button_2)  # disabled
panel_17 = Panel("0.0256232426078395")  # disabled
panel_18 = Panel("0.00625")  # disabled
python = PythonScript(x=domaincyl.Domain)  # -> out, a; disabled
# ---------- python: Python ----------
a = x.equalDivisions;
# ---------- end python ----------
panel_19 = Panel(python.a)  # disabled
python_2 = PythonScript(x=domaincyl_3.Domain)  # -> out, a; disabled; same code as python
clean_4 = Clean(Dir=panel_8, Run=button_4)  # disabled
panel_20 = Panel(python_2.a)  # disabled
python_3 = PythonScript(x=domaincyl_2.Domain)  # -> out, a; disabled; same code as python
panel_21 = Panel(python_3.a)  # disabled
python_4 = PythonScript(x=domaincyl_4.Domain)  # -> out, a; disabled; same code as python
cellsize = CellSize(Domain=domaincyl.Domain, BlockMeshCellSize=panel_13, DesiredCellSize=panel_14)  # disabled
panel_22 = Panel(python_4.a)  # disabled
number_slider_14 = Slider(2, range=0..10)  # disabled
cluster = Cluster(x=domaincyl.Domain)  # disabled
number_slider_15 = Slider(2, range=0..10)  # disabled
number_slider_16 = Slider(3, range=0..10)  # disabled
number_slider_17 = Slider(50, range=0..100)  # disabled
python_5 = PythonScript(x=domaincyl_2.Domain)  # -> out, a; disabled; same code as python
number_slider_18 = Slider(2, range=0..10)  # disabled
number_slider_19 = Slider(2, range=0..10)  # disabled
cluster_2 = Cluster(x=domaincyl_2.Domain)  # disabled
python_6 = PythonScript(x=domaincyl_3.Domain)  # -> out, a; disabled; same code as python
# layers constant
# zCells
cluster_3 = Cluster(x=domaincyl_3.Domain)  # disabled
number_slider_20 = Slider(2, range=0..10)  # disabled
number_slider_21 = Slider(3, range=0..10)  # disabled
number_slider_22 = Slider(50, range=0..100)  # disabled
number_slider_23 = Slider(2, range=0..10)  # disabled
number_slider_24 = Slider(3, range=0..10)  # disabled
number_slider_25 = Slider(50, range=0..100)  # disabled
cellsize_2 = CellSize(Domain=domaincyl_4.Domain, BlockMeshCellSize=panel_17, DesiredCellSize=panel_18)  # disabled
number_slider_26 = Slider(2, range=0..10)  # disabled
cluster_4 = Cluster(x=domaincyl_4.Domain)  # disabled
number_slider_27 = Slider(2, range=0..10)  # disabled
number_slider_28 = Slider(3, range=0..10)  # disabled
number_slider_29 = Slider(50, range=0..100)  # disabled
panel_23 = Panel(cluster)  # disabled
panel_24 = Panel(python_5.a)  # disabled
cellsize_3 = CellSize(Domain=domaincyl_2.Domain, BlockMeshCellSize=panel_24, DesiredCellSize=panel_16)  # disabled
panel_25 = Panel(python_6.a)  # disabled
cellsize_4 = CellSize(Domain=domaincyl_3.Domain, BlockMeshCellSize=panel_25, DesiredCellSize=panel_15)  # disabled
panel_26 = Panel(cluster_2)  # disabled
panel_27 = Panel(cluster_3)  # disabled
panel_28 = Panel(cellsize)  # disabled
crv = Curve(<curve referenced from the Rhino model>)  # disabled
panel_29 = Panel(cluster_4)  # disabled
panel_30 = Panel(cellsize_3)  # disabled
panel_31 = Panel(cellsize_4)  # disabled
crv_2 = Curve(<curve referenced from the Rhino model>)  # disabled
crv_3 = Curve(<curve referenced from the Rhino model>)  # disabled
panel_32 = Panel(cellsize_2)  # disabled
divide = DivideCurve(Curve=crv, Count=number_slider_17, Kinks=False)  # -> Points, Tangents, Parameters; disabled
mesh = Mesh(
    Domain=domaincyl.Domain,
    AccBuilding=number_slider_14,
    AccFeatures=number_slider_14,
    AccGround=number_slider_15,
    Layer=number_slider_16,
    Run=toggle)  # -> Out, Domain; disabled
crv_4 = Curve(<curve referenced from the Rhino model>)  # disabled
divide_2 = DivideCurve(Curve=crv_2, Count=number_slider_22, Kinks=False)  # -> Points, Tangents, Parameters; disabled
mesh_2 = Mesh(
    Domain=domaincyl_2.Domain,
    AccBuilding=number_slider_18,
    AccFeatures=number_slider_18,
    AccGround=number_slider_20,
    Layer=number_slider_21,
    Run=toggle_3)  # -> Out, Domain; disabled
divide_3 = DivideCurve(Curve=crv_3, Count=number_slider_25, Kinks=False)  # -> Points, Tangents, Parameters; disabled
mesh_3 = Mesh(
    Domain=domaincyl_3.Domain,
    AccBuilding=number_slider_19,
    AccFeatures=number_slider_23,
    AccGround=number_slider_23,
    Layer=number_slider_24,
    Run=toggle_2)  # -> Out, Domain; disabled
number_slider_30 = Slider(0, range=0..100)  # disabled
number_slider_31 = Slider(13, range=0..25)  # disabled
divide_4 = DivideCurve(Curve=crv_4, Count=number_slider_29, Kinks=False)  # -> Points, Tangents, Parameters; disabled
mesh_4 = Mesh(
    Domain=domaincyl_4.Domain,
    AccBuilding=number_slider_26,
    AccFeatures=number_slider_26,
    AccGround=number_slider_27,
    Layer=number_slider_28,
    Run=toggle_4)  # -> Out, Domain; disabled
number_slider_32 = Slider(0, range=0..10)  # disabled
number_slider_33 = Slider(0.005, range=0..100)  # disabled
toggle_5 = BooleanToggle(False)  # disabled
number_slider_34 = Slider(0, range=0..100)  # disabled
number_slider_35 = Slider(0, range=0..100)  # disabled
number_slider_36 = Slider(13, range=0..25)  # disabled
number_slider_37 = Slider(13, range=0..25)  # disabled
number_slider_38 = Slider(0, range=0..10)  # disabled
number_slider_39 = Slider(0, range=0..10)  # disabled
number_slider_40 = Slider(0.005, range=0..100)  # disabled
number_slider_41 = Slider(0.005, range=0..100)  # disabled
toggle_6 = BooleanToggle(False)  # disabled
toggle_7 = BooleanToggle(False)  # disabled
number_slider_42 = Slider(0.5, range=0..100)  # disabled
number_slider_43 = Slider(12, range=0..100)  # disabled
number_slider_44 = Slider(0, range=0..100)  # disabled
number_slider_45 = Slider(13, range=0..25)  # disabled
number_slider_46 = Slider(0, range=0..10)  # disabled
number_slider_47 = Slider(0.5, range=0..100)  # disabled
number_slider_48 = Slider(0.5, range=0..100)  # disabled
number_slider_49 = Slider(0.005, range=0..100)  # disabled
toggle_8 = BooleanToggle(False)  # disabled
number_slider_50 = Slider(12, range=0..100)  # disabled
number_slider_51 = Slider(12, range=0..100)  # disabled
number_slider_52 = Slider(0.5, range=0..100)  # disabled
number_slider_53 = Slider(0.01, range=0..1)  # disabled
number_slider_54 = Slider(12, range=0..100)  # disabled
number_slider_55 = Slider(0.01, range=0..1)  # disabled
probes = Probes(Domain=domaincyl.Domain, Points=divide.Points, PointName=1, Run=toggle_5)  # disabled
number_slider_56 = Slider(0.01, range=0..1)  # disabled
number_slider_57 = Slider(4, range=0..10)  # disabled
probes_2 = Probes(Domain=domaincyl_2.Domain, Points=divide_2.Points, PointName=1, Run=toggle_6)  # disabled
probes_3 = Probes(Domain=domaincyl_3.Domain, Points=divide_3.Points, PointName=1, Run=toggle_7)  # disabled
number_slider_58 = Slider(26, range=0..100)  # disabled
number_slider_59 = Slider(7659, range=0..10000)  # disabled
gradient = Gradient(
    LowerLimit=number_slider_32,
    UpperLimit=number_slider_31,
    Parameter=probes,
    stops=[0: RGB(0, 128, 0), 0.5: RGB(255, 255, 0), 1: RGB(255, 0, 0)])  # disabled
number_slider_60 = Slider(0.01, range=0..1)  # disabled
number_slider_61 = Slider(4, range=0..10)  # disabled
number_slider_62 = Slider(4, range=0..10)  # disabled
number_slider_63 = Slider(26, range=0..100)  # disabled
abl = ABL(Uref=number_slider_43, Zref=number_slider_42, Z0=number_slider_33, ZGround=number_slider_30)  # disabled
gradient_2 = Gradient(
    LowerLimit=number_slider_38,
    UpperLimit=number_slider_36,
    Parameter=probes_2,
    stops=[0: RGB(0, 128, 0), 0.5: RGB(255, 255, 0), 1: RGB(255, 0, 0)])  # disabled
number_slider_64 = Slider(7659, range=0..10000)  # disabled
probes_4 = Probes(Domain=domaincyl_4.Domain, Points=divide_4.Points, PointName=1, Run=toggle_8)  # disabled
number_slider_65 = Slider(26, range=0..100)  # disabled
number_slider_66 = Slider(7659, range=0..10000)  # disabled
gradient_3 = Gradient(
    LowerLimit=number_slider_39,
    UpperLimit=number_slider_37,
    Parameter=probes_3,
    stops=[0: RGB(0, 128, 0), 0.5: RGB(255, 255, 0), 1: RGB(255, 0, 0)])  # disabled
button_5 = Button()  # disabled
abl_2 = ABL(Uref=number_slider_50, Zref=number_slider_47, Z0=number_slider_40, ZGround=number_slider_34)  # disabled
number_slider_67 = Slider(4, range=0..10)  # disabled
abl_3 = ABL(Uref=number_slider_51, Zref=number_slider_48, Z0=number_slider_41, ZGround=number_slider_35)  # disabled
number_slider_68 = Slider(26, range=0..100)  # disabled
gradient_4 = Gradient(
    LowerLimit=number_slider_46,
    UpperLimit=number_slider_45,
    Parameter=probes_4,
    stops=[0: RGB(0, 128, 0), 0.5: RGB(255, 255, 0), 1: RGB(255, 0, 0)])  # disabled
number_slider_69 = Slider(7659, range=0..10000)  # disabled
button_6 = Button()  # disabled
button_7 = Button()  # disabled
abl_4 = ABL(Uref=number_slider_54, Zref=number_slider_52, Z0=number_slider_49, ZGround=number_slider_44)  # disabled
multiplication = Multiplication(A=probes, B=number_slider_53)  # disabled
button_8 = Button()  # disabled
multiplication_2 = Multiplication(A=probes_2, B=number_slider_55)  # disabled
multiplication_3 = Multiplication(A=probes_3, B=number_slider_56)  # disabled
simulation = Simulation(
    Domain=mesh.Domain,
    Iterations=number_slider_59,
    WriteInterval=number_slider_58,
    KeepTimeSteps=number_slider_57,
    Mode=0,
    Bcond=abl,
    Run=toggle)  # disabled
multiplication_4 = Multiplication(A=probes_4, B=number_slider_60)  # disabled
simulation_2 = Simulation(
    Domain=mesh_2.Domain,
    Iterations=number_slider_64,
    WriteInterval=number_slider_63,
    KeepTimeSteps=number_slider_61,
    Mode=0,
    Bcond=abl_2,
    Run=toggle_3)  # disabled
simulation_3 = Simulation(
    Domain=mesh_3.Domain,
    Iterations=number_slider_66,
    WriteInterval=number_slider_65,
    KeepTimeSteps=number_slider_62,
    Mode=0,
    Bcond=abl_3,
    Run=toggle_2)  # disabled
residualwriter = ResidualWriter(WorkingDir=panel_5, Mode=0)  # disabled
simulation_4 = Simulation(
    Domain=mesh_4.Domain,
    Iterations=number_slider_69,
    WriteInterval=number_slider_68,
    KeepTimeSteps=number_slider_67,
    Mode=0,
    Bcond=abl_4,
    Run=toggle_4)  # disabled
vdisex = VectorDisplayEx(Point=divide.Points, Vector=multiplication, Colour=gradient, Width=2)  # disabled
residualwriter_2 = ResidualWriter(WorkingDir=panel_7, Mode=0)  # disabled
residualwriter_3 = ResidualWriter(WorkingDir=panel_6, Mode=0)  # disabled
vdisex_2 = VectorDisplayEx(Point=divide_2.Points, Vector=multiplication_2, Colour=gradient_2, Width=2)  # disabled
vdisex_3 = VectorDisplayEx(Point=divide_3.Points, Vector=multiplication_3, Colour=gradient_3, Width=2)  # disabled
residualwriter_4 = ResidualWriter(WorkingDir=panel_8, Mode=0)  # disabled
vdisex_4 = VectorDisplayEx(Point=divide_4.Points, Vector=multiplication_4, Colour=gradient_4, Width=2)  # disabled
# 40
number_slider_70 = Slider(0.066, range=0..0.1)  # disabled
# take2
# 10
number_slider_71 = Slider(0.264, range=0..1)  # disabled
# 20
number_slider_72 = Slider(0.132, range=0..1)  # disabled
number_slider_73 = Slider(0.033, range=0..0.1)  # disabled
number_slider_74 = Slider(2, range=0..10)  # disabled
number_slider_75 = Slider(2, range=0..10)  # disabled
number_slider_76 = Slider(3, range=0..10)  # disabled
# 40
number_slider_77 = Slider(0.332, range=0..0.4)
# 10
number_slider_78 = Slider(0.332, range=0..1)
# 20
number_slider_79 = Slider(0.132, range=0..1)  # disabled
# 80
number_slider_80 = Slider(0.033, range=0..0.1)  # disabled
panel_33 = Panel("C:\MeshingPaper\Pu\")
number_slider_81 = Slider(21, range=0..150)  # disabled
panel_37 = Panel("C:\MeshingPaper\take2\cyl\coarse")  # disabled
panel_38 = Panel("C:\MeshingPaper\take2\cyl\normal\")  # disabled
panel_39 = Panel("C:\MeshingPaper\take2\cyl\very_coarse\")
panel_40 = Panel("C:\MeshingPaper\take2\cyl\fine\")  # disabled
number_slider_82 = Slider(0.095, range=0..1)  # disabled
number_slider_83 = Slider(100, range=1..100)
number_slider_84 = Slider(1, range=0..1)  # disabled
number_slider_85 = Slider(0.125, range=0..5)
number_slider_86 = Slider(0.095, range=0..1)  # disabled
number_slider_87 = Slider(0.444, range=0..10)  # disabled
number_slider_88 = Slider(1, range=0..1)  # disabled
number_slider_89 = Slider(1, range=0..1)
toggle_9 = BooleanToggle(True)  # disabled
number_slider_90 = Slider(0.095, range=0..1)  # disabled
wind_dir_5 = ControlKnob(Decimals=0, Limit=True, Maximum=359, Minimum=0, Range=360, Value=0)  # disabled
panel_41 = Panel("31")  # disabled
toggle_10 = BooleanToggle(True)
toggle_11 = BooleanToggle(True)  # disabled
number_slider_91 = Slider(1, range=0..1)  # disabled
wind_dir_6 = ControlKnob(Decimals=0, Limit=True, Maximum=359, Minimum=0, Range=360, Value=0)  # disabled
wind_dir_7 = ControlKnob(Decimals=0, Limit=True, Maximum=359, Minimum=0, Range=360, Value=0)
panel_42 = Panel("63")  # disabled
toggle_12 = BooleanToggle(True)  # disabled
wind_dir_8 = ControlKnob(Decimals=0, Limit=True, Maximum=359, Minimum=0, Range=360, Value=0)  # disabled
geo_5 = Geometry(<mesh referenced from the Rhino model>)  # disabled
panel_43 = Panel("126")  # disabled
geo_6 = Geometry(<mesh referenced from the Rhino model>)  # disabled
button_9 = Button()  # disabled
geo_7 = Geometry(<mesh referenced from the Rhino model>)
button_10 = Button()  # disabled
geo_8 = Geometry(<mesh referenced from the Rhino model>)  # disabled
button_11 = Button()  # disabled
domaincyl_5 = DomainCyl(
    Geometry=geo_5,
    Directory=panel_37,
    WindDir=wind_dir_5,
    DivisionsOuterCirc=panel_41,
    DivisionsZ=10,
    ScaleInnerR=number_slider_78,
    RAM=number_slider_84,
    CPUs=number_slider_84,
    Run=toggle_9)  # -> Out, Domain, Cyl; disabled
domaincyl_6 = DomainCyl(
    Geometry=geo_7,
    Directory=panel_39,
    WindDir=wind_dir_7,
    DivisionsOuterCirc=number_slider_83,
    DivisionsZ=10,
    ScaleInnerR=number_slider_85,
    RAM=number_slider_89,
    CPUs=number_slider_89,
    Run=toggle_10)  # -> Out, Domain, Cyl
python_7 = PythonScript(x=domaincyl_6.Domain)  # -> out, a, b; disabled
# ---------- python_7: Python ----------
a = x.radius;
b = x.center;
# ---------- end python_7 ----------
c_script = CSharpScript(
    center=python_7.b,
    sizeInnerRect=number_slider_85,
    divisions=number_slider_83,
    circleRadius=python_7.a,
    windDir=wind_dir_7)  # -> out, A, B, C, D, E, F; inputs center: Point3d, sizeInnerRect: Double, divisions: Int32, circleRadius: Double, windDir: Double; disabled
# ---------- c_script: C# ----------
    List<Point3d> pointsOnCircle = new List<Point3d>();
    var pl = new Plane(center, Vector3d.ZAxis);
    var h = 10;
    var xinter = new Interval(-sizeInnerRect, sizeInnerRect);

    var m = Mesh.CreateFromPlane(pl, xinter, xinter, divisions, divisions); // creates the inner rectangle with arbitrary subdivision

    double minRad = Math.Sqrt(2 * (sizeInnerRect * sizeInnerRect));
    double circRad = circleRadius;
    if (circleRadius < minRad) circRad = minRad;

    var c = new Circle(center, circRad);

    var poly = m.GetNakedEdges()[0]; //returns a polygon with line segments for each mesh cell

    for (int i = 0; i < poly.Count; i++)
    {
      var vec = center - poly[i];
      vec.Unitize();
      vec *= (circleRadius + 1);
      double t1;
      double t2;
      Point3d p1;
      Point3d p2;
      var inter = Rhino.Geometry.Intersect.Intersection.LineCircle(new Line(center, vec), c, out t1, out p1, out t2, out p2);
      //if(inter == LineCircleIntersection.Single)
      pointsOnCircle.Add(p1);
    }

    var core = new Mesh();
    core.Append(m);
    core.Flip(true, true, true);

    var coreTop = new Mesh();
    coreTop.Append(m);
    coreTop.Translate(Vector3d.ZAxis * h);



    var perim = PerimeterRing(poly, pointsOnCircle);
    var perimTop = new Mesh();
    perimTop.Append(perim);
    perimTop.Translate(Vector3d.ZAxis * h);
    perimTop.Flip(true, true, true);




    var side = SideWalls(pointsOnCircle, h);
    //  B = side;

    var outMesh = new Mesh();
    outMesh.Append(perim);
    outMesh.Append(core);
    outMesh.Append(perimTop);
    outMesh.Append(coreTop);
    outMesh.Append(side);
    Print(outMesh.Vertices.Count.ToString());
    outMesh.Weld(0.00001);
    A = outMesh;
    B = perim;
    C = core;

    D = side;








    // D =

    //  D = stringifyBlocks(perim, core, perimTop, coreTop, 5, 10);
    //E = stringyfyVertexList(outMesh);
    // F = stringifyPatches(outMesh);
# ---------- c_script: C# additional code ----------
  public Mesh SideWalls(List < Point3d > pt, double h){

    int vcount = 0;
    var m = new Mesh();
    for (int i = 0; i < pt.Count - 1; i++)
    {
      m.Vertices.Add(pt[i]);
      m.Vertices.Add(pt[i] + Vector3d.ZAxis * h);
      m.Vertices.Add(pt[i + 1] + Vector3d.ZAxis * h);
      m.Vertices.Add(pt[i + 1]);

      m.Faces.AddFace(new MeshFace(vcount, vcount + 1, vcount + 2, vcount + 3));
      vcount += 4;
    }
    return m;
  }

  public Mesh PerimeterRing(Polyline poly, List<Point3d> pointsOnCircle){
    var mOutBottom = new Mesh();
    int vcount = 0;
    for (int i = 0; i < poly.Count - 1; i++)
    {
      mOutBottom.Vertices.Add(poly[i]);
      mOutBottom.Vertices.Add(pointsOnCircle[i]);
      mOutBottom.Vertices.Add(pointsOnCircle[i + 1]);
      mOutBottom.Vertices.Add(poly[i + 1]);

      mOutBottom.Faces.AddFace(new MeshFace(vcount, vcount + 1, vcount + 2, vcount + 3));
      vcount += 4;
    }
    return mOutBottom;
  }

  public string stringifyBlocks (Mesh perim, Mesh core, Mesh perimTop, Mesh coreTop, int divY, int divZ){
    System.Text.StringBuilder sb = new System.Text.StringBuilder();

    int counter = perim.Faces.Count + core.Faces.Count + perimTop.Faces.Count;

    for (int i = 0; i < core.Faces.Count; i++){
      sb.AppendLine("hex (" + core.Faces[i].A + " " + core.Faces[i].B + " " + core.Faces[i].C + " " + core.Faces[i].D + " " + ((coreTop.Faces[i].A + counter)) + " " + (coreTop.Faces[i].B + counter) + " " + (coreTop.Faces[i].C + counter) + " " + (coreTop.Faces[i].D + counter) + ") (1 " + divY + " " + divZ + ") simpleGrading (1 1 1)");
    }
    return sb.ToString();
  }

  public string stringifyPatches (Mesh outMesh){
    System.Text.StringBuilder sb = new System.Text.StringBuilder();
    for (int i = 0; i < outMesh.Faces.Count; i++){
      sb.AppendLine("patch" + i +@"
        {
        type patch;
        faces
        (");
      sb.AppendLine("(" + outMesh.Faces[i].A + " " + +outMesh.Faces[i].B + " " + outMesh.Faces[i].C + " " + outMesh.Faces[i].D + ")");
      sb.AppendLine(@");
        }");
    }


    return sb.ToString();
  }

  private static string stringyfyVertexList(Mesh outMesh)
  {
    System.Text.StringBuilder stb = new System.Text.StringBuilder();

    for (int i = 0; i < outMesh.Vertices.Count; i++)
    {
      stb.AppendLine("(" + outMesh.Vertices[i].X + " " + +outMesh.Vertices[i].Y + " " + +outMesh.Vertices[i].Z + ")");
    }
    return stb.ToString();
  }

  private int RoundToNearest5(double _Knob)
  {
    double Knob = _Knob;
    if (Knob < 0) Knob = 0;
    if (Knob > 359) Knob = 359;

    int flowDir = 0;
    while (Knob < 358)
    {
      if (Knob % 5 == 0)
      {
        flowDir = (int) Knob;
      }
      if (Knob % 5 == 1)
      {
        flowDir = (int) Knob - 1;
      }
      if (Knob % 5 == 2)
      {
        flowDir = (int) Knob - 2;
      }
      if (Knob % 5 == 3)
      {
        flowDir = (int) Knob + 2;
      }
      if (Knob % 5 == 4)
      {
        flowDir = (int) Knob + 1;
      }
      break;
    }
    if (Knob == 358 | Knob == 359)
    {
      flowDir = 0;
    }
    return flowDir;
  }
# ---------- end c_script ----------
panel_44 = Panel(c_script.out)  # disabled
demesh = DeconstructMesh(Mesh=c_script.A)  # -> Vertices, Faces, Colours, Normals; disabled
c_script_2 = CSharpScript(m=c_script.A, divs=number_slider_83)  # -> out, A; inputs m: Mesh, n: Mesh, divs: Int32; disabled
# ---------- c_script_2: C# ----------
    m.Append(n);
    //for (int i = 2; i < m.Vertices.Count; i++){
    m.Faces.AddFace(1, 2, 66, 65);

    A = m;
    //return mOutBottom;
# ---------- end c_script_2 ----------
face = MeshFace(demesh.Faces)  # disabled
item = ListItem(List=demesh.Vertices, Index=number_slider_81, Wrap=True)  # disabled
panel_45 = Panel(c_script.D)  # disabled
panel_46 = Panel(c_script.E)  # disabled
points = PointList(Points=demesh.Vertices, Size=number_slider_87)  # disabled
python_8 = PythonScript(x=domaincyl_6.Domain)  # -> out, a, b
# ---------- python_8: Python ----------
b = x.DomainMesh.Vertices;
# ---------- end python_8 ----------
domaincyl_7 = DomainCyl(
    Geometry=geo_6,
    Directory=panel_38,
    WindDir=wind_dir_6,
    DivisionsOuterCirc=panel_42,
    DivisionsZ=10,
    ScaleInnerR=number_slider_78,
    RAM=number_slider_88,
    CPUs=number_slider_88,
    Run=toggle_11)  # -> Out, Domain, Cyl; disabled
item_2 = ListItem(List=python_8.b, Index=Slider(41, range=0..50), Wrap=True)
domaincyl_8 = DomainCyl(
    Geometry=geo_8,
    Directory=panel_40,
    WindDir=wind_dir_8,
    DivisionsOuterCirc=panel_43,
    DivisionsZ=10,
    ScaleInnerR=number_slider_78,
    RAM=number_slider_91,
    CPUs=number_slider_91,
    Run=toggle_12)  # -> Out, Domain, Cyl; disabled
demesh_2 = DeconstructMesh(Mesh=domaincyl_6.Cyl)  # -> Vertices, Faces, Colours, Normals; disabled
panel_47 = Panel("0.0125")  # disabled
clean_5 = Clean(Dir=panel_37, Run=button_9)  # disabled
# Cyl
points_2 = PointList(Points=item_2)
panel_48 = Panel("0.00625")  # disabled
clean_6 = Clean(Dir=panel_39, Run=Button())
clean_7 = Clean(Dir=panel_38, Run=button_10)  # disabled
points_3 = PointList(Points=demesh_2.Vertices, Size=1)  # disabled
python_9 = PythonScript(x=domaincyl_5.Domain)  # -> out, a; disabled; same code as python
panel_49 = Panel(python_9.a)  # disabled
panel_50 = Panel("0.003125")  # disabled
clean_8 = Clean(Dir=panel_40, Run=button_11)  # disabled
python_10 = PythonScript(x=domaincyl_7.Domain)  # -> out, a; disabled; same code as python
panel_51 = Panel(python_10.a)  # disabled
python_11 = PythonScript(x=domaincyl_6.Domain)  # -> out, a; same code as python
panel_52 = Panel(python_11.a)
python_12 = PythonScript(x=domaincyl_8.Domain)  # -> out, a; disabled; same code as python
panel_53 = Panel(python_12.a)  # disabled
python_13 = PythonScript(x=domaincyl_6.Domain, y=domaincyl_5.Domain)  # -> out, a; disabled; same code as python
number_slider_92 = Slider(2, range=0..10)  # disabled
cluster_5 = Cluster(x=domaincyl_5.Domain)  # disabled
number_slider_93 = Slider(2, range=0..10)  # disabled
number_slider_94 = Slider(3, range=0..10)  # disabled
number_slider_95 = Slider(50, range=0..100)  # disabled
python_14 = PythonScript(x=domaincyl_7.Domain)  # -> out, a; disabled; same code as python
number_slider_96 = Slider(2, range=0..10)  # disabled
number_slider_97 = Slider(2, range=0..10)
cluster_6 = Cluster(x=domaincyl_7.Domain)  # disabled
python_15 = PythonScript(x=domaincyl_6.Domain)  # -> out, a; same code as python
# zCells
cluster_7 = Cluster(x=domaincyl_6.Domain)
number_slider_98 = Slider(2, range=0..10)  # disabled
number_slider_99 = Slider(3, range=0..10)  # disabled
number_slider_100 = Slider(50, range=0..100)  # disabled
number_slider_101 = Slider(2, range=0..10)
python_16 = PythonScript(x=domaincyl_8.Domain)  # -> out, a; disabled; same code as python
panel_54 = Panel(python_13.a)  # disabled
cellsize_5 = CellSize(Domain=domaincyl_5.Domain, BlockMeshCellSize=panel_54, DesiredCellSize=panel_47)  # disabled
number_slider_102 = Slider(2, range=0..10)  # disabled
cluster_8 = Cluster(x=domaincyl_8.Domain)  # disabled
number_slider_103 = Slider(2, range=0..10)  # disabled
number_slider_104 = Slider(3, range=0..10)  # disabled
number_slider_105 = Slider(50, range=0..100)  # disabled
panel_55 = Panel(cluster_5)  # disabled
panel_56 = Panel(python_14.a)  # disabled
cellsize_6 = CellSize(Domain=domaincyl_7.Domain, BlockMeshCellSize=panel_56, DesiredCellSize=panel_48)  # disabled
panel_57 = Panel(python_15.a)
cellsize_7 = CellSize(Domain=domaincyl_6.Domain, BlockMeshCellSize=panel_57, DesiredCellSize="0.025")
# layers variable
panel_58 = Panel(cluster_7)
panel_59 = Panel(cluster_6)  # disabled
panel_60 = Panel(python_16.a)  # disabled
cellsize_8 = CellSize(Domain=domaincyl_8.Domain, BlockMeshCellSize=panel_60, DesiredCellSize=panel_50)  # disabled
panel_61 = Panel(cellsize_5)  # disabled
crv_5 = Curve(<curve referenced from the Rhino model>)  # disabled
panel_62 = Panel(cluster_8)  # disabled
panel_63 = Panel(cellsize_6)  # disabled
crv_6 = Curve(<curve referenced from the Rhino model>)  # disabled
crv_7 = Curve(<curve referenced from the Rhino model>)
panel_64 = Panel(cellsize_7)
panel_65 = Panel(cellsize_8)  # disabled
divide_5 = DivideCurve(Curve=crv_5, Count=number_slider_95, Kinks=False)  # -> Points, Tangents, Parameters; disabled
mesh_5 = Mesh(
    Domain=domaincyl_5.Domain,
    AccBuilding=cellsize_5,
    AccFeatures=cellsize_5,
    AccGround=cellsize_5,
    Layer=number_slider_94,
    Run=toggle_9)  # -> Out, Domain; disabled
crv_8 = Curve(<curve referenced from the Rhino model>)  # disabled
divide_6 = DivideCurve(Curve=crv_6, Count=number_slider_100, Kinks=False)  # -> Points, Tangents, Parameters; disabled
mesh_6 = Mesh(
    Domain=domaincyl_7.Domain,
    AccBuilding=cellsize_6,
    AccFeatures=cellsize_6,
    AccGround=cellsize_6,
    Layer=number_slider_99,
    Run=toggle_11)  # -> Out, Domain; disabled
divide_7 = DivideCurve(Curve=crv_7, Count=Slider(50, range=0..100), Kinks=False)  # -> Points, Tangents, Parameters
mesh_7 = Mesh(
    Domain=domaincyl_6.Domain,
    AccBuilding=cellsize_7,
    AccFeatures=cellsize_7,
    AccGround=cellsize_7,
    Layer=Slider(3, range=0..10),
    Run=toggle_10)  # -> Out, Domain; disabled
number_slider_106 = Slider(0, range=0..100)  # disabled
number_slider_107 = Slider(13, range=0..25)  # disabled
divide_8 = DivideCurve(Curve=crv_8, Count=number_slider_105, Kinks=False)  # -> Points, Tangents, Parameters; disabled
mesh_8 = Mesh(
    Domain=domaincyl_8.Domain,
    AccBuilding=cellsize_8,
    AccFeatures=cellsize_8,
    AccGround=cellsize_8,
    Layer=number_slider_104,
    Run=toggle_12)  # -> Out, Domain; disabled
number_slider_108 = Slider(0, range=0..10)  # disabled
number_slider_109 = Slider(0.005, range=0..100)  # disabled
toggle_13 = BooleanToggle(False)  # disabled
number_slider_110 = Slider(0, range=0..100)  # disabled
number_slider_111 = Slider(0, range=0..100)  # disabled
number_slider_112 = Slider(13, range=0..25)  # disabled
number_slider_113 = Slider(13, range=0..25)  # disabled
number_slider_114 = Slider(0, range=0..10)  # disabled
number_slider_115 = Slider(0, range=0..10)  # disabled
number_slider_116 = Slider(0.005, range=0..100)  # disabled
number_slider_117 = Slider(0.005, range=0..100)  # disabled
toggle_14 = BooleanToggle(False)  # disabled
toggle_15 = BooleanToggle(False)  # disabled
number_slider_118 = Slider(0.5, range=0..100)  # disabled
number_slider_119 = Slider(12, range=0..100)  # disabled
number_slider_120 = Slider(0, range=0..100)  # disabled
number_slider_121 = Slider(13, range=0..25)  # disabled
number_slider_122 = Slider(0, range=0..10)  # disabled
number_slider_123 = Slider(0.5, range=0..100)  # disabled
number_slider_124 = Slider(0.005, range=0..100)  # disabled
number_slider_125 = Slider(0.5, range=0..100)  # disabled
toggle_16 = BooleanToggle(False)  # disabled
number_slider_126 = Slider(12, range=0..100)  # disabled
number_slider_127 = Slider(12, range=0..100)  # disabled
number_slider_128 = Slider(0.5, range=0..100)  # disabled
number_slider_129 = Slider(0.01, range=0..1)  # disabled
number_slider_130 = Slider(12, range=0..100)  # disabled
number_slider_131 = Slider(0.01, range=0..1)  # disabled
probes_5 = Probes(Domain=domaincyl_5.Domain, Points=divide_5.Points, PointName=1, Run=toggle_13)  # disabled
number_slider_132 = Slider(0.01, range=0..1)  # disabled
number_slider_133 = Slider(4, range=0..10)  # disabled
probes_6 = Probes(Domain=domaincyl_7.Domain, Points=divide_6.Points, PointName=1, Run=toggle_14)  # disabled
probes_7 = Probes(Domain=domaincyl_6.Domain, Points=divide_7.Points, PointName=1, Run=toggle_15)  # disabled
number_slider_134 = Slider(26, range=0..100)  # disabled
number_slider_135 = Slider(7659, range=0..10000)  # disabled
gradient_5 = Gradient(
    LowerLimit=number_slider_108,
    UpperLimit=number_slider_107,
    Parameter=probes_5,
    stops=[0: RGB(0, 128, 0), 0.5: RGB(255, 255, 0), 1: RGB(255, 0, 0)])  # disabled
number_slider_136 = Slider(0.01, range=0..1)  # disabled
number_slider_137 = Slider(4, range=0..10)  # disabled
number_slider_138 = Slider(4, range=0..10)  # disabled
number_slider_139 = Slider(26, range=0..100)  # disabled
abl_5 = ABL(Uref=number_slider_119, Zref=number_slider_118, Z0=number_slider_109, ZGround=number_slider_106)  # disabled
gradient_6 = Gradient(
    LowerLimit=number_slider_114,
    UpperLimit=number_slider_112,
    Parameter=probes_6,
    stops=[0: RGB(0, 128, 0), 0.5: RGB(255, 255, 0), 1: RGB(255, 0, 0)])  # disabled
number_slider_140 = Slider(7659, range=0..10000)  # disabled
probes_8 = Probes(Domain=domaincyl_8.Domain, Points=divide_8.Points, PointName=1, Run=toggle_16)  # disabled
number_slider_141 = Slider(26, range=0..100)  # disabled
number_slider_142 = Slider(7659, range=0..10000)  # disabled
gradient_7 = Gradient(
    LowerLimit=number_slider_115,
    UpperLimit=number_slider_113,
    Parameter=probes_7,
    stops=[0: RGB(0, 128, 0), 0.5: RGB(255, 255, 0), 1: RGB(255, 0, 0)])  # disabled
button_12 = Button()  # disabled
abl_6 = ABL(Uref=number_slider_126, Zref=number_slider_123, Z0=number_slider_116, ZGround=number_slider_110)  # disabled
number_slider_143 = Slider(4, range=0..10)  # disabled
abl_7 = ABL(Uref=number_slider_127, Zref=number_slider_125, Z0=number_slider_117, ZGround=number_slider_111)  # disabled
number_slider_144 = Slider(26, range=0..100)  # disabled
gradient_8 = Gradient(
    LowerLimit=number_slider_122,
    UpperLimit=number_slider_121,
    Parameter=probes_8,
    stops=[0: RGB(0, 128, 0), 0.5: RGB(255, 255, 0), 1: RGB(255, 0, 0)])  # disabled
number_slider_145 = Slider(7659, range=0..10000)  # disabled
button_13 = Button()  # disabled
button_14 = Button()  # disabled
abl_8 = ABL(Uref=number_slider_130, Zref=number_slider_128, Z0=number_slider_124, ZGround=number_slider_120)  # disabled
multiplication_5 = Multiplication(A=probes_5, B=number_slider_129)  # disabled
button_15 = Button()  # disabled
multiplication_6 = Multiplication(A=probes_6, B=number_slider_131)  # disabled
multiplication_7 = Multiplication(A=probes_7, B=number_slider_132)  # disabled
simulation_5 = Simulation(
    Domain=mesh_5.Domain,
    Iterations=number_slider_135,
    WriteInterval=number_slider_134,
    KeepTimeSteps=number_slider_133,
    Mode=0,
    Bcond=abl_5,
    Run=toggle_9)  # disabled
multiplication_8 = Multiplication(A=probes_8, B=number_slider_136)  # disabled
simulation_6 = Simulation(
    Domain=mesh_6.Domain,
    Iterations=number_slider_140,
    WriteInterval=number_slider_139,
    KeepTimeSteps=number_slider_137,
    Mode=0,
    Bcond=abl_6,
    Run=toggle_11)  # disabled
simulation_7 = Simulation(
    Domain=mesh_7.Domain,
    Iterations=number_slider_142,
    WriteInterval=number_slider_141,
    KeepTimeSteps=number_slider_138,
    Mode=0,
    Bcond=abl_7,
    Run=toggle_10)  # disabled
residualwriter_5 = ResidualWriter(WorkingDir=panel_37, Mode=0)  # disabled
simulation_8 = Simulation(
    Domain=mesh_8.Domain,
    Iterations=number_slider_145,
    WriteInterval=number_slider_144,
    KeepTimeSteps=number_slider_143,
    Mode=0,
    Bcond=abl_8,
    Run=toggle_12)  # disabled
vdisex_5 = VectorDisplayEx(Point=divide_5.Points, Vector=multiplication_5, Colour=gradient_5, Width=2)  # disabled
residualwriter_6 = ResidualWriter(WorkingDir=panel_38, Mode=0)  # disabled
residualwriter_7 = ResidualWriter(WorkingDir=panel_39, Mode=0)  # disabled
vdisex_6 = VectorDisplayEx(Point=divide_6.Points, Vector=multiplication_6, Colour=gradient_6, Width=2)  # disabled
vdisex_7 = VectorDisplayEx(Point=divide_7.Points, Vector=multiplication_7, Colour=gradient_7, Width=2)
residualwriter_8 = ResidualWriter(WorkingDir=panel_40, Mode=0)  # disabled
vdisex_8 = VectorDisplayEx(Point=divide_8.Points, Vector=multiplication_8, Colour=gradient_8, Width=2)  # disabled
toggle_17 = BooleanToggle(True)  # disabled
panel_66 = Panel("C:\MeshingPaper\take2\box\fine\")  # disabled
panel_67 = Panel("C:\MeshingPaper\take2\box\normal\")  # disabled
panel_68 = Panel("0.125")  # disabled
panel_69 = Panel("C:\MeshingPaper\take2\box\coarse\")  # disabled
panel_70 = Panel("C:\MeshingPaper\take2\box\very_coarse\")  # disabled
panel_71 = Panel("0.025")  # disabled
geo_9 = Geometry(<mesh referenced from the Rhino model>)  # disabled
panel_72 = Panel("0.05")  # disabled
panel_73 = Panel("0.1")  # disabled
panel_74 = Panel("1")  # disabled
button_16 = Button()  # disabled
toggle_18 = BooleanToggle(True)  # disabled
button_17 = Button()  # disabled
num = Number(panel_74)  # disabled
geo_10 = Geometry(<mesh referenced from the Rhino model>)  # disabled
toggle_19 = BooleanToggle(True)  # disabled
geo_11 = Geometry(<mesh referenced from the Rhino model>)  # disabled
panel_75 = Panel("1")  # disabled
num_2 = Number(panel_75)  # disabled
clean_9 = Clean(Dir=panel_70, Run=button_16)  # disabled
panel_76 = Panel("1")  # disabled
num_3 = Number(panel_76)  # disabled
button_18 = Button()  # disabled
toggle_20 = BooleanToggle(True)  # disabled
# Box
domainbox = DomainBox(Geometry=geo_9, Directory=panel_70, BaseMesh=panel_73, RAM=num, CPUs=1, Run=toggle_17)  # -> Out, Domain, Cyl, D, E; disabled
domainbox_2 = DomainBox(Geometry=geo_10, Directory=panel_69, BaseMesh=panel_72, RAM=num_2, CPUs=1, Run=toggle_17)  # -> Out, Domain, Cyl, D, E; disabled
geo_12 = Geometry(<mesh referenced from the Rhino model>)  # disabled
clean_10 = Clean(Dir=panel_69, Run=button_17)  # disabled
button_19 = Button()  # disabled
domainbox_3 = DomainBox(Geometry=geo_11, Directory=panel_67, BaseMesh=panel_71, RAM=num_3, CPUs=1, Run=toggle_17)  # -> Out, Domain, Cyl, D, E; disabled
panel_77 = Panel("1")  # disabled
num_4 = Number(panel_77)  # disabled
clean_11 = Clean(Dir=panel_67, Run=button_18)  # disabled
domainbox_4 = DomainBox(Geometry=geo_12, Directory=panel_66, BaseMesh=panel_68, RAM=num_4, CPUs=1, Run=toggle_17)  # -> Out, Domain, Cyl, D, E; disabled
panel_78 = Panel("2")  # disabled
clean_12 = Clean(Dir=panel_66, Run=button_19)  # disabled
panel_79 = Panel("3")  # disabled
panel_80 = Panel("2")  # disabled
panel_81 = Panel("3")  # disabled
panel_82 = Panel("2")  # disabled
panel_83 = Panel("3")  # disabled
number_slider_146 = Slider(0, range=0..100)  # disabled
number_slider_147 = Slider(0.005, range=0..100)  # disabled
panel_84 = Panel("2")  # disabled
panel_85 = Panel("3")  # disabled
number_slider_148 = Slider(0, range=0..100)  # disabled
mesh_9 = Mesh(Domain=domainbox.Domain, AccBuilding=panel_78, AccFeatures=panel_78, AccGround=panel_78, Layer=panel_79, Run=toggle_17)  # -> Out, Domain; disabled
number_slider_149 = Slider(0.5, range=0..100)  # disabled
number_slider_150 = Slider(0.005, range=0..100)  # disabled
number_slider_151 = Slider(12, range=0..100)  # disabled
number_slider_152 = Slider(0, range=0..100)  # disabled
number_slider_153 = Slider(0.005, range=0..100)  # disabled
mesh_10 = Mesh(Domain=domainbox_2.Domain, AccBuilding=panel_80, AccFeatures=panel_80, AccGround=panel_80, Layer=panel_81, Run=toggle_17)  # -> Out, Domain; disabled
number_slider_154 = Slider(0.5, range=0..100)  # disabled
number_slider_155 = Slider(12, range=0..100)  # disabled
mesh_11 = Mesh(Domain=domainbox_3.Domain, AccBuilding=panel_82, AccFeatures=panel_82, AccGround=panel_82, Layer=panel_83, Run=toggle_17)  # -> Out, Domain; disabled
number_slider_156 = Slider(0.5, range=0..100)  # disabled
number_slider_157 = Slider(0, range=0..100)  # disabled
number_slider_158 = Slider(12, range=0..100)  # disabled
number_slider_159 = Slider(0.005, range=0..100)  # disabled
mesh_12 = Mesh(Domain=domainbox_4.Domain, AccBuilding=panel_84, AccFeatures=panel_84, AccGround=panel_84, Layer=panel_85, Run=toggle_17)  # -> Out, Domain; disabled
number_slider_160 = Slider(0.5, range=0..100)  # disabled
number_slider_161 = Slider(4, range=0..10)  # disabled
number_slider_162 = Slider(26, range=0..100)  # disabled
number_slider_163 = Slider(12, range=0..100)  # disabled
number_slider_164 = Slider(7659, range=0..10000)  # disabled
abl_9 = ABL(Uref=number_slider_151, Zref=number_slider_149, Z0=number_slider_147, ZGround=number_slider_146)  # disabled
number_slider_165 = Slider(4, range=0..10)  # disabled
number_slider_166 = Slider(26, range=0..100)  # disabled
number_slider_167 = Slider(7659, range=0..10000)  # disabled
abl_10 = ABL(Uref=number_slider_155, Zref=number_slider_154, Z0=number_slider_150, ZGround=number_slider_148)  # disabled
number_slider_168 = Slider(4, range=0..10)  # disabled
number_slider_169 = Slider(26, range=0..100)  # disabled
number_slider_170 = Slider(7659, range=0..10000)  # disabled
abl_11 = ABL(Uref=number_slider_158, Zref=number_slider_156, Z0=number_slider_153, ZGround=number_slider_152)  # disabled
number_slider_171 = Slider(4, range=0..10)  # disabled
number_slider_172 = Slider(26, range=0..100)  # disabled
number_slider_173 = Slider(7659, range=0..10000)  # disabled
abl_12 = ABL(Uref=number_slider_163, Zref=number_slider_160, Z0=number_slider_159, ZGround=number_slider_157)  # disabled
simulation_9 = Simulation(
    Domain=mesh_9.Domain,
    Iterations=number_slider_164,
    WriteInterval=number_slider_162,
    KeepTimeSteps=number_slider_161,
    Mode=0,
    Bcond=abl_9,
    Run=toggle_17)  # disabled
simulation_10 = Simulation(
    Domain=mesh_10.Domain,
    Iterations=number_slider_167,
    WriteInterval=number_slider_166,
    KeepTimeSteps=number_slider_165,
    Mode=0,
    Bcond=abl_10,
    Run=toggle_17)  # disabled
residualwriter_9 = ResidualWriter(WorkingDir=panel_70, Mode=0)  # disabled
simulation_11 = Simulation(
    Domain=mesh_11.Domain,
    Iterations=number_slider_170,
    WriteInterval=number_slider_169,
    KeepTimeSteps=number_slider_168,
    Mode=0,
    Bcond=abl_11,
    Run=toggle_17)  # disabled
residualwriter_10 = ResidualWriter(WorkingDir=panel_69, Mode=0)  # disabled
residualwriter_11 = ResidualWriter(WorkingDir=panel_67, Mode=0)  # disabled
simulation_12 = Simulation(
    Domain=mesh_12.Domain,
    Iterations=number_slider_173,
    WriteInterval=number_slider_172,
    KeepTimeSteps=number_slider_171,
    Mode=0,
    Bcond=abl_12,
    Run=toggle_17)  # disabled
residualwriter_12 = ResidualWriter(WorkingDir=panel_66, Mode=0)  # disabled

# ==== cluster Cluster
x = ClusterInput()
python = PythonScript(x=x)  # -> out, a
# ---------- python: Python ----------
a = x.cellSizeInner;
# ---------- end python ----------
division = Division(A="1.5", B=python.a)
round = Round(Number=division)  # -> Nearest, Floor, Ceiling
N = ClusterOutput(round.Nearest)
