# Grasshopper definition clusterWindDirections.gh (Grasshopper 0.9.76)
# plug-ins: VirtualWindTunnel, Archsim

panel = Panel("""0.9
1
1
1
1
1
1.1
1.9
2
2
2
2
2
2.1""")
weather = Weather(
    Location="NLD_Amsterdam.062400_IWEC",
    Input_0_Hidden=False,
    Input_0_Name="Location",
    Output_0_Hidden=False,
    Output_0_Name="Location",
    Output_1_Hidden=True,
    Output_1_Name="Latitude",
    Output_10_Hidden=False,
    Output_10_Name="DiffuseHorizontalRadiation",
    Output_11_Hidden=True,
    Output_11_Name="GlobalHorizontalRadiation",
    Output_12_Hidden=True,
    Output_12_Name="SkyCover",
    Output_13_Hidden=True,
    Output_13_Name="Precipitation",
    Output_14_Hidden=True,
    Output_14_Name="Elev",
    Output_15_Hidden=True,
    Output_15_Name="Azimuth",
    Output_16_Hidden=True,
    Output_16_Name="Illuminance",
    Output_17_Hidden=True,
    Output_17_Name="DateTime",
    Output_18_Hidden=True,
    Output_18_Name="DryBulbAverages",
    Output_19_Hidden=True,
    Output_19_Name="DewPointAverages",
    Output_2_Hidden=True,
    Output_2_Name="Longitude",
    Output_20_Hidden=True,
    Output_20_Name="DryBulbMinima"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)  # -> Location, DryBulbTemp, RelativeHumidity, WindDirection, DirectNormalRadiation, DiffuseHorizontalRadiation
panel_2 = Panel(weather.WindDirection)
rad = Radians(Degrees=weather.WindDirection)
Y = UnitY(Factor=1)
Z = UnitZ(Factor=1)
cluster = Cluster(Data=weather.WindDirection, Bins="2")  # -> C, Cl, B
branch = TreeBranch(Tree=cluster.Cl, Path=Slider(0, range=0..8), MaintainPaths=True)
circle = CircleCNR(Center=branch, Normal=Vector(0, 0, 1), Radius=0.1)
vrot = Rotate(Vector=Y, Axis=Z, Angle=rad)
dprod = DotProduct(VectorA=Y, VectorB=vrot, Unitize=False)
panel_3 = Panel(cluster.C)
item = ListItem(List=cluster.B, Index="2", Wrap=True)
item_2 = ListItem(List=cluster.B, Index="1", Wrap=True)
larger = LargerThan(FirstNumber=panel_2, SecondNumber=item_2)  # -> LargerThan, OrEqualTo
smaller = SmallerThan(FirstNumber=panel_2, SecondNumber=item)  # -> SmallerThan, OrEqualTo
smaller_2 = SmallerThan(FirstNumber=panel_2, SecondNumber=item_2)  # -> SmallerThan, OrEqualTo
pt = ConstructPoint(XCoordinate=0, YCoordinate=0, ZCoordinate=0)
and = GateAnd(A=larger.OrEqualTo, B=smaller.SmallerThan)
dispatch = Dispatch(List=vrot, DispatchPattern=smaller_2.SmallerThan)  # -> ListA, ListB
dispatch_2 = Dispatch(List=vrot, DispatchPattern=and)  # -> ListA, ListB
vdis = VectorDisplay(Anchor=pt, Vector=dispatch_2.ListA)
vdis_2 = VectorDisplay(Anchor=pt, Vector=vrot)
