# Grasshopper definition licence.gh (Grasshopper 0.9.76)

c_script = CSharpScript()  # -> out, A
# ---------- c_script: C# ----------
      
    
    
    var dateNow = GetNistTime();
    DateTime dateCompile = new DateTime(2018, 5, 10, 15, 42, 00).ToUniversalTime();   
    var diff = dateNow.Subtract(dateCompile);    
    var diffMax = new TimeSpan(12, 0, 0, 0);
    
    if ( diff > diffMax){
      Print("Not allowed");}
    else{
      Print("everythings good");
    }
    
    A = diff;
# ---------- c_script: C# additional code ----------
  public static DateTime GetNistTime()
  {
    DateTime dateTime = DateTime.MinValue;
    DateTime dateTimeUTC = DateTime.MinValue;

    System.Net.HttpWebRequest request = (System.Net.HttpWebRequest) System.Net.WebRequest.Create("http://nist.time.gov/actualtime.cgi?lzbc=siqm9b");
    request.Method = "GET";
    request.Accept = "text/html, application/xhtml+xml, */*";
    request.UserAgent = "Mozilla/5.0 (compatible; MSIE 10.0; Windows NT 6.1; Trident/6.0)";
    request.ContentType = "application/x-www-form-urlencoded";
    //request.CachePolicy = new RequestCachePolicy(System.Net.Cache.RequestCacheLevel.NoCacheNoStore); //No caching
    System.Net.HttpWebResponse response = (System.Net.HttpWebResponse) request.GetResponse();
    if (response.StatusCode == (System.Net.HttpStatusCode.OK))
    {
      System.IO.StreamReader stream = new StreamReader(response.GetResponseStream());
      string html = stream.ReadToEnd();//<timestamp time=\"1395772696469995\" delay=\"1395772696469995\"/>
      string time = System.Text.RegularExpressions.Regex.Match(html, @"(?<=\btime="")[^""]*").Value;
      double milliseconds = Convert.ToInt64(time) / 1000.0;
      dateTime = new DateTime(1970, 1, 1).AddMilliseconds(milliseconds).ToLocalTime();
      dateTimeUTC = dateTime.ToUniversalTime();
    }

    return dateTimeUTC;
  }
# ---------- end c_script ----------
panel = Panel(c_script.A)
panel_2 = Panel(c_script.out)
