# Grasshopper definition parseValues.gh (Grasshopper 0.9.76)
# plug-ins: VirtualWindTunnel

panel = Panel("C:\cpPaper\cpPaper4524_90_testclean\")
panel_2 = Panel("C:\cpPaper\cpPaper4524_90\")
number_slider = Slider(1, range=0..1)
mesh = Mesh([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])
srf = Surface(<surface referenced from the Rhino model>)
number_slider_2 = Slider(1, range=0..1)
brep = Brep(<brep referenced from the Rhino model>)
domainbox = DomainBox(Geometry=brep, Directory=panel, BaseMesh=number_slider, RAM=number_slider, CPUs=number_slider, Run=Toggle(False))  # -> Out, Domain, Cyl, D, E
cluster = Cluster(B=srf, min_edge=number_slider_2, max_edge=number_slider_2)
# U
c_script = CSharpScript(workingDirectory=panel, topologyName="c_p_patch", points=cluster)  # -> out, A, B, C, D, E, F; inputs workingDirectory: String, points: list of Point3d
# ---------- c_script: C# ----------
   

    string postProcessDirectory = workingDirectory + @"\postProcessing\";
    int counterPoints = 0;


    counterPoints = points.Count();


    string[] dir = Directory.GetDirectories(postProcessDirectory);

    //replace this with input
    string basePath = postProcessDirectory + @"\cpSamples";

    int counterIter = Directory.GetDirectories(basePath).Length;





    string[] filePathResults = new string[counterPoints];
    string[] directoriesBasePath = Directory.GetDirectories(dir[0]);




    var latestTimedirectoriesBasePath = directoriesBasePath[directoriesBasePath.Length - 1];




    string latestTime = Path.GetFileName(latestTimedirectoriesBasePath);





    // Build get fileName

    //filePathResults = Directory.GetFiles(fullDir[0]);
    //string fileName = new String(Path.GetFileName(filePathResults[0]).Where(c => Char.IsLetter(c) | Char.IsPunctuation(c)).ToArray());;
    //string fileName2 = Regex.Replace(filePathResults[0], @"[^A-Z]+", String.Empty);


    string fullPath = "";


    fullPath = basePath + @"\" + latestTime + @"\" + "U";




    var csv = new System.Text.StringBuilder();


    List<Vector3d> values = new List<Vector3d>();

    var lastLine = File.ReadLines(fullPath).Last();
    string replacedString = System.Text.RegularExpressions.Regex.Replace(lastLine, "[()]", ""); //  RegexOptions.Compiled



    //double[] values = lastLine.Split(' ').Select(n => Convert.ToDouble(n)).ToArray();
    for (int i = 1; i < counterPoints; i += 3)
    {
      values.Add(new Vector3d(double.Parse(replacedString.Split(" ".ToCharArray(), StringSplitOptions.RemoveEmptyEntries)[i]), double.Parse(replacedString.Split(" ".ToCharArray(), StringSplitOptions.RemoveEmptyEntries)[i + 1]), double.Parse(replacedString.Split(" ".ToCharArray(), StringSplitOptions.RemoveEmptyEntries)[i + 2])));
    }
    A = values;
    //File.WriteAllText(postProcessDirectory + "cpvalues.csv", csv.ToString());
# ---------- end c_script ----------
panel_3 = Panel(c_script.A)
demesh = DeconstructMesh(Mesh=mesh)  # -> Vertices, Faces, Colours, Normals
clean = Clean(Dir=panel, Run=Button())
avr = Average(Input=demesh.Vertices)  # -> flatten(ArithmeticMean)
pt = Point([Point(-10.5, 20, 31.5), Point(-11.5, 20, 31.5), Point(-12.5, 20, 31.5), Point(-13.5, 20, 31.5), Point(-14.5, 20, 31.5), Point(-15.5, 20, 31.5)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])
gradient = Gradient(
    LowerLimit=Slider(0, range=0..10),
    UpperLimit=Slider(10, range=0..10),
    Parameter=c_script.A,
    stops=[0: RGB(234, 38, 0), 0.25: RGB(234, 126, 0), 0.5: RGB(254, 244, 84), 0.75: RGB(173, 203, 249), 1: RGB(75, 107, 169)])
panel_4 = Panel(cluster)
panel_5 = Panel(avr)
# cp values
c_script_2 = CSharpScript(workingDirectory=panel, topologyName="c_p_patch", points=pt)  # -> out, A, B, C, D, E, F; inputs workingDirectory: String, points: list of Point3d
# ---------- c_script_2: C# ----------
    //List<Point3d> listOfPoints = new List<Point3d>();




    string postProcessDirectory = workingDirectory + @"\postProcessing\";
    int counterPoints = 0;


    counterPoints = points.Count();


    string[] dir = Directory.GetDirectories(postProcessDirectory);

    //replace this with input
    string basePath = postProcessDirectory + @"\cpSamples";

    int counterIter = Directory.GetDirectories(basePath).Length;





    string[] filePathResults = new string[counterPoints];
    string[] directoriesBasePath = Directory.GetDirectories(dir[0]);




    var latestTimedirectoriesBasePath = directoriesBasePath[directoriesBasePath.Length - 1];




    string latestTime = Path.GetFileName(latestTimedirectoriesBasePath);





    // Build get fileName

    //filePathResults = Directory.GetFiles(fullDir[0]);
    //string fileName = new String(Path.GetFileName(filePathResults[0]).Where(c => Char.IsLetter(c) | Char.IsPunctuation(c)).ToArray());;
    //string fileName2 = Regex.Replace(filePathResults[0], @"[^A-Z]+", String.Empty);


    string fullPath = "";


    fullPath = basePath + @"\" + latestTime + @"\" + "total(p)_coeff";
    A = fullPath;


    double[] cpValues = new double[counterPoints];
    var csv = new System.Text.StringBuilder();

    double[] values = new double[counterPoints];

    var lastLine = File.ReadLines(fullPath).Last();

    //double[] values = lastLine.Split(' ').Select(n => Convert.ToDouble(n)).ToArray();
    for (int i = 1; i < counterPoints; i++)
    {
      values[i] = double.Parse(lastLine.Split(" ".ToCharArray(), StringSplitOptions.RemoveEmptyEntries)[i]); //this workes
      //var firstColumn = i.ToString();
      //var secondColumn = cpValues[i].ToString();
      //var newLine = string.Format("{0},{1}", firstColumn, secondColumn);
      //csv.AppendLine(newLine);
    }
    B = values;
    //File.WriteAllText(postProcessDirectory + "cpvalues.csv", csv.ToString());
# ---------- end c_script_2 ----------
c_script_3 = CSharpScript(workingDir=panel, topologyName="c_p_patch", topologyMeshes=mesh)  # -> out, A, B, C, D, E, F; inputs workingDir: String, topologyMeshes: list of Mesh
# ---------- c_script_3: C# ----------
    //List<String> directories = new List<String>();
    string postProcessPath = workingDir + @"\postProcessing\";


    if (!Directory.Exists(postProcessPath))
    {
      // AddRuntimeMessage(GH_RuntimeMessageLevel.Error, "There is no postProcessing directory.");
      Print("There is no postProcessing directory.");
    }
    else{

      int counterTopologies = Directory.GetDirectories(postProcessPath).Length;
      string[] dir = Directory.GetDirectories(postProcessPath);
      string basePath = postProcessPath + @"\swakExpression_";

      int counterIter = Directory.GetDirectories(dir[0]).Length;


      string[] fullDir = new string[counterTopologies];
      string[] filePathResults = new string[counterTopologies];
      string[] dirLastIter = Directory.GetDirectories(dir[0]);


      var item = dirLastIter[dirLastIter.Length - 1];

      string lastIter = Path.GetFileName(item);



      // Build filepath
      for (int i = 0;i < counterTopologies; i++){
        fullDir[i] = basePath + topologyName + i;
      }


      // Build get fileName

      //filePathResults = Directory.GetFiles(fullDir[0]);
      //string fileName = new String(Path.GetFileName(filePathResults[0]).Where(c => Char.IsLetter(c) | Char.IsPunctuation(c)).ToArray());;

      //string fileName2 = Regex.Replace(filePathResults[0], @"[^A-Z]+", String.Empty);


      List<String> fullPath = new List<String>();

      for (int i = 0; i < counterTopologies; i++){
        fullPath.Add(fullDir[i] + @"\" + lastIter + @"\" + topologyName + i);
      }
      A = fullPath;



      double[] cpValues = new double[counterTopologies];


      var csv = new System.Text.StringBuilder();


      for (int i = 0; i < fullPath.Count ; i++)
      {
        var lastLine = File.ReadLines(fullPath[i]).Last();
        cpValues[i] = double.Parse(lastLine.Split(" ".ToCharArray(), StringSplitOptions.RemoveEmptyEntries)[1]);
        if (cpValues[i] > 100 ){
          cpValues[i] = cpValues[i - 1];
          };
        var first = i.ToString();
        var second = cpValues[i].ToString();
        //Suggestion made by KyleMit
        var newLine = string.Format("{0},{1}", first, second);
        csv.AppendLine(newLine);
      }



      B = cpValues;


      File.WriteAllText(workingDir + "cpvalues.csv", csv.ToString());

    }
# ---------- end c_script_3 ----------
bnd = Bounds(Numbers=c_script_3.B)
vdisex = VectorDisplayEx(Point=cluster, Vector=c_script.A, Colour=gradient, Width=2)
dedomain = DeconstructDomain(Domain=bnd)  # -> Start, End
gradient_2 = Gradient(
    LowerLimit=dedomain.Start,
    UpperLimit=dedomain.End,
    Parameter=c_script_3.B,
    stops=[0: RGB(234, 38, 0), 0.25: RGB(234, 126, 0), 0.5: RGB(254, 244, 84), 0.75: RGB(173, 203, 249), 1: RGB(75, 107, 169)])
panel_6 = Panel(c_script_2.B)
points = PointList(Points=avr)
panel_7 = Panel(c_script_2.out)
panel_8 = Panel(c_script_3.B)
preview = CustomPreview(Geometry=mesh, Shader=gradient_2)
panel_9 = Panel(c_script_3.out)
panel_10 = Panel(c_script_3.A)

# ==== cluster Cluster
min_edge = ClusterInput()
max_edge = ClusterInput()
custom_mesh_settings = SettingsCustom(
    StitchSeams=True,
    SimplePlanes=False,
    Refine=True,
    MinCount=16,
    MaxCount=400,
    AspectRatio=20,
    MaxDistance=0,
    MaxAngle=20,
    MinEdge=min_edge,
    MaxEdge=max_edge)
B = ClusterInput()
mesh = MeshBrep(Brep=B, Settings=custom_mesh_settings)
demesh = DeconstructMesh(Mesh=mesh)  # -> Vertices, Faces, Colours, Normals
V = ClusterOutput(demesh.Vertices)
