# Grasshopper definition cpPaper.gh (Grasshopper 0.9.76)
# plug-ins: Python Interpreter, VirtualWindTunnel, DIVA Daylight

toggle = BooleanToggle(False)
toggle_2 = BooleanToggle(False)
toggle_3 = BooleanToggle(False)
button = Button()
knob = ControlKnob(Decimals=0, Limit=True, Maximum=359, Minimum=0, Range=360, Value=90)
geo = Geometry([<brep referenced from the Rhino model> x10])
int = Integer(knob)
xz = XZPlane(Origin=Point(-0.0485980799, -4.042677826, 0))
c_script = CSharpScript(p=xz)  # -> out, B, A; inputs b: list of Brep, p: Plane
# ---------- c_script: C# ----------
    double pj = 0;
    A = FindFacades(p, b, out pj);
    B = pj;
# ---------- c_script: C# additional code ----------
  static List<Brep> FindFacades(Plane plane, List<Brep> volumes, out double projectedAreaTotal)
  {
    List<Brep> Facades = new List<Brep>();

    List<double> projectedAreas = new List<double>();
    foreach (Brep b in volumes)
    {
      for (int i = 0; i < b.Faces.Count; i++)
      {
        Vector3d vSurf = b.Faces[i].NormalAt(0.5, 0.5);
        double dot = plane.ZAxis * vSurf;
        if (dot < 0.1) continue;


        Brep face = b.Faces[i].DuplicateFace(false);
        //Print(dot + "");
        Facades.Add(face);

        Vector3d cross = Vector3d.CrossProduct(plane.ZAxis, vSurf);
        double norm = cross.Length;
        double angle = Math.Atan2(norm, dot);

        //Print((angle * 180 / Math.PI) + "");

        double projectedArea = face.GetArea() * Math.Cos(angle);

        projectedAreas.Add(projectedArea);
        //Print(projectedArea + "");
      }
    }
    projectedAreaTotal = projectedAreas.Sum(x => x);

    return Facades;
  }
# ---------- end c_script ----------
panel = Panel(c_script.B)
cellsize = CellSize(Size="20.0", DesiredCellSize="1")
number_slider = Slider(5, range=0..10)
int_2 = Integer(number_slider)
number_slider_2 = Slider(4, range=0..10)
int_3 = Integer(number_slider_2)
number_slider_3 = Slider(2, range=0..10)
int_4 = Integer(number_slider_3)
number_slider_4 = Slider(4, range=0..10)
int_5 = Integer(number_slider_4)
concat = Concatenate(
    FragmentA="C:\cpPaper\cpPaper",
    FragmentB=int_3,
    FragmentC=int_2,
    FragmentD=int_4,
    FragmentE=int_5,
    FragmentF="_",
    FragmentG=int,
    FragmentH="\")
domaincyl = DomainCyl(
    Geometry=geo,
    Directory=concat,
    WindDir=knob,
    DivisionsOuterCirc=Slider(3, range=0..10),
    DivisionsZ=Slider(9, range=0..10),
    ScaleInnerR=Slider(0.5, range=0..1),
    RAM=Slider(1, range=0..64000),
    CPUs=Slider(6, range=1..8),
    Run=toggle)  # -> Out, Domain, Cyl
clean = Clean(Dir=concat, Run=Button())
panel_2 = Panel(concat)
cluster = Cluster()
panel_3 = Panel(cellsize)
python = PythonScript()  # -> out, a, b, c, d, e, f
# ---------- python: Python ----------
a=x.BBox
b=x.centerGroundBBox
c=x.BBox.Min
d=x.BBox.Max
e=x.dimY
f=x.newBoxDomain.GetCorners
# ---------- end python ----------
panel_4 = Panel(python.b)
panel_5 = Panel(python.f)
panel_6 = Panel(python.a)
panel_7 = Panel(python.c)
mesh = Mesh(
    Domain=domaincyl.Domain,
    AccBuilding=number_slider_2,
    AccFeatures=number_slider,
    AccGround=number_slider_3,
    Layer=number_slider_4,
    Run=toggle)  # -> Out, Domain
panel_8 = Panel("C:\MeshingPaper\withoutLayers\City_case_Cyl-wL-4710\")
panel_9 = Panel("C:\MeshingPaper\withoutLayers\City_case_WT-wL-4710_rF\")
panel_10 = Panel("C:\MeshingPaper\Ref_case_WT-5513_plots2\")
panel_11 = Panel("C:\MeshingPaper\A_high-rise_building_in_city_blocks_Cyl_plots\")
panel_12 = Panel("C:\MeshingPaper\Ref_case_Cyl-5513_plots\")
panel_13 = Panel("C:\MeshingPaper\A_high-rise_building_in_city_blocks_WT_plots2\")
path = FilePath("C:\MeshingPaper\withoutLayers\City_case_WT-wL-4710\")
simulation = Simulation(
    Domain=mesh.Domain,
    Iterations=Slider(10, range=0..1000),
    WriteInterval=Slider(10, range=0..100),
    KeepTimeSteps=Slider(5, range=0..10),
    Mode=0,
    Run=Button())
path_2 = FilePath(concat)
residualwriter = ResidualWriter(FileP=path)
gradient = Gradient(
    LowerLimit=0,
    UpperLimit=1,
    stops=[0: RGB(234, 38, 0), 0.463: RGB(254, 244, 84), 0.75: RGB(173, 203, 249), 1: RGB(75, 107, 169)])  # disabled
button_2 = Button()

# ----
# Plotter
toggle_4 = BooleanToggle(True)
c_script_2 = CSharpScript(Dir=path, Run=toggle_4)  # -> out, A; inputs Dir: String, Run: Boolean
# ---------- c_script_2: C# ----------
    System.Diagnostics.ProcessStartInfo psi = new System.Diagnostics.ProcessStartInfo();
    psi.WorkingDirectory = System.IO.Path.GetDirectoryName(Dir);
    psi.FileName = "gnuplot";
    psi.Arguments = "plotter.gnu";

    string csvName = "residuals.csv";


    string gnuCommands = @"set key autotitle columnhead
      set logscale y
      set ylabel 'Residual'
      set xlabel 'Iteration'
      set format y ""10^{%T}""
      set datafile separator ','
      plot """ + csvName + @""" u($0):2 with lines, """ + csvName + @""" u($0):3 with lines, """ + csvName + @""" u($0):4 with lines, """ + csvName + @""" u($0):5 with lines, """ + csvName + @""" u($0):6 with lines, """ + csvName + @""" u($0):7 with lines
      set terminal pdf
      set output ""residuals.pdf""
      replot
      #pause 5
      #reread
      ";


    System.IO.File.WriteAllText(psi.WorkingDirectory + @"\plotter.gnu", gnuCommands);


    System.Diagnostics.Process p = new System.Diagnostics.Process();
    p.StartInfo = psi;

    if(Run == true){  p.Start();
      p.WaitForExit();
    }
# ---------- end c_script_2 ----------

concat_2 = Concatenate(FragmentA=path_2, FragmentB="\constant\triSurface\patch.stl")
vdisex = VectorDisplayEx(Colour=gradient, Width=2)  # disabled
brep = Brep(<brep referenced from the Rhino model>)
c_script_3 = CSharpScript(Dir=path, Run=toggle_4)  # -> out, A; inputs Dir: String, Run: Boolean
# ---------- c_script_3: C# ----------
    System.Diagnostics.ProcessStartInfo psi = new System.Diagnostics.ProcessStartInfo();
    psi.WorkingDirectory = System.IO.Path.GetDirectoryName(Dir);
    psi.FileName = "gnuplot";
    psi.Arguments = "plotter.gnu";

    string csvName = "residuals.csv";


    string gnuCommands = @"set key autotitle columnhead
      set logscale y
      set ylabel 'Residual'
      set xlabel 'Iteration'
      set format y ""10^{%T}""
      set grid ytics lc rgb ""#bbbbbb"" lw 1 lt 0
      set grid xtics lc rgb ""#bbbbbb"" lw 1 lt 0
      set datafile separator ','
      plot """ + csvName + @""" u($0):2 with lines, """ + csvName + @""" u($0):3 with lines, """ + csvName + @""" u($0):4 with lines, """ + csvName + @""" u($0):5 with lines, """ + csvName + @""" u($0):6 with lines, """ + csvName + @""" u($0):7 with lines
      pause 5
      reread
      ";


    System.IO.File.WriteAllText(psi.WorkingDirectory + @"\plotter.gnu", gnuCommands);


    System.Diagnostics.Process p = new System.Diagnostics.Process();
    p.StartInfo = psi;

    if(Run == true){  p.Start();
      p.WaitForExit();
    }
# ---------- end c_script_3 ----------
grid = DaylightingGrid(
    Geometry=brep,
    Spacing=Slider(1, range=0..10),
    BooleanValue_0=False,
    BooleanValue_1=False,
    BooleanValue_10=False,
    BooleanValue_11=False,
    BooleanValue_12=False,
    BooleanValue_13=False,
    BooleanValue_14=False,
    BooleanValue_15=False,
    BooleanValue_16=False,
    BooleanValue_17=False,
    BooleanValue_18=False,
    BooleanValue_19=False,
    BooleanValue_2=False,
    BooleanValue_20=False,
    BooleanValue_21=False,
    BooleanValue_22=False,
    BooleanValue_3=False,
    BooleanValue_4=False,
    BooleanValue_5=False,
    BooleanValue_6=False,
    BooleanValue_7=False,
    BooleanValue_8=False,
    BooleanValue_9=False,
    Color_0=RGBA(0, 0, 0, 0),
    Color_1=RGBA(0, 0, 0, 0),
    Color_10=RGBA(0, 0, 0, 0),
    Color_11=RGBA(0, 0, 0, 0),
    Color_12=RGBA(0, 0, 0, 0),
    Color_13=RGBA(0, 0, 0, 0),
    Color_14=RGBA(0, 0, 0, 0)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)
grid_v = GridViewer(
    Grid=grid,
    active_element_0="Show Grid Faces",
    active_element_1="Show Grid Boundaries",
    active_element_2="Show Grid Wires",
    active_element_3="Show Shades (if active)",
    active_element_4="Show Legend",
    annual_metric=0,
    BooleanValue_0=False,
    BooleanValue_1=False,
    BooleanValue_10=False,
    BooleanValue_11=False,
    BooleanValue_12=False,
    BooleanValue_13=False,
    BooleanValue_14=False,
    BooleanValue_15=False,
    BooleanValue_16=False,
    BooleanValue_17=False,
    BooleanValue_18=False,
    BooleanValue_19=False,
    BooleanValue_2=False,
    BooleanValue_20=False,
    BooleanValue_3=False,
    BooleanValue_4=False,
    BooleanValue_5=False,
    BooleanValue_6=False,
    BooleanValue_7=False,
    BooleanValue_8=False,
    BooleanValue_9=False,
    Color_0=RGBA(0, 0, 0, 0),
    Color_1=RGBA(0, 0, 0, 0),
    Color_10=RGBA(0, 0, 0, 0)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)  # -> Faces, SensorPts, SensorData
postprocessing = PostProcessing(Domain=mesh.Domain, Topologies=grid_v.Faces, Variable=0)
stlexporter = STLExporter(Breps=grid_v.Faces, File=concat_2, Mode=2)
panel_14 = Panel(grid_v.Faces)
mesh_2 = Mesh([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])
python_2 = PythonScript()  # -> out, a; inputs windows: list
# ---------- python_2: Python ----------
import Rhino as rc
import rhinoscriptsyntax as rs
import scriptcontext as sc

sc.doc = ghdoc

sc.doc = rc.RhinoDoc.ActiveDoc
rs.EnableRedraw(False)
layertable = sc.doc.Layers

textFile1 = []
for i,w in enumerate(windows):
    layerName = _layer + str(i)
    print layerName
    layerindex = layertable.Find(layerName, True)

    if layerindex > 0:
        found_objects = rs.ObjectsByLayer(layerName)
        if len(found_objects) > 0:
            rs.DeleteObjects(found_objects)
    else:
        rs.AddLayer(layerName)
    
    export_brep = rs.AddPlanarSrf(w.Edges)
    surface_guid = str(export_brep)
    surface_guid = surface_guid.split('[')[-1]
    surface_guid = surface_guid.split(']')[0]
    rs.ObjectLayer('%s'%surface_guid,layerName)
    rs.ObjectColorSource('%s'%surface_guid,0)
    
    if _bake == True:
        rs.Command("-_SelLayer \"" + layerName + "\"", True)
        full_file_name = _directory + layerName + '.stl'
        print full_file_name
        rs.Command("-_Export \"" + full_file_name + "\" _Enter _Enter", True)
        textFile1.append('{')
        textFile1.append('name ' + layerName + ';')
        textFile1.append('type faceZoneSet;')
        textFile1.append('action new;')
        textFile1.append('source searchableSurfaceToFaceZone;')
        textFile1.append('sourceInfo')
        textFile1.append('{')
        textFile1.append('surface triSurfaceMesh;')
        textFile1.append('name "' + layerName + '.stl";')
        textFile1.append('}')
        textFile1.append('}')
    else:
        pass
if _bake == True:
    finalStr = '\n'.join(textFile1)
    f = open(_directory + 'topoSetDict_new.txt', 'w+')
    f.write(finalStr)
    f.close()
sc.doc = ghdoc
# ---------- end python_2 ----------

# ==== cluster Cluster
number_slider = Slider(0, range=0..17)
bacc = Panel("""3
4
5
6
7
8
3
4
5
6
7
8
3
4
5
6
7
8""")
panel = Panel("""3
4
5
6
7
8
3
4
5
6
7
8
3
4
5
6
7
8""")
item = ListItem(List=bacc, Index=number_slider, Wrap=True)
item_2 = ListItem(List=panel, Index=number_slider, Wrap=True)
panel_2 = Panel("""3
3
3
3
3
3
4
4
4
4
4
4
5
5
5
5
5
5""")
item_3 = ListItem(List=panel_2, Index=number_slider, Wrap=True)
