# Grasshopper definition parseHourlyU.gh (Grasshopper 0.9.76)

panel = Panel("""C:\temp\11\postProcessing\U_Probes.csv
C:\temp\33\postProcessing\U_Probes.csv
C:\temp\75\postProcessing\U_Probes.csv
C:\temp\122\postProcessing\U_Probes.csv""")
c_script = CSharpScript(fullProbeFilePath=panel)  # -> out, A; inputs fullProbeFilePath: list of String
# ---------- c_script: C# ----------
    // Array for output data

    DataTree<Vector3d> UTree = new DataTree<Vector3d>();
    var numberOfWindDirs = 4;
    var numberOfProbes = 80;

    var listOfAnnualData = new Vector3d[numberOfWindDirs][];

    
    
    List<double> Uvalues = new List<double>();
    
    
    
    for (int r = 0; r < numberOfWindDirs; r++)
    {
      listOfAnnualData[r] = new Vector3d[numberOfProbes];
      int counter = 1;
      for (int c = 0; c < numberOfProbes; c++)
      {       
        listOfAnnualData[r][c] = new Vector3d(double.Parse(File.ReadAllLines(fullProbeFilePath[r])[c].Split(",".ToCharArray(), StringSplitOptions.RemoveEmptyEntries)[0]),double.Parse(File.ReadAllLines(fullProbeFilePath[r])[c].Split(",".ToCharArray(), StringSplitOptions.RemoveEmptyEntries)[1]),double.Parse(File.ReadAllLines(fullProbeFilePath[r])[c].Split(",".ToCharArray(), StringSplitOptions.RemoveEmptyEntries)[2]));
        counter += 3;
      }
    }

    for (int c = 0; c < numberOfWindDirs; c++)
    {
      for (int r = 0; r < numberOfProbes; r++)
      {
        UTree.Add(listOfAnnualData[c][r], new Grasshopper.Kernel.Data.GH_Path(c));
      }

    }

   
    

    A = UTree;
# ---------- end c_script ----------
panel_2 = Panel(c_script.out)
panel_3 = Panel(c_script.A)
