# Grasshopper definition residuals_meshing_paper.gh (Grasshopper 0.9.76)
# plug-ins: VirtualWindTunnel

residualwriter = ResidualWriter(WorkingDir="C:\MeshingPaper\take2\cyl\coarse_2\", Mode=1)
residualwriter_2 = ResidualWriter(WorkingDir="C:\MeshingPaper\take2\cyl\coarse_0\", Mode=1)
residualwriter_3 = ResidualWriter(WorkingDir="C:\MeshingPaper\take2\done\cyl\coarse_3\", Mode=1)
residualwriter_4 = ResidualWriter(WorkingDir="C:\MeshingPaper\take2\cyl\coarse_1\", Mode=1)
residualwriter_5 = ResidualWriter(WorkingDir="C:\MeshingPaper\take2\box\coarse_3\", Mode=1)
residualwriter_6 = ResidualWriter(WorkingDir="C:\MeshingPaper\take2\box\coarse_2\", Mode=1)
residualwriter_7 = ResidualWriter(WorkingDir="C:\MeshingPaper\take2\box\coarse_1\", Mode=1)
residualwriter_8 = ResidualWriter(WorkingDir="C:\MeshingPaper\take2\box\coarse_0\", Mode=1)
