# Grasshopper definition testFile.gh (Grasshopper 0.9.76)
# plug-ins: Python Interpreter, VirtualWindTunnel

panel = Panel("C:\MeshingPaper\Niigata_case_ref_app_dimensions_comp\")
wind_dir = ControlKnob(Decimals=0, Limit=True, Maximum=359, Minimum=0, Range=360, Value=0)
brep = Brep(<brep referenced from the Rhino model>)
brep_2 = Brep(brep)
geo = Geometry([<mesh referenced from the Rhino model>, <brep referenced from the Rhino model>])
xz = XZPlane(Origin=Point(-0.0485980799, -4.042677826, 0))  # disabled
clean = Clean(Dir=panel, Run=Button())
domain = Domain(
    Geometry=geo,
    Directory=panel,
    Mode=1,
    BaseMesh=Slider(20, range=0..100),
    RAM=Slider(1, range=0..64000),
    CPUs=Slider(1, range=1..8),
    Run=Toggle(False))  # -> Out, Domain, Cyl
clean_2 = Clean(Run=Button())
domaincyl = DomainCyl(
    Geometry=geo,
    Directory="C:\MeshingPaper\Niigata_cyl_thin_plates_no_layers_ref4_3y\",
    WindDir=wind_dir,
    DivisionsX="1",
    DivisionsY=Slider(3, range=1..100),
    DivisionsZ=Slider(9, range=0..100),
    RAM=Slider(1, range=0..1),
    CPUs=1,
    Run=Toggle(False))  # -> Out, Domain, Cyl
c_script = CSharpScript(b=brep, p=xz)  # -> out, B, A; inputs b: list of Brep, p: Plane; disabled
# ---------- c_script: C# ----------
    double pj = 0;
    A = FindFacades(p, b, out pj);
    B = pj;
# ---------- c_script: C# additional code ----------
  static List<Brep> FindFacades(Plane plane, List<Brep> volumes, out double projectedAreaTotal)
  {
    List<Brep> Facades = new List<Brep>();

    List<double> projectedAreas = new List<double>();
    foreach (Brep b in volumes)
    {
      for (int i = 0; i < b.Faces.Count; i++)
      {
        Vector3d vSurf = b.Faces[i].NormalAt(0.5, 0.5);
        double dot = plane.ZAxis * vSurf;
        if (dot < 0.1) continue;


        Brep face = b.Faces[i].DuplicateFace(false);
        //Print(dot + "");
        Facades.Add(face);

        Vector3d cross = Vector3d.CrossProduct(plane.ZAxis, vSurf);
        double norm = cross.Length;
        double angle = Math.Atan2(norm, dot);

        //Print((angle * 180 / Math.PI) + "");

        double projectedArea = face.GetArea() * Math.Cos(angle);

        projectedAreas.Add(projectedArea);
        //Print(projectedArea + "");
      }
    }
    projectedAreaTotal = projectedAreas.Sum(x => x);

    return Facades;
  }
# ---------- end c_script ----------
python = PythonScript(x=domain.Domain)  # -> out, a
# ---------- python: Python ----------
a = x.BuildingGeometry
# ---------- end python ----------
panel_2 = Panel(domain.Domain)
panel_3 = Panel(c_script.B)
panel_4 = Panel(domaincyl.Domain)
python_2 = PythonScript(x=domaincyl.Domain)  # -> out, a
# ---------- python_2: Python ----------
a = x.frontageBuildingArea
# ---------- end python_2 ----------
num = Number("20.0")
num_2 = Number("430")
cellsize = CellSize(Domain=domaincyl.Domain, Size=num_2, DesiredCellSize=num)
number_slider = Slider(5, range=0..10)  # disabled
toggle = BooleanToggle(False)  # disabled
python_3 = PythonScript()  # -> out, a, b, c, d, e, f; disabled
# ---------- python_3: Python ----------
a=x.BBox
b=x.centerGroundBBox
c=x.BBox.Min
d=x.BBox.Max
e=x.dimY
f=x.newBoxDomain.GetCorners
# ---------- end python_3 ----------
panel_5 = Panel(cellsize)
mesh = Mesh(Domain=domaincyl.Domain, Accuracy=number_slider, Run=toggle)  # -> Out, Domain; disabled
panel_6 = Panel(python_3.b)  # disabled
panel_7 = Panel(mesh.Domain)  # disabled
panel_8 = Panel(python_3.f)  # disabled
panel_9 = Panel(python_3.a)  # disabled
panel_10 = Panel(python_3.c)  # disabled
number_slider_2 = Slider(5, range=0..10)  # disabled
number_slider_3 = Slider(5, range=0..100)  # disabled
number_slider_4 = Slider(10, range=0..1000)  # disabled
toggle_2 = BooleanToggle(False)  # disabled
simulation = Simulation(
    Domain=mesh.Domain,
    Iterations=number_slider_4,
    WriteInterval=number_slider_3,
    KeepTimeSteps=number_slider_2,
    Run=toggle_2)  # disabled
gradient = Gradient(
    LowerLimit=0,
    UpperLimit=1,
    stops=[0: RGB(234, 38, 0), 0.25: RGB(234, 126, 0), 0.463: RGB(254, 244, 84), 0.75: RGB(173, 203, 249), 1: RGB(75, 107, 169)])  # disabled
vdisex = VectorDisplayEx(Colour=gradient, Width=2)  # disabled
number_slider_5 = Slider(4, range=1..100)  # disabled
number_slider_6 = Slider(1, range=1..100)  # disabled
pt = ConstructPoint(XCoordinate=0, YCoordinate=0, ZCoordinate=0)  # disabled
neg = Negative(Value=number_slider_6)  # disabled
xy = XYPlane(Origin=pt)  # disabled
dom = ConstructDomain(DomainStart=neg, DomainEnd=number_slider_6)  # disabled
circle = CircleCNR(Center=pt, Normal=Vector(0, 0, 1), Radius=number_slider_5)  # disabled
rectangle = Rectangle(Plane=xy, XSize=dom, YSize=dom, Radius=0)  # -> Rectangle, Length; disabled
Y = UnitY(Factor=number_slider_5)  # disabled
move = Move(Geometry=pt, Motion=Y)  # -> Geometry, Transform; disabled
angle = Panel("5")  # disabled
panel_11 = Panel("360")  # disabled
division = Division(A=panel_11, B=angle)  # disabled
number_slider_7 = Slider(0.4, range=0..100)  # disabled
series = Series(Start=0, Step=angle, Count=division)  # disabled
rad = Radians(Degrees=series)  # disabled
# arcPoints0
rotate = Rotate(Geometry=move.Geometry, Angle=rad, Plane=xy)  # -> Geometry, Transform; disabled
ln = Line(StartPoint=pt, EndPoint=rotate.Geometry)  # disabled
panel_12 = Panel("""10
11
12
13
14
15
16
17
18
19
20
21
22
23
24
25
26""")  # disabled
# boxPoints0
ccx = CurveCurve(CurveA=rectangle.Rectangle, CurveB=ln)  # -> flatten(Points), ParamsA, ParamsB; disabled
points = PointList(Points=ccx.Points, Size=number_slider_7)  # disabled
points_2 = PointList(Points=rotate.Geometry, Size=number_slider_7)  # disabled
panel_13 = Panel("""0
1
2
3
4
5
6
7
8
71
70
69
68
67
66
65
64""")  # disabled
lng = ListLength(List=ccx.Points)  # disabled
panel_14 = Panel("""62
61
60
59
58
57
56
55
54
53
52
51
50
49
48
47
46""")  # disabled
panel_15 = Panel("""36
35
34
33
32
31
30
29
28
37
38
39
40
41
42
43
44""")  # disabled
panel_16 = Panel("2")  # disabled
panel_17 = Panel(series)  # disabled
division_2 = Division(A=lng, B=panel_16)  # disabled
item = ListItem(List=ccx.Points, Index=panel_13, Wrap=True)  # disabled
item_2 = ListItem(List=ccx.Points, Index=panel_15, Wrap=True)  # disabled
item_3 = ListItem(List=ccx.Points, Index=panel_12, Wrap=True)  # disabled
item_4 = ListItem(List=ccx.Points, Index=panel_14, Wrap=True)  # disabled
ln_2 = Line(StartPoint=item_3, EndPoint=item_4)  # disabled
ln_3 = Line(StartPoint=item, EndPoint=item_2)  # disabled
crossref = CrossReference(ListA=ln_3, ListB=ln_2, CrossMode=1)  # -> ListA, ListB, ListC, ListD; disabled
# gridPoints0
ccx_2 = CurveCurve(CurveA=crossref.ListA, CurveB=crossref.ListB)  # -> flatten(Points), ParamsA, ParamsB; disabled
points_3 = PointList(Points=ccx_2.Points, Size=number_slider_7)  # disabled
number_slider_8 = Slider(10, range=0..10)  # disabled
Z = UnitZ(Factor=number_slider_8)  # disabled
number_slider_9 = Slider(5, range=0..10)  # disabled
number_slider_10 = Slider(10, range=0..10)  # disabled
panel_18 = Panel("1")  # disabled
# arcPoints1
# 24
# boxPoints1
move_2 = Move(Geometry=ccx_2.Points, Motion=Z)  # -> Geometry, Transform; disabled
# gridPoints1
# 25
move_3 = Move(Geometry=rotate.Geometry, Motion=Z)  # -> Geometry, Transform; disabled
# 25
move_4 = Move(Geometry=ccx.Points, Motion=Z)  # -> Geometry, Transform; disabled
fulllist = CSharpScript(
    arcPoints0=rotate.Geometry,
    boxPoints0=ccx.Points,
    gridPoints0=ccx_2.Points,
    arcPoints1=move_3.Geometry,
    boxPoints1=move_4.Geometry,
    gridPoints1=move_2.Geometry)  # -> out, A, B; inputs arcPoints0: list of Point3d, boxPoints0: list of Point3d, gridPoints0: list of Point3d, arcPoints1: list of Point3d, boxPoints1: list of Point3d, gridPoints1: list of Point3d; disabled
# ---------- fulllist: C# ----------
    List<Point3d> L = new List<Point3d>();
    List<String> L2 = new List<String>();

    //L = arcPoints0.Concat(boxPoints0).Concat(gridPoints0).ToList();
    //L2 = arcPoints0.Concat(boxPoints0).Concat(gridPoints0).Concat(arcPoints1).Concat(boxPoints1).Concat(gridPoints1).ToList().GetRange(73, 73);
    L = arcPoints0.Concat(boxPoints0).Concat(gridPoints0).Concat(arcPoints1).Concat(boxPoints1).Concat(gridPoints1).ToList();
    //L = arcPoints0.Concat(boxPoints0).Concat(gridPoints0).ToList();

    A = L;
    //B = L2;


    for (int i = 0; i < L.Count ; i++){
      L2.Add("(" + L[i].X + " " + +L[i].Y + " " + +L[i].Z + ")");
    }
    B = L2;
# ---------- end fulllist ----------
points_4 = PointList(Points=fulllist.A, Size=number_slider_7)  # disabled
panel_19 = Panel(fulllist.B)
# faces
# arcs
c_script_2 = CSharpScript(fullList=fulllist.A, divisionsX=panel_18, divisionsY=number_slider_9, divisionsZ=number_slider_10)  # -> out, A, B, C, D, E, F, G, AA; inputs fullList: list of Point3d, divisionsX: Int32, divisionsY: Int32, divisionsZ: Int32; disabled
# ---------- c_script_2: C# ----------
    Mesh m = new Mesh();
    Mesh n = new Mesh();
    List<String> L1 = new List<String>();
    List<String> L2 = new List<String>();
    List<String> L3 = new List<String>();
    List<String> listGround = new List<String>();
    List<String> listTop = new List<String>();

    foreach(Point3d xx in fullList) m.Vertices.Add(xx);


    for(int i = 0; i < fullList.Count / 12 - 1 ;i++){
      m.Faces.AddFace(i, i + 1, fullList.Count / 12 + i + 1, fullList.Count / 12 + i);
    }
    //last Face in list
    m.Faces.AddFace(fullList.Count / 12 - 1, 0, fullList.Count / 12, fullList.Count / 12 + fullList.Count / 12 - 1);

    for(int i = fullList.Count / 2; i < fullList.Count / 2 + fullList.Count / 12 - 1 ;i++){
      m.Faces.AddFace(i, i + 1, fullList.Count / 12 + i + 1, fullList.Count / 12 + i);
    }
    //last Face in list
    m.Faces.AddFace(fullList.Count / 2 + fullList.Count / 12 - 1, fullList.Count / 2, fullList.Count / 12 + fullList.Count / 2, fullList.Count / 2 + (2 * fullList.Count / 12) - 1);


    //arcPoints1.Count - 1


    A = m;

    for(int i = 0; i < fullList.Count / 12;i++){
      L1.Add(" hex (" + m.Faces[i].A.ToString() + " " + m.Faces[i].B.ToString() + " " + m.Faces[i].C.ToString() + " " + m.Faces[i].D.ToString() + " ");
    }
    //
    for(int i = fullList.Count / 12; i < fullList.Count / 6  ;i++){
      L2.Add(m.Faces[i].A.ToString() + " " + m.Faces[i].B.ToString() + " " + m.Faces[i].C.ToString() + " " + m.Faces[i].D.ToString() + ") (" + divisionsX + " " + divisionsY + " " + divisionsZ + ") simpleGrading (1 1 1) ");
    }

    // for(int i = 0; i < fullList.Count / 12;i++){
    //   L3.Add(m.Faces[i].A.ToString());
    //   L3.Add(m.Faces[i].B.ToString());
    //  L3.Add(m.Faces[i].C.ToString());
    //  L3.Add(m.Faces[i].D.ToString());
    // }

    listGround.Add("ground\n {\n type wall;\n faces\n (");
    for(int i = 0; i < fullList.Count / 12;i++){
      listGround.Add("(" + m.Faces[i].A.ToString() + " " + m.Faces[i].B.ToString() + " " + m.Faces[i].C.ToString() + " " + m.Faces[i].D.ToString() + ")");
    }
    //listGround.Add(" \n  );\n}");

    listTop.Add("top\n {\n type symmetry;\n faces\n (");
    for(int i = fullList.Count / 12; i < fullList.Count / 6  ;i++){
      listTop.Add("(" + m.Faces[i].A.ToString() + " " + m.Faces[i].B.ToString() + " " + m.Faces[i].C.ToString() + " " + m.Faces[i].D.ToString() + ")");
    }
    //listTop.Add(" \n  );\n}");

    C = L1;
    D = L2;
    E = L3;
    F = listGround;
    G = listTop;
# ---------- end c_script_2 ----------
points_5 = PointList(Points=move_2.Geometry, Size=number_slider_7)  # disabled
points_6 = PointList(Points=move_4.Geometry, Size=number_slider_7)  # disabled
points_7 = PointList(Points=move_3.Geometry, Size=number_slider_7)  # disabled
reset = Button()  # disabled
# vertices
concat = Concatenate(FragmentA=c_script_2.C, FragmentB=c_script_2.D)  # disabled
panel_20 = Panel(c_script_2.F)  # disabled
panel_21 = Panel(c_script_2.G)  # disabled
# blocks
# arc
panel_22 = Panel(concat)
panel_23 = Panel(c_script_2.C)  # disabled
panel_24 = Panel("5")  # disabled
panel_25 = Panel("""True
True
True
True
True
True
True
True
True
True
True
True
True
True
True
True
True
True
False
False
False
False
False
False
False
False
False
False
False
False
False
False
False
False
False
False
False
False
False
False
False
False
False
False
False
False
False
False
False
False
False
False
False
False
True
True
True
True
True
True
True
True
True
True
True
True
True
True
True
True
True
True""")  # disabled
panel_26 = Panel("36")  # disabled
c_script_3 = CSharpScript(arcPoints1=move_3.Geometry, boxPoints1=move_4.Geometry, gridPoints1=move_3.Geometry)  # -> out, A, B; inputs arcPoints1: list, boxPoints1: list, gridPoints1: list; disabled
# ---------- c_script_3: C# ----------
    Mesh m = new Mesh();
    Mesh n = new Mesh();


    //foreach(Point3d xx in arcPoints0) m.Vertices.Add(xx);
    //foreach(Point3d xx in boxPoints0) m.Vertices.Add(xx);
    //foreach(Point3d xx in gridPoints0) m.Vertices.Add(xx);
    foreach(Point3d xx in arcPoints1) n.Vertices.Add(xx);
    foreach(Point3d xx in boxPoints1) n.Vertices.Add(xx);
    foreach(Point3d xx in gridPoints1) n.Vertices.Add(xx);


    //for(int i = 0; i < arcPoints0.Count - 1 ;i++){
    //  m.Faces.AddFace(i, i + 1, arcPoints0.Count + i + 1, arcPoints0.Count + i);
    //}
    //last Face in list
    //m.Faces.AddFace(arcPoints0.Count - 1, 0, arcPoints0.Count, arcPoints0.Count + boxPoints0.Count - 1);

    for(int i = 0; i < arcPoints1.Count - 1;i++){
      n.Faces.AddFace(i, i + 1, arcPoints1.Count + i + 1, arcPoints1.Count + i);
    }
    n.Faces.AddFace(arcPoints1.Count - 1 , 0, arcPoints1.Count , arcPoints1.Count + boxPoints1.Count - 1 );


    //arcPoints1.Count - 1



    A = n;




    //for(int i = 0; i < m.Faces.Count;i++){
    //
    //  Print(m.Faces[i].A + " " + m.Faces[i].B + " " + m.Faces[i].C + " " + m.Faces[i].D + " ");

    //}
    for(int i = 0; i < n.Faces.Count;i++){

      Print(n.Faces[i].A + " " + n.Faces[i].B + " " + n.Faces[i].C + " " + n.Faces[i].D + " ");

    }
# ---------- end c_script_3 ----------
number_slider_11 = Slider(3.6, range=0..20)  # disabled
c_script_4 = CSharpScript(
    boxPoints0=ccx.Points,
    gridPoints0=ccx_2.Points,
    arcPoints1=move_3.Geometry,
    boxPoints1=move_4.Geometry,
    gridPoints1=move_2.Geometry)  # -> out, A, B; inputs arcPoints0: list of Point3d, boxPoints0: list of Point3d, gridPoints0: list of Point3d, arcPoints1: list of Point3d, boxPoints1: list of Point3d, gridPoints1: list of Point3d; disabled
# ---------- c_script_4: C# ----------
    List<Point3d> L = new List<Point3d>();
    List<Point3d> L2 = new List<Point3d>();



    L = boxPoints0.Concat(gridPoints0).Concat(boxPoints1).Concat(gridPoints1).ToList();
    //L2 = arcPoints0.Concat(boxPoints0).Concat(gridPoints0).Concat(arcPoints1).Concat(boxPoints1).Concat(gridPoints1).ToList().GetRange(73, 73);
    //L2 = boxPoints1.Concat(gridPoints1).ToList();
    A = L;
    B = L2;
# ---------- end c_script_4 ----------
# faces
# patches
c_script_5 = CSharpScript(fullList=fulllist.A, arcPoints0=rotate.Geometry, arcPoints1=move_3.Geometry, inletOutletCheck=panel_25)  # -> out, A, B, C, D; inputs fullList: list of Point3d, arcPoints0: list of Point3d, arcPoints1: list of Point3d, inletOutletCheck: list of String; disabled
# ---------- c_script_5: C# ----------
    Mesh m = new Mesh();
    //Mesh n = new Mesh();
    List<string> L1 = new List<String>();
    //List<string> inletOutletCheck = new List<String>();
    List<string> inletOutletList = new List<String>();
    // List<String> L2 = new List<String>();


    //foreach(Point3d xx in arcPoints0) m.Vertices.Add(xx);
    //foreach(Point3d xx in arcPoints1) m.Vertices.Add(xx);
    foreach(Point3d xx in fullList) m.Vertices.Add(xx);


    for(int i = 0; i < fullList.Count / 12 - 1 ;i++){
      m.Faces.AddFace(i, i + 1, fullList.Count / 2 + i + 1, fullList.Count / 2 + i);
    }
    //last Face in list
    m.Faces.AddFace(fullList.Count / 12 - 1, 0, fullList.Count / 2, fullList.Count / 2 + fullList.Count / 12 - 1);

    A = m;

    for(int i = 0; i < fullList.Count / 12 ;i++){
      if (inletOutletCheck[i] == "True"){
        inletOutletList.Add("inlet" + i);
      }
      else{
        inletOutletList.Add("outlet" + i);
      }
    }

    for(int i = 0; i < fullList.Count / 12 ;i++){
      L1.Add(inletOutletList[i] + "\n {\n type patch;\n faces\n (\n(\t" + m.Faces[i].A.ToString() + " " + m.Faces[i].B.ToString() + " " + m.Faces[i].C.ToString() + " " + m.Faces[i].D.ToString() + ") \n  );\n}");
    }


    D = inletOutletList;
    C = L1;
    //D = L2;
# ---------- end c_script_5 ----------
facen = FaceNormals(Mesh=c_script_5.A)  # -> Centers, Normals; disabled
mesh_2 = Mesh(c_script_3.A)  # disabled
panel_27 = Panel("2")  # disabled
points_8 = PointList(Points=c_script_4.B, Size=number_slider_7)  # disabled
points_9 = PointList(Points=c_script_4.A, Size=number_slider_7)  # disabled
division_3 = Division(A=number_slider_8, B=panel_27)  # disabled
panel_28 = Panel(c_script_5.C)  # disabled
vec = VectorXYZ(XComponent=0, YComponent=0, ZComponent=division_3)  # -> Vector, Length; disabled
c_script_6 = CSharpScript(arcPoints1=rotate.Geometry, boxPoints1=ccx.Points, gridPoints1=ccx_2.Points)  # -> out, A, B; inputs arcPoints1: list, boxPoints1: list, gridPoints1: list; disabled
# ---------- c_script_6: C# ----------
    Mesh m = new Mesh();
    Mesh n = new Mesh();


    //foreach(Point3d xx in arcPoints0) m.Vertices.Add(xx);
    //foreach(Point3d xx in boxPoints0) m.Vertices.Add(xx);
    //foreach(Point3d xx in gridPoints0) m.Vertices.Add(xx);
    foreach(Point3d xx in arcPoints1) n.Vertices.Add(xx);
    foreach(Point3d xx in boxPoints1) n.Vertices.Add(xx);
    foreach(Point3d xx in gridPoints1) n.Vertices.Add(xx);


  

    for(int i = 0; i < boxPoints1.Count - 1;i++){
      n.Faces.AddFace(i, i + 1, arcPoints1.Count + i + 1, arcPoints1.Count + i);
    }
    n.Faces.AddFace(arcPoints1.Count - 1, 0, arcPoints1.Count, arcPoints1.Count + boxPoints1.Count - 1);


    //arcPoints1.Count - 1



    A = n;




    //for(int i = 0; i < m.Faces.Count;i++){
    //
    //  Print(m.Faces[i].A + " " + m.Faces[i].B + " " + m.Faces[i].C + " " + m.Faces[i].D + " ");

    //}
    for(int i = 0; i < n.Faces.Count;i++){

      Print(n.Faces[i].A + " " + n.Faces[i].B + " " + n.Faces[i].C + " " + n.Faces[i].D + " ");

    }
# ---------- end c_script_6 ----------
swatch = ColourSwatch(SwatchColor=RGB(62, 157, 189))  # disabled
vdisex_2 = VectorDisplayEx(Point=facen.Centers, Vector=facen.Normals, Colour=swatch, Width=2)  # disabled
panel_29 = Panel("""72
73
145
144
73
74
146
145
74
75
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""")  # disabled
panel_30 = Panel("""505
506
578
577
506
507
579
578
507
508
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""")  # disabled
# faces
# box
c_script_7 = CSharpScript(inputGroundVertices=panel_29, inputTopVertices=panel_30, fullList=fulllist.A)  # -> out, A, B, C, D, E; inputs inputGroundVertices: list of Int32, inputTopVertices: list of Int32, fullList: list of Point3d; disabled
# ---------- c_script_7: C# ----------
    List<Point3d> cutList = new List<Point3d>();
    List<String> groundBoxList = new List<String>();
    List<String> topBoxList = new List<String>();


    Mesh m = new Mesh();
    //Mesh n = new Mesh();
    //List<String> L1 = new List<String>();
    // List<String> L2 = new List<String>();
    //B = input;

    //cutList = fullList.GetRange(24, 122);
    //cutList.RemoveRange(49, 24);


    foreach(Point3d xx in fullList) m.Vertices.Add(xx);





    for (int i = 0;i < inputTopVertices.Count - 3; i = i + 4){
      m.Faces.AddFace(inputGroundVertices[i], inputGroundVertices[i + 1], inputGroundVertices[i + 2], inputGroundVertices[i + 3]);
    }
    for (int i = 0;i < inputTopVertices.Count - 3; i = i + 4){
      m.Faces.AddFace(inputTopVertices[i], inputTopVertices[i + 1], inputTopVertices[i + 2], inputTopVertices[i + 3]);
    }

    //groundBoxList.Add("ground\n {\n type wall;\n faces\n (");
    for(int i = 0; i < m.Faces.Count() / 2;i++){
      groundBoxList.Add("(" + m.Faces[i].A.ToString() + " " + m.Faces[i].B.ToString() + " " + m.Faces[i].C.ToString() + " " + m.Faces[i].D.ToString() + ")");
    }
    groundBoxList.Add(" \n  );\n}");

    //topBoxList.Add("top\n {\n type symmetry;\n faces\n (");
    for(int i = m.Faces.Count() / 2; i < m.Faces.Count()  ;i++){
      topBoxList.Add("(" + m.Faces[i].A.ToString() + " " + m.Faces[i].B.ToString() + " " + m.Faces[i].C.ToString() + " " + m.Faces[i].D.ToString() + ")");
    }
    topBoxList.Add(" \n  );\n}");


    A = m;
    B = m.Faces.Count();
    C = groundBoxList;
    D = topBoxList;
# ---------- end c_script_7 ----------
# blocks
# box
c_script_8 = CSharpScript(inputGroundFaces=panel_29, inputTopFaces=panel_30, divisionsZ=number_slider_10)  # -> out, A, B, C, D; inputs inputGroundFaces: list of Int32, inputTopFaces: list of Int32; disabled
# ---------- c_script_8: C# ----------
    List<int> m = new List<Int32>();
    List<string> L1 = new List<String>();


    for (int i = 0;i < inputGroundFaces.Count - 3; i = i + 4){
      bool continueLoop = true;
      m.Add(inputGroundFaces[i]);
      m.Add(inputGroundFaces[i + 1]);
      m.Add(inputGroundFaces[i + 2]);
      m.Add(inputGroundFaces[i + 3]);
      while (continueLoop){
        m.Add(inputTopFaces[i]);
        m.Add(inputTopFaces[i + 1]);
        m.Add(inputTopFaces[i + 2]);
        m.Add(inputTopFaces[i + 3]);
        continueLoop = false;
      }
    }


    for(int i = 0; i < inputGroundFaces.Count + inputTopFaces.Count ;i = i + 8){
      L1.Add("hex (" + m[i].ToString() + " " + m[i + 1].ToString() + " " + m[i + 2].ToString() + " " + m[i + 3].ToString() + " " + m[i + 4].ToString() + " " + m[i + 5].ToString() + " " + m[i + 6].ToString() + " " + m[i + 7].ToString() + ") (1 1 " + divisionsZ + ") simpleGrading (1 1 1)  ");
    }



    A = m;
    B = L1;
# ---------- end c_script_8 ----------
points_10 = PointList(Points=fulllist.A, Size=number_slider_7)  # disabled
panel_31 = Panel(c_script_7.C)  # disabled
panel_32 = Panel(c_script_7.D)  # disabled
panel_33 = Panel(c_script_8.B)  # disabled
wind_dir_2 = ControlKnob(Decimals=0, Limit=True, Maximum=359, Minimum=0, Range=360, Value=53)  # disabled
c_script_9 = CSharpScript(knob=wind_dir_2, reset=reset)  # -> A; inputs knob: Double, reset: Boolean; disabled
# ---------- c_script_9: C# ----------
    //Converting double to decimal to work with knob/dial
    decimal val = Convert.ToDecimal(knob);

    // Finding current knob/dial object name
    GH_Document ghDoc = this.GrasshopperDocument;
    IGH_Param param = Component.Params.Input[0].Sources[0];
    string name = param.NickName;
    Grasshopper.Kernel.Special.GH_DialKnob KnobDial = FindObject(ghDoc, name);


    while (val < 358)
    {
      if (val % 5 == 0)
      {
        val = KnobDial.Value;
      }
      if (val % 5 == 1)
      {
        val = KnobDial.Value - 1;
      }
      if (val % 5 == 2)
      {
        val = KnobDial.Value - 2;
      }
      if (val % 5 == 3)
      {
        val = KnobDial.Value + 2;
      }
      if (val % 5 == 4)
      {
        val = KnobDial.Value + 1;
      }
      break;
    }
    if (val  == 358 | val == 359 )
    {
      val = 0;
    }
   
    

    A = val;
    //val = KnobDial.Value;


    // if (val < KnobDial.Minimum){
    //  KnobDial.Value = KnobDial.Value - KnobDial.Minimum;
    //  KnobDial.ExpireSolution(true);
    // }
    //if (val > KnobDial.Maximum){
    //  KnobDial.Value = KnobDial.Value - KnobDial.Maximum;
    //  KnobDial.ExpireSolution(true);
    //}
    if (reset){
      KnobDial.Value = 0;
      KnobDial.ExpireSolution(true);
    }
    // KnobDial.ExpireSolution(false);
# ---------- c_script_9: C# additional code ----------
  public Grasshopper.Kernel.Special.GH_DialKnob FindObject(GH_Document doc, string name)
  {
    foreach (IGH_DocumentObject obj in doc.Objects)
    {
      if (!obj.NickName.Equals(name, StringComparison.Ordinal))
        continue;

      Grasshopper.Kernel.Special.GH_DialKnob knob =
        obj as Grasshopper.Kernel.Special.GH_DialKnob;
      if (knob != null)
        return knob;
    }

    return null;
  }
# ---------- end c_script_9 ----------
panel_34 = Panel(c_script_9)  # disabled
division_4 = Division(A=panel_34, B=panel_24)  # disabled
panel_35 = Panel(division_4)  # disabled
rad_2 = Radians(Degrees=panel_34)  # disabled
addition = Addition(A=panel_35, B=panel_26)  # disabled
cos = Cosine(Value=rad_2)  # disabled
sin = Sine(Value=rad_2)  # disabled
neg_2 = Negative(Value=addition)  # disabled
item_5 = ListItem(List=facen.Centers, Index=neg_2, Wrap=True)  # disabled
pt_2 = Point(item_5)  # disabled
vec_2 = VectorXYZ(XComponent=sin, YComponent=cos, ZComponent=0)  # -> Vector, Length; disabled
addition_2 = Addition(A=pt_2, B=vec_2.Vector)  # disabled
vec2pt = Vector2Pt(PointA=pt_2, PointB=addition_2, Unitize=False)  # -> Vector, Length; disabled
move_5 = Move(Geometry=vec_2.Vector, Motion=vec.Vector)  # -> Geometry, Transform; disabled
pt_3 = Point(vec_2.Vector)  # disabled
scale = Scale(Geometry=vec2pt.Vector, Center=Point(0, 0, 0), Factor=number_slider_11)  # -> Geometry, Transform; disabled
dprod = DotProduct(VectorA=vec2pt.Vector, VectorB=facen.Normals, Unitize=True)  # disabled
xprod = CrossProduct(VectorA=scale.Geometry, VectorB=facen.Normals, Unitize=True)  # -> Vector, Length; disabled
division_5 = Division(A=dprod, B=xprod.Length)  # disabled
vdisex_3 = VectorDisplayEx(Point=facen.Centers, Vector=scale.Geometry, Colour=swatch, Width=2)  # disabled
acos = ArcCosine(Value=division_5)  # disabled
deg = Degrees(Radians=acos)  # disabled
round = Round(Number=deg)  # -> Nearest, Floor, Ceiling; disabled
panel_36 = Panel(round.Nearest)  # disabled
panel_37 = Panel("90")  # disabled
smaller = SmallerThan(FirstNumber=panel_36, SecondNumber=panel_37)  # -> SmallerThan, OrEqualTo; disabled
panel_38 = Panel("""/*--------------------------------*- C++ -*----------------------------------*\
| =========                 |                                                 |
| \\      /  F ield         | OpenFOAM: The Open Source CFD Toolbox           |
|  \\    /   O peration     | Version:  2.1.0                                  |
|   \\  /    A nd           | Web:      http://www.OpenFOAM.com               |
|    \\/     M anipulation  |                                                 |
\*---------------------------------------------------------------------------*/

FoamFile
{
    version     2.0;
    format      ascii;
    class       dictionary;
    object      blockMeshDict;
}
// * * * * * * * * * * * * * * * * * * * * * * * * * * * * * * * * * * * * * //
 
convertToMeters 1;
 



//
vertices        
(""")  # disabled
panel_39 = Panel(smaller.OrEqualTo)  # disabled
panel_40 = Panel("""); 

blocks          
(""")  # disabled
panel_41 = Panel(""");
 
 edges           
 (

 );
boundary
(""")  # disabled
panel_42 = Panel("""    );

 
mergePatchPairs 
(
);""")  # disabled
c_script_10 = CSharpScript(
    x=panel_38,
    y=panel_19,
    z=panel_40,
    u=panel_22,
    v=panel_33,
    w=panel_41,
    xx=panel_28,
    xz=panel_20,
    xv=panel_31,
    xu=panel_21,
    xw=panel_32,
    xy=panel_42)  # -> out, A; inputs x: list of String, y: list of String, z: list of String, u: list of String, v: list of String, w: list of String, xx: list of String, xz: list of String, xv: list of String, xu: list of String, xw: list of String, xy: list of String; disabled
# ---------- c_script_10: C# ----------
    List<String> L = new List<String>();
    List<String> L2 = new List<String>();



    L = x.Concat(y).Concat(z).Concat(u).Concat(v).Concat(w).Concat(xx).Concat(xz).Concat(xv).Concat(xu).Concat(xw).Concat(xy).ToList();
    A = L;
# ---------- end c_script_10 ----------
panel_43 = Panel(c_script_10.A)  # disabled
number_slider_12 = Slider(32, range=1..100)  # disabled
number_slider_13 = Slider(17, range=1..100)  # disabled
pt_4 = ConstructPoint(XCoordinate=0, YCoordinate=0, ZCoordinate=0)  # disabled
neg_3 = Negative(Value=number_slider_13)  # disabled
xy_2 = XYPlane(Origin=pt_4)  # disabled
dom_2 = ConstructDomain(DomainStart=neg_3, DomainEnd=number_slider_13)  # disabled
circle_2 = CircleCNR(Center=pt_4, Normal=Vector(0, 0, 1), Radius=number_slider_12)  # disabled
rectangle_2 = Rectangle(Plane=xy_2, XSize=dom_2, YSize=dom_2, Radius=0)  # -> Rectangle, Length; disabled
Y_2 = UnitY(Factor=number_slider_12)  # disabled
move_6 = Move(Geometry=pt_4, Motion=Y_2)  # -> Geometry, Transform; disabled
angle_2 = Panel("15")  # disabled
panel_44 = Panel("360")  # disabled
division_6 = Division(A=panel_44, B=angle_2)  # disabled
number_slider_14 = Slider(2, range=1..100)  # disabled
series_2 = Series(Start=0, Step=angle_2, Count=division_6)  # disabled
rad_3 = Radians(Degrees=series_2)  # disabled
rotate_2 = Rotate(Geometry=move_6.Geometry, Angle=rad_3, Plane=xy_2)  # -> Geometry, Transform; disabled
ln_4 = Line(StartPoint=pt_4, EndPoint=rotate_2.Geometry)  # disabled
points_11 = PointList(Points=rotate_2.Geometry, Size=number_slider_14)  # disabled
ccx_3 = CurveCurve(CurveA=rectangle_2.Rectangle, CurveB=ln_4)  # -> flatten(Points), ParamsA, ParamsB; disabled
points_12 = PointList(Points=ccx_3.Points, Size=number_slider_14)  # disabled
lng_2 = ListLength(List=ccx_3.Points)  # disabled
panel_45 = Panel("2")  # disabled
panel_46 = Panel(series_2)  # disabled
panel_47 = Panel("""0
1
2
22
23""")  # disabled
panel_48 = Panel("""4
5
6
7
8""")  # disabled
division_7 = Division(A=lng_2, B=panel_45)  # disabled
panel_49 = Panel("""12
11
10
14
13""")  # disabled
panel_50 = Panel("""20
19
18
17
16""")  # disabled
item_6 = ListItem(List=ccx_3.Points, Index=panel_48, Wrap=True)  # disabled
item_7 = ListItem(List=ccx_3.Points, Index=panel_50, Wrap=True)  # disabled
item_8 = ListItem(List=ccx_3.Points, Index=panel_47, Wrap=True)  # disabled
item_9 = ListItem(List=ccx_3.Points, Index=panel_49, Wrap=True)  # disabled
ln_5 = Line(StartPoint=item_6, EndPoint=item_7)  # disabled
ln_6 = Line(StartPoint=item_8, EndPoint=item_9)  # disabled
crossref_2 = CrossReference(ListA=ln_6, ListB=ln_5, CrossMode=1)  # -> ListA, ListB; disabled
number_slider_15 = Slider(10, range=0..10)  # disabled
ccx_4 = CurveCurve(CurveA=crossref_2.ListA, CurveB=crossref_2.ListB)  # -> flatten(Points), ParamsA, ParamsB; disabled
points_13 = PointList(Points=ccx_4.Points, Size=number_slider_14)  # disabled
Z_2 = UnitZ(Factor=number_slider_15)  # disabled
move_7 = Move(Geometry=ccx_4.Points, Motion=Z_2)  # -> Geometry, Transform; disabled
move_8 = Move(Geometry=rotate_2.Geometry, Motion=Z_2)  # -> Geometry, Transform; disabled
move_9 = Move(Geometry=ccx_3.Points, Motion=Z_2)  # -> Geometry, Transform; disabled
fulllist_2 = CSharpScript(
    arcPoints0=rotate_2.Geometry,
    boxPoints0=ccx_3.Points,
    gridPoints0=ccx_4.Points,
    arcPoints1=move_8.Geometry,
    boxPoints1=move_9.Geometry,
    gridPoints1=move_7.Geometry)  # -> out, A, B; inputs arcPoints0: list of Point3d, boxPoints0: list of Point3d, gridPoints0: list of Point3d, arcPoints1: list of Point3d, boxPoints1: list of Point3d, gridPoints1: list of Point3d; disabled
# ---------- fulllist_2: C# ----------
    List<Point3d> L = new List<Point3d>();
    List<String> L2 = new List<String>();

    //L = arcPoints0.Concat(boxPoints0).Concat(gridPoints0).ToList();
    //L2 = arcPoints0.Concat(boxPoints0).Concat(gridPoints0).Concat(arcPoints1).Concat(boxPoints1).Concat(gridPoints1).ToList().GetRange(73, 73);
    L = arcPoints0.Concat(boxPoints0).Concat(gridPoints0).Concat(arcPoints1).Concat(boxPoints1).Concat(gridPoints1).ToList();
    A = L;
    //B = L2;


    for (int i = 0; i < L.Count ; i++){
      L2.Add("(" + L[i].X + " " + +L[i].Y + " " + +L[i].Z + ")");
    }
    B = L2;
# ---------- end fulllist_2 ----------
panel_51 = Panel(fulllist_2.B)  # disabled
points_14 = PointList(Points=move_8.Geometry, Size=number_slider_14)  # disabled
points_15 = PointList(Points=move_7.Geometry, Size=number_slider_14)  # disabled
points_16 = PointList(Points=move_9.Geometry, Size=number_slider_14)  # disabled
c_script_11 = CSharpScript(fullList=fulllist_2.A)  # -> out, A, B, C, D, E; inputs fullList: list of Point3d; disabled
# ---------- c_script_11: C# ----------
    Mesh m = new Mesh();
    Mesh n = new Mesh();
    List<String> L1 = new List<String>();
    List<String> L2 = new List<String>();
    List<String> L3 = new List<String>();

    foreach(Point3d xx in fullList) m.Vertices.Add(xx);


    for(int i = 0; i < fullList.Count / 6 - 1 ;i++){
      m.Faces.AddFace(i, i + 1, fullList.Count / 6 + i + 1, fullList.Count / 6 + i);
    }
    //last Face in list
    m.Faces.AddFace(fullList.Count / 6 - 1, 0, fullList.Count / 6, fullList.Count / 6 + fullList.Count / 6 - 1);

    for(int i = 73; i < fullList.Count / 6 - 1 + 73 ;i++){
      m.Faces.AddFace(i, i + 1, fullList.Count / 6 + i + 1, fullList.Count / 6 + i);
    }
    //last Face in list
    m.Faces.AddFace(fullList.Count / 6 - 1 + 73, 73, fullList.Count / 6 + 73, fullList.Count / 6 + fullList.Count / 6 - 1 + 73);


    //arcPoints1.Count - 1


    A = m;

    for(int i = 0; i < fullList.Count / 6;i++){
      L1.Add(m.Faces[i].A.ToString() + " " + m.Faces[i].B.ToString() + " " + m.Faces[i].C.ToString() + " " + m.Faces[i].D.ToString() + " ");
    }

    for(int i = fullList.Count / 6; i < fullList.Count / 6 * 2;i++){
      L2.Add(m.Faces[i].A.ToString() + " " + m.Faces[i].B.ToString() + " " + m.Faces[i].C.ToString() + " " + m.Faces[i].D.ToString());
    }

    for(int i = 0; i < fullList.Count/6;i++){
      L3.Add(m.Faces[i].A.ToString());
      L3.Add(m.Faces[i].B.ToString());
      L3.Add(m.Faces[i].C.ToString());
      L3.Add(m.Faces[i].D.ToString());
    }

    C = L1;
    D = L2;
    E = L3;
# ---------- end c_script_11 ----------
concat_2 = Concatenate(FragmentA=c_script_11.C, FragmentB=c_script_11.D)  # disabled
panel_52 = Panel(concat_2)  # disabled
c_script_12 = CSharpScript(arcPoints1=move_8.Geometry, boxPoints1=move_9.Geometry, gridPoints1=move_8.Geometry)  # -> out, A, B; inputs arcPoints1: list, boxPoints1: list, gridPoints1: list; disabled; same code as c_script_3
c_script_13 = CSharpScript(
    boxPoints0=ccx_3.Points,
    gridPoints0=ccx_4.Points,
    arcPoints1=move_8.Geometry,
    boxPoints1=move_9.Geometry,
    gridPoints1=move_7.Geometry)  # -> out, A, B; inputs arcPoints0: list of Point3d, boxPoints0: list of Point3d, gridPoints0: list of Point3d, arcPoints1: list of Point3d, boxPoints1: list of Point3d, gridPoints1: list of Point3d; disabled; same code as c_script_4
c_script_14 = CSharpScript(fullList=fulllist_2.A, arcPoints0=rotate_2.Geometry, arcPoints1=move_8.Geometry)  # -> out, A, B, C, D; inputs fullList: list of Point3d, arcPoints0: list of Point3d, arcPoints1: list of Point3d; disabled
# ---------- c_script_14: C# ----------
    Mesh m = new Mesh();
    //Mesh n = new Mesh();
    List<String> L1 = new List<String>();
    // List<String> L2 = new List<String>();


    //foreach(Point3d xx in arcPoints0) m.Vertices.Add(xx);
    //foreach(Point3d xx in arcPoints1) m.Vertices.Add(xx);
    foreach(Point3d xx in fullList) m.Vertices.Add(xx);


    for(int i = 0; i < fullList.Count / 6 - 1 ;i++){
      m.Faces.AddFace(i, i + 1, fullList.Count / 2 + i + 1, fullList.Count / 2 + i);
    }
    //last Face in list
    m.Faces.AddFace(fullList.Count / 6 - 1, 0, fullList.Count / 2, fullList.Count / 2 + fullList.Count / 6 -1);

    A = m;

    for(int i = 0; i < fullList.Count / 6;i++){
      L1.Add("(" + m.Faces[i].A.ToString() + " " + m.Faces[i].B.ToString() + " " + m.Faces[i].C.ToString() + " " + m.Faces[i].D.ToString() + ")");
    }


    C = L1;
    //D = L2;
# ---------- end c_script_14 ----------
mesh_3 = Mesh(c_script_12.A)  # disabled
points_17 = PointList(Points=c_script_13.B, Size=number_slider_14)  # disabled
points_18 = PointList(Points=c_script_13.A, Size=number_slider_14)  # disabled
panel_53 = Panel(c_script_14.C)  # disabled
panel_54 = Panel(c_script_14.A)  # disabled
c_script_15 = CSharpScript(arcPoints1=rotate_2.Geometry, boxPoints1=ccx_3.Points, gridPoints1=ccx_4.Points)  # -> out, A, B; inputs arcPoints1: list, boxPoints1: list, gridPoints1: list; disabled; same code as c_script_6
panel_55 = Panel("""24
25
49
48
25
26
50
49
26
27
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""")  # disabled
panel_56 = Panel("""97
98
122
121
98
99
123
122
99
100
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""")  # disabled
c_script_16 = CSharpScript(inputGroundVertices=panel_55, inputTopVertices=panel_56, fullList=fulllist_2.A)  # -> out, A, B, C, D; inputs inputGroundVertices: list of Int32, inputTopVertices: list of Int32, fullList: list of Point3d; disabled
# ---------- c_script_16: C# ----------
    List<Point3d> cutList = new List<Point3d>();


    Mesh m = new Mesh();
    //Mesh n = new Mesh();
    //List<String> L1 = new List<String>();
    // List<String> L2 = new List<String>();
    //B = input;

    //cutList = fullList.GetRange(24, 122);
    //cutList.RemoveRange(49, 24);


    foreach(Point3d xx in fullList) m.Vertices.Add(xx);





    for (int i = 0;i < inputTopVertices.Count - 3; i = i + 4){
      m.Faces.AddFace(inputGroundVertices[i], inputGroundVertices[i + 1], inputGroundVertices[i + 2], inputGroundVertices[i + 3]);
    }
    for (int i = 0;i < inputTopVertices.Count - 3; i = i + 4){
       m.Faces.AddFace(inputTopVertices[i], inputTopVertices[i + 1], inputTopVertices[i + 2], inputTopVertices[i + 3]);
     }

    A = m;
    B = cutList;
# ---------- end c_script_16 ----------
c_script_17 = CSharpScript(inputGroundFaces=panel_55, inputTopFaces=panel_56)  # -> out, A, B, C, D; inputs inputGroundFaces: list of Int32, inputTopFaces: list of Int32; disabled
# ---------- c_script_17: C# ----------
    List<int> m = new List<Int32>();
    List<string> L1 = new List<String>();


    for (int i = 0;i < inputGroundFaces.Count - 3; i = i + 4){
      bool continueLoop = true;
      m.Add(inputGroundFaces[i]);
      m.Add(inputGroundFaces[i + 1]);
      m.Add(inputGroundFaces[i + 2]);
      m.Add(inputGroundFaces[i + 3]);
      while (continueLoop){
        m.Add(inputTopFaces[i]);
        m.Add(inputTopFaces[i + 1]);
        m.Add(inputTopFaces[i + 2]);
        m.Add(inputTopFaces[i + 3]);
        continueLoop = false;
      }
    }


    for(int i = 0; i < inputGroundFaces.Count + inputTopFaces.Count ;i = i + 8){
      L1.Add("(" +m[i].ToString() + " " + m[i + 1].ToString() + " " + m[i + 2].ToString() + " " + m[i + 3].ToString() + " " + m[i + 4].ToString() + " " + m[i + 5].ToString() + " " + m[i + 6].ToString() + " " + m[i + 7].ToString()+ ")");
    }

 

    A = m;
    B = L1;
# ---------- end c_script_17 ----------
points_19 = PointList(Points=fulllist_2.A, Size=number_slider_14)  # disabled
points_20 = PointList(Points=fulllist_2.A, Size=number_slider_14)  # disabled
panel_57 = Panel(c_script_17.B)  # disabled
gradient_2 = Gradient(
    LowerLimit=0,
    UpperLimit=1,
    stops=[0: RGB(234, 38, 0), 0.25: RGB(234, 126, 0), 0.463: RGB(254, 244, 84), 0.75: RGB(173, 203, 249), 1: RGB(75, 107, 169)])  # disabled
panel_58 = Panel(""");
 
 edges           
 (

 );
boundary
(
    test
    {
    type wall;
    faces
	(
    (0 1 25 24)

    );
    }
  

 );

 
mergePatchPairs 
(
);
 
// ************************************************************************* //""")  # disabled
panel_59 = Panel("""); 

blocks          
(""")  # disabled
panel_60 = Panel("""/*--------------------------------*- C++ -*----------------------------------*\
| =========                 |                                                 |
| \\      /  F ield         | OpenFOAM: The Open Source CFD Toolbox           |
|  \\    /   O peration     | Version:  2.1.0                                  |
|   \\  /    A nd           | Web:      http://www.OpenFOAM.com               |
|    \\/     M anipulation  |                                                 |
\*---------------------------------------------------------------------------*/

FoamFile
{
    version     2.0;
    format      ascii;
    class       dictionary;
    object      blockMeshDict;
}
// * * * * * * * * * * * * * * * * * * * * * * * * * * * * * * * * * * * * * //
 
convertToMeters 1;
 



//
vertices        
(""")  # disabled
vdisex_4 = VectorDisplayEx(Colour=gradient_2, Width=2)  # disabled
c_script_18 = CSharpScript(x=panel_60, y=panel_51, z=panel_59, v=panel_52, w=panel_57, u=panel_58)  # -> out, A; inputs x: list of String, y: list of String, z: list of String, u: list of String; disabled
# ---------- c_script_18: C# ----------
    List<String> L2 = new List<String>();


    L2 = x.Concat(z);
    //.ToString().Concat(z).Concat(u)
    A = L2;
# ---------- end c_script_18 ----------
panel_61 = Panel(c_script_18.A)  # disabled
