# Grasshopper definition testFile_5degrees.gh (Grasshopper 0.9.76)

number_slider = Slider(32, range=1..100)
number_slider_2 = Slider(17, range=1..100)
pt = ConstructPoint(XCoordinate=0, YCoordinate=0, ZCoordinate=0)
neg = Negative(Value=number_slider_2)
xy = XYPlane(Origin=pt)
dom = ConstructDomain(DomainStart=neg, DomainEnd=number_slider_2)
circle = CircleCNR(Center=pt, Normal=Vector(0, 0, 1), Radius=number_slider)
rectangle = Rectangle(Plane=xy, XSize=dom, YSize=dom, Radius=0)  # -> Rectangle, Length
Y = UnitY(Factor=number_slider)
move = Move(Geometry=pt, Motion=Y)  # -> Geometry, Transform
angle = Panel("5")
division = Division(A="360", B=angle)
number_slider_3 = Slider(0.4, range=0..100)
series = Series(Start=0, Step=angle, Count=division)
rad = Radians(Degrees=series)
# arcPoints0
rotate = Rotate(Geometry=move.Geometry, Angle=rad, Plane=xy)  # -> Geometry, Transform
ln = Line(StartPoint=pt, EndPoint=rotate.Geometry)
panel = Panel("""10
11
12
13
14
15
16
17
18
19
20
21
22
23
24
25
26""")
# boxPoints0
ccx = CurveCurve(CurveA=rectangle.Rectangle, CurveB=ln)  # -> flatten(Points), ParamsA, ParamsB
points = PointList(Points=ccx.Points, Size=number_slider_3)
points_2 = PointList(Points=rotate.Geometry, Size=number_slider_3)
panel_2 = Panel("""0
1
2
3
4
5
6
7
8
71
70
69
68
67
66
65
64""")
lng = ListLength(List=ccx.Points)
panel_3 = Panel("""62
61
60
59
58
57
56
55
54
53
52
51
50
49
48
47
46""")
panel_4 = Panel("""36
35
34
33
32
31
30
29
28
37
38
39
40
41
42
43
44""")
panel_5 = Panel(series)
division_2 = Division(A=lng, B="2")
item = ListItem(List=ccx.Points, Index=panel_2, Wrap=True)
item_2 = ListItem(List=ccx.Points, Index=panel_4, Wrap=True)
item_3 = ListItem(List=ccx.Points, Index=panel, Wrap=True)
item_4 = ListItem(List=ccx.Points, Index=panel_3, Wrap=True)
ln_2 = Line(StartPoint=item_3, EndPoint=item_4)
ln_3 = Line(StartPoint=item, EndPoint=item_2)
crossref = CrossReference(ListA=ln_3, ListB=ln_2, CrossMode=1)  # -> ListA, ListB, ListC, ListD
# gridPoints0
ccx_2 = CurveCurve(CurveA=crossref.ListA, CurveB=crossref.ListB)  # -> flatten(Points), ParamsA, ParamsB
points_3 = PointList(Points=ccx_2.Points, Size=number_slider_3)
Z = UnitZ(Factor=Slider(10, range=0..10))
# arcPoints1
# 24
# boxPoints1
move_2 = Move(Geometry=ccx_2.Points, Motion=Z)  # -> Geometry, Transform
# gridPoints1
# 25
move_3 = Move(Geometry=rotate.Geometry, Motion=Z)  # -> Geometry, Transform
# 25
move_4 = Move(Geometry=ccx.Points, Motion=Z)  # -> Geometry, Transform
fulllist = CSharpScript(
    arcPoints0=rotate.Geometry,
    boxPoints0=ccx.Points,
    gridPoints0=ccx_2.Points,
    arcPoints1=move_3.Geometry,
    boxPoints1=move_4.Geometry,
    gridPoints1=move_2.Geometry)  # -> out, A, B; inputs arcPoints0: list of Point3d, boxPoints0: list of Point3d, gridPoints0: list of Point3d, arcPoints1: list of Point3d, boxPoints1: list of Point3d, gridPoints1: list of Point3d
# ---------- fulllist: C# ----------
    List<Point3d> L = new List<Point3d>();
    List<String> L2 = new List<String>();

    //L = arcPoints0.Concat(boxPoints0).Concat(gridPoints0).ToList();
    //L2 = arcPoints0.Concat(boxPoints0).Concat(gridPoints0).Concat(arcPoints1).Concat(boxPoints1).Concat(gridPoints1).ToList().GetRange(73, 73);
    L = arcPoints0.Concat(boxPoints0).Concat(gridPoints0).Concat(arcPoints1).Concat(boxPoints1).Concat(gridPoints1).ToList();
    //L = arcPoints0.Concat(boxPoints0).Concat(gridPoints0).ToList();

    A = L;
    //B = L2;


    for (int i = 0; i < L.Count ; i++){
      L2.Add("(" + L[i].X + " " + +L[i].Y + " " + +L[i].Z + ")");
    }
    B = L2;
# ---------- end fulllist ----------
item_5 = ListItem(List=fulllist.A, Index=Slider(27, range=0..1000), Wrap=True)
c_script = CSharpScript(ListOfAllPointsInMagicOrder=fulllist.A)  # -> out, A; inputs ListOfAllPointsInMagicOrder: list of Point3d
# ---------- c_script: C# ----------
    double cellSizeOuter = 0;
    cellSizeOuter = Math.Abs(ListOfAllPointsInMagicOrder[432].X - ListOfAllPointsInMagicOrder[117].X);
    var vec1 = (ListOfAllPointsInMagicOrder[432] - ListOfAllPointsInMagicOrder[117]).Length;
    double vec1L = vec1;
    A = vec1L;
# ---------- end c_script ----------
points_4 = PointList(Points=item_5, Size=number_slider_3)
panel_6 = Panel(c_script.A)
points_5 = PointList(Points=fulllist.A, Size=number_slider_3)
panel_7 = Panel(fulllist.B)
points_6 = PointList(Points=move_2.Geometry, Size=number_slider_3)
points_7 = PointList(Points=move_4.Geometry, Size=number_slider_3)
points_8 = PointList(Points=move_3.Geometry, Size=number_slider_3)
# faces
# arcs
c_script_2 = CSharpScript(fullList=fulllist.A)  # -> out, A, B, C, D, E, F; inputs fullList: list of Point3d
# ---------- c_script_2: C# ----------
    Mesh m = new Mesh();
    Mesh n = new Mesh();
    List<String> L1 = new List<String>();
    List<String> L2 = new List<String>();
    List<String> L3 = new List<String>();

    foreach(Point3d xx in fullList) m.Vertices.Add(xx);


    for(int i = 0; i < fullList.Count / 12 - 1 ;i++){
      m.Faces.AddFace(i, i + 1, fullList.Count / 12 + i + 1, fullList.Count / 12 + i);
    }
    //last Face in list
    m.Faces.AddFace(fullList.Count / 12 - 1, 0, fullList.Count / 12, fullList.Count / 12 + fullList.Count / 12 - 1);

    for(int i = fullList.Count / 2; i < fullList.Count / 2 + fullList.Count / 12 - 1 ;i++){
      m.Faces.AddFace(i, i + 1, fullList.Count / 12 + i + 1, fullList.Count / 12 + i);
    }
    //last Face in list
    m.Faces.AddFace(fullList.Count / 2 + fullList.Count / 12 - 1, fullList.Count / 2, fullList.Count / 12 + fullList.Count / 2, fullList.Count / 2 + (2 * fullList.Count / 12) - 1);


    //arcPoints1.Count - 1


    A = m;

    for(int i = 0; i < fullList.Count / 12;i++){
      L1.Add("(" + m.Faces[i].A.ToString() + " " + m.Faces[i].B.ToString() + " " + m.Faces[i].C.ToString() + " " + m.Faces[i].D.ToString() + " ");
    }
    //
    for(int i = fullList.Count / 12; i < fullList.Count / 6  ;i++){
      L2.Add(m.Faces[i].A.ToString() + " " + m.Faces[i].B.ToString() + " " + m.Faces[i].C.ToString() + " " + m.Faces[i].D.ToString() + ")");
    }

    // for(int i = 0; i < fullList.Count / 12;i++){
    //   L3.Add(m.Faces[i].A.ToString());
    //   L3.Add(m.Faces[i].B.ToString());
    //  L3.Add(m.Faces[i].C.ToString());
    //  L3.Add(m.Faces[i].D.ToString());
    // }

    C = L1;
    D = L2;
    E = L3;
    F = fullList;
# ---------- end c_script_2 ----------
# vertices
concat = Concatenate(FragmentA=c_script_2.C, FragmentB=c_script_2.D)
# blocks
# arc
panel_8 = Panel(concat)
panel_9 = Panel(c_script_2.A)
c_script_3 = CSharpScript(arcPoints1=move_3.Geometry, boxPoints1=move_4.Geometry, gridPoints1=move_3.Geometry)  # -> out, A, B; inputs arcPoints1: list, boxPoints1: list, gridPoints1: list; disabled
# ---------- c_script_3: C# ----------
    Mesh m = new Mesh();
    Mesh n = new Mesh();


    //foreach(Point3d xx in arcPoints0) m.Vertices.Add(xx);
    //foreach(Point3d xx in boxPoints0) m.Vertices.Add(xx);
    //foreach(Point3d xx in gridPoints0) m.Vertices.Add(xx);
    foreach(Point3d xx in arcPoints1) n.Vertices.Add(xx);
    foreach(Point3d xx in boxPoints1) n.Vertices.Add(xx);
    foreach(Point3d xx in gridPoints1) n.Vertices.Add(xx);


    //for(int i = 0; i < arcPoints0.Count - 1 ;i++){
    //  m.Faces.AddFace(i, i + 1, arcPoints0.Count + i + 1, arcPoints0.Count + i);
    //}
    //last Face in list
    //m.Faces.AddFace(arcPoints0.Count - 1, 0, arcPoints0.Count, arcPoints0.Count + boxPoints0.Count - 1);

    for(int i = 0; i < arcPoints1.Count - 1;i++){
      n.Faces.AddFace(i, i + 1, arcPoints1.Count + i + 1, arcPoints1.Count + i);
    }
    n.Faces.AddFace(arcPoints1.Count - 1 , 0, arcPoints1.Count , arcPoints1.Count + boxPoints1.Count - 1 );


    //arcPoints1.Count - 1



    A = n;




    //for(int i = 0; i < m.Faces.Count;i++){
    //
    //  Print(m.Faces[i].A + " " + m.Faces[i].B + " " + m.Faces[i].C + " " + m.Faces[i].D + " ");

    //}
    for(int i = 0; i < n.Faces.Count;i++){

      Print(n.Faces[i].A + " " + n.Faces[i].B + " " + n.Faces[i].C + " " + n.Faces[i].D + " ");

    }
# ---------- end c_script_3 ----------
c_script_4 = CSharpScript(
    boxPoints0=ccx.Points,
    gridPoints0=ccx_2.Points,
    arcPoints1=move_3.Geometry,
    boxPoints1=move_4.Geometry,
    gridPoints1=move_2.Geometry)  # -> out, A, B; inputs arcPoints0: list of Point3d, boxPoints0: list of Point3d, gridPoints0: list of Point3d, arcPoints1: list of Point3d, boxPoints1: list of Point3d, gridPoints1: list of Point3d; disabled
# ---------- c_script_4: C# ----------
    List<Point3d> L = new List<Point3d>();
    List<Point3d> L2 = new List<Point3d>();



    L = boxPoints0.Concat(gridPoints0).Concat(boxPoints1).Concat(gridPoints1).ToList();
    //L2 = arcPoints0.Concat(boxPoints0).Concat(gridPoints0).Concat(arcPoints1).Concat(boxPoints1).Concat(gridPoints1).ToList().GetRange(73, 73);
    //L2 = boxPoints1.Concat(gridPoints1).ToList();
    A = L;
    B = L2;
# ---------- end c_script_4 ----------
# faces
# patches
c_script_5 = CSharpScript(fullList=fulllist.A, arcPoints0=rotate.Geometry, arcPoints1=move_3.Geometry)  # -> out, A, B, C, D; inputs fullList: list of Point3d, arcPoints0: list of Point3d, arcPoints1: list of Point3d
# ---------- c_script_5: C# ----------
    Mesh m = new Mesh();
    //Mesh n = new Mesh();
    List<String> L1 = new List<String>();
    // List<String> L2 = new List<String>();


    //foreach(Point3d xx in arcPoints0) m.Vertices.Add(xx);
    //foreach(Point3d xx in arcPoints1) m.Vertices.Add(xx);
    foreach(Point3d xx in fullList) m.Vertices.Add(xx);


    for(int i = 0; i < fullList.Count / 12 - 1 ;i++){
      m.Faces.AddFace(i, i + 1, fullList.Count / 2 + i + 1, fullList.Count / 2 + i);
    }
    //last Face in list
    m.Faces.AddFace(fullList.Count / 12 - 1, 0, fullList.Count / 2, fullList.Count / 2 + fullList.Count / 12 - 1);

    A = m;

    for(int i = 0; i < fullList.Count / 12 - 1;i++){
      L1.Add("(" + m.Faces[i].A.ToString() + " " + m.Faces[i].B.ToString() + " " + m.Faces[i].C.ToString() + " " + m.Faces[i].D.ToString() + ")");
    }


    C = L1;
    //D = L2;
# ---------- end c_script_5 ----------
mesh = Mesh(c_script_3.A)  # disabled
points_9 = PointList(Points=c_script_4.B, Size=number_slider_3)  # disabled
points_10 = PointList(Points=c_script_4.A, Size=number_slider_3)  # disabled
panel_10 = Panel(c_script_5.A)  # disabled
panel_11 = Panel(c_script_5.C)
c_script_6 = CSharpScript(arcPoints1=rotate.Geometry, boxPoints1=ccx.Points, gridPoints1=ccx_2.Points)  # -> out, A, B; inputs arcPoints1: list, boxPoints1: list, gridPoints1: list; disabled
# ---------- c_script_6: C# ----------
    Mesh m = new Mesh();
    Mesh n = new Mesh();


    //foreach(Point3d xx in arcPoints0) m.Vertices.Add(xx);
    //foreach(Point3d xx in boxPoints0) m.Vertices.Add(xx);
    //foreach(Point3d xx in gridPoints0) m.Vertices.Add(xx);
    foreach(Point3d xx in arcPoints1) n.Vertices.Add(xx);
    foreach(Point3d xx in boxPoints1) n.Vertices.Add(xx);
    foreach(Point3d xx in gridPoints1) n.Vertices.Add(xx);


  

    for(int i = 0; i < boxPoints1.Count - 1;i++){
      n.Faces.AddFace(i, i + 1, arcPoints1.Count + i + 1, arcPoints1.Count + i);
    }
    n.Faces.AddFace(arcPoints1.Count - 1, 0, arcPoints1.Count, arcPoints1.Count + boxPoints1.Count - 1);


    //arcPoints1.Count - 1



    A = n;




    //for(int i = 0; i < m.Faces.Count;i++){
    //
    //  Print(m.Faces[i].A + " " + m.Faces[i].B + " " + m.Faces[i].C + " " + m.Faces[i].D + " ");

    //}
    for(int i = 0; i < n.Faces.Count;i++){

      Print(n.Faces[i].A + " " + n.Faces[i].B + " " + n.Faces[i].C + " " + n.Faces[i].D + " ");

    }
# ---------- end c_script_6 ----------
panel_12 = Panel("""72
73
145
144
73
74
146
145
74
75
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""")
panel_13 = Panel("""505
506
578
577
506
507
579
578
507
508
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""")
# faces
# box
c_script_7 = CSharpScript(inputGroundVertices=panel_12, inputTopVertices=panel_13, fullList=fulllist.A)  # -> out, A, B, C, D; inputs inputGroundVertices: list of Int32, inputTopVertices: list of Int32, fullList: list of Point3d
# ---------- c_script_7: C# ----------
    List<Point3d> cutList = new List<Point3d>();


    Mesh m = new Mesh();
    //Mesh n = new Mesh();
    //List<String> L1 = new List<String>();
    // List<String> L2 = new List<String>();
    //B = input;

    //cutList = fullList.GetRange(24, 122);
    //cutList.RemoveRange(49, 24);


    foreach(Point3d xx in fullList) m.Vertices.Add(xx);





    for (int i = 0;i < inputTopVertices.Count - 3; i = i + 4){
      m.Faces.AddFace(inputGroundVertices[i], inputGroundVertices[i + 1], inputGroundVertices[i + 2], inputGroundVertices[i + 3]);
    }
    for (int i = 0;i < inputTopVertices.Count - 3; i = i + 4){
      m.Faces.AddFace(inputTopVertices[i], inputTopVertices[i + 1], inputTopVertices[i + 2], inputTopVertices[i + 3]);
    }

    A = m;
    B = cutList;
# ---------- end c_script_7 ----------
# blocks
# box
c_script_8 = CSharpScript(inputGroundFaces=panel_12, inputTopFaces=panel_13)  # -> out, A, B, C, D; inputs inputGroundFaces: list of Int32, inputTopFaces: list of Int32
# ---------- c_script_8: C# ----------
    List<int> m = new List<Int32>();
    List<string> L1 = new List<String>();


    for (int i = 0;i < inputGroundFaces.Count - 3; i = i + 4){
      bool continueLoop = true;
      m.Add(inputGroundFaces[i]);
      m.Add(inputGroundFaces[i + 1]);
      m.Add(inputGroundFaces[i + 2]);
      m.Add(inputGroundFaces[i + 3]);
      while (continueLoop){
        m.Add(inputTopFaces[i]);
        m.Add(inputTopFaces[i + 1]);
        m.Add(inputTopFaces[i + 2]);
        m.Add(inputTopFaces[i + 3]);
        continueLoop = false;
      }
    }


    for(int i = 0; i < inputGroundFaces.Count + inputTopFaces.Count ;i = i + 8){
      L1.Add("(" + m[i].ToString() + " " + m[i + 1].ToString() + " " + m[i + 2].ToString() + " " + m[i + 3].ToString() + " " + m[i + 4].ToString() + " " + m[i + 5].ToString() + " " + m[i + 6].ToString() + " " + m[i + 7].ToString() + ")");
    }



    A = m;
    B = L1;
# ---------- end c_script_8 ----------
points_11 = PointList(Points=fulllist.A, Size=number_slider_3)
panel_14 = Panel(c_script_8.B)
gradient = Gradient(
    LowerLimit=0,
    UpperLimit=1,
    stops=[0: RGB(234, 38, 0), 0.25: RGB(234, 126, 0), 0.463: RGB(254, 244, 84), 0.75: RGB(173, 203, 249), 1: RGB(75, 107, 169)])  # disabled
vdisex = VectorDisplayEx(Colour=gradient, Width=2)  # disabled
