# Grasshopper definition testFile_Niigata.gh (Grasshopper 0.9.76)
# plug-ins: Python Interpreter, VirtualWindTunnel

panel = Panel("C:\MeshingPaper\Niigata_fineMesh_")
custom_mesh_settings = SettingsCustom(
    StitchSeams=True,
    SimplePlanes=False,
    Refine=True,
    MinCount=16,
    MaxCount=400,
    AspectRatio=20,
    MaxDistance=0,
    MaxAngle=20,
    MinEdge=0,
    MaxEdge="1")
toggle = BooleanToggle(False)
toggle_2 = BooleanToggle(True)
toggle_3 = BooleanToggle(False)
number_slider = Slider(0.228, range=0.1..1)
geo = Geometry([<brep referenced from the Rhino model> x597])
mesh = MeshBrep(Brep=geo, Settings=custom_mesh_settings)
button = Button()
clean = Clean(Dir=panel, Run=Button())
xz = XZPlane(Origin=Point(-0.0485980799, -4.042677826, 0))
domain = Domain(
    Geometry=mesh,
    Directory=panel,
    Mode=1,
    BaseMesh=Slider(58, range=0..500),
    RAM=Slider(1, range=0..64000),
    CPUs=Slider(1, range=1..8),
    Run=toggle_2)  # -> Out, Domain, Cyl, D, E
panel_2 = Panel(domain.Domain)
c_script = CSharpScript(p=xz)  # -> out, B, A; inputs b: list of Brep, p: Plane
# ---------- c_script: C# ----------
    double pj = 0;
    A = FindFacades(p, b, out pj);
    B = pj;
# ---------- c_script: C# additional code ----------
  static List<Brep> FindFacades(Plane plane, List<Brep> volumes, out double projectedAreaTotal)
  {
    List<Brep> Facades = new List<Brep>();

    List<double> projectedAreas = new List<double>();
    foreach (Brep b in volumes)
    {
      for (int i = 0; i < b.Faces.Count; i++)
      {
        Vector3d vSurf = b.Faces[i].NormalAt(0.5, 0.5);
        double dot = plane.ZAxis * vSurf;
        if (dot < 0.1) continue;


        Brep face = b.Faces[i].DuplicateFace(false);
        //Print(dot + "");
        Facades.Add(face);

        Vector3d cross = Vector3d.CrossProduct(plane.ZAxis, vSurf);
        double norm = cross.Length;
        double angle = Math.Atan2(norm, dot);

        //Print((angle * 180 / Math.PI) + "");

        double projectedArea = face.GetArea() * Math.Cos(angle);

        projectedAreas.Add(projectedArea);
        //Print(projectedArea + "");
      }
    }
    projectedAreaTotal = projectedAreas.Sum(x => x);

    return Facades;
  }
# ---------- end c_script ----------
python = PythonScript(x=domain.Domain)  # -> out, a
# ---------- python: Python ----------
a = x.BuildingGeometry
# ---------- end python ----------
number_slider_2 = Slider(0, range=0..17)
panel_3 = Panel(c_script.B)
cellsize = CellSize(Domain=domain.Domain, Size="20.0", DesiredCellSize="1")
number_slider_3 = Slider(1, range=0..10)
int = Integer(number_slider_3)
number_slider_4 = Slider(4, range=0..10)
int_2 = Integer(number_slider_4)
number_slider_5 = Slider(6, range=0..10)
int_3 = Integer(number_slider_5)
number_slider_6 = Slider(6, range=0..10)
int_4 = Integer(number_slider_6)
concat = Concatenate(FragmentA=panel, FragmentB=int_4, FragmentC=int_3, FragmentD=int, FragmentE=int_2, FragmentF="\")
bacc = Panel("""3
4
5
6
7
8
3
4
5
6
7
8
3
4
5
6
7
8""")
panel_4 = Panel(cellsize)
panel_5 = Panel("""3
4
5
6
7
8
3
4
5
6
7
8
3
4
5
6
7
8""")
python_2 = PythonScript()  # -> out, a, b, c, d, e, f
# ---------- python_2: Python ----------
a=x.BBox
b=x.centerGroundBBox
c=x.BBox.Min
d=x.BBox.Max
e=x.dimY
f=x.newBoxDomain.GetCorners
# ---------- end python_2 ----------
button_2 = Button()
item = ListItem(List=bacc, Index=number_slider_2, Wrap=True)
item_2 = ListItem(List=panel_5, Index=number_slider_2, Wrap=True)
panel_6 = Panel("""3
3
3
3
3
3
4
4
4
4
4
4
5
5
5
5
5
5""")
item_3 = ListItem(List=panel_6, Index=number_slider_2, Wrap=True)
mesh_2 = Mesh(
    Domain=domain.Domain,
    AccBuilding=number_slider_6,
    AccFeatures=number_slider_5,
    AccGround=number_slider_3,
    Layer=number_slider_4,
    Run=toggle_2)  # -> Out, Domain
panel_7 = Panel(python_2.b)
panel_8 = Panel(python_2.f)
panel_9 = Panel(python_2.a)
panel_10 = Panel(python_2.c)
button_3 = Button()
gradient = Gradient(
    LowerLimit=0,
    UpperLimit=1,
    stops=[0: RGB(234, 38, 0), 0.25: RGB(234, 126, 0), 0.463: RGB(254, 244, 84), 0.75: RGB(173, 203, 249), 1: RGB(75, 107, 169)])  # disabled
simulation = Simulation(
    Domain=mesh_2.Domain,
    Iterations=Slider(1000, range=0..1000),
    WriteInterval=Slider(10, range=0..100),
    KeepTimeSteps=Slider(5, range=0..10),
    Run=toggle_2)
vdisex = VectorDisplayEx(Colour=gradient, Width=2)  # disabled
