# Grasshopper definition testFile_ref_case.gh (Grasshopper 0.9.76)
# plug-ins: Python Interpreter, VirtualWindTunnel

panel = Panel("C:\MeshingPaper\Niigata_cyl_thin_plates_no_layers_ref4_3y\")
number_slider = Slider(1, range=0..100)
wind_dir = ControlKnob(Decimals=0, Limit=True, Maximum=359, Minimum=0, Range=360, Value=0)
geo = Geometry(<mesh referenced from the Rhino model>)
geo_2 = Geometry(<mesh referenced from the Rhino model>)
geo_3 = Geometry(geo)
clean = Clean(Run=Button())
clean_2 = Clean(Dir="C:\MeshingPaper\Niigata_case_ref_app_dimensions_comp\", Run=Button())
xz = XZPlane(Origin=Point(-0.0485980799, -4.042677826, 0))
domain = Domain(
    Geometry=geo_3,
    Directory="C:\MeshingPaper\case_ref_app_dimensions_comp\",
    Mode=1,
    BaseMesh=Slider(0.2, range=0.1..1),
    RAM=Slider(1, range=0..64000),
    CPUs=Slider(1, range=1..8),
    Run=Toggle(True))  # -> Out, Domain, Cyl, D, E
domaincyl = DomainCyl(
    Geometry=geo_3,
    Directory="C:\MeshingPaper\cyl_thin_plates_no_layers_ref4_3y\",
    WindDir=wind_dir,
    DivisionsX="1",
    DivisionsY=Slider(3, range=1..100),
    DivisionsZ=Slider(9, range=0..100),
    RAM=Slider(1, range=0..1),
    CPUs=1,
    Run=Toggle(True))  # -> Out, Domain, Cyl
c_script = CSharpScript(p=xz)  # -> out, B, A; inputs b: list of Brep, p: Plane
# ---------- c_script: C# ----------
    double pj = 0;
    A = FindFacades(p, b, out pj);
    B = pj;
# ---------- c_script: C# additional code ----------
  static List<Brep> FindFacades(Plane plane, List<Brep> volumes, out double projectedAreaTotal)
  {
    List<Brep> Facades = new List<Brep>();

    List<double> projectedAreas = new List<double>();
    foreach (Brep b in volumes)
    {
      for (int i = 0; i < b.Faces.Count; i++)
      {
        Vector3d vSurf = b.Faces[i].NormalAt(0.5, 0.5);
        double dot = plane.ZAxis * vSurf;
        if (dot < 0.1) continue;


        Brep face = b.Faces[i].DuplicateFace(false);
        //Print(dot + "");
        Facades.Add(face);

        Vector3d cross = Vector3d.CrossProduct(plane.ZAxis, vSurf);
        double norm = cross.Length;
        double angle = Math.Atan2(norm, dot);

        //Print((angle * 180 / Math.PI) + "");

        double projectedArea = face.GetArea() * Math.Cos(angle);

        projectedAreas.Add(projectedArea);
        //Print(projectedArea + "");
      }
    }
    projectedAreaTotal = projectedAreas.Sum(x => x);

    return Facades;
  }
# ---------- end c_script ----------
python = PythonScript(x=domain.Domain)  # -> out, a
# ---------- python: Python ----------
a = x.BuildingGeometry
# ---------- end python ----------
panel_2 = Panel(domain.Domain)
panel_3 = Panel(domaincyl.Domain)
python_2 = PythonScript(x=domaincyl.Domain)  # -> out, a
# ---------- python_2: Python ----------
a = x.frontageBuildingArea
# ---------- end python_2 ----------
panel_4 = Panel(c_script.B)
cellsize = CellSize(Domain=domaincyl.Domain, Size="39", DesiredCellSize="20.0")
cellsize_2 = CellSize(Domain=domain.Domain, Size="20.0", DesiredCellSize="1")
toggle = BooleanToggle(False)
panel_5 = Panel(cellsize)
mesh = Mesh(
    Domain=domaincyl.Domain,
    AccBuilding=Slider(4, range=0..10),
    AccFeatures=Slider(5, range=0..10),
    AccGround=Slider(1, range=0..10),
    Layer=Slider(3, range=0..10),
    Run=Toggle(False))  # -> Out, Domain
panel_6 = Panel(cellsize_2)
python_3 = PythonScript()  # -> out, a, b, c, d, e, f
# ---------- python_3: Python ----------
a=x.BBox
b=x.centerGroundBBox
c=x.BBox.Min
d=x.BBox.Max
e=x.dimY
f=x.newBoxDomain.GetCorners
# ---------- end python_3 ----------
mesh_2 = Mesh(
    Domain=domain.Domain,
    AccBuilding=Slider(4, range=0..10),
    AccFeatures=Slider(5, range=0..10),
    AccGround=Slider(1, range=0..10),
    Layer=Slider(3, range=0..10),
    Run=Toggle(False))  # -> Out, Domain
panel_7 = Panel(python_3.b)
panel_8 = Panel(python_3.f)
panel_9 = Panel(python_3.a)
panel_10 = Panel(python_3.c)
number_slider_2 = Slider(5, range=0..10)  # disabled
number_slider_3 = Slider(5, range=0..100)  # disabled
number_slider_4 = Slider(10, range=0..1000)  # disabled
toggle_2 = BooleanToggle(False)  # disabled
number_slider_5 = Slider(5, range=0..10)  # disabled
number_slider_6 = Slider(5, range=0..100)  # disabled
number_slider_7 = Slider(10, range=0..1000)  # disabled
toggle_3 = BooleanToggle(False)  # disabled
simulation = Simulation(
    Domain=mesh.Domain,
    Iterations=number_slider_4,
    WriteInterval=number_slider_3,
    KeepTimeSteps=number_slider_2,
    Run=toggle_2)  # disabled
gradient = Gradient(
    LowerLimit=0,
    UpperLimit=1,
    stops=[0: RGB(234, 38, 0), 0.25: RGB(234, 126, 0), 0.463: RGB(254, 244, 84), 0.75: RGB(173, 203, 249), 1: RGB(75, 107, 169)])  # disabled
simulation_2 = Simulation(
    Domain=mesh_2.Domain,
    Iterations=number_slider_7,
    WriteInterval=number_slider_6,
    KeepTimeSteps=number_slider_5,
    Run=toggle_3)  # disabled
vdisex = VectorDisplayEx(Colour=gradient, Width=2)  # disabled
