# Grasshopper definition testFile_urban_case_Cyl.gh (Grasshopper 0.9.76)
# plug-ins: Python Interpreter, VirtualWindTunnel

toggle = BooleanToggle(False)
toggle_2 = BooleanToggle(False)
toggle_3 = BooleanToggle(False)
pipeline = GeometryPipeline(
    GroupByLayer=False,
    GroupByType=False,
    IncludeHidden=True,
    IncludeLocked=True,
    LayerFilter="Building",
    NameFilter="*",
    TypeFilter=1073741880)
wind_dir = ControlKnob(Decimals=0, Limit=True, Maximum=359, Minimum=0, Range=360, Value=0)
button = Button()
geo = Geometry(pipeline)
clean = Clean(Run=Button())
xz = XZPlane(Origin=Point(-0.0485980799, -4.042677826, 0))
c_script = CSharpScript(p=xz)  # -> out, B, A; inputs b: list of Brep, p: Plane
# ---------- c_script: C# ----------
    double pj = 0;
    A = FindFacades(p, b, out pj);
    B = pj;
# ---------- c_script: C# additional code ----------
  static List<Brep> FindFacades(Plane plane, List<Brep> volumes, out double projectedAreaTotal)
  {
    List<Brep> Facades = new List<Brep>();

    List<double> projectedAreas = new List<double>();
    foreach (Brep b in volumes)
    {
      for (int i = 0; i < b.Faces.Count; i++)
      {
        Vector3d vSurf = b.Faces[i].NormalAt(0.5, 0.5);
        double dot = plane.ZAxis * vSurf;
        if (dot < 0.1) continue;


        Brep face = b.Faces[i].DuplicateFace(false);
        //Print(dot + "");
        Facades.Add(face);

        Vector3d cross = Vector3d.CrossProduct(plane.ZAxis, vSurf);
        double norm = cross.Length;
        double angle = Math.Atan2(norm, dot);

        //Print((angle * 180 / Math.PI) + "");

        double projectedArea = face.GetArea() * Math.Cos(angle);

        projectedAreas.Add(projectedArea);
        //Print(projectedArea + "");
      }
    }
    projectedAreaTotal = projectedAreas.Sum(x => x);

    return Facades;
  }
# ---------- end c_script ----------
number_slider = Slider(0, range=0..17)
number_slider_2 = Slider(4, range=0..10)
panel = Panel(c_script.B)
number_slider_3 = Slider(6, range=0..10)
number_slider_4 = Slider(1, range=0..10)
int = Integer(number_slider_4)
number_slider_5 = Slider(3, range=0..10)
button_2 = Button()
bacc = Panel("""3
4
5
6
7
8
3
4
5
6
7
8
3
4
5
6
7
8""")
python = PythonScript()  # -> out, a, b, c, d, e, f
# ---------- python: Python ----------
a=x.BBox
b=x.centerGroundBBox
c=x.BBox.Min
d=x.BBox.Max
e=x.dimY
f=x.newBoxDomain.GetCorners
# ---------- end python ----------
panel_2 = Panel("""3
4
5
6
7
8
3
4
5
6
7
8
3
4
5
6
7
8""")
item = ListItem(List=bacc, Index=number_slider, Wrap=True)
int_2 = Integer(item)
item_2 = ListItem(List=panel_2, Index=number_slider, Wrap=True)
int_3 = Integer(item_2)
panel_3 = Panel("""3
3
3
3
3
3
4
4
4
4
4
4
5
5
5
5
5
5""")
item_3 = ListItem(List=panel_3, Index=number_slider, Wrap=True)
int_4 = Integer(item_3)
concat = Concatenate(
    FragmentA="C:\MeshingPaper\Ref_case_Cyl-",
    FragmentB=int_2,
    FragmentC=int_3,
    FragmentD=int,
    FragmentE=int_4,
    FragmentF="\")
domaincyl = DomainCyl(
    Geometry=geo,
    Directory=concat,
    WindDir=wind_dir,
    DivisionsX="1",
    DivisionsY=Slider(3, range=1..100),
    DivisionsZ=Slider(9, range=0..100),
    RAM=Slider(1, range=0..1),
    CPUs=1,
    Run=toggle_2)  # -> Out, Domain, Cyl
panel_4 = Panel(domaincyl.Domain)
python_2 = PythonScript(x=domaincyl.Domain)  # -> out, a
# ---------- python_2: Python ----------
a = x.frontageBuildingArea
# ---------- end python_2 ----------
cellsize = CellSize(Domain=domaincyl.Domain, Size="58", DesiredCellSize="0.5")
panel_5 = Panel(cellsize)
mesh = Mesh(Domain=domaincyl.Domain, AccBuilding=item, AccFeatures=item_2, AccGround=number_slider_4, Layer=item_3, Run=toggle_2)  # -> Out, Domain
panel_6 = Panel(python.b)
panel_7 = Panel(python.f)
panel_8 = Panel(python.a)
panel_9 = Panel(python.c)
button_3 = Button()
simulation = Simulation(
    Domain=mesh.Domain,
    Iterations=Slider(1000, range=0..1000),
    WriteInterval=Slider(10, range=0..100),
    KeepTimeSteps=Slider(5, range=0..10),
    Run=toggle_2)
gradient = Gradient(
    LowerLimit=0,
    UpperLimit=1,
    stops=[0: RGB(234, 38, 0), 0.25: RGB(234, 126, 0), 0.463: RGB(254, 244, 84), 0.75: RGB(173, 203, 249), 1: RGB(75, 107, 169)])  # disabled
vdisex = VectorDisplayEx(Colour=gradient, Width=2)  # disabled
