# Grasshopper definition testFile_urban_case_Cyl_wL.gh (Grasshopper 0.9.76)
# plug-ins: Python Interpreter, VirtualWindTunnel

custom_mesh_settings = SettingsCustom(
    StitchSeams=True,
    SimplePlanes=False,
    Refine=True,
    MinCount=16,
    MaxCount=400,
    AspectRatio=20,
    MaxDistance=0,
    MaxAngle=20,
    MinEdge="2",
    MaxEdge="2")
geo = Geometry([<brep referenced from the Rhino model> x83])
toggle = BooleanToggle(False)
toggle_2 = BooleanToggle(False)
toggle_3 = BooleanToggle(False)
jagged = SettingsSpeed()
number_slider = Slider(3, range=1..100)
mesh = MeshBrep(Brep=geo, Settings=custom_mesh_settings)
wind_dir = ControlKnob(Decimals=0, Limit=True, Maximum=359, Minimum=0, Range=360, Value=0)
button = Button()
int = Integer("1")
num = Number("0.5")
clean = Clean(Run=Button())
xz = XZPlane(Origin=Point(-0.0485980799, -4.042677826, 0))
c_script = CSharpScript(p=xz)  # -> out, B, A; inputs b: list of Brep, p: Plane
# ---------- c_script: C# ----------
    double pj = 0;
    A = FindFacades(p, b, out pj);
    B = pj;
# ---------- c_script: C# additional code ----------
  static List<Brep> FindFacades(Plane plane, List<Brep> volumes, out double projectedAreaTotal)
  {
    List<Brep> Facades = new List<Brep>();

    List<double> projectedAreas = new List<double>();
    foreach (Brep b in volumes)
    {
      for (int i = 0; i < b.Faces.Count; i++)
      {
        Vector3d vSurf = b.Faces[i].NormalAt(0.5, 0.5);
        double dot = plane.ZAxis * vSurf;
        if (dot < 0.1) continue;


        Brep face = b.Faces[i].DuplicateFace(false);
        //Print(dot + "");
        Facades.Add(face);

        Vector3d cross = Vector3d.CrossProduct(plane.ZAxis, vSurf);
        double norm = cross.Length;
        double angle = Math.Atan2(norm, dot);

        //Print((angle * 180 / Math.PI) + "");

        double projectedArea = face.GetArea() * Math.Cos(angle);

        projectedAreas.Add(projectedArea);
        //Print(projectedArea + "");
      }
    }
    projectedAreaTotal = projectedAreas.Sum(x => x);

    return Facades;
  }
# ---------- end c_script ----------
panel = Panel("0.3")
python = PythonScript()  # -> out, a
# ---------- python: Python ----------
a = x.frontageBuildingArea
# ---------- end python ----------
panel_2 = Panel(c_script.B)
number_slider_2 = Slider(1, range=0..10)
int_2 = Integer(number_slider_2)
cellsize = CellSize(Size="58", DesiredCellSize="0.5")
number_slider_3 = Slider(9, range=0..17)
button_2 = Button()
panel_3 = Panel(cellsize)
bacc = Panel("""3
4
5
6
7
8
3
4
5
6
7
8
3
4
5
6
7
8""")
python_2 = PythonScript()  # -> out, a, b, c, d, e, f
# ---------- python_2: Python ----------
a=x.BBox
b=x.centerGroundBBox
c=x.BBox.Min
d=x.BBox.Max
e=x.dimY
f=x.newBoxDomain.GetCorners
# ---------- end python_2 ----------
panel_4 = Panel("""3
4
5
6
7
8
3
4
5
6
7
8
3
4
5
6
7
8""")
item = ListItem(List=bacc, Index=number_slider_3, Wrap=True)
int_3 = Integer(item)
item_2 = ListItem(List=panel_4, Index=number_slider_3, Wrap=True)
int_4 = Integer(item_2)
panel_5 = Panel("""3
3
3
3
3
3
4
4
4
4
4
4
5
5
5
5
5
5""")
item_3 = ListItem(List=panel_5, Index=number_slider_3, Wrap=True)
int_5 = Integer(item_3)
concat = Concatenate(
    FragmentA="C:\MeshingPaper\City_case-wL-",
    FragmentB=int_3,
    FragmentC=int_4,
    FragmentD=int_2,
    FragmentE=int_5,
    FragmentF="\")
domaincyl = DomainCyl(
    Geometry=mesh,
    Directory=concat,
    WindDir=wind_dir,
    DivisionsX=number_slider,
    DivisionsY=number_slider,
    DivisionsZ=Slider(9, range=0..100),
    ScaleInnerR=num,
    RAM=int,
    CPUs=Slider(1, range=0..1),
    Run=toggle_2)  # -> Out, Domain, Cyl
mesh_2 = Mesh(
    Domain=domaincyl.Domain,
    AccBuilding=Slider(2, range=0..10),
    AccFeatures=Slider(3, range=0..10),
    AccGround=number_slider_2,
    Layer=Slider(0, range=0..10),
    Run=toggle_2)  # -> Out, Domain
panel_6 = Panel(python_2.b)
panel_7 = Panel(python_2.f)
panel_8 = Panel(python_2.a)
panel_9 = Panel(python_2.c)
button_3 = Button()
simulation = Simulation(
    Domain=mesh_2.Domain,
    Iterations=Slider(1000, range=0..1000),
    WriteInterval=Slider(10, range=0..100),
    KeepTimeSteps=Slider(5, range=0..10),
    Run=toggle_2)
gradient = Gradient(
    LowerLimit=0,
    UpperLimit=1,
    stops=[0: RGB(234, 38, 0), 0.25: RGB(234, 126, 0), 0.463: RGB(254, 244, 84), 0.75: RGB(173, 203, 249), 1: RGB(75, 107, 169)])  # disabled
vdisex = VectorDisplayEx(Colour=gradient, Width=2)  # disabled
