# Grasshopper definition testFile_urban_case_WT.gh (Grasshopper 0.9.76)
# plug-ins: Python Interpreter, VirtualWindTunnel

panel = Panel("C:\MeshingPaper\Ref_case_WT-")
pipeline = GeometryPipeline(
    GroupByLayer=False,
    GroupByType=False,
    IncludeHidden=True,
    IncludeLocked=True,
    LayerFilter="Building",
    NameFilter="*",
    TypeFilter=1073741880)
toggle = BooleanToggle(False)
toggle_2 = BooleanToggle(False)
toggle_3 = BooleanToggle(False)
geo = Geometry(pipeline)
number_slider = Slider(0, range=0..500)
button = Button()
clean = Clean(Dir=panel, Run=Button())
xz = XZPlane(Origin=Point(-0.0485980799, -4.042677826, 0))
c_script = CSharpScript(p=xz)  # -> out, B, A; inputs b: list of Brep, p: Plane
# ---------- c_script: C# ----------
    double pj = 0;
    A = FindFacades(p, b, out pj);
    B = pj;
# ---------- c_script: C# additional code ----------
  static List<Brep> FindFacades(Plane plane, List<Brep> volumes, out double projectedAreaTotal)
  {
    List<Brep> Facades = new List<Brep>();

    List<double> projectedAreas = new List<double>();
    foreach (Brep b in volumes)
    {
      for (int i = 0; i < b.Faces.Count; i++)
      {
        Vector3d vSurf = b.Faces[i].NormalAt(0.5, 0.5);
        double dot = plane.ZAxis * vSurf;
        if (dot < 0.1) continue;


        Brep face = b.Faces[i].DuplicateFace(false);
        //Print(dot + "");
        Facades.Add(face);

        Vector3d cross = Vector3d.CrossProduct(plane.ZAxis, vSurf);
        double norm = cross.Length;
        double angle = Math.Atan2(norm, dot);

        //Print((angle * 180 / Math.PI) + "");

        double projectedArea = face.GetArea() * Math.Cos(angle);

        projectedAreas.Add(projectedArea);
        //Print(projectedArea + "");
      }
    }
    projectedAreaTotal = projectedAreas.Sum(x => x);

    return Facades;
  }
# ---------- end c_script ----------
number_slider_2 = Slider(0, range=0..17)
panel_2 = Panel(c_script.B)
number_slider_3 = Slider(1, range=0..10)
int = Integer(number_slider_3)
number_slider_4 = Slider(3, range=0..10)
bacc = Panel("""3
4
5
6
7
8
3
4
5
6
7
8
3
4
5
6
7
8""")
panel_3 = Panel("""3
4
5
6
7
8
3
4
5
6
7
8
3
4
5
6
7
8""")
python = PythonScript()  # -> out, a, b, c, d, e, f
# ---------- python: Python ----------
a=x.BBox
b=x.centerGroundBBox
c=x.BBox.Min
d=x.BBox.Max
e=x.dimY
f=x.newBoxDomain.GetCorners
# ---------- end python ----------
button_2 = Button()
item = ListItem(List=bacc, Index=number_slider_2, Wrap=True)
int_2 = Integer(item)
item_2 = ListItem(List=panel_3, Index=number_slider_2, Wrap=True)
int_3 = Integer(item_2)
panel_4 = Panel("""3
3
3
3
3
3
4
4
4
4
4
4
5
5
5
5
5
5""")
item_3 = ListItem(List=panel_4, Index=number_slider_2, Wrap=True)
int_4 = Integer(item_3)
concat = Concatenate(FragmentA=panel, FragmentB=int_2, FragmentC=int_3, FragmentD=int, FragmentE=int_4, FragmentF="\")
domain = Domain(
    Geometry=geo,
    Directory=concat,
    Mode=1,
    BaseMesh=Slider(0.228, range=0.1..1),
    RAM=Slider(1, range=0..64000),
    CPUs=Slider(1, range=1..8),
    Run=toggle_2)  # -> Out, Domain, Cyl, D, E
panel_5 = Panel(domain.Domain)
python_2 = PythonScript(x=domain.Domain)  # -> out, a
# ---------- python_2: Python ----------
a = x.BuildingGeometry
# ---------- end python_2 ----------
cellsize = CellSize(Domain=domain.Domain, Size="20.0", DesiredCellSize="1")
panel_6 = Panel(cellsize)
mesh = Mesh(Domain=domain.Domain, AccBuilding=item, AccFeatures=item_2, AccGround=number_slider_3, Layer=item_3, Run=toggle_2)  # -> Out, Domain
panel_7 = Panel(python.b)
panel_8 = Panel(python.f)
panel_9 = Panel(python.a)
panel_10 = Panel(python.c)
button_3 = Button()
gradient = Gradient(
    LowerLimit=0,
    UpperLimit=1,
    stops=[0: RGB(234, 38, 0), 0.25: RGB(234, 126, 0), 0.463: RGB(254, 244, 84), 0.75: RGB(173, 203, 249), 1: RGB(75, 107, 169)])  # disabled
simulation = Simulation(
    Domain=mesh.Domain,
    Iterations=Slider(1000, range=0..1000),
    WriteInterval=Slider(10, range=0..100),
    KeepTimeSteps=Slider(5, range=0..10),
    Run=toggle_2)
vdisex = VectorDisplayEx(Colour=gradient, Width=2)  # disabled
