# Grasshopper definition GenerateOutdoorIndoorDocumentation.gh (Grasshopper 1.0.8)

docsdir = Python3Script()  # -> outdoor
# ---------- docsdir: Python ----------
import os
import Grasshopper
from pathlib import Path

# Get the Grasshopper document
gh_doc = ghenv.Component.OnPingDocument()

# Get the file path of the current Grasshopper file
gh_file_path = gh_doc.FilePath

# Extract the directory
if gh_file_path:
    gh_directory = os.path.dirname(gh_file_path)
else:
    gh_directory = "Grasshopper file not saved yet."

# Add "/docs/" to the output
docs_directory = os.path.join(gh_directory, "docs")

# Output
file_dir = docs_directory

gh_project_dir = Path(file_dir).parent.parent.parent / "Documentation"

outdoor = Path(file_dir).parent.parent.parent.parent / "Eddy3D-Documentation/docs/outdoor"
# ---------- end docsdir ----------
docsdir_2 = Python3Script()  # -> indoor
# ---------- docsdir_2: Python ----------
import os
import Grasshopper
from pathlib import Path

# Get the Grasshopper document
gh_doc = ghenv.Component.OnPingDocument()

# Get the file path of the current Grasshopper file
gh_file_path = gh_doc.FilePath

# Extract the directory
if gh_file_path:
    gh_directory = os.path.dirname(gh_file_path)
else:
    gh_directory = "Grasshopper file not saved yet."

# Add "/docs/" to the output
docs_directory = os.path.join(gh_directory, "docs")

# Output
file_dir = docs_directory

gh_project_dir = Path(file_dir).parent.parent.parent / "Documentation"

indoor = Path(file_dir).parent.parent.parent.parent / "Eddy3D-Documentation/docs/indoor"
# ---------- end docsdir_2 ----------
data = Data(docsdir_2)
data_2 = Data(docsdir)
panel = Panel(" ")  # disabled
panel_2 = Panel(" ")  # disabled
panel_3 = Panel(data)
panel_4 = Panel(docsdir)
python_3_script = Python3Script(workingDir=data, pluginGHRepo=panel, pluginName="Eddy3D", export=Toggle(True))  # -> a; inputs workingDir: String, pluginGHRepo: String, pluginName: String
# ---------- python_3_script: Python ----------
import Grasshopper
import System.Drawing
import shutil
import os
import glob
import re
import json

# --- CONFIGURATION -----------------------------------------------------------
# "ALL"     = Process ALL components (Fixes broken links in first_steps.md)
# "INDOOR"  = Process ONLY components in the '9 | Indoor' subcategory.
# "OUTDOOR" = Process everything EXCEPT '9 | Indoor'.
EXPORT_SCOPE = "INDOOR" 

# Set to True to wipe the output folder before starting. 
CLEAN_OUTPUT_DIR = True

# Set to True to link images with '-crop' suffix (e.g. 'Name-crop.png')
USE_CROPPED_IMAGES = True
# -----------------------------------------------------------------------------

# --- TEXT HELPERS ------------------------------------------------------------
def _read_text_safely(path):
    for enc in ("utf-8", "utf-8-sig", "cp1252", "latin-1"):
        try:
            with open(path, "r", encoding=enc) as f:
                return f.read()
        except UnicodeDecodeError:
            continue
    with open(path, "r", encoding="utf-8", errors="replace") as f:
        return f.read()

def _ensure_parent_dir(path):
    parent = os.path.dirname(path)
    if parent and not os.path.exists(parent):
        os.makedirs(parent, exist_ok=True)

def ensure_utf8_file(path):
    if not os.path.exists(path):
        return
    try:
        with open(path, "r", encoding="utf-8") as _f:
            _ = _f.read()
    except UnicodeDecodeError:
        txt = _read_text_safely(path)
        _ensure_parent_dir(path)
        with open(path, "w", encoding="utf-8", newline="\n") as f:
            f.write(txt)

def write_utf8(path, text, mode="w"):
    _ensure_parent_dir(path)
    with open(path, mode, encoding="utf-8", newline="\n") as f:
        f.write(text)

def clean_string(text):
    if not text: return ""
    text = text.replace("%20", " ")
    text = text.replace("|", " ").replace(":", "").replace("/", "_").replace("\\", "_")
    text = text.replace("<", "").replace(">", "").replace("?", "").replace("*", "").replace("\"", "")
    while "  " in text:
        text = text.replace("  ", " ")
    return text.strip()

def should_process_category(cleaned_sub_cat):
    if EXPORT_SCOPE == "ALL":
        return True
    check_name = cleaned_sub_cat.lower()
    is_indoor = "9 indoor" in check_name or "indoor" in check_name
    
    if EXPORT_SCOPE == "INDOOR":
        return is_indoor
    elif EXPORT_SCOPE == "OUTDOOR":
        return not is_indoor
    return True

def write_grouped_components(file_path, exposure_dict, link_prefix="components/"):
    main_components = []
    hidden_components = []

    for expo_name in sorted(exposure_dict.keys()):
        comps = sorted(exposure_dict[expo_name])
        if "obscure" in expo_name.lower():
            hidden_components.extend(comps)
        else:
            main_components.extend(comps)

    if main_components:
        write_utf8(file_path, "#### Main Components\n", mode="a")
        for comp in main_components:
            display_name = comp.replace('_', ' ')
            write_utf8(file_path, f"* [{display_name}]({link_prefix}{comp}.md)\n", mode="a")

    if hidden_components:
        write_utf8(file_path, "\n#### Hidden Components\n", mode="a")
        for comp in hidden_components:
            display_name = comp.replace('_', ' ')
            write_utf8(file_path, f"* [{display_name}]({link_prefix}{comp}.md)\n", mode="a")

def reset_output_directories(base_dir):
    if not CLEAN_OUTPUT_DIR:
        print("Skipping directory cleanup (CLEAN_OUTPUT_DIR = False)")
        return
    print(f"Cleaning output directories in {base_dir}...")
    dirs_to_clean = [
        os.path.join(base_dir, "categories"),
        os.path.join(base_dir, "text", "categories"),
    ]
    for d in dirs_to_clean:
        if os.path.exists(d):
            try: shutil.rmtree(d)
            except: pass
    comp_dir = os.path.join(base_dir, "components")
    if os.path.exists(comp_dir):
        md_files = glob.glob(os.path.join(comp_dir, "*.md"))
        for f in md_files:
            try: os.remove(f)
            except: pass

def captureGrasshopperScreen(fileName, workingDirectory):
    print(f"Capturing screenshot for {fileName}...")
    imageSettings = Grasshopper.GUI.Canvas.GH_Canvas.GH_ImageSettings()
    imageSettings.Zoom = 2.15
    canvas = Grasshopper.GH_InstanceServer.ActiveCanvas
    rect = System.Drawing.Rectangle(0, 0, 2, 2)
    imgsOfCanvas = canvas.GenerateHiResImage(rect, imageSettings)
    screenCapture = imgsOfCanvas[0][0]
    filePath = os.path.join(workingDirectory, "images", "components", fileName)
    shutil.copyfile(screenCapture, filePath)
    path = os.path.split(screenCapture)[0]
    shutil.rmtree(path)

def exportIcon(component, pluginName, workingDirectory):
    print(f"Exporting icon for {pluginName}...")
    fileName = getComponentName(component) + ".png"
    filePath = os.path.join(workingDirectory, "images", "icons", fileName)
    icon = component.Icon_24x24
    icon.Save(filePath)

def getComponentByName(document, name):
    print(f"Searching for component: {name}...")
    for component in document.Objects:
        if component.Name == name:
            return component

def getComponentName(component_obj_or_desc):
    raw_name = component_obj_or_desc.Name
    name_no_prefix = raw_name.replace(pluginName + "_", "")
    return clean_string(name_no_prefix).replace(" ", "_")

def exportDescription(component, pluginName, githubFolder, githubRepo=None):
    originalName = component.Name
    bName = originalName.replace(pluginName + "_", "")
    name = getComponentName(component)
    description = component.Description

    components_dir = os.path.join(githubFolder, "components")
    os.makedirs(components_dir, exist_ok=True)

    lines = []
    header = f"## ![](../images/icons/{name}.png) {bName}"
    if githubRepo:
        source = f" - [[source code]]({githubRepo}/{originalName.replace(' ', '%20')}.cs)\n"
        lines.append(header + source)
    else:
        lines.append(header + "\n")

    image_filename = f"{name}-crop.png" if USE_CROPPED_IMAGES else f"{name}.png"
    image = f"![](../images/components/{image_filename})"
    lines.append(image)
    
    desc = description.split("Provided by ")[0].replace("\n", " ")
    lines.append("\n" + desc)

    try:
        lines.append("\n#### Input")
        for i in range(component.Params.Input.Count):
            iname = component.Params.Input[i].NickName
            cleaned_description = component.Params.Input[i].Description.replace("\n", " ")
            lines.append(f"* ##### {iname} \n{cleaned_description}")
        lines.append("\n#### Output")
        for i in range(component.Params.Output.Count):
            iname = component.Params.Output[i].NickName
            cleaned_description = component.Params.Output[i].Description.replace("\n", " ")
            lines.append(f"* ##### {iname}\n{cleaned_description}")
    except Exception:
        pass

    fileName = f"{name}.md"
    filePath = os.path.join(components_dir, fileName)
    write_utf8(filePath, "\n".join(lines))
    return True # Signal success

def getPluginComponents(pluginName):
    components = {}
    doc = Grasshopper.Instances.ActiveCanvas.Document
    for proxy in Grasshopper.Instances.ComponentServer.ObjectProxies:
        if proxy.Obsolete: continue
        
        cat = proxy.Desc.Category
        subCat = proxy.Desc.SubCategory
        
        if cat.strip() == pluginName:
            cleanSubCat = clean_string(subCat)
            if not should_process_category(cleanSubCat):
                continue
            
            # Expanded Kind check to catch more component types
            # If a component is neither CompiledObject nor UserObject, it might be skipped here
            # but usually appearing in proxy list.
            if str(proxy.Kind) == "CompiledObject":
                components[proxy.Desc.Name] = proxy.CreateInstance()
            elif str(proxy.Kind) == "UserObject":
                components[proxy.Desc.Name] = Grasshopper.Kernel.GH_UserObject(proxy.Location).InstantiateObject()
            else:
                # Try generic instantiation for other types (e.g. scripts)
                try:
                    components[proxy.Desc.Name] = proxy.CreateInstance()
                except:
                    print(f"Skipping component {proxy.Desc.Name} (Kind: {proxy.Kind}) - Could not instantiate")
    return components

def createFolderStructure(githubFolder):
    os.makedirs(githubFolder, exist_ok=True)
    imagesFolder = os.path.join(githubFolder, "images")
    for sub in ["components", "icons"]:
        os.makedirs(os.path.join(imagesFolder, sub), exist_ok=True)
    textFolder = os.path.join(githubFolder)
    for sub in ["categories", "components"]:
        os.makedirs(os.path.join(textFolder, sub), exist_ok=True)

# --- MAIN EXECUTION ---
componentsHeights = {}
pluginComponents = {} # We will populate this AS we export

if not workingDir:
    githubFolder = "C:/Users/Administrator/Documents/GitHub/%s-primer/" % pluginName
else:
    githubFolder = workingDir

if export:
    reset_output_directories(githubFolder)
    createFolderStructure(githubFolder)
    
    doc = Grasshopper.Instances.ActiveCanvas.Document
    components = getPluginComponents(pluginName)

    for GHObjectName, GHObject in components.items():
        if GHObject.Attributes:
            GHObject.Attributes.Pivot = System.Drawing.PointF(200, 215)
            doc.AddObject(GHObject, False, 0)
            component = getComponentByName(doc, GHObjectName)
            
            cleanSubCat = clean_string(component.SubCategory)
            
            # Double check filtering
            if should_process_category(cleanSubCat):
                name = getComponentName(component)
                
                try:
                    # 1. Capture Image
                    captureGrasshopperScreen(name + ".png", githubFolder)
                    
                    # 2. Export Icon
                    exportIcon(component, pluginName, githubFolder)
                    
                    # 3. Export Description
                    # We assume success if this doesn't crash
                    exportDescription(component, pluginName, githubFolder, pluginGHRepo)
                    
                    # 4. Record Height
                    componentsHeights[name] = str(component.Attributes.Bounds.Height)

                    # --- 5. POPULATE README DICTIONARY HERE ---
                    # Only add to README if we actually processed it successfully!
                    if cleanSubCat not in pluginComponents:
                        pluginComponents[cleanSubCat] = {}
                    
                    expo = str(component.Exposure).split(",")[-1].strip()
                    if expo not in pluginComponents[cleanSubCat]:
                        pluginComponents[cleanSubCat][expo] = []
                    
                    pluginComponents[cleanSubCat][expo].append(name)
                    
                except Exception as e:
                    print(f"Error exporting {name}: {str(e)}")
            
            doc.RemoveObject(GHObject, False)

    with open(os.path.join(githubFolder, "images", "componentsHeight.json"), "w", encoding="utf-8") as compHeight:
        json.dump(componentsHeights, compHeight, ensure_ascii=False, indent=4)


# --- CATEGORY & README GENERATION ---
# Now we generate the README based ONLY on what is inside pluginComponents
# (which only contains items that successfully passed the loop above)

finalOutputFolder = githubFolder 
os.makedirs(os.path.join(finalOutputFolder, "categories"), exist_ok=True)
os.makedirs(os.path.join(finalOutputFolder, "components"), exist_ok=True)

# Generate Category Files
for cleanSubCat in pluginComponents:
    safeFileName = cleanSubCat.replace(" ", "_") 
    categoryFilePath = os.path.join(finalOutputFolder, "categories", f"{safeFileName}.md")
    ensure_utf8_file(categoryFilePath)
    write_utf8(categoryFilePath, f"# {cleanSubCat}\n")
    write_grouped_components(categoryFilePath, pluginComponents[cleanSubCat], link_prefix="../components/")

os.makedirs(os.path.join(finalOutputFolder, "text"), exist_ok=True)

# Generate README
summaryPath = os.path.join(finalOutputFolder, "README.md")
ensure_utf8_file(summaryPath)
write_utf8(summaryPath, "# UMCF Component list\n")

for cleanSubCat in sorted(pluginComponents.keys()):
    write_utf8(summaryPath, f"## {cleanSubCat}\n", mode="a")
    write_grouped_components(summaryPath, pluginComponents[cleanSubCat], link_prefix="components/")

a = True
# ---------- end python_3_script ----------
python_3_script_2 = Python3Script(workingDir=data_2, pluginGHRepo=panel_2, pluginName="Eddy3D", export=Toggle(True))  # -> a; inputs workingDir: String, pluginGHRepo: String, pluginName: String
# ---------- python_3_script_2: Python ----------
import Grasshopper
import System.Drawing
import shutil
import os
import glob
import re
import json

# --- CONFIGURATION -----------------------------------------------------------
# "ALL"     = Process ALL components (Fixes broken links in first_steps.md)
# "INDOOR"  = Process ONLY components in the '9 | Indoor' subcategory.
# "OUTDOOR" = Process everything EXCEPT '9 | Indoor'.
EXPORT_SCOPE = "OUTDOOR" 

# Set to True to wipe the output folder before starting. 
CLEAN_OUTPUT_DIR = False

# Set to True to link images with '-crop' suffix (e.g. 'Name-crop.png')
USE_CROPPED_IMAGES = True
# -----------------------------------------------------------------------------

# --- TEXT HELPERS ------------------------------------------------------------
def _read_text_safely(path):
    for enc in ("utf-8", "utf-8-sig", "cp1252", "latin-1"):
        try:
            with open(path, "r", encoding=enc) as f:
                return f.read()
        except UnicodeDecodeError:
            continue
    with open(path, "r", encoding="utf-8", errors="replace") as f:
        return f.read()

def _ensure_parent_dir(path):
    parent = os.path.dirname(path)
    if parent and not os.path.exists(parent):
        os.makedirs(parent, exist_ok=True)

def ensure_utf8_file(path):
    if not os.path.exists(path):
        return
    try:
        with open(path, "r", encoding="utf-8") as _f:
            _ = _f.read()
    except UnicodeDecodeError:
        txt = _read_text_safely(path)
        _ensure_parent_dir(path)
        with open(path, "w", encoding="utf-8", newline="\n") as f:
            f.write(txt)

def write_utf8(path, text, mode="w"):
    _ensure_parent_dir(path)
    with open(path, mode, encoding="utf-8", newline="\n") as f:
        f.write(text)

def clean_string(text):
    if not text: return ""
    text = text.replace("%20", " ")
    text = text.replace("|", " ").replace(":", "").replace("/", "_").replace("\\", "_")
    text = text.replace("<", "").replace(">", "").replace("?", "").replace("*", "").replace("\"", "")
    while "  " in text:
        text = text.replace("  ", " ")
    return text.strip()

def should_process_category(cleaned_sub_cat):
    if EXPORT_SCOPE == "ALL":
        return True
    check_name = cleaned_sub_cat.lower()
    is_indoor = "9 indoor" in check_name or "indoor" in check_name
    
    if EXPORT_SCOPE == "INDOOR":
        return is_indoor
    elif EXPORT_SCOPE == "OUTDOOR":
        return not is_indoor
    return True

def write_grouped_components(file_path, exposure_dict, link_prefix="components/"):
    main_components = []
    hidden_components = []

    for expo_name in sorted(exposure_dict.keys()):
        comps = sorted(exposure_dict[expo_name])
        if "obscure" in expo_name.lower():
            hidden_components.extend(comps)
        else:
            main_components.extend(comps)

    if main_components:
        write_utf8(file_path, "#### Main Components\n", mode="a")
        for comp in main_components:
            display_name = comp.replace('_', ' ')
            write_utf8(file_path, f"* [{display_name}]({link_prefix}{comp}.md)\n", mode="a")

    if hidden_components:
        write_utf8(file_path, "\n#### Hidden Components\n", mode="a")
        for comp in hidden_components:
            display_name = comp.replace('_', ' ')
            write_utf8(file_path, f"* [{display_name}]({link_prefix}{comp}.md)\n", mode="a")

def reset_output_directories(base_dir):
    if not CLEAN_OUTPUT_DIR:
        print("Skipping directory cleanup (CLEAN_OUTPUT_DIR = False)")
        return
    print(f"Cleaning output directories in {base_dir}...")
    dirs_to_clean = [
        os.path.join(base_dir, "categories"),
        os.path.join(base_dir, "text", "categories"),
    ]
    for d in dirs_to_clean:
        if os.path.exists(d):
            try: shutil.rmtree(d)
            except: pass
    comp_dir = os.path.join(base_dir, "components")
    if os.path.exists(comp_dir):
        md_files = glob.glob(os.path.join(comp_dir, "*.md"))
        for f in md_files:
            try: os.remove(f)
            except: pass

def captureGrasshopperScreen(fileName, workingDirectory):
    print(f"Capturing screenshot for {fileName}...")
    imageSettings = Grasshopper.GUI.Canvas.GH_Canvas.GH_ImageSettings()
    imageSettings.Zoom = 2.15
    canvas = Grasshopper.GH_InstanceServer.ActiveCanvas
    rect = System.Drawing.Rectangle(0, 0, 2, 2)
    imgsOfCanvas = canvas.GenerateHiResImage(rect, imageSettings)
    screenCapture = imgsOfCanvas[0][0]
    filePath = os.path.join(workingDirectory, "images", "components", fileName)
    shutil.copyfile(screenCapture, filePath)
    path = os.path.split(screenCapture)[0]
    shutil.rmtree(path)

def exportIcon(component, pluginName, workingDirectory):
    print(f"Exporting icon for {pluginName}...")
    fileName = getComponentName(component) + ".png"
    filePath = os.path.join(workingDirectory, "images", "icons", fileName)
    icon = component.Icon_24x24
    icon.Save(filePath)

def getComponentByName(document, name):
    print(f"Searching for component: {name}...")
    for component in document.Objects:
        if component.Name == name:
            return component

def getComponentName(component_obj_or_desc):
    raw_name = component_obj_or_desc.Name
    name_no_prefix = raw_name.replace(pluginName + "_", "")
    return clean_string(name_no_prefix).replace(" ", "_")

def exportDescription(component, pluginName, githubFolder, githubRepo=None):
    originalName = component.Name
    bName = originalName.replace(pluginName + "_", "")
    name = getComponentName(component)
    description = component.Description

    components_dir = os.path.join(githubFolder, "components")
    os.makedirs(components_dir, exist_ok=True)

    lines = []
    header = f"## ![](../images/icons/{name}.png) {bName}"
    if githubRepo:
        source = f" - [[source code]]({githubRepo}/{originalName.replace(' ', '%20')}.cs)\n"
        lines.append(header + source)
    else:
        lines.append(header + "\n")

    image_filename = f"{name}-crop.png" if USE_CROPPED_IMAGES else f"{name}.png"
    image = f"![](../images/components/{image_filename})"
    lines.append(image)
    
    desc = description.split("Provided by ")[0].replace("\n", " ")
    lines.append("\n" + desc)

    try:
        lines.append("\n#### Input")
        for i in range(component.Params.Input.Count):
            iname = component.Params.Input[i].NickName
            cleaned_description = component.Params.Input[i].Description.replace("\n", " ")
            lines.append(f"* ##### {iname} \n{cleaned_description}")
        lines.append("\n#### Output")
        for i in range(component.Params.Output.Count):
            iname = component.Params.Output[i].NickName
            cleaned_description = component.Params.Output[i].Description.replace("\n", " ")
            lines.append(f"* ##### {iname}\n{cleaned_description}")
    except Exception:
        pass

    fileName = f"{name}.md"
    filePath = os.path.join(components_dir, fileName)
    write_utf8(filePath, "\n".join(lines))
    return True # Signal success

def getPluginComponents(pluginName):
    components = {}
    doc = Grasshopper.Instances.ActiveCanvas.Document
    for proxy in Grasshopper.Instances.ComponentServer.ObjectProxies:
        if proxy.Obsolete: continue
        
        cat = proxy.Desc.Category
        subCat = proxy.Desc.SubCategory
        
        if cat.strip() == pluginName:
            cleanSubCat = clean_string(subCat)
            if not should_process_category(cleanSubCat):
                continue
            
            # Expanded Kind check to catch more component types
            # If a component is neither CompiledObject nor UserObject, it might be skipped here
            # but usually appearing in proxy list.
            if str(proxy.Kind) == "CompiledObject":
                components[proxy.Desc.Name] = proxy.CreateInstance()
            elif str(proxy.Kind) == "UserObject":
                components[proxy.Desc.Name] = Grasshopper.Kernel.GH_UserObject(proxy.Location).InstantiateObject()
            else:
                # Try generic instantiation for other types (e.g. scripts)
                try:
                    components[proxy.Desc.Name] = proxy.CreateInstance()
                except:
                    print(f"Skipping component {proxy.Desc.Name} (Kind: {proxy.Kind}) - Could not instantiate")
    return components

def createFolderStructure(githubFolder):
    os.makedirs(githubFolder, exist_ok=True)
    imagesFolder = os.path.join(githubFolder, "images")
    for sub in ["components", "icons"]:
        os.makedirs(os.path.join(imagesFolder, sub), exist_ok=True)
    textFolder = os.path.join(githubFolder)
    for sub in ["categories", "components"]:
        os.makedirs(os.path.join(textFolder, sub), exist_ok=True)

# --- MAIN EXECUTION ---
componentsHeights = {}
pluginComponents = {} # We will populate this AS we export

if not workingDir:
    githubFolder = "C:/Users/Administrator/Documents/GitHub/%s-primer/" % pluginName
else:
    githubFolder = workingDir

if export:
    reset_output_directories(githubFolder)
    createFolderStructure(githubFolder)
    
    doc = Grasshopper.Instances.ActiveCanvas.Document
    components = getPluginComponents(pluginName)

    for GHObjectName, GHObject in components.items():
        if GHObject.Attributes:
            GHObject.Attributes.Pivot = System.Drawing.PointF(200, 215)
            doc.AddObject(GHObject, False, 0)
            component = getComponentByName(doc, GHObjectName)
            
            cleanSubCat = clean_string(component.SubCategory)
            
            # Double check filtering
            if should_process_category(cleanSubCat):
                name = getComponentName(component)
                
                try:
                    # 1. Capture Image
                    captureGrasshopperScreen(name + ".png", githubFolder)
                    
                    # 2. Export Icon
                    exportIcon(component, pluginName, githubFolder)
                    
                    # 3. Export Description
                    # We assume success if this doesn't crash
                    exportDescription(component, pluginName, githubFolder, pluginGHRepo)
                    
                    # 4. Record Height
                    componentsHeights[name] = str(component.Attributes.Bounds.Height)

                    # --- 5. POPULATE README DICTIONARY HERE ---
                    # Only add to README if we actually processed it successfully!
                    if cleanSubCat not in pluginComponents:
                        pluginComponents[cleanSubCat] = {}
                    
                    expo = str(component.Exposure).split(",")[-1].strip()
                    if expo not in pluginComponents[cleanSubCat]:
                        pluginComponents[cleanSubCat][expo] = []
                    
                    pluginComponents[cleanSubCat][expo].append(name)
                    
                except Exception as e:
                    print(f"Error exporting {name}: {str(e)}")
            
            doc.RemoveObject(GHObject, False)

    with open(os.path.join(githubFolder, "images", "componentsHeight.json"), "w", encoding="utf-8") as compHeight:
        json.dump(componentsHeights, compHeight, ensure_ascii=False, indent=4)


# --- CATEGORY & README GENERATION ---
# Now we generate the README based ONLY on what is inside pluginComponents
# (which only contains items that successfully passed the loop above)

finalOutputFolder = githubFolder 
os.makedirs(os.path.join(finalOutputFolder, "categories"), exist_ok=True)
os.makedirs(os.path.join(finalOutputFolder, "components"), exist_ok=True)

# Generate Category Files
for cleanSubCat in pluginComponents:
    safeFileName = cleanSubCat.replace(" ", "_") 
    categoryFilePath = os.path.join(finalOutputFolder, "categories", f"{safeFileName}.md")
    ensure_utf8_file(categoryFilePath)
    write_utf8(categoryFilePath, f"# {cleanSubCat}\n")
    write_grouped_components(categoryFilePath, pluginComponents[cleanSubCat], link_prefix="../components/")

os.makedirs(os.path.join(finalOutputFolder, "text"), exist_ok=True)

# Generate README
summaryPath = os.path.join(finalOutputFolder, "README.md")
ensure_utf8_file(summaryPath)
write_utf8(summaryPath, "# UMCF Component list\n")

for cleanSubCat in sorted(pluginComponents.keys()):
    write_utf8(summaryPath, f"## {cleanSubCat}\n", mode="a")
    write_grouped_components(summaryPath, pluginComponents[cleanSubCat], link_prefix="components/")

a = True
# ---------- end python_3_script_2 ----------
boolean = Boolean(python_3_script)
boolean_2 = Boolean(python_3_script_2)
and = GateAnd(A=boolean_2, B=boolean)
result = ContextBake(Content=boolean)
result_2 = ContextBake(Content=and)
