# Grasshopper definition 10_IndoorExample_new.ghx (Grasshopper 1.0.7)
# plug-ins: Eddy3D

geo = Geometry(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)
geo_2 = Geometry(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)
facen = FaceNormals(Mesh=geo)  # -> Centers, Normals
geo_3 = Geometry(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)
pt = Point(<point referenced from the Rhino model>)
geo_4 = Geometry(Geo=geo_2, Temp=Slider(49, range=0..100))
ol = Outlet(Geo=geo_3, Vel=Vector(0, 0, 0))
il = Inlet(Geo=geo, Vel=facen.Normals, Temp=Slider(20, range=0..100))
brep = Brep(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)
brep_2 = Brep(<brep referenced from the Rhino model>)
idom = IndoorDomain(Geo=geo_4, Inlet=il, Outlet=ol, CellSize="C:\temp\EddyProject\0\", CellSize_2=pt, CellSize_3=Slider(2, range=0..10))
c_script = CSharpScript(Dom=idom, Reference="C:\Users\pkastner\Documents\GitHub\Eddy3d\Eddy\bin\EddyLib.dll")  # -> Res
# ---------- c_script: C# usings ----------
using EddyLib;
using EddyLib.BCs;
using System.Linq;
# ---------- c_script: C# ----------
    var point0 = new Rhino.Geometry.Point3d(0, 0, 0);
    var point1 = new Rhino.Geometry.Point3d(20, 0, 0);
    var point2 = new Rhino.Geometry.Point3d(0, 20, 0);
    var point3 = new Rhino.Geometry.Point3d(20, 20, 0);
    var point4 = new Rhino.Geometry.Point3d(0, 0, 40);
    var point5 = new Rhino.Geometry.Point3d(20, 0, 40);
    var point6 = new Rhino.Geometry.Point3d(0, 20, 40);
    var point7 = new Rhino.Geometry.Point3d(20, 20, 40);
    Rhino.Geometry.Box box1 = new Rhino.Geometry.Box(Rhino.Geometry.Plane.WorldXY, new List<Rhino.Geometry.Point3d>() { point0, point1, point2, point3, point4, point5, point6, point7 });
    Rhino.Geometry.MeshingParameters mp = new Rhino.Geometry.MeshingParameters();
    var m = Mesh.CreateFromBrep(box1.ToBrep(), mp);

    Rhino.Geometry.Mesh mm = new Rhino.Geometry.Mesh();

    foreach (Rhino.Geometry.Mesh im in m)
    {
      mm.Append(im);
    }



    var windDirList = new List<int>() { 0 };
    BoundaryCondition bcond = new ABL(windDirList, 5, 10, 1, 0, "");

    OFCylDomain DOMCYL = new OFCylDomain(mm, new Mesh(), bcond, 5, 50, 300, 80);




    var DOM = (EddyLib.Indoor.IndoorDomain) Dom;

    var RUNSETTINGS = new OFRunSettings(1000, 20, 5, fvSchemes.Optimized, 1, SimEngine.BlueCFD, OSType.Windows10, TurbModel.RNGkEpsilon, RelaxationFactors.Optimized, false, false);
    var MESHSETTINGS = new OFMeshSettings();


    var baseWorkingDirectory = DOM.WorkingDir;


    MESHSETTINGS.meshStlDir = baseWorkingDirectory + @"\\constant\triSurface\";
    MESHSETTINGS.meshPolyMeshDir = baseWorkingDirectory + @"\\constant\polyMesh\";
    MESHSETTINGS.meshSystemDir = baseWorkingDirectory + @"\\system\";
    MESHSETTINGS.meshConstantDir = baseWorkingDirectory + @"\\constant\";
    MESHSETTINGS.meshWorkingDir = baseWorkingDirectory + @"\\";


    // MESHSETTINGS.meshStlFilenameBuildings = baseWorkingDirectory + @"\\constant\triSurface\building.stl";
    //MESHSETTINGS.meshStlFilenameGround = baseWorkingDirectory + @"\\constant\triSurface\ground.stl";
    // MESHSETTINGS.meshStlFilenameGroundPerim = baseWorkingDirectory + @"\\constant\triSurface\ground_perim.stl";
    // MESHSETTINGS.meshBoundaryConditionsDirectory = baseWorkingDirectory + @"\\0.org\";


    var RES = new EddyLib.OFResult(DOMCYL, RUNSETTINGS, MESHSETTINGS, DOM.WorkingDir.Replace("0\\", ""));

    Res = RES;
# ---------- end c_script ----------
writebatfiles = CSharpScript(workingDir="C:\temp\EddyProject\0\")  # inputs workingDir: String
# ---------- writebatfiles: C# usings ----------
using System.Text;
using System.IO;
# ---------- writebatfiles: C# ----------
    WriteRun(workingDir);
    WriteRunMesh(workingDir);
    WriteRunSim(workingDir);
    WriteResiduals(workingDir);
# ---------- writebatfiles: C# additional code ----------
  public static void WriteRun(string workingDir){



    string str = String.Format( @"call ""C:\Program Files\blueCFD-Core-2017\\setvars.bat""
      set PATH=%HOME%msys64\usr\bin;%PATH%
      cd /d %~dp0
      cd ""{0}""


      REM blockMesh.exe
      REM surfaceFeatureExtract | tee -a log
      REM decomposePar -force | tee -a log
      REM mpiexec -np 8 snappyHexMesh -overwrite -parallel | tee -a log
      REM reconstructParMesh -constant | tee -a log
      REM renumberMesh -overwrite | tee -a log
      REM decomposePar -force | tee -a log
      REM mpiexec -np 8 buoyantSimpleFoam -parallel | tee -a log


      blockMesh.exe
      surfaceFeatureExtract
      snappyHexMesh -overwrite
      renumberMesh -overwrite
      buoyantSimpleFoam



      REM mergeMeshes.exe
      REM topoSet.exe
      REM setFields.exe


      PAUSE", workingDir);

    string fileName = @"\run.bat";

    File.WriteAllText(workingDir + fileName, str);

  }
  public static void WriteRunMesh(string workingDir){

    string str = String.Format( @"call ""C:\Program Files\blueCFD-Core-2017\\setvars.bat""
      set PATH=%HOME%msys64\usr\bin;%PATH%
      cd /d %~dp0
      cd ""{0}""


      blockMesh.exe
      surfaceFeatureExtract
      snappyHexMesh -overwrite
      renumberMesh -overwrite


      PAUSE", workingDir);

    string fileName = @"\run_mesh.bat";

    File.WriteAllText(workingDir + fileName, str);

  }


  public static void WriteRunSim(string workingDir){

    string str = String.Format( @"call ""C:\Program Files\blueCFD-Core-2017\\setvars.bat""
      set PATH=%HOME%msys64\usr\bin;%PATH%
      cd /d %~dp0
      cd ""{0}""



      REM decomposePar -force
      REM mpiexec -np 8 buoyantSimpleFoam -parallel
      REM reconstructPar -constant

      buoyantSimpleFoam 



      REM mergeMeshes.exe
      REM topoSet.exe
      REM setFields.exe
      ", workingDir);

    string fileName = @"\run_sim.bat";

    File.WriteAllText(workingDir + fileName, str);



  }


  public static void WriteResiduals(string workingDir){

    string str = String.Format( @"
      call C:\ProgramData\Anaconda3\Scripts\activate.bat C:\ProgramData\Anaconda3
      python residuals.py
      ", workingDir);

    string fileName = @"\run_residuals.bat";

    File.WriteAllText(workingDir + fileName, str);



  }
# ---------- end writebatfiles ----------
cluster = Cluster(B=brep_2, relay=Slider(0.5, range=0..1))
probing = Probing(Result=c_script, ProbingPoints=cluster, NameOfField=0, Run=Button())  # -> PorbingPoints, ProbingResult
vlen = VectorLength(Vector=probing.ProbingResult)
vdisex = VectorDisplayEx(Point=probing.PorbingPoints, Vector=probing.ProbingResult, Colour=RGB(0, 0, 0), Width=2)
panel = Panel(vlen)

# ==== cluster Cluster
relay = ClusterInput()
custom_mesh_settings = SettingsCustom(
    StitchSeams=True,
    SimplePlanes=False,
    Refine=True,
    MinCount=16,
    MaxCount=400,
    AspectRatio=20,
    MaxDistance=0,
    MaxAngle=20,
    MinEdge=relay,
    MaxEdge=relay)
B = ClusterInput()
mesh = MeshBrep(Brep=B, Settings=custom_mesh_settings)
demesh = DeconstructMesh(Mesh=mesh)  # -> Vertices, Faces, Colours, Normals
V = ClusterOutput(demesh.Vertices)
