# Grasshopper definition 1_WindDirs_8.ghx (Grasshopper 1.0.7)

panel = Panel("15")
panel_2 = Panel("""0
45
90
135
180
225
270
315""")
series = Series(Start="0", Step="10", Count=Slider(36, range=0..100))
panel_3 = Panel(series)
