# Grasshopper definition 20_VolumetricFlowRates.ghx (Grasshopper 1.0.7)
# plug-ins: MeshEdit Components, Eddy3D

# ----
# 1. Geometry &
# Boundary Conditions
panel = Panel("0")
abl = ABL(WDir=panel, Uref=5, Zref=10, Z0=1, ZGround=0)

geo = Geometry(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)
cluster = Cluster()
uniform_flow = UniformFlow(ReferenceVelocity_m_s=5, SurfaceRoughnessHeight_m=1)

# ----
# 2. Simulation Domain
domainbox = BoxShapedDomain(Geometry=cluster, Terrain=geo, BoundaryCondition=uniform_flow, BlockSize=20)  # -> Domain, Mesh

srf = Surface(<surface referenced from the Rhino model>)
tri = Triangulate(Mesh=srf)  # -> Mesh, Count
mesh = Mesh(tri.Mesh)
explode = MeshExplode(Mesh=mesh, Interpolate=False)
medges = MeshEdges(Mesh=mesh)  # -> NakedEdges, InteriorEdges, NonManifoldEdges
faceb = FaceBoundaries(Mesh=explode)
angle = Angle()  # -> Angle, Reflex
vec = VectorXYZ(XComponent=Slider(0, range=0..100), YComponent=Slider(0, range=0..100), ZComponent=Slider(-1, range=-1..1))  # -> Vector, Length
# 4. Probing points & probing
number_slider = Slider(5, range=1..30)
vec_2 = VectorXYZ(XComponent=Slider(0, range=0..100), YComponent=Slider(0, range=0..100), ZComponent=Slider(1, range=-1..1))  # -> Vector, Length
disc = Discontinuity(Curve=faceb, Level=1)  # -> Points, Parameters
lng = ListLength(List=disc.Points)
brep = Brep(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)
brep_2 = Brep(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)
equals = Equality(FirstNumber=lng, SecondNumber="3")  # -> Equality, Inequality
c_script = CSharpScript(x=vec_2.Vector, y=vec.Vector)  # -> out, A; inputs x: Vector3d, y: Vector3d
# ---------- c_script: C# ----------
    string str_error2 = "";
    
    A = Angle_3D(x, y, out str_error2);
# ---------- c_script: C# additional code ----------
  public static double Angle_3D(Vector3d A, Vector3d B, out string str_error)
  {
    
    str_error = "";
    //IL_0038: Unknown result type (might be due to invalid IL or missing references)
    //IL_0039: Unknown result type (might be due to invalid IL or missing references)
    if (!((Vector3d)( A)).Unitize())
    {
      str_error = "First vector is zero-length";
      return double.NaN;
    }
    if (!((Vector3d)( B)).Unitize())
    {
      str_error = "Second vector is zero-length";
      return double.NaN;
    }
    return Math.Acos(Math.Max(Math.Min(A * B, 1.0), -1.0));
  }
# ---------- end c_script ----------
cull = CullPattern(List=lng, CullPattern=equals.Equality)
E = CleanEmpty(True)
cos = Cosine(Value=c_script.A)
clean = CleanTree(Data=cull, CleanInvalid=True, CleanEmpty=E)
panel_2 = Panel(cos)
tstat = TreeStatistics(Tree=clean)  # -> Paths, Length, Count
lng_2 = ListLength(List=tstat.Paths)
panel_3 = Panel(lng_2)
rad = Radians(Degrees=Slider(67.5, range=0..100))
brep_3 = Brep(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)
meshplane = MeshPlane(brep=brep_3, number=number_slider)
probing = Probing(BuildingMesh=cluster, Points=meshplane)
area = Area(Geometry=brep_3)  # -> Area, Centroid
area_2 = Area(Geometry=brep_3)  # -> Area, Centroid
rad_2 = Radians(Degrees=Slider(45, range=0..100))
rot3d = Rotate3D(Geometry=brep_3, Angle=rad, Center=area.Centroid, Axis=Vector(0, 0, 1))  # -> Geometry, Transform
panel_4 = Panel(area.Area)
cos_2 = Cosine(Value=rad)
panel_5 = Panel(area_2.Area)
cos_3 = Cosine(Value=rad_2)
rot3d_2 = Rotate3D(Geometry=brep_3, Angle=rad_2, Center=area_2.Centroid, Axis=Vector(0, 0, 1))  # -> Geometry, Transform
mesh_2 = MeshBrep(
    Brep=brep_3,
    Settings={GridMaxCount=0, GridMinCount=16, JaggedSeams=False, MaxEdgeLength=0, MinEdgeLength=0.0001, MinTolerance=0, Refine=True, RefineAngle=0, RelativeTolerance=0.65, SimplePlanes=True, Tolerance=0})
area_3 = Area(Geometry=brep_3)  # -> Area, Centroid
mesh_3 = MeshBrep(
    Brep=rot3d.Geometry,
    Settings={GridMaxCount=0, GridMinCount=16, JaggedSeams=False, MaxEdgeLength=0, MinEdgeLength=0.0001, MinTolerance=0, Refine=True, RefineAngle=0, RelativeTolerance=0.65, SimplePlanes=True, Tolerance=0})
mesh_4 = MeshBrep(
    Brep=rot3d_2.Geometry,
    Settings={GridMaxCount=0, GridMinCount=16, JaggedSeams=False, MaxEdgeLength=0, MinEdgeLength=0.0001, MinTolerance=0, Refine=True, RefineAngle=0, RelativeTolerance=0.65, SimplePlanes=True, Tolerance=0})
panel_6 = Panel(area_3.Area)
flipm = FlipMesh(Mesh=mesh_2, VertexNormals=True, FaceNormals=True, FaceOrientation=True)
flipm_2 = FlipMesh(Mesh=mesh_3, VertexNormals=True, FaceNormals=True, FaceOrientation=True)
flipm_3 = FlipMesh(Mesh=mesh_4, VertexNormals=True, FaceNormals=True, FaceOrientation=True)
demesh = DeconstructMesh(Mesh=flipm)  # -> Vertices, Faces, Colours, Normals
demesh_2 = DeconstructMesh(Mesh=flipm_2)  # -> Vertices, Faces, Colours, Normals
demesh_3 = DeconstructMesh(Mesh=flipm_3)  # -> Vertices, Faces, Colours, Normals
vdis = VectorDisplay(Anchor=demesh.Vertices, Vector=demesh.Normals)
vdis_2 = VectorDisplay(Anchor=demesh_2.Vertices, Vector=demesh_2.Normals)
vdis_3 = VectorDisplay(Anchor=demesh_3.Vertices, Vector=demesh_3.Normals)

# ----
# 3. Mesh & Simulation
panel_7 = Panel("100")
panel_8 = Panel("C:\3_SimpleWindAnalysis")
rset = RunSettings(
    NumberOfIterations=panel_7,
    WriteInterval=20,
    NumberOfTimestepsToKeep=3,
    TurbulenceModel=1,
    RelaxationFactors=3,
    SolutionAndAlgorithmControl=1,
    PotentialFoamInitialization=False,
    AgeOfAir=False,
    NumberOfCPUs="-1",
    OperatingSystem=0)

mset = MeshSettings(AccBuilding=2, AccFeatures="3", AccBBox=0, AccGround="3", MiscSettings=1, NumberOfLayers=4, Mode=2)

simulation = Simulation(
    SimulationDomain=domainbox.Domain,
    WorkingDirectory=panel_8,
    MeshSettings=mset,
    RunSettings=rset,
    RunMeshing=Button(),
    MakeTrees=False,
    RunSimulation=Button(),
    runWithBlueCFD=True)
residuals = Residuals(Result=simulation, X=":", Y=":", Version=1, Run=Button(), visResiduals=True)

visprobes = VisualizeProbes(Result=simulation, ProbingPoints=demesh.Vertices, NameOfInstance="ttt", NameOfField=0, Run=Button())  # -> PorbingPoints, ProbingResult
visprobes_2 = VisualizeProbes(Result=simulation, ProbingPoints=demesh_2.Vertices, NameOfInstance="ttttt", NameOfField=0, Run=Button())  # -> PorbingPoints, ProbingResult
visprobes_3 = VisualizeProbes(Result=simulation, ProbingPoints=demesh_3.Vertices, NameOfInstance="tttt", NameOfField=0, Run=Button())  # -> PorbingPoints, ProbingResult

# ----
# 5. Post-processing
# 5.1. Paraview
button = Button()
paraview = Paraview(Result=simulation, ParaviewVersion=2, Run=button)

# ----
# 6. Clean
button_2 = Button()
clean_2 = Clean(Directory=panel_8, Mode=2, Run=button_2)

flow_rates = FlowRates(VelocityVectors=visprobes_2.ProbingResult, Mesh=flipm_2)  # -> Flows, Centers, FlowDirs
flow_rates_2 = FlowRates(VelocityVectors=visprobes.ProbingResult, Mesh=flipm)  # -> Flows, Centers, FlowDirs
flow_rates_3 = FlowRates(VelocityVectors=visprobes_3.ProbingResult, Mesh=flipm_3)  # -> Flows, Centers, FlowDirs
ma = MassAddition(Input=flow_rates_2.Flows)  # -> flatten(Result), PartialResults
vdis_4 = VectorDisplay(Anchor=flow_rates_2.Centers, Vector=flow_rates_2.FlowDirs)
vdis_5 = VectorDisplay(Anchor=flow_rates.Centers, Vector=flow_rates.FlowDirs)
ma_2 = MassAddition(Input=flow_rates.Flows)  # -> flatten(Result), PartialResults
ma_3 = MassAddition(Input=flow_rates_3.Flows)  # -> flatten(Result), PartialResults
vdis_6 = VectorDisplay(Anchor=flow_rates_3.Centers, Vector=flow_rates_3.FlowDirs)
panel_9 = Panel(flow_rates_2.Flows)
multiplication = Multiplication(A=panel_9, B=cos_2)
multiplication_2 = Multiplication(A=panel_9, B=cos_3)
panel_10 = Panel(flow_rates.Flows)
panel_11 = Panel(multiplication)
panel_12 = Panel(flow_rates_3.Flows)
panel_13 = Panel(multiplication_2)

# ==== cluster MeshPlane
number = ClusterInput()
number_2 = Number(number)
settings_custom = SettingsCustom(
    StitchSeams=True,
    SimplePlanes=False,
    Refine=True,
    MinCount=16,
    MaxCount=400,
    AspectRatio=20,
    MaxDistance=0,
    MaxAngle=20,
    MinEdge=number_2,
    MaxEdge=number_2)
brep = ClusterInput()
mesh_brep = MeshBrep(Brep=brep, Settings=settings_custom)
deconstruct_mesh = DeconstructMesh(Mesh=mesh_brep)  # -> Vertices, Faces, Colours, Normals
vertices = ClusterOutput(deconstruct_mesh.Vertices)

# ==== cluster Cluster
geo = Geometry([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])
mesh = Mesh(geo)
mjoin = MeshJoin(Meshes=mesh)
M = ClusterOutput(mjoin)
