# Grasshopper definition 3_AnnualOutdoorComfort.gh (Grasshopper 1.0.7)
# plug-ins: VirtualWindTunnel

panel = Panel("C:\DIVA\WeatherData\USA_IL_Chicago-OHare.Intl.AP.725300_TMY3.epw")
panel_2 = Panel("""0
45
90
135
180
225
270
315""")
geo = Geometry([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])
abl = ABL(WDir=panel_2, Uref=5, Zref=10, Z0=1, ZGround=0, Epw=panel)
domaincyl = CylindricalDomain(
    Geometry=geo,
    BCond=abl,
    BlockSize="10",
    SizeOfInnerRectangle=Slider(50, range=0..1000),
    SizeOfOuterRadius=Slider(300, range=0..1000),
    Height=Slider(80, range=0..1000))  # -> Domain, Mesh, Div
mset = MeshSettings(AccBuilding=2, AccFeatures="3", AccRefinement=0, AccGround=2, NLayer="2", Mode=2)
rset = RunSettings(
    Iterations="60",
    WriteInterval=20,
    KeepTimeSteps=2,
    Turbulence=1,
    RelaxationFactors=0,
    Mode=0,
    CPUs="2",
    OperationSystem=2)
simulation = Simulation(
    SimulationDomain=domaincyl.Domain,
    WorkingDirectory="C:\test",
    MeshSettings=mset,
    RunSettings=rset,
    RunMeshing=Button(),
    RunSimulation=Button(),
    runWithBlueCFD=True)
clean = Clean(Directory="C:\test", Mode=2, Run=Button())
residuals = Residuals(Res=simulation, Sel=panel_2, X=":", Y=":", Version=0, Run=Button(), visResiduals=True)
paraview = Paraview(Res=simulation, Dirs=panel_2, Version=1, Run=Button())

brep = Brep(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)
meshplane = MeshPlane(brep=brep, number=Slider(7, range=1..50))  # -> vertices, faces
point = Point(meshplane.vertices)

visprobes = VisualizeProbes(Result=simulation, ProbingPoints=point, NameOfInstance="test", NameOfField=0, Run=Button(), Culling=True)  # -> PorbingPoints, ProbingResult
dir = Slider(0, range=0..7)
points = Data(visprobes.PorbingPoints)
vectors = Data(visprobes.ProbingResult)
# Annual wind vectors
choose_dir = TreeBranch(Tree=vectors, Path=dir, MaintainPaths=True)
# Annual outdoor comfort
button = Button()
cluster = Cluster(data=choose_dir)  # -> S, E, data_3
windfactors = WindFactors(Result=simulation, ProbingPoints=visprobes.PorbingPoints, U=visprobes.ProbingResult, Run=button, Interpolation=True)  # -> WindFactors, PedestrianComfort, OffSet
mrt = MRT(SimulationResult=simulation, ProbingPoints=visprobes.PorbingPoints, Run=Button())
gradient = Gradient(
    LowerLimit=cluster.S,
    UpperLimit=cluster.E,
    Parameter=cluster.data_3,
    stops=[0.103: RGB(0, 0, 255), 0.22: RGB(0, 170, 255), 0.305: RGB(0, 255, 255), 0.398: RGB(0, 255, 188), 0.504: RGB(0, 255, 106), 0.605: RGB(91, 255, 0), 0.699: RGB(184, 255, 0), 0.799: RGB(255, 255, 0), 0.898: RGB(255, 170, 0)])
dedata = DeconstructData()  # disabled
dedata_2 = DeconstructData()  # disabled
utci = UTCI(
    SimulationResult=simulation,
    ProbingPoints=visprobes.PorbingPoints,
    WindFactors=windfactors.WindFactors,
    MeanRadiantTemperature=mrt,
    Run=Button())  # -> UniversalThermalClimateIndexCObject, ComfortableHours
vdisex = VectorDisplayEx(Point=points, Vector=choose_dir, Colour=gradient, Width=Slider(3, range=0..10))
dedata_3 = DeconstructData(In=utci.UniversalThermalClimateIndexCObject)  # disabled
branch = TreeBranch(Tree=dedata_3, Path=Slider(0, range=0..10000), MaintainPaths=True)
cluster_2 = Cluster(data=utci.ComfortableHours)  # -> S, E, data_3
gradient_2 = Gradient(
    LowerLimit=cluster_2.S,
    UpperLimit=cluster_2.E,
    Parameter=cluster_2.data_3,
    stops=[0.103: RGB(0, 0, 255), 0.22: RGB(0, 170, 255), 0.305: RGB(0, 255, 255), 0.398: RGB(0, 255, 188), 0.504: RGB(0, 255, 106), 0.605: RGB(91, 255, 0), 0.699: RGB(184, 255, 0), 0.799: RGB(255, 255, 0), 0.898: RGB(255, 170, 0)])
cluster_3 = Cluster_2(C=visprobes.PorbingPoints, R=Slider(2, range=0..10))
preview = CustomPreview(Geometry=cluster_3, Material=gradient_2)

# ==== cluster MeshPlane
number = ClusterInput()
number_2 = Number(number)
settings_custom = SettingsCustom(
    StitchSeams=True,
    SimplePlanes=False,
    Refine=True,
    MinCount=16,
    MaxCount=400,
    AspectRatio=20,
    MaxDistance=0,
    MaxAngle=20,
    MinEdge=number_2,
    MaxEdge=number_2)
brep = ClusterInput()
mesh_brep = MeshBrep(Brep=brep, Settings=settings_custom)
deconstruct_mesh = DeconstructMesh(Mesh=mesh_brep)  # -> Vertices, Faces, Colours, Normals
faces = ClusterOutput(deconstruct_mesh.Faces)
vertices = ClusterOutput(deconstruct_mesh.Vertices)

# ==== cluster Cluster
data = ClusterInput()
data_2 = Data(data)
data_3 = ClusterOutput(data_2)
bnd = Bounds(Numbers=data_2)
dedomain = DeconstructDomain(Domain=bnd)  # -> Start, End
S = ClusterOutput(dedomain.Start)
E = ClusterOutput(dedomain.End)

# ==== cluster Cluster_2
C = ClusterInput()
R = ClusterInput()
circle = CircleCNR(Center=C, Normal=Vector(0, 0, 1), Radius=R)
srf = Surface(circle)
srf_2 = ClusterOutput(srf)
