# Grasshopper definition 3_SimpleWindAnalysis.gh (Grasshopper 1.0.7)
# plug-ins: VirtualWindTunnel

# ----
# 1. Geometry &
# Boundary Conditions
panel = Panel("C:\DIVA\WeatherData\USA_IL_Chicago-OHare.Intl.AP.725300_TMY3.epw")
abl = ABL(WDir="0", Uref=5, Zref=10, Z0=1, ZGround=0, Epw=panel)
geo = Geometry([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])

# ----
# 2. Simulation Domain
domainbox = BoxShapedDomain(Geometry=geo, BoundaryCondition=abl, BlockSize=20)  # -> Domain, Mesh

# ----
# 3. Mesh & Simulation
panel_2 = Panel("3")
mset = MeshSettings(AccBuilding=2, AccFeatures=panel_2, AccRefinement=0, AccGround=2, NLayer=3, Mode=1)
rset = RunSettings(
    Iterations="100",
    WriteInterval=20,
    KeepTimeSteps=2,
    Turbulence=1,
    RelaxationFactors=0,
    Mode=0,
    CPUs="2",
    OperationSystem=0)
simulation = Simulation(
    SimulationDomain=domainbox.Domain,
    WorkingDirectory="C:\test",
    MeshSettings=mset,
    RunSettings=rset,
    RunMeshing=Button(),
    RunSimulation=Button(),
    runWithBlueCFD=True)
residuals = Residuals(Res=simulation, X=":", Y=":", Version=0, Run=Button(), visResiduals=True)

# ----
# 4. Probing points & probing
number_slider = Slider(9, range=1..30)
brep = Brep(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)
brep_2 = Brep(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)
meshplane = MeshPlane(brep=brep, number=number_slider)
point = Point(meshplane)
visprobes = VisualizeProbes(Result=simulation, PorbingPoints=point, NameOfInstance="test", NameOfField=0, Run=Button(), Culling=True)  # -> PorbingPoints, ProbingResult

# ----
# 5. Post-processing
# 5.1. Paraview
# 5.2. Grasshopper
# Multi-directional / annual wind vectors
points = Data(visprobes.PorbingPoints)
vectors = Data(visprobes.ProbingResult)
dir = Slider(0, range=0..7)
paraview = Paraview(Res=simulation, Version=2, Run=Button())
choose_dir = TreeBranch(Tree=vectors, Path=dir, MaintainPaths=True)
cluster = Cluster(data=choose_dir)  # -> S, E, data_3
gradient = Gradient(
    LowerLimit=cluster.S,
    UpperLimit=Slider(6, range=0..10),
    Parameter=cluster.data_3,
    stops=[0.103: RGB(0, 0, 255), 0.22: RGB(0, 170, 255), 0.305: RGB(0, 255, 255), 0.398: RGB(0, 255, 188), 0.504: RGB(0, 255, 106), 0.605: RGB(91, 255, 0), 0.699: RGB(184, 255, 0), 0.799: RGB(255, 255, 0), 0.898: RGB(255, 170, 0)])
vdisex = VectorDisplayEx(Point=points, Vector=choose_dir, Colour=gradient, Width=Slider(3, range=0..10))

# ----
# 6. Clean
button = Button()
clean = Clean(Directory="C:\test", Mode=2, Run=button)

# ==== cluster MeshPlane
number = ClusterInput()
number_2 = Number(number)
settings_custom = SettingsCustom(
    StitchSeams=True,
    SimplePlanes=False,
    Refine=True,
    MinCount=16,
    MaxCount=400,
    AspectRatio=20,
    MaxDistance=0,
    MaxAngle=20,
    MinEdge=number_2,
    MaxEdge=number_2)
brep = ClusterInput()
mesh_brep = MeshBrep(Brep=brep, Settings=settings_custom)
deconstruct_mesh = DeconstructMesh(Mesh=mesh_brep)  # -> Vertices, Faces, Colours, Normals
vertices = ClusterOutput(deconstruct_mesh.Vertices)

# ==== cluster Cluster
data = ClusterInput()
data_2 = Data(data)
data_3 = ClusterOutput(data_2)
bnd = Bounds(Numbers=data_2)
dedomain = DeconstructDomain(Domain=bnd)  # -> Start, End
S = ClusterOutput(dedomain.Start)
E = ClusterOutput(dedomain.End)
