# Grasshopper definition 3_SimpleWindAnalysis.ghx (Grasshopper 1.0.7)
# plug-ins: MeshEdit Components, Eddy3D

# ----
# 1. Geometry &
# Boundary Conditions
panel = Panel("0")
abl = ABL(WDir=Slider(24, range=0..100), Uref=5, Zref=10, Z0=1, ZGround=0)

geo = Geometry(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)
cluster = Cluster_2()
c_script = CSharpScript(
    x=cluster,
    y=geo,
    z=abl,
    u=Slider(20, range=0..100),
    Reference="C:\Users\pkastner\Documents\GitHub\Eddy3d\Eddy\bin\EddyLib.dll")  # -> out, A, B; inputs x: Mesh, y: Mesh, u: Double
# ---------- c_script: C# usings ----------
using System.Drawing;
using EddyLib;
using EddyLib.BCs;
using System.Text;
# ---------- c_script: C# ----------
    var a = new OFBoxDomain(x, y, (EddyLib.BCs.ABL) z, u, 0, 0, 0, null);

    A = a.bp;
    B = Mesh.CreateFromBox(a.bp, 50, 50, 50);
# ---------- c_script: C# additional code ----------
  public class OFBaseDomain
  {
    public Point3d CenterGround;

    public Point3d LocationInMesh;

    public double[] FrontageBuildingAreas = new double[360];

    public double MaxFrontageBuildingArea;

    public Bitmap[] FrontagePNGs = new Bitmap[360];

    public Cylinder RefinementCylinder;

    public Box BBox;

    // 3 Main meshes

    public Mesh TerrainMesh;

    public Mesh DomainMesh;

    public Mesh[] DomainMeshIntersection;

    public Mesh BuildingGeometry;

    public BoundaryCondition BCond;

    public List<Tree> Trees;

    public int NumberOFCellsInMesh;

    public List<double> Runtimes = new List<double>();

    public bool hasTerrain;

    public double MaxHeightBuilding;

    public static Plane GetOrientedBasePlane(Vector3d windDir, Point3d CenterGround)
    {
      var up = Vector3d.ZAxis;
      var forward = windDir;
      var right = Vector3d.CrossProduct(forward, up);

      forward.Unitize();
      right.Unitize();

      var orientedBasePlane = new Plane(CenterGround, right, forward);

      return orientedBasePlane;
    }

    public static BoundingBox GetRefinementBox(Plane localSystem, Mesh buildings, double padding = 0)
    {
      Plane worldXY = Plane.WorldXY;
      Transform xform = Transform.ChangeBasis(worldXY, localSystem);
      var refBox = BoundingBox.Empty;
      BoundingBox boundingBox = buildings.GetBoundingBox(xform);
      refBox.Union(boundingBox);
      refBox.Max = new Point3d(refBox.Max.X + padding, refBox.Max.Y + padding, refBox.Max.Z + padding);
      refBox.Min = new Point3d(refBox.Min.X - padding, refBox.Min.Y - padding, refBox.Min.Z);

      return boundingBox;
    }

    public Cylinder GetRefinementCyl(Point3d center, Mesh buildings, double paddingXY = 0, double paddingZ = 0.3)
    {
      BoundingBox bb = buildings.GetBoundingBox(true);
      var pt = new Point3d(bb.Max.X, bb.Max.Y, center.Z);
      var radiusRefBox = (center - pt).Length;
      var cyl = new Cylinder(new Circle(center, radiusRefBox + paddingXY), bb.Max.Z + paddingZ);
      return cyl;
    }

    public static double GetZMinTerrain(Mesh terrain, BoundingBox Box, Plane orientedlocalPlane)
    {
      // If terrain is used, scale down Z to make sure all points are inside the domain Zinter
      // is call divisionsZ for CylDomain which is an int instead of an Interval

      Plane worldXY = Plane.WorldXY;
      Transform xform = Transform.ChangeBasis(worldXY, orientedlocalPlane);
      var refBox = BoundingBox.Empty;
      BoundingBox bboxTerrain = terrain.GetBoundingBox(xform);

      double zDomain = Box.Min.Z;

      //BoundingBox bboxTerrain = terrain.GetBoundingBox(orientedlocalPlane);

      if (terrain.Faces.Count > 0)
      {
        if (bboxTerrain.Min.Z < zDomain)
        {
          zDomain = bboxTerrain.Min.Z;
        }
      }

      return zDomain;
    }

    public static double GetZMinTerrain(Mesh terrain, Box Box, Plane orientedlocalPlane)
    {
      // If terrain is used, scale down Z to make sure all points are inside the domain Zinter
      // is call divisionsZ for CylDomain which is an int instead of an Interval

      Plane worldXY = Plane.WorldXY;
      Transform xform = Transform.ChangeBasis(worldXY, orientedlocalPlane);
      var refBox = BoundingBox.Empty;
      BoundingBox bboxTerrain = terrain.GetBoundingBox(xform);

      double zDomain = Box.Z.Min;

      //BoundingBox bboxTerrain = terrain.GetBoundingBox(orientedlocalPlane);

      if (terrain.Faces.Count > 0)
      {
        if (bboxTerrain.Min.Z < zDomain)
        {
          zDomain = bboxTerrain.Min.Z;
        }
      }

      return zDomain;
    }

    public Box UnionB(List < Mesh > list, Plane pl)
    {
      Transform val = Transform.ChangeBasis(Plane.WorldXY, pl);

      Point3d val3;
      Point3d val4;
      Interval val5 = default(Interval);
      Point3d val7;
      Point3d val8;
      Interval val9 = default(Interval);
      Point3d val11;
      Point3d val12;
      Interval val13 = default(Interval);

      List<Box> list2 = new List<Box>();
      List<Box> list3 = new List<Box>();
      int num2 = list.Count - 1;
      Box item = default(Box);
      Box item2 = default(Box);
      for (int j = 0; j <= num2; j++)
      {
        if (list[j] == null)
        {
          list2.Add(Box.Unset);
          list3.Add(Box.Unset);
          continue;
        }
        BoundingBox boundingBox2 = list[j].GetBoundingBox(val);
        Plane val15 = pl;
        val12 = boundingBox2.Min;
        double x2 = ((Point3d) (val12)).X;
        val11 = ((BoundingBox) (boundingBox2)).Max;
        val13 = new Interval(x2, ((Point3d) (val11)).X);
        Interval val16 = val13;
        val8 = ((BoundingBox) (boundingBox2)).Min;
        double y2 = ((Point3d) (val8)).Y;
        val7 = ((BoundingBox) (boundingBox2)).Max;
        val9 = new Interval(y2, val7.Y);
        Interval val17 = val9;
        val4 = ((BoundingBox) (boundingBox2)).Min;
        double z2 = ((Point3d) (val4)).Z;
        val3 = ((BoundingBox) (boundingBox2)).Max;
        val5 = new Interval(z2, ((Point3d) (val3)).Z);
        item = new Box(val15, val16, val17, val5);
        list2.Add(item);
        item2 = new Box(boundingBox2);
        list3.Add(item2);
      }

      return item;
    }

    public static double GetProjectedBuildingArea(int windDir, Mesh buildings, out Bitmap FrontageImage)
    {
      // Spacing in meters between rays
      //Todo: checked this number how correct it is
      double spacing = 10;

      Vector3d windDirVec = Utilities.Dir2Vec(windDir);

      var up = Vector3d.ZAxis;
      var forward = windDirVec;
      forward.Unitize();
      var right = Vector3d.CrossProduct(forward, up);
      right.Unitize();

      var CenterGround = buildings.GetBoundingBox(true).Center + 0.5 * -Vector3d.ZAxis * (buildings.GetBoundingBox(true).Max.Z - buildings.GetBoundingBox(true).Min.Z);

      BoundingBox empty = BoundingBox.Empty;
      BoundingBox boundingBox = buildings.GetBoundingBox(true);
      empty.Union(boundingBox);

      //var startPoint = new Point3d(empty.Min.X, empty.Min.Y, empty.Min.Z);

      Plane local = new Plane(CenterGround, right, forward);

      var BBox = empty;

      var xMin = BBox.Min.X;
      var xMax = BBox.Max.X;
      var yMin = BBox.Min.Y;
      var yMax = BBox.Max.Y;
      var zMin = BBox.Min.Z;
      var zMax = BBox.Max.Z;

      var dimX = xMax - xMin;

      //var dimY = yMax - yMin;
      //var dimZ = zMax - zMin;

      Interval intervalX = new Interval(empty.Min.X, empty.Max.X);
      Interval intervalZ = new Interval(empty.Min.Z, empty.Max.Z);

      // condition ? consequent : alternative

      int x = (int) Math.Round(intervalX.Length / spacing) == 0 ? 1 : (int) Math.Round(intervalX.Length / spacing);
      int z = (int) Math.Round(intervalZ.Length / spacing) == 0 ? 1 : (int) Math.Round(intervalZ.Length / spacing);

      if (x > 5000 || z > 5000)
      {
        new System.ArgumentException("Simulation domain either too large or too far from the origin.");
      }

      double incrX = intervalX.Length / x;
      double incrZ = intervalZ.Length / z;
      double raylen = 9999;

      List<Point3d> points = new List<Point3d>();
      List<Ray3d> rays = new List<Ray3d>();

      //testVecs = new List<Vector3d>();

      List<bool> hits = new List<bool>();
      int hitcount = 0;

      using (var FI = new Bitmap(x, z))

      {
        for (int zz = 0; zz < z; zz++)
        {
          for (int xx = 0; xx < x; xx++)
          {
            var centerZ = (0.5 * incrZ);
            var centerX = (0.5 * incrX);

            var pt = local.PointAt(centerX + xx * incrX - 0.5 * dimX, -50, centerZ + zz * incrZ);

            points.Add(pt);

            var ray = new Ray3d(pt, local.YAxis * raylen);
            var vec = new Vector3d(local.YAxis * raylen);

            rays.Add(ray);

            //testVecs.Add(vec);

            double d = Rhino.Geometry.Intersect.Intersection.MeshRay(buildings, ray);
            if (d > 0)
            {
              hitcount++;
              hits.Add(true);

              FI.SetPixel(xx, zz, Color.Black);
            }
            else
            {
              hits.Add(false);
              FI.SetPixel(xx, zz, Color.White);
            }
          }
        }

        FrontageImage = FI;

        //Needs to be rotated and flipped to represend the view from the wind direction
        FrontageImage.RotateFlip(RotateFlipType.Rotate180FlipX);
      }

      return incrX * incrZ * hitcount;
    }

    public static double GetProjectedBuildingArea(int windDir, Mesh buildings, out Bitmap FrontageImage, out List<Vector3d> testVecs)
    {
      // Spacing in meters between rays
      double spacing = 2;

      Vector3d windDirVec = Utilities.Dir2Vec(windDir);

      var up = Vector3d.ZAxis;
      var forward = windDirVec;
      forward.Unitize();
      var right = Vector3d.CrossProduct(forward, up);
      right.Unitize();

      var CenterGround = buildings.GetBoundingBox(true).Center + 0.5 * -Vector3d.ZAxis * (buildings.GetBoundingBox(true).Max.Z - buildings.GetBoundingBox(true).Min.Z);

      BoundingBox empty = BoundingBox.Empty;
      BoundingBox boundingBox = buildings.GetBoundingBox(true);
      empty.Union(boundingBox);

      //var startPoint = new Point3d(empty.Min.X, empty.Min.Y, empty.Min.Z);

      Plane local = new Plane(CenterGround, right, forward);

      var BBox = empty;

      var xMin = BBox.Min.X;
      var xMax = BBox.Max.X;
      var yMin = BBox.Min.Y;
      var yMax = BBox.Max.Y;
      var zMin = BBox.Min.Z;
      var zMax = BBox.Max.Z;

      var dimX = xMax - xMin;
      var dimY = yMax - yMin;
      var dimZ = zMax - zMin;

      Interval intervalX = new Interval(empty.Min.X, empty.Max.X);

      //Interval intervalY = new Interval(empty.Min.Y, empty.Max.Y);
      Interval intervalZ = new Interval(empty.Min.Z, empty.Max.Z);

      int x = (int) Math.Round(intervalX.Length / spacing);
      int z = (int) Math.Round(intervalZ.Length / spacing);

      double incrX = intervalX.Length / x;
      double incrZ = intervalZ.Length / z;
      double raylen = 9999;

      List<Point3d> points = new List<Point3d>();
      List<Ray3d> rays = new List<Ray3d>();
      testVecs = new List<Vector3d>();

      List<bool> hits = new List<bool>();
      int hitcount = 0;

      using (var FI = new Bitmap(x, z))

      {
        for (int zz = 0; zz < z; zz++)
        {
          for (int xx = 0; xx < x; xx++)
          {
            //var pt = local.PointAt((0.5 * incrX) + xx * incrX, -0.1, (0.5 * incrZ) + zz * incrZ);
            var centerZ = (0.5 * incrZ);
            var centerX = (0.5 * incrX);

            var pt = local.PointAt(centerX + xx * incrX - 0.5 * dimX, -50, centerZ + zz * incrZ);

            points.Add(pt);

            var ray = new Ray3d(pt, local.YAxis * raylen);
            var vec = new Vector3d(local.YAxis * raylen);

            rays.Add(ray);
            testVecs.Add(vec);

            double d = Rhino.Geometry.Intersect.Intersection.MeshRay(buildings, ray);
            if (d > 0)
            {
              hitcount++;
              hits.Add(true);

              FI.SetPixel(xx, zz, Color.Black);
            }
            else
            {
              hits.Add(false);
              FI.SetPixel(xx, zz, Color.White);
            }
          }
        }

        FrontageImage = FI;

        //Needs to be rotated and flipped to represend the view from the wind direction
        FrontageImage.RotateFlip(RotateFlipType.Rotate180FlipX);
      }

      return incrX * incrZ * hitcount;
    }
  }


  public class OFBoxDomain : OFBaseDomain
  {
    //BoundingBox
    public double width;

    public double length;

    public double height;

    public double Length_BBox;

    public double Width_BBox;

    public double Height_BBox;

    public double Width_SBox;

    public double Length_SBox;

    public double Height_SBox;

    public int CellsAlongWidth;

    public int CellsAlongLength;

    public int CellsAlongHeight;

    public Mesh DomainMeshGround;

    public Mesh DomainMeshGroundPerim;

    public Box SBox;

    //public Mesh BoxWithDivs;

    public double blockDimension;

    public string info;

    public double test;

    public Box bp;

    public OFBoxDomain(Mesh BuildingGeometry, Mesh terrainMesh, BoundaryCondition BCond, double blockDimension, double length = 0, double width = 0, double height = 0, List<Tree> Trees = null)
    {
      this.BCond = BCond;
      this.BuildingGeometry = BuildingGeometry;
      this.blockDimension = blockDimension;

      // Box-shaped tunnel can only have 1 windDir which is the 1st windDir

      Vector3d windDirVector = BCond.flowDir[0];
      windDirVector.Unitize();

      // Rotate the Plane based on wind vector area

      var bb = BuildingGeometry.GetBoundingBox(true);

      var centerBottomOfBuildings = new Point3d(bb.Center.X, bb.Center.Y, bb.Min.Z);
      Plane orientedPlane = GetOrientedBasePlane(windDirVector, centerBottomOfBuildings);


      orientedPlane.Origin = centerBottomOfBuildings;

      var l = new List<Mesh>();
      l.Add(BuildingGeometry);
      this.BBox = UnionB(l, orientedPlane);

      var corners = new List<Point3d>();

      foreach (Point3d pt in BBox.GetCorners())
      {
        corners.Add(pt);
      }

      var MinHeightBBox = corners[0].Z;
      var MaxHeightBBox = corners[4].Z;
      this.MaxHeightBuilding = MaxHeightBBox;

      Length_BBox = corners[0].DistanceTo(corners[1]);
      Width_BBox = corners[0].DistanceTo(corners[3]);
      Height_BBox = corners[0].DistanceTo(corners[4]);

      Bitmap FrontageImage;
      this.MaxFrontageBuildingArea = OFBaseDomain.GetProjectedBuildingArea(BCond.windDirs[0], BuildingGeometry, out FrontageImage);
      this.FrontagePNGs[BCond.windDirs[0]] = FrontageImage;

      // Order important Z --> Y --> X

      // Z
      double scaleZ = height == 0 ? 5 * Height_BBox : height;

      // X; take blocking ratio into account

      double WidthDueToBlockingRatio = ((RequiredInletArea(MaxFrontageBuildingArea) / (6 * Height_BBox)) - (MaxFrontageBuildingArea / MaxHeightBuilding)) / 2;

      double scaleRectDomainXUser = 0;

      if (width != 0)
      {
        scaleRectDomainXUser = width / 2;
      }

      double scaleX = width == 0 ? WidthDueToBlockingRatio : scaleRectDomainXUser;

      // Y
      double scaleYDownStream = length == 0 ? 15 * Height_BBox : length / 3 * 2;
      double scaleYUpStream = length == 0 ? 5 * Height_BBox : length / 3 * 1;

      var yTransUpStr = Transform.Translation(scaleYUpStream * -windDirVector);
      var yTransDownStr = Transform.Translation(scaleYDownStream * windDirVector);

      var NormalToWindDir = Vector3d.CrossProduct(windDirVector, Vector3d.ZAxis);
      NormalToWindDir.Unitize();


      var xTransMinusX = Transform.Translation((scaleX) *-NormalToWindDir);
      var xTransPlusX = Transform.Translation((scaleX) *NormalToWindDir);

      var zTrans = Transform.Translation((scaleZ) *Vector3d.ZAxis);

      Point3d P0 = corners[0];
      Point3d P1 = corners[1];
      Point3d P2 = corners[2];
      Point3d P3 = corners[3];
      Point3d P4 = corners[4];
      Point3d P5 = corners[5];
      Point3d P6 = corners[6];
      Point3d P7 = corners[7];

      // Move all in y

      P0.Transform(yTransUpStr);
      P1.Transform(yTransUpStr);
      P4.Transform(yTransUpStr);
      P5.Transform(yTransUpStr);

      P2.Transform(yTransDownStr);
      P3.Transform(yTransDownStr);
      P6.Transform(yTransDownStr);
      P7.Transform(yTransDownStr);

      // Move all in x

      P0.Transform(xTransMinusX);
      P3.Transform(xTransMinusX);
      P7.Transform(xTransMinusX);
      P4.Transform(xTransMinusX);

      P1.Transform(xTransPlusX);
      P5.Transform(xTransPlusX);
      P2.Transform(xTransPlusX);
      P6.Transform(xTransPlusX);

      // Move all in z

      P4.Transform(zTrans);
      P5.Transform(zTrans);
      P6.Transform(zTrans);
      P7.Transform(zTrans);

      // Z If terrain is used, scale down Z to make sure all points are inside the domain
      // Zinter is call divisionsZ for CylDomain which is an int instead of an Interval

      if (terrainMesh.Faces.Count > 0)
      {
        this.hasTerrain = true;
      }

      // zInter is with respect to the CenterGround of the Plane
      if (hasTerrain)
      {
        double zMinTerrain = OFBaseDomain.GetZMinTerrain(terrainMesh, BBox, orientedPlane);

        var zTransTerrain = Transform.Translation((Math.Abs(zMinTerrain - centerBottomOfBuildings.Z)) * -Vector3d.ZAxis);

        P0.Transform(zTransTerrain);
        P1.Transform(zTransTerrain);
        P2.Transform(zTransTerrain);
        P3.Transform(zTransTerrain);

        MinHeightBBox = zMinTerrain;
      }

      // Update Dimensions now that we know the terrain

      Height_BBox = MaxHeightBBox - MinHeightBBox;

      IEnumerable<Point3d> Corners = new List<Point3d> { P0, P1, P2, P3, P4, P5, P6, P7 };
      SBox = new Box(orientedPlane, Corners);
      this.bp = SBox;

      // Compute dimension of simulation domain

      Width_SBox = Math.Abs(SBox.X.Max - SBox.X.Min);
      Length_SBox = Math.Abs(SBox.Y.Max - SBox.Y.Min);
      Height_SBox = Math.Abs(SBox.Z.Max - SBox.Z.Min);

      // Pick location in Mesh

      SetLocationInMesh(BuildingGeometry, scaleZ);

      // Add terrain to ground mesh if it exists
      if (hasTerrain)
      {
        this.TerrainMesh = terrainMesh;
        this.DomainMeshGround = terrainMesh;
      }
      else
      {
        double tolerance = 0.01;

        // Create ground meshes

        MeshingParameters mpGround = MeshingParameters.Default;

        // Inner Ground Mesh

        var plg1 = new Rectangle3d(orientedPlane, corners[0], corners[2]);

        DomainMeshGround = Utilities.ConvertToQuads(Mesh.CreateFromPlanarBoundary(plg1.ToNurbsCurve(), mpGround, tolerance));

        // 4 Surrounding Ground Meshes

        IEnumerable<Point3d> p2 = new List<Point3d> { P0, corners[0], corners[1], P1, P0 };
        var plg2 = new Rhino.Geometry.Polyline(p2);

        IEnumerable<Point3d> p3 = new List<Point3d> { P1, corners[1], corners[2], P2, P1 };
        var plg3 = new Rhino.Geometry.Polyline(p3);

        IEnumerable<Point3d> p4 = new List<Point3d> { P2, corners[2], corners[3], P3, P2 };
        var plg4 = new Rhino.Geometry.Polyline(p4);

        IEnumerable<Point3d> p5 = new List<Point3d> { P3, corners[3], corners[0], P0, P3, };
        var plg5 = new Rhino.Geometry.Polyline(p5);

        DomainMeshGroundPerim = new Mesh();
        DomainMeshGroundPerim.Append(Mesh.CreateFromPlanarBoundary(plg2.ToPolylineCurve(), mpGround, tolerance));
        DomainMeshGroundPerim.Append(Mesh.CreateFromPlanarBoundary(plg3.ToPolylineCurve(), mpGround, tolerance));
        DomainMeshGroundPerim.Append(Mesh.CreateFromPlanarBoundary(plg4.ToPolylineCurve(), mpGround, tolerance));
        DomainMeshGroundPerim.Append(Mesh.CreateFromPlanarBoundary(plg5.ToPolylineCurve(), mpGround, tolerance));
      }

      // Create final Mesh

      CellsAlongWidth = (int) ((Math.Abs(Width_SBox)) / blockDimension);
      CellsAlongLength = (int) ((Math.Abs(Length_SBox)) / blockDimension);
      CellsAlongHeight = (int) ((Math.Abs(Height_SBox)) / blockDimension);

      this.CenterGround = centerBottomOfBuildings;

      this.DomainMesh = Mesh.CreateFromBox(SBox, CellsAlongWidth, CellsAlongLength, CellsAlongHeight);

      // Show only intersection of domain and terrain

      IEnumerable<Mesh> first = new List<Mesh>() { DomainMesh };
      IEnumerable<Mesh> second = new List<Mesh>() { TerrainMesh };
      this.DomainMeshIntersection = Mesh.CreateBooleanIntersection(first, second);

      base.BCond = BCond;

      PressureCoeff BCondCP = new PressureCoeff(MaxHeightBuilding, BCond);
      BCondCP.SetUatBuildingHeight(MaxHeightBuilding, BCond);

      #region Trees

      this.Trees = Trees;

      #endregion Trees

      ToString();
    }

    private void SetLocationInMesh(Mesh BuildingGeo, double scaleZ)
    {
      var vec = new Vector3d(0, 0, 0.1 * scaleZ);
      var moveUP = Transform.Translation(vec);
      var bg = BuildingGeo.GetBoundingBox(true).GetCorners()[7];

      LocationInMesh = new Point3d(SBox.Center.X, SBox.Center.Y, bg.Z);
      LocationInMesh.Transform(moveUP);
    }

    private double RequiredInletArea(double FrontageFacadeArea)
    {
      // Required area for 3 % blocking ratio
      return 100 / 3 * (FrontageFacadeArea);
    }

    public override string ToString()
    {
      StringBuilder sb = new StringBuilder();

      sb.AppendLine(@"Building Geometries
        Width: " + Math.Round(this.Length_BBox, 0) + " m\n" +
        "Length: " + Math.Round(this.Width_BBox, 0) + " m\n" +
        "Height: " + Math.Round(this.Height_BBox, 0) + " m\n" + "Projected facade area: " + Math.Round(this.MaxFrontageBuildingArea) + " m^2");

      sb.AppendLine("\nBox Domain\n" +
        "Width: " + Math.Round(this.Width_SBox, 0) + " m\n" +
        "Length: " + Math.Round(this.Length_SBox, 0) + " m\n" +
        "Height: " + Math.Round(this.Height_SBox, 0) + " m\n" +
        "Cells along width: " + CellsAlongWidth + "\n" +
        "Cells along length: " + CellsAlongLength + "\n" +
        "Cells along height: " + CellsAlongHeight + "\n");

      this.info = sb.ToString();

      return sb.ToString();
    }
  }
# ---------- end c_script ----------
geo_2 = Geometry(c_script.B)
panel_2 = Panel(c_script.out)
rec = Rectangle(c_script.A)

# ----
# 2. Simulation Domain
domainbox = BoxShapedDomain(Geometry=cluster, Terrain=geo, BoundaryCondition=abl, BlockSize=20)  # -> Domain, Mesh

srf = Surface(<surface referenced from the Rhino model>)
tri = Triangulate(Mesh=srf)  # -> Mesh, Count
mesh = Mesh(tri.Mesh)
explode = MeshExplode(Mesh=mesh, Interpolate=False)
medges = MeshEdges(Mesh=mesh)  # -> NakedEdges, InteriorEdges, NonManifoldEdges
faceb = FaceBoundaries(Mesh=explode)
angle = Angle()  # -> Angle, Reflex
vec = VectorXYZ(XComponent=Slider(0, range=0..100), YComponent=Slider(0, range=0..100), ZComponent=Slider(-1, range=-1..1))  # -> Vector, Length
vec_2 = VectorXYZ(XComponent=Slider(0, range=0..100), YComponent=Slider(0, range=0..100), ZComponent=Slider(1, range=-1..1))  # -> Vector, Length
disc = Discontinuity(Curve=faceb, Level=1)  # -> Points, Parameters
custom_mesh_settings = SettingsCustom(
    StitchSeams=True,
    SimplePlanes=False,
    Refine=True,
    MinCount=16,
    MaxCount=400,
    AspectRatio=20,
    MaxDistance=0,
    MaxAngle=20,
    MinEdge=0,
    MaxEdge="1")
lng = ListLength(List=disc.Points)
equals = Equality(FirstNumber=lng, SecondNumber="3")  # -> Equality, Inequality
brep = Brep(<brep referenced from the Rhino model>)

# ----
# 4. Probing points & probing
number_slider = Slider(5, range=1..30)
brep_2 = Brep(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)
brep_3 = Brep(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)
panel_3 = Panel("ttt")
button = Button()
meshplane = MeshPlane(brep=brep, number=number_slider)
probing = Probing(BuildingMesh=cluster, Points=meshplane)

mesh_2 = MeshBrep(Brep=brep, Settings=custom_mesh_settings)
demesh = DeconstructMesh(Mesh=mesh_2)  # -> Vertices, Faces, Colours, Normals
c_script_2 = CSharpScript(x=vec_2.Vector, y=vec.Vector)  # -> out, A; inputs x: Vector3d, y: Vector3d
# ---------- c_script_2: C# ----------
    string str_error2 = "";
    
    A = Angle_3D(x, y, out str_error2);
# ---------- c_script_2: C# additional code ----------
  public static double Angle_3D(Vector3d A, Vector3d B, out string str_error)
  {
    
    str_error = "";
    //IL_0038: Unknown result type (might be due to invalid IL or missing references)
    //IL_0039: Unknown result type (might be due to invalid IL or missing references)
    if (!((Vector3d)( A)).Unitize())
    {
      str_error = "First vector is zero-length";
      return double.NaN;
    }
    if (!((Vector3d)( B)).Unitize())
    {
      str_error = "Second vector is zero-length";
      return double.NaN;
    }
    return Math.Acos(Math.Max(Math.Min(A * B, 1.0), -1.0));
  }
# ---------- end c_script_2 ----------
cull = CullPattern(List=lng, CullPattern=equals.Equality)
mesh_3 = Mesh(brep)
tri_2 = Triangulate(Mesh=mesh_3)  # -> Mesh, Count
c_script_3 = CSharpScript(m=tri_2.Mesh)  # -> out, flatten(Flow), Cent, Norm; inputs m: Mesh, U: list of Vector3d
# ---------- c_script_3: C# ----------
    var faces = m.Faces;
    var faceNormals = m.FaceNormals;

    var flows = new double[m.Faces.Count];
    var normals = new Vector3d[m.Faces.Count];
    var centers = new Point3d[m.Faces.Count];

    m.FaceNormals.ComputeFaceNormals();



    for (int mf_id = 0; mf_id < m.Faces.Count; mf_id++){

      //get points into a nice, concise format


      Point3d[] pts = new Point3d[4];
      pts[0] = m.Vertices[m.Faces[mf_id].A];
      pts[1] = m.Vertices[m.Faces[mf_id].B];
      pts[2] = m.Vertices[m.Faces[mf_id].C];
      if (m.Faces[mf_id].IsQuad)
      {
        pts[3] = m.Vertices[m.Faces[mf_id].D];
      }



      var avgVec = new Vector3d();
      var center = new Point3d();

      if (m.Faces[mf_id].IsQuad){


        avgVec = AverageVectors(new List<Vector3d> (){U[m.Faces[mf_id].A], U[m.Faces[mf_id].B], U[m.Faces[mf_id].C], U[m.Faces[mf_id].D]});
        center = AveragePoints(new List<Point3d >(){  pts[0], pts[1],    pts[2], pts[3]});
      }

      else{

        avgVec = AverageVectors(new List<Vector3d> (){U[m.Faces[mf_id].A], U[m.Faces[mf_id].B], U[m.Faces[mf_id].C]});
        center = AveragePoints(new List<Point3d >(){  pts[0], pts[1],    pts[2]});

      }
      string error = "";





      var angleBetween = Angle_3D(avgVec, m.FaceNormals[mf_id], out error);


      centers[mf_id] = center;
      normals[mf_id] = avgVec;
      flows[mf_id] = MeshFaceArea(mf_id, m) * Math.Cos(angleBetween);



    }




    Flow = flows;


    Cent = centers;
    Norm = normals;
# ---------- c_script_3: C# additional code ----------
  public static double Angle_3D(Vector3d A, Vector3d B, out string str_error)
  {

    str_error = "";
    //IL_0038: Unknown result type (might be due to invalid IL or missing references)
    //IL_0039: Unknown result type (might be due to invalid IL or missing references)
    if (!((Vector3d) ( A)).Unitize())
    {
      str_error = "First vector is zero-length";
      return double.NaN;
    }
    if (!((Vector3d) ( B)).Unitize())
    {
      str_error = "Second vector is zero-length";
      return double.NaN;
    }
    return Math.Acos(Math.Max(Math.Min(A * B, 1.0), -1.0));
  }

  public static double MeshFaceArea(int meshfaceindex, Mesh m)
  {
    //get points into a nice, concise format
    Point3d[] pts = new Point3d[4];
    pts[0] = m.Vertices[m.Faces[meshfaceindex].A];
    pts[1] = m.Vertices[m.Faces[meshfaceindex].B];
    pts[2] = m.Vertices[m.Faces[meshfaceindex].C];
    if (m.Faces[meshfaceindex].IsQuad)
    {
      pts[3] = m.Vertices[m.Faces[meshfaceindex].D];
    }

    //calculate areas of triangles
    double a = pts[0].DistanceTo(pts[1]);
    double b = pts[1].DistanceTo(pts[2]);
    double c = pts[2].DistanceTo(pts[0]);
    double p = 0.5 * (a + b + c);
    double area1 = Math.Sqrt(p * (p - a) * (p - b) * (p - c));

    //if quad, calc area of second triangle
    double area2 = 0;
    if (m.Faces[meshfaceindex].IsQuad)
    {
      a = pts[0].DistanceTo(pts[2]);
      b = pts[2].DistanceTo(pts[3]);
      c = pts[3].DistanceTo(pts[0]);
      p = 0.5 * (a + b + c);
      area2 = Math.Sqrt(p * (p - a) * (p - b) * (p - c));
    }

    return area1 + area2;
  }

  public static Vector3d AverageVectors (List<Vector3d> list){

    Vector3d val3 = Vector3d.Zero;
    int num9 = 0;
    int num10 = list.Count - 1;
    for (int m = 0; m <= num10; m++)
    {
      if (list[m] != null)
      {
        val3 += list[m];
        num9++;
      }
    }
    // if (num9 != 0)
    // {
    return (val3 / (double) num9);
    //}


  }

  public static Point3d AveragePoints (List<Point3d> list){

    Point3d val2 = Point3d.Origin;
    int num7 = 0;
    int num8 = list.Count - 1;
    for (int l = 0; l <= num8; l++)
    {
      if (list[l] != null)
      {
        val2 += list[l];
        num7++;
      }
    }
    //if (num7 != 0)
    // {
    return (val2 / (double) num7);
    //  }


  }
# ---------- end c_script_3 ----------
vdis = VectorDisplay(Anchor=c_script_3.Cent, Vector=c_script_3.Norm)
demesh_2 = DeconstructMesh(Mesh=tri_2.Mesh)  # -> flatten(Vertices), Faces, Colours, Normals
probing_2 = Probing(NameOfField=0, Run=False, Culling=False)  # -> PorbingPoints, ProbingResult
panel_4 = Panel(c_script_3.Flow)
E = CleanEmpty(True)
cos = Cosine(Value=c_script_2.A)
quad = Quadrangulate(Mesh=mesh_3, Angle=0.03490658504, Ratio=0.875)  # -> Mesh, Count
clean = CleanTree(Data=cull, CleanInvalid=True, CleanEmpty=E)
flow_rates = FlowRates(Mesh=mesh_3)  # -> Result, Min, Max
panel_5 = Panel(cos)
avr = Average()
avr_2 = Average()
tstat = TreeStatistics(Tree=clean)  # -> Paths, Length, Count
lng_2 = ListLength(List=tstat.Paths)
vdis_2 = VectorDisplay(Anchor=avr, Vector=avr_2)
panel_6 = Panel(lng_2)

# ----
# 5. Post-processing
# 5.1. Paraview
# 5.2. Grasshopper
# Wind vectors
points = Data()
vectors = Data()
cluster_2 = Cluster(data=vectors)  # -> S, E, data_3
gradient = Gradient(
    LowerLimit=cluster_2.S,
    UpperLimit=Slider(5, range=0..10),
    Parameter=cluster_2.data_3,
    stops=[0.103: RGB(0, 0, 255), 0.22: RGB(0, 170, 255), 0.305: RGB(0, 255, 255), 0.398: RGB(0, 255, 188), 0.504: RGB(0, 255, 106), 0.605: RGB(91, 255, 0), 0.699: RGB(184, 255, 0), 0.799: RGB(255, 255, 0), 0.898: RGB(255, 170, 0)])
vdisex = VectorDisplayEx(Point=points, Vector=vectors, Colour=gradient, Width=Slider(2, range=0..10))

ma = MassAddition(Input=panel_4)  # -> flatten(Result), PartialResults
panel_7 = Panel(ma.Result)

# ----
# 3. Mesh & Simulation
panel_8 = Panel("3")
panel_9 = Panel("C:\3_SimpleWindAnalysis")
panel_10 = Panel("100")
button_2 = Button()
rset = RunSettings(
    NumberOfIterations=1000,
    WriteInterval=20,
    NumberOfTimestepsToKeep=3,
    TurbulenceModel=1,
    RelaxationFactors=3,
    SolutionAndAlgorithmControl=1,
    PotentialFoamInitialization=False,
    AgeOfAir=False,
    NumberOfCPUs="-1",
    OperatingSystem=0)

mset = MeshSettings(AccBuilding=2, AccFeatures=panel_8, AccBBox=0, AccGround=panel_8, MiscSettings=1, NumberOfLayers=4, Mode=2)

simulation = Simulation(
    SimulationDomain=domainbox.Domain,
    WorkingDirectory=panel_9,
    MeshSettings=mset,
    RunSettings=rset,
    RunMeshing=button_2,
    MakeTrees=False,
    RunSimulation=button_2,
    runWithBlueCFD=True)
residuals = Residuals(Result=simulation, X=":", Y=":", Version=1, Run=Button(), visResiduals=True)

# ----
# 6. Clean
button_3 = Button()
clean_2 = Clean(Directory=panel_9, Mode=2, Run=button_3)

paraview = Paraview(Result=simulation, ParaviewVersion=2, Run=Button())

# ==== cluster MeshPlane
number = ClusterInput()
number_2 = Number(number)
settings_custom = SettingsCustom(
    StitchSeams=True,
    SimplePlanes=False,
    Refine=True,
    MinCount=16,
    MaxCount=400,
    AspectRatio=20,
    MaxDistance=0,
    MaxAngle=20,
    MinEdge=number_2,
    MaxEdge=number_2)
brep = ClusterInput()
mesh_brep = MeshBrep(Brep=brep, Settings=settings_custom)
deconstruct_mesh = DeconstructMesh(Mesh=mesh_brep)  # -> Vertices, Faces, Colours, Normals
vertices = ClusterOutput(deconstruct_mesh.Vertices)

# ==== cluster Cluster
data = ClusterInput()
data_2 = Data(data)
data_3 = ClusterOutput(data_2)
bnd = Bounds(Numbers=data_2)
dedomain = DeconstructDomain(Domain=bnd)  # -> Start, End
S = ClusterOutput(dedomain.Start)
E = ClusterOutput(dedomain.End)

# ==== cluster Cluster_2
geo = Geometry([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])
mesh = Mesh(geo)
mjoin = MeshJoin(Meshes=mesh)
M = ClusterOutput(mjoin)
