# Grasshopper definition 3_SimpleWindAnalysisCylDomain.ghx (Grasshopper 1.0.8)
# plug-ins: Eddy3D

templates = Templates()

# ----
# 1. Geometry &
# Boundary Conditions
abl = ABL(WDir=Slider(270, range=0..359), Uref=5, Zref=10, Z0=1, ZGround=0)

# ----
# 2. Simulation Domain
cluster = Cluster_2()
circle = Circle(Plane=PlaneXY(0, 0, 0), Radius=Slider(150, range=0..1000))
unit_z = UnitZ(Factor=Slider(2, range=0..10))
cylindrical_domain = CylindricalDomain(Geometry=cluster, BoundaryCondition=abl, BlockSize=20, RadialMultiplier=2, DivisionsX=1)  # -> Domain, Mesh
move = Move(Geometry=circle, Motion=unit_z)  # -> Geometry, Transform
brep = Brep(move.Geometry)

# ----
# 4. Probing points & probing
panel = Panel("ttt")
mjoin = MeshJoin(Meshes=cluster)

probing = Probing(BuildingMesh=mjoin, GroundMesh=brep, TargetCount=Slider(5000, range=0..10000), ConvertQuadsToTriangles=True)
demesh = DeconstructMesh(Mesh=probing)  # -> Vertices, Faces, Colours, Normals

# ----
# 3. Mesh & Simulation
panel_2 = Panel("C:\Eddy3D-Cases\3_SimpleWindAnalysis")
rset = RunSettings(
    NumberOfIterations="500",
    WriteInterval=20,
    NumberOfTimestepsToKeep=3,
    TurbulenceModel=3,
    RelaxationFactors=0,
    SolutionAndAlgorithmControl=1,
    PotentialFoamInitialization=False,
    AgeOfAir=False,
    NumberOfCPUs="-1",
    OperatingSystem=0)

mset = MeshSettings(AccBuilding=Slider(4, range=0..10), AccFeatures="2", AccBBox=0, AccGround="2", MiscSettings=1, NumberOfLayers=4, Mode=2)

simulation = Simulation(
    SimulationDomain=cylindrical_domain.Domain,
    WorkingDirectory=panel_2,
    MeshSettings=mset,
    RunSettings=rset,
    RunMeshing=Button(),
    MakeTrees=False,
    RunSimulation=Button(),
    runWithBlueCFD=True)

residuals = VisualizeResiduals(Result=simulation, X=":", Y=":", Version=0, Run=Button(), visResiduals=True)
probing_2 = Probing(
    Result=simulation,
    ProbingPoints=demesh.Vertices,
    NameOfInstance=panel,
    InterpolationScheme=3,
    NameOfField=0,
    Run=Button())  # -> ProbingPoints, ProbingResult

# ----
# 5. Post-processing
# 5.1. Paraview
# 5.2. Grasshopper
# Wind vectors
points = Data(probing_2.ProbingPoints)
vectors = Data(probing_2.ProbingResult)
cluster_2 = Cluster(data=vectors)  # -> S, E, data_3
gradient = Gradient(
    LowerLimit=cluster_2.S,
    UpperLimit=Slider(5, range=0..10),
    Parameter=cluster_2.data_3,
    stops=[0.103: RGB(0, 0, 255), 0.22: RGB(0, 170, 255), 0.305: RGB(0, 255, 255), 0.398: RGB(0, 255, 188), 0.504: RGB(0, 255, 106), 0.605: RGB(91, 255, 0), 0.699: RGB(184, 255, 0), 0.799: RGB(255, 255, 0), 0.898: RGB(255, 170, 0)])
vdisex = VectorDisplayEx(Point=points, Vector=vectors, Colour=gradient, Width=Slider(4, range=0..10))

# ----
# 6. Clean
button = Button()
clean = Clean(Directory=panel_2, Mode=2, Run=button)

paraview = Paraview(Result=simulation, ParaviewVersion=1, Run=Button())

# ==== cluster Cluster
data = ClusterInput()
data_2 = Data(data)
data_3 = ClusterOutput(data_2)
bnd = Bounds(Numbers=data_2)
dedomain = DeconstructDomain(Domain=bnd)  # -> Start, End
S = ClusterOutput(dedomain.Start)
E = ClusterOutput(dedomain.End)

# ==== cluster Cluster_2
geo = Geometry([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])
mesh = Mesh(geo)
mjoin = MeshJoin(Meshes=mesh)
M = ClusterOutput(mjoin)
