# Grasshopper definition 3_SimpleWindAnalysisWithTree.ghx (Grasshopper 1.0.7)
# plug-ins: Eddy3D

# ----
# 1. Geometry &
# Boundary Conditions
panel = Panel("0")
abl = ABL(WDir=panel, Uref=5, Zref=10, Z0=1, ZGround=0)

cluster = Cluster_2()
cluster_2 = Cluster_2()
cluster_3 = Cluster_3(G=cluster)
geo = Geometry(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)
geo_2 = Geometry(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)
geo_3 = Geometry([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])
tree = Tree(Geo=geo, Type="dense")
tree_2 = Tree(Geo=geo_2, Type="medium")
tree_3 = Tree(Geo=geo_3, Type="dense")
relay = Relay([cluster_2, cluster_3])

# ----
# 2. Simulation Domain
domainbox = BoxShapedDomain(Geometry=relay, Trees=[tree, tree_2, tree_3], BoundaryCondition=abl, BlockSize=20)  # -> Domain, Mesh

mjoin = MeshJoin(Meshes=relay)

# ----
# 3. Mesh & Simulation
panel_2 = Panel("C:\3_SimpleWindAnalysisWithTree")
rset = RunSettings(
    NumberOfIterations="1500",
    WriteInterval=20,
    NumberOfTimestepsToKeep=3,
    TurbulenceModel=1,
    RelaxationFactors=3,
    SolutionAndAlgorithmControl=1,
    PotentialFoamInitialization=False,
    AgeOfAir=False,
    NumberOfCPUs="-1",
    OperatingSystem=0)

mset = MeshSettings(AccBuilding=2, AccFeatures="3", AccBBox="3", AccGround="3", MiscSettings=1, NumberOfLayers=4, Mode=2)

simulation = Simulation(
    SimulationDomain=domainbox.Domain,
    WorkingDirectory=panel_2,
    MeshSettings=mset,
    RunSettings=rset,
    RunMeshing=Button(),
    MakeTrees=Button(),
    RunSimulation=Button(),
    runWithBlueCFD=True)
residuals = Residuals(Result=simulation, X=":", Y=":", Version=1, Run=Button(), visResiduals=True)

# ----
# 4. Probing points & probing
number_slider = Slider(2, range=1..30)
brep = Brep(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)
brep_2 = Brep(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)
meshplane = MeshPlane(brep=brep_2, number=number_slider)
probing = Probing(BuildingMesh=mjoin, Points=meshplane)
visprobes = VisualizeProbes(Result=simulation, ProbingPoints=probing, NameOfInstance="ttt", NameOfField=0, Run=Button())  # -> PorbingPoints, ProbingResult

mesh = Mesh(brep_2)
c_script = CSharpScript(GroundPlane=mesh, Buildings=relay, MeshSize=Slider(2, range=0..10))  # -> out, Msh; inputs GroundPlane: Mesh, Buildings: list of Mesh, MeshSize: Double
# ---------- c_script: C# usings ----------
using Grasshopper.Kernel.Geometry;

using Rhino.Collections;



using System.IO;
using System.Linq;
using System.Text;
using System.Text.RegularExpressions;
# ---------- c_script: C# ----------
    
    
    
    
    var JoinedBuildings = new Mesh();
    
    foreach(Mesh m in Buildings){
      
      
      JoinedBuildings.Append(m); 
    }


    Line[] l = Rhino.Geometry.Intersect.Intersection.MeshMeshFast(JoinedBuildings, GroundPlane);







    var planeNE = GetNakedEdgesLines(GroundPlane);





    var  allLines = new Line[l.Length + planeNE.Count];
    l.CopyTo(allLines, 0);
    planeNE.CopyTo(allLines, l.Length);

    var allCurves = new Curve[allLines.Length];
    var allCurves_GH = new List<GH_Curve>();

    for (int i = 0; i < allLines.Length;i++){

      allCurves[i] = NurbsCurve.CreateFromLine(allLines[i]);

      var target = new GH_Curve();
      GH_Convert.ToGHCurve(allCurves[i], GH_Conversion.Both, ref target);


      allCurves_GH.Add(target);



    }





    CurveList data = GetData(allCurves_GH);
    Brep[] Surfaces = Compute(data, 1);
    //var JoinedBrep = Brep.JoinBreps(Surfaces, 1);




    MeshingParameters mp = new MeshingParameters();
    mp.MaximumEdgeLength = MeshSize;
    mp.MinimumEdgeLength = MeshSize;




    var ResultingMesh = Mesh.CreateFromBrep(Surfaces[0], mp);

    Msh = ResultingMesh;
# ---------- c_script: C# additional code ----------
  public static List<Line> GetNakedEdgesLines(Mesh val){

    List<Line> list = new List<Line>();
    checked
    {
      int num = val.TopologyEdges.Count - 1;
      for (int i = 0; i <= num; i++)
      {
        if (!val.TopologyEdges.IsNgonInterior(i))
        {
          Line val2 = val.TopologyEdges.EdgeLine(i);
          switch (val.TopologyEdges.GetConnectedFaces(i).Length)
          {
            case 0:
              //AddRuntimeMessage((GH_RuntimeMessageLevel) 10, "An isolated edge was found in this mesh");
              break;
            case 1:
              Line b = new Line(val2.From, val2.To);
              list.Add(b);

              break;
          }
        }
      }
    }
    return list;
  }


  private Polyline ToPolyline(Curve curve, double DocumentTolerance)
  {
    //IL_000a: Unknown result type (might be due to invalid IL or missing references)
    //IL_000f: Unknown result type (might be due to invalid IL or missing references)
    //IL_0053: Unknown result type (might be due to invalid IL or missing references)
    //IL_0054: Unknown result type (might be due to invalid IL or missing references)
    //IL_0094: Unknown result type (might be due to invalid IL or missing references)
    //IL_009b: Expected O, but got Unknown
    //IL_00af: Unknown result type (might be due to invalid IL or missing references)
    //IL_00c4: Unknown result type (might be due to invalid IL or missing references)
    //IL_00ce: Expected O, but got Unknown
    if (curve == null)
    {
      return null;
    }
    Rhino.Geometry.Plane worldXY = Rhino.Geometry.Plane.WorldXY;
    if (!curve.TryGetPlane(out worldXY, 2.0 * DocumentTolerance))
    {
      return null;
    }
    Polyline val = null;
    if (!curve.TryGetPolyline(out val))
    {
      return null;
    }
    if (!val.IsClosed)
    {
      return null;
    }
    ((Point3dList) val).Transform(Transform.PlanarProjection(worldXY));
    val.ReduceSegments(0.1 * DocumentTolerance);
    if (val.SegmentCount < 3)
    {
      return null;
    }
    if (val.SegmentCount > 4)
    {
      return null;
    }
    List<int> list = new List<int>();
    Node2List val2 = (Node2List) (object) new Node2List();
    checked
    {
      int num = ((RhinoList<Point3d>) (object) val).Count - 2;
      double num2 = default(double);
      double num3 = default(double);
      for (int i = 0; i <= num; i++)
      {
        ((Rhino.Geometry.Plane) (worldXY)).ClosestParameter(((RhinoList<Point3d>) (object) val)[i], out num2, out num3);
        val2.Append((Node2) (object) new Node2(num2, num3));
      }

      //if (!Solver.Compute(val2, list))
      //{
      //	return null;
      //}
      if (list.Count != val.SegmentCount)
      {
        return null;
      }
      return val;
    }
  }

  private Brep[] Compute(CurveList edges, double DocumentTolerance)
  {
    //IL_003f: Unknown result type (might be due to invalid IL or missing references)
    //IL_0046: Unknown result type (might be due to invalid IL or missing references)
    //IL_004d: Unknown result type (might be due to invalid IL or missing references)
    //IL_006f: Unknown result type (might be due to invalid IL or missing references)
    //IL_0076: Unknown result type (might be due to invalid IL or missing references)
    //IL_007d: Unknown result type (might be due to invalid IL or missing references)
    //IL_0084: Unknown result type (might be due to invalid IL or missing references)
    if (((RhinoList<Curve>) (object) edges).Count == 0)
    {
      return null;
    }
    if (((RhinoList<Curve>) (object) edges).Count == 1)
    {
      Polyline val = ToPolyline(((RhinoList<Curve>) (object) edges)[0], DocumentTolerance);
      if (val != null)
      {
        switch (val.SegmentCount)
        {
          case 3:
          {
            Brep val3 = Brep.CreateFromCornerPoints(((RhinoList<Point3d>) (object) val)[0], ((RhinoList<Point3d>) (object) val)[1], ((RhinoList<Point3d>) (object) val)[2], DocumentTolerance);
            if (val3 != null)
            {
              return (Brep[]) (object) new Brep[1]
                {
                val3
                };
            }
            break;
          }
          case 4:
          {
            Brep val2 = Brep.CreateFromCornerPoints(((RhinoList<Point3d>) (object) val)[0], ((RhinoList<Point3d>) (object) val)[1], ((RhinoList<Point3d>) (object) val)[2], ((RhinoList<Point3d>) (object) val)[3], DocumentTolerance);
            if (val2 != null)
            {
              return (Brep[]) (object) new Brep[1]
                {
                val2
                };
            }
            break;
          }
        }
      }
    }
    return Brep.CreatePlanarBreps(edges, DocumentTolerance);
  }

  private CurveList GetData(List<GH_Curve> list)
  {
    //IL_0027: Unknown result type (might be due to invalid IL or missing references)
    //IL_002d: Expected O, but got Unknown

    CurveList val = (CurveList) (object) new CurveList();
    foreach (GH_Curve item in list)
    {
      if (item != null && item.Value != null)
      {
        ((RhinoList<Curve>) (object) val).Add(item.Value);
      }
    }

    //if (((RhinoList<Curve>)(object)val).Count == 0)
    //{
    //	((GH_ActiveObject)this).AddRuntimeMessage((GH_RuntimeMessageLevel)10, "All curves failed to load");
    //	return null;
    //}
    return val;
  }
# ---------- end c_script ----------
geo_4 = Geometry(c_script.Msh)
del = DelaunayMesh(Points=probing, Plane=PlaneXY(0, 0, 0))
demesh = DeconstructMesh(Mesh=del)  # -> Vertices, Faces, Colours, Normals

# ----
# 5. Post-processing
# 5.1. Paraview
# 5.2. Grasshopper
# Wind vectors
points = Data(visprobes.PorbingPoints)
vectors = Data(visprobes.ProbingResult)
cluster_4 = Cluster(data=vectors)  # -> S, E, data_3
gradient = Gradient(
    LowerLimit=cluster_4.S,
    UpperLimit=Slider(5, range=0..10),
    Parameter=cluster_4.data_3,
    stops=[0.103: RGB(0, 0, 255), 0.22: RGB(0, 170, 255), 0.305: RGB(0, 255, 255), 0.398: RGB(0, 255, 188), 0.504: RGB(0, 255, 106), 0.605: RGB(91, 255, 0), 0.699: RGB(184, 255, 0), 0.799: RGB(255, 255, 0), 0.898: RGB(255, 170, 0)])
vdisex = VectorDisplayEx(Point=points, Vector=vectors, Colour=gradient, Width=Slider(2, range=0..10))

conmesh = ConstructMesh(Vertices=demesh.Vertices, Faces=demesh.Faces, Colours=gradient)

# ----
# 6. Clean
button = Button()
clean = Clean(Directory=panel_2, Mode=2, Run=button)

paraview = Paraview(Result=simulation, ParaviewVersion=2, Run=Button())

# ==== cluster MeshPlane
number = ClusterInput()
number_2 = Number(number)
settings_custom = SettingsCustom(
    StitchSeams=True,
    SimplePlanes=False,
    Refine=True,
    MinCount=16,
    MaxCount=400,
    AspectRatio=20,
    MaxDistance=0,
    MaxAngle=20,
    MinEdge=number_2,
    MaxEdge=number_2)
brep = ClusterInput()
mesh_brep = MeshBrep(Brep=brep, Settings=settings_custom)
deconstruct_mesh = DeconstructMesh(Mesh=mesh_brep)  # -> Vertices, Faces, Colours, Normals
vertices = ClusterOutput(deconstruct_mesh.Vertices)

# ==== cluster Cluster
data = ClusterInput()
data_2 = Data(data)
data_3 = ClusterOutput(data_2)
bnd = Bounds(Numbers=data_2)
dedomain = DeconstructDomain(Domain=bnd)  # -> Start, End
S = ClusterOutput(dedomain.Start)
E = ClusterOutput(dedomain.End)

# ==== cluster Cluster_2
geo = Geometry([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])
mesh = Mesh(geo)
mjoin = MeshJoin(Meshes=mesh)
M = ClusterOutput(mjoin)

# ==== cluster Cluster_3
X = UnitX(Factor="150")
G = ClusterInput()
move = Move(Geometry=G, Motion=X)  # -> Geometry, Transform
G_2 = ClusterOutput(move.Geometry)
