# Grasshopper definition 4_AnnualWindAnalysis.gh (Grasshopper 1.0.7)
# plug-ins: VirtualWindTunnel

# ----
# 1. Geometry &
# Boundary Conditions
panel = Panel("C:\DIVA\WeatherData\USA_IL_Chicago-OHare.Intl.AP.725300_TMY3.epw")
panel_2 = Panel("""0
45
90
135
180
225
270
315""")
geo = Geometry([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])
abl = ABL(WDir=panel_2, Uref="10", Zref=10, Z0=1, ZGround=0, Epw=panel)

# ----
# 2. Simulation Domain
number_slider = Slider(50, range=0..1000)
domaincyl = CylindricalDomain(
    Geometry=geo,
    BCond=abl,
    BlockSize="10",
    SizeOfInnerRectangle=number_slider,
    SizeOfOuterRadius=Slider(300, range=0..1000),
    Height=Slider(80, range=0..1000))  # -> Domain, Mesh, Div

# ----
# 3. Mesh & Simulation
panel_3 = Panel("100")
mset = MeshSettings(AccBuilding=2, AccFeatures="3", AccRefinement=0, AccGround=2, NLayer=3, Mode=1)
rset = RunSettings(
    Iterations=panel_3,
    WriteInterval=20,
    KeepTimeSteps=2,
    Turbulence=1,
    RelaxationFactors=0,
    Mode=0,
    CPUs="4",
    OperationSystem=0)
simulation = Simulation(
    SimulationDomain=domaincyl.Domain,
    WorkingDirectory="C:\test_cyl_prec",
    MeshSettings=mset,
    RunSettings=rset,
    RunMeshing=Button(),
    RunSimulation=Button(),
    runWithBlueCFD=True)
residuals = Residuals(Res=simulation, Sel=panel_2, X=":", Y=":", Version=0, Run=Button(), visResiduals=True)

# ----
# 4. Probing points & probing
number_slider_2 = Slider(6, range=1..50)
brep = Brep(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)
meshplane = MeshPlane(brep=brep, number=number_slider_2)  # -> vertices, faces
point = Point(meshplane.vertices)
visprobes = VisualizeProbes(Res=simulation, Points=point, Name="cyl", Field=0, Run=Button(), Culling=True)  # -> Points, Result

# ----
# 6. Clean
button = Button()
clean = Clean(Directory="C:\test_cyl", Mode=1, Run=button)

circle = CircleCNR(Center=visprobes.Points, Normal=Vector(0, 0, 1), Radius=2)
srf = Surface(circle)

# ----
# 5. Post-processing
# 5.1. Paraview
# Multi-directional / annual wind vectors
# 5.2. Grasshopper
# 5.3. Grasshopper
# Pedestrian wind comfort
button_2 = Button()
dir = Slider(0, range=0..7)
points = Data(visprobes.Points)
vectors = Data(visprobes.Result)
paraview = Paraview(Res=simulation, Dirs=panel_2, Version=1, Run=button_2)
choose_dir = TreeBranch(Tree=vectors, Path=dir, MaintainPaths=True)
windfactors = WindFactors(Result=simulation, ProbingPoints=visprobes.Points, U=visprobes.Result, Run=Button(), Interpolation=False)  # -> WindFactors, PedestrianComfort, OffSet
cluster = Cluster(data=choose_dir)  # -> S, E, data_3
gradient = Gradient(
    LowerLimit=cluster.S,
    UpperLimit=Slider(5, range=0..10),
    Parameter=cluster.data_3,
    stops=[0.103: RGB(0, 0, 255), 0.22: RGB(0, 170, 255), 0.305: RGB(0, 255, 255), 0.398: RGB(0, 255, 188), 0.504: RGB(0, 255, 106), 0.605: RGB(91, 255, 0), 0.699: RGB(184, 255, 0), 0.799: RGB(255, 255, 0), 0.898: RGB(255, 170, 0)])
vdisex = VectorDisplayEx(Point=points, Vector=choose_dir, Colour=gradient, Width=Slider(3, range=0..10))

dedata = DeconstructData(Data=windfactors.WindFactors)
flip = FlipMatrix(Data=dedata)
avr = Average(Input=flip)  # -> flatten(ArithmeticMean)

cluster_2 = Cluster(data=avr)  # -> S, E, data_3
gradient_2 = Gradient(
    LowerLimit=cluster_2.S,
    UpperLimit=cluster_2.E,
    Parameter=cluster_2.data_3,
    stops=[0.103: RGB(0, 0, 255), 0.22: RGB(0, 170, 255), 0.305: RGB(0, 255, 255), 0.398: RGB(0, 255, 188), 0.504: RGB(0, 255, 106), 0.605: RGB(91, 255, 0), 0.699: RGB(184, 255, 0), 0.799: RGB(255, 255, 0), 0.898: RGB(255, 170, 0)])

choose_dir_2 = TreeBranch(Tree=flip, Path=Slider(0, range=0..10000), MaintainPaths=True)
graph = QuickGraph(choose_dir_2, SortOrder=0)
preview = CustomPreview(Geometry=srf, Material=gradient_2)

# ==== cluster MeshPlane
number = ClusterInput()
number_2 = Number(number)
settings_custom = SettingsCustom(
    StitchSeams=True,
    SimplePlanes=False,
    Refine=True,
    MinCount=16,
    MaxCount=400,
    AspectRatio=20,
    MaxDistance=0,
    MaxAngle=20,
    MinEdge=number_2,
    MaxEdge=number_2)
brep = ClusterInput()
mesh_brep = MeshBrep(Brep=brep, Settings=settings_custom)
deconstruct_mesh = DeconstructMesh(Mesh=mesh_brep)  # -> Vertices, Faces, Colours, Normals
faces = ClusterOutput(deconstruct_mesh.Faces)
vertices = ClusterOutput(deconstruct_mesh.Vertices)

# ==== cluster Cluster
data = ClusterInput()
data_2 = Data(data)
data_3 = ClusterOutput(data_2)
bnd = Bounds(Numbers=data_2)
dedomain = DeconstructDomain(Domain=bnd)  # -> Start, End
S = ClusterOutput(dedomain.Start)
E = ClusterOutput(dedomain.End)
