# Grasshopper definition 4_AnnualWindAnalysis.ghx (Grasshopper 1.0.7)
# plug-ins: Eddy3D

panel = Panel("C:\Users\pkastner\Documents\GitHub\HoboPlot\GameFarmRoad_2019.epw")
panel_2 = Panel("https://energyplus.net/weather-download/europe_wmo_region_6/DEU//DEU_Munich.108660_IWEC/DEU_Munich.108660_IWEC.epw")
gfr_unique_dirs = Panel("""157
162
169
272
281
299
311
313
325
327""")
gfr_unique_dirs_2 = Panel("""136
138
141
145
147
148
149
150
152
153
154
156""")
data = Data([gfr_unique_dirs_2, gfr_unique_dirs])

# ----
# 1. Geometry &
# Boundary Conditions
panel_3 = Panel("""0
22
45
90
135
180
225
270
315""")
geo = Geometry([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])
abl = ABL(WDir=data, Uref="2", Zref=10, Z0=1, ZGround=0, Epw=panel)

cluster = Cluster_2(mesh=geo)
# 5. Post-processing
# 5.1. Paraview
# 5.2. Grasshopper
button = Button()
dir = Slider(2, range=0..7)
# 5.3. Grasshopper
button_2 = Button()
panel_4 = Panel("55")  # disabled
panel_5 = Panel("-1")  # disabled
number_slider = Slider(3, range=0..10)  # disabled
number_slider_2 = Slider(6072, range=0..8760)  # disabled
avr = Average()  # -> flatten(ArithmeticMean); disabled
panel_6 = Panel("""3.6 
5.3 
7.6 
9.8 
9.8 
15.1""")  # disabled

# ----
# 2. Simulation Domain
number_slider_3 = Slider(50, range=0..1000)

domaincyl = CylindricalDomain(
    Geometry=geo,
    BoundaryCondition=abl,
    BlockSize="10",
    SizeOfInnerRectangle=number_slider_3,
    SizeOfOuterRadius=Slider(300, range=0..1000),
    Height=Slider(80, range=0..1000))  # -> Domain, Mesh

cellsize = CellSize(SimulationDomain=domaincyl.Domain, BlockSize="10", DesiredCellSize=Slider(3, range=0..10))

# ----
# 3. Mesh & Simulation
panel_7 = Panel("C:\4_AnnualWindAnalysis")
mset = MeshSettings(AccBuilding=cellsize, AccFeatures=cellsize, AccRefinement=0, AccGround=cellsize, NLayer=3, Mode=1, Mode_2=1)

downloadepw = CSharpScript(epwURL=panel_2, folder=panel_7, download=Button())  # -> path; inputs epwURL: String, folder: String, download: Boolean
# ---------- downloadepw: C# usings ----------
using System.Net;
using System.IO;
using System.Text;
# ---------- downloadepw: C# ----------
    if(!Directory.Exists(folder)){  Directory.CreateDirectory(folder);}

    if (download == true){

      DownLoadFile(epwURL, folder + "\\weather.epw");



    }

    path = folder + "\\weather.epw";
# ---------- downloadepw: C# additional code ----------
  public static void DownLoadFile(string URL, string FilePath)
  {
    WebClient webClient = new WebClient();
    webClient.DownloadFile(URL, FilePath);
  }
# ---------- end downloadepw ----------
rset = RunSettings(
    NumberOfIterations="100",
    WriteInterval=20,
    NumberOfTimestepsToKeep=3,
    TurbulenceModel=1,
    RelaxationFactors=3,
    SolutionAndAlgorithmControl=1,
    PotentialFoamInitialization=False,
    AgeOfAir=True,
    NumberOfCPUs="8",
    OperatingSystem=0)
simulation = Simulation(
    SimulationDomain=domaincyl.Domain,
    WorkingDirectory=panel_7,
    MeshSettings=mset,
    RunSettings=rset,
    RunMeshing=Button(),
    MakeTrees=False,
    RunSimulation=Button(),
    runWithBlueCFD=True)
residuals = Residuals(Result=simulation, SelectionOfWindDirections="0", X=":", Y=":", Version=0, Run=Button(), visResiduals=False)

# ----
# 6. Clean
button_3 = Button()  # disabled
clean = Clean(Directory=panel_7, Mode=2, Run=button_3)  # disabled

paraview = Paraview(Result=simulation, ParaviewVersion=2, Run=button)

# ----
# 4. Probing points & probing
number_slider_4 = Slider(5, range=1..50)
brep = Brep(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)
meshplane = MeshPlane(brep=brep, number=number_slider_4, B=geo)  # -> L, faces, mesh

probing = Probing(BuildingMesh=cluster, Points=meshplane.mesh, ConvertQuadsToTriangles=False)
demesh = DeconstructMesh(Mesh=probing)  # -> Vertices, Faces, Colours, Normals

visprobes = VisualizeProbes(Result=simulation, ProbingPoints=demesh.Vertices, NameOfInstance="ttt", NameOfField=0, Run=Button())  # -> PorbingPoints, ProbingResult

vectors = Data(visprobes.ProbingResult)
points = Data(visprobes.PorbingPoints)
wind_factors = WindFactors(Result=simulation, ProbingPoints=points, WindVelocity=vectors, Run=button_2, Interpolation=False)  # -> WindFactorsSpatial, WindFactorsAnnual
# Multi-directional / annual wind vectors
choose_dir = TreeBranch(Tree=vectors, Path=dir, MaintainPaths=True)
cluster_2 = Cluster(data=choose_dir)  # -> S, E, data_3; disabled
data_2 = Data(wind_factors.WindFactorsSpatial)  # disabled
# Set to -1 for average of entire year (takes 30 s to compute)
data_3 = Data(wind_factors.WindFactorsAnnual)  # disabled

# ----
# Wind Comfort Metrics
vec = Vector(Vector(-271, -230, 0))  # disabled
cluster_3 = Cluster_4(C=points, T=Vector(0, 0, 10))  # disabled
cluster_4 = Cluster_4(C=points, T=Vector(0, 0, 10))  # disabled
pedestrian_wind_comfort = PedestrianWindComfort(WindFactorsSpatial=data_2, WindFactorsAnnual=data_3, WindComfortMetric=1, Weibull_Fit=False)  # -> WindComfortRank, WindComfortClassLetter, WindComfortClass; disabled
pedestrian_wind_comfort_2 = PedestrianWindComfort(WindFactorsSpatial=data_2, WindFactorsAnnual=data_3, WindComfortMetric=1, Weibull_Fit=True)  # -> WindComfortRank, WindComfortClassLetter, WindComfortClass; disabled
move = Move(Geometry=cluster_3, Motion=vec)  # -> flatten(Geometry), Transform; disabled
move_2 = Move(Geometry=cluster_4, Motion=Vector(-280.6944615, 0, 0))  # -> flatten(Geometry), Transform; disabled
move_3 = Move(Geometry=geo, Motion=vec)  # -> flatten(Geometry), Transform; disabled
move_4 = Move(Geometry=geo, Motion=Vector(-280.6944615, 0, 0))  # -> flatten(Geometry), Transform; disabled
area = Area(Geometry=move.Geometry)  # -> Area, Centroid; disabled
area_2 = Area(Geometry=move_2.Geometry)  # -> Area, Centroid; disabled
cluster_5 = Cluster(data=pedestrian_wind_comfort.WindComfortRank)  # -> S, E, data_3; disabled
tag = TextTag(Location=area_2.Centroid, Text=pedestrian_wind_comfort.WindComfortClassLetter)  # disabled
cluster_6 = Cluster(data=pedestrian_wind_comfort_2.WindComfortRank)  # -> S, E, data_3; disabled
tag_2 = TextTag(Location=area.Centroid, Text=pedestrian_wind_comfort_2.WindComfortClassLetter)  # disabled
gradient = Gradient(
    LowerLimit=cluster_5.S,
    UpperLimit=cluster_5.E,
    Parameter=cluster_5.data_3,
    stops=[0.103: RGB(0, 0, 255), 0.22: RGB(0, 170, 255), 0.305: RGB(0, 255, 255), 0.398: RGB(0, 255, 188), 0.504: RGB(0, 255, 106), 0.605: RGB(91, 255, 0), 0.699: RGB(184, 255, 0), 0.799: RGB(255, 255, 0), 0.898: RGB(255, 170, 0)])  # disabled
gradient_2 = Gradient(
    LowerLimit=cluster_6.S,
    UpperLimit=cluster_6.E,
    Parameter=cluster_6.data_3,
    stops=[0.103: RGB(0, 0, 255), 0.22: RGB(0, 170, 255), 0.305: RGB(0, 255, 255), 0.398: RGB(0, 255, 188), 0.504: RGB(0, 255, 106), 0.605: RGB(91, 255, 0), 0.699: RGB(184, 255, 0), 0.799: RGB(255, 255, 0), 0.898: RGB(255, 170, 0)])  # disabled
preview = CustomPreview(Geometry=move_2.Geometry, Material=gradient)  # disabled
preview_2 = CustomPreview(Geometry=area.Centroid, Material=gradient_2)  # disabled

gradient_3 = Gradient(
    LowerLimit=cluster_2.S,
    UpperLimit=Slider(6, range=0..10),
    Parameter=cluster_2.data_3,
    stops=[0.103: RGB(0, 0, 255), 0.22: RGB(0, 170, 255), 0.305: RGB(0, 255, 255), 0.398: RGB(0, 255, 188), 0.504: RGB(0, 255, 106), 0.605: RGB(91, 255, 0), 0.699: RGB(184, 255, 0), 0.799: RGB(255, 255, 0), 0.898: RGB(255, 170, 0)])  # disabled
dedata = DeconstructDataObjects(Data=data_3, Select=panel_5)  # disabled
flip = FlipMatrix(Data=dedata)  # disabled
vdisex = VectorDisplayEx(Point=points, Vector=choose_dir, Colour=gradient_3, Width=number_slider)  # disabled
avr_2 = Average(Input=flip)  # -> flatten(ArithmeticMean); disabled
cluster_7 = Cluster(data=avr_2)  # -> S, E, data_3; disabled
cluster_8 = Cluster_4(C=points, T=Vector(0, 0, 10))  # disabled
gradient_4 = Gradient(
    LowerLimit=cluster_7.S,
    UpperLimit=cluster_7.E,
    Parameter=cluster_7.data_3,
    stops=[0.103: RGB(0, 0, 255), 0.22: RGB(0, 170, 255), 0.305: RGB(0, 255, 255), 0.398: RGB(0, 255, 188), 0.504: RGB(0, 255, 106), 0.605: RGB(91, 255, 0), 0.699: RGB(184, 255, 0), 0.799: RGB(255, 255, 0), 0.898: RGB(255, 170, 0)])  # disabled
preview_3 = CustomPreview(Geometry=cluster_8, Material=gradient_4)  # disabled
item = ListItem(List=flip, Index=number_slider_2, Wrap=True)  # -> flatten(Item); disabled
panel_8 = Panel(item)  # disabled
larger = LargerThan(FirstNumber=panel_8, SecondNumber=graft(panel_6))  # -> LargerThan, OrEqualTo; disabled
python = GhPythonScript(x=larger.LargerThan)  # -> out, flatten(a); inputs x: list of Boolean; disabled
# ---------- python: Python ----------
__author__ = "pkastner"
__version__ = "2021.02.24"

import rhinoscriptsyntax as rs

a = x.count(True)/8760*100
# ---------- end python ----------
c_script = CSharpScript(x=panel_8)  # -> out, A, B, C, D, E, S; inputs x: list of Double; disabled
# ---------- c_script: C# usings ----------
using System.Linq;
# ---------- c_script: C# ----------
    var THI = ThresholdInfo(PCMetric.Davenport);

    //  UTC.Add(1, new UThresholdInfo { Cat = 1, UThres = 3.6, TimeThres = Perc2Dec(1.5), Class = "Sitting Long", ClassLetter = "A", Operator = CompOperator.S });
    // UTC.Add(2, new UThresholdInfo { Cat = 2, UThres = 5.3, TimeThres = Perc2Dec(1.5), Class = "Sitting Short", ClassLetter = "B", Operator = CompOperator.S });
    // UTC.Add(3, new UThresholdInfo { Cat = 3, UThres = 7.6, TimeThres = Perc2Dec(1.5), Class = "Walking Leisurely", ClassLetter = "C", Operator = CompOperator.S });
    // UTC.Add(4, new UThresholdInfo { Cat = 4, UThres = 9.8, TimeThres = Perc2Dec(1.5), Class = "Walking Fast", ClassLetter = "D", Operator = CompOperator.S });
    // UTC.Add(5, new UThresholdInfo { Cat = 5, UThres = 9.8, TimeThres = Perc2Dec(1.5), Class = "Uncomfortable", ClassLetter = "E", Operator = CompOperator.GOE });
    //UTC.Add(6, new UThresholdInfo { Cat = 6, UThres = 15.1, TimeThres = Perc2Dec(0.01), Class = "Dangerous", ClassLetter = "S", Operator = CompOperator.GOE });




    var SS = x.Where(num => num > THI[6].UThres).Count() > THI[6].TimeThres;
    var EE = x.Where(num => num > THI[5].UThres).Count() > THI[5].TimeThres;
    var DD = x.Where(num => num > THI[4].UThres).Count() > 1 - THI[4].TimeThres;
    var CC = x.Where(num => num > THI[3].UThres).Count() > 1 - THI[3].TimeThres;
    var BB = x.Where(num => num > THI[2].UThres).Count() > 1 - THI[2].TimeThres;
    var AA = x.Where(num => num > THI[1].UThres).Count() > 1 - THI[1].TimeThres;







    A = AA;
    B = BB;
    C = CC;
    D = DD;
    E = EE;
    S = SS;
# ---------- c_script: C# additional code ----------
  public static double Perc2Dec(double input)
  {
    return input / 100;
  }
  public enum CompOperator
  {
    G, // Greater

    GOE,// GreaterOrEqual

    S // Smaller
  }

  public struct UThresholdInfo
  {
    public int Cat; // integer catefory

    public double UThres; // Velocity

    public double TimeThres; // in decimals

    public string Class; // Words

    public string ClassLetter; // Letter: e.g. A

    public CompOperator Operator; // ComparisonOperator
  }

  public enum PCMetric
  {
    LawsonGeneral,

    LawsonLDDC,

    Lawson2001,

    Davenport,

    NEN8100Comfort,

    NEN8100Safety,
  };


  public  Dictionary<int, UThresholdInfo> ThresholdInfo(PCMetric cmftidx)
  {
    Dictionary<int, UThresholdInfo> UTC = new Dictionary<int, UThresholdInfo>();

    if (cmftidx == PCMetric.LawsonGeneral)
    {
      // General Lawson

      //1 - A > 1.8 m / s < 2 % Sitting Long
      //2 - B > 3.6 m / s < 2 % Sitting Short
      //3 - C > 5.3 m / s < 2 % Walking Leisurely
      //4 - D > 7.6 m / s > 5 % Walking Fast
      //5 - E > 7.6 m / s >= 2 % Uncomfortable

      UTC.Add(1, new UThresholdInfo { Cat = 1, UThres = 1.8, TimeThres = Perc2Dec(2), Class = "Sitting Long", ClassLetter = "A", Operator = CompOperator.S });
      UTC.Add(2, new UThresholdInfo { Cat = 2, UThres = 3.6, TimeThres = Perc2Dec(2), Class = "Sitting Short", ClassLetter = "B", Operator = CompOperator.S });
      UTC.Add(3, new UThresholdInfo { Cat = 3, UThres = 5.3, TimeThres = Perc2Dec(2), Class = "Walking Leisurely", ClassLetter = "C", Operator = CompOperator.S });
      UTC.Add(4, new UThresholdInfo { Cat = 4, UThres = 7.6, TimeThres = Perc2Dec(5), Class = "Walking Fast", ClassLetter = "D", Operator = CompOperator.GOE });
      UTC.Add(5, new UThresholdInfo { Cat = 5, UThres = 7.6, TimeThres = Perc2Dec(2), Class = "Uncomfortable", ClassLetter = "E", Operator = CompOperator.GOE });

      //UTC.Add(1, new UThresholdInfo { Cat = 1, UThres = 1.8, TimeThres = Percent(2), Class = "Sitting Long", ClassLetter = "A", Operator = CompOperator.S });
      //UTC.Add(2, new UThresholdInfo { Cat = 2, UThres = 3.6, TimeThres = Percent(2), Class = "Sitting Short", ClassLetter = "B", Operator = CompOperator.G });
      //UTC.Add(3, new UThresholdInfo { Cat = 3, UThres = 5.3, TimeThres = Percent(2), Class = "Walking Leisurely", ClassLetter = "C", Operator = CompOperator.G });
      //UTC.Add(4, new UThresholdInfo { Cat = 4, UThres = 7.6, TimeThres = Percent(5), Class = "Walking Fast", ClassLetter = "D", Operator = CompOperator.GOE });
      //UTC.Add(5, new UThresholdInfo { Cat = 5, UThres = 7.6, TimeThres = Percent(2), Class = "Uncomfortable", ClassLetter = "E", Operator = CompOperator.GOE });
    }
    else if (cmftidx == PCMetric.LawsonLDDC)
    {
      // Lawson LDDC

      //1 - A > 2.5 m / s < 5 % Frequent sitting
      //2 - B > 4 m / s < 5 % Occasional sitting
      //3 - C > 6 m / s < 5 % Standing
      //4 - D > 8 m / s < 5 % Walking
      //5 - E > 8 m / s > 5 % Uncomfortable
      //6 - S > 15 m / s > 0.022 % Unsafe

      UTC.Add(1, new UThresholdInfo { Cat = 1, UThres = 2.5, TimeThres = Perc2Dec(5), Class = "Frequent sitting", ClassLetter = "A", Operator = CompOperator.S });
      UTC.Add(2, new UThresholdInfo { Cat = 2, UThres = 4, TimeThres = Perc2Dec(5), Class = "Occasional sitting", ClassLetter = "B", Operator = CompOperator.S });
      UTC.Add(3, new UThresholdInfo { Cat = 3, UThres = 6, TimeThres = Perc2Dec(5), Class = "Standing", ClassLetter = "C", Operator = CompOperator.S });
      UTC.Add(4, new UThresholdInfo { Cat = 4, UThres = 8, TimeThres = Perc2Dec(5), Class = "Walking", ClassLetter = "D", Operator = CompOperator.S });
      UTC.Add(5, new UThresholdInfo { Cat = 5, UThres = 8, TimeThres = Perc2Dec(5), Class = "Uncomfortable", ClassLetter = "E", Operator = CompOperator.G });
      UTC.Add(6, new UThresholdInfo { Cat = 6, UThres = 15, TimeThres = Perc2Dec(0.022), Class = "Unsafe", ClassLetter = "S", Operator = CompOperator.G });

      //UTC.Add(1, new UThresholdInfo { Cat = 1, UThres = 2.5, TimeThres = Percent(5), Class = "Frequent sitting", ClassLetter = "A", Operator = CompOperator.S });
      //UTC.Add(2, new UThresholdInfo { Cat = 2, UThres = 4, TimeThres = Percent(5), Class = "Occasional sitting", ClassLetter = "B", Operator = CompOperator.G });
      //UTC.Add(3, new UThresholdInfo { Cat = 3, UThres = 6, TimeThres = Percent(5), Class = "Standing", ClassLetter = "C", Operator = CompOperator.G });
      //UTC.Add(4, new UThresholdInfo { Cat = 4, UThres = 8, TimeThres = Percent(5), Class = "Walking", ClassLetter = "D", Operator = CompOperator.G });
      //UTC.Add(5, new UThresholdInfo { Cat = 5, UThres = 8, TimeThres = Percent(5), Class = "Uncomfortable", ClassLetter = "E", Operator = CompOperator.G });
      //UTC.Add(6, new UThresholdInfo { Cat = 6, UThres = 15, TimeThres = Percent(0.022), Class = "Unsafe", ClassLetter = "S", Operator = CompOperator.G });
    }
    else if (cmftidx == PCMetric.Lawson2001)
    {
      //Lawson 2001

      //1 - A > 4 m / s < 5 % Sitting
      //2 - B > 6 m / s < 5 % Standing
      //3 - C > 8 m / s < 5 % Strolling
      //4 - D > 10 m / s < 5 % Business Walking
      //5 - E > 10 m / s > 5 % Uncomfortable
      //6 - S15 > 15 m / s > 0.023 % Unsafe frail
      //7 - S20 > 20 m / s > 0.023 % Unsafe all

      UTC.Add(1, new UThresholdInfo { Cat = 1, UThres = 4, TimeThres = Perc2Dec(5), Class = "Frequent sitting", ClassLetter = "A", Operator = CompOperator.S });
      UTC.Add(2, new UThresholdInfo { Cat = 2, UThres = 6, TimeThres = Perc2Dec(5), Class = "Occasional sitting", ClassLetter = "B", Operator = CompOperator.S });
      UTC.Add(3, new UThresholdInfo { Cat = 3, UThres = 8, TimeThres = Perc2Dec(5), Class = "Standing", ClassLetter = "C", Operator = CompOperator.S });
      UTC.Add(4, new UThresholdInfo { Cat = 4, UThres = 10, TimeThres = Perc2Dec(5), Class = "Walking", ClassLetter = "D", Operator = CompOperator.S });
      UTC.Add(5, new UThresholdInfo { Cat = 5, UThres = 10, TimeThres = Perc2Dec(5), Class = "Uncomfortable", ClassLetter = "E", Operator = CompOperator.G });
      UTC.Add(6, new UThresholdInfo { Cat = 6, UThres = 15, TimeThres = Perc2Dec(0.023), Class = "Unsafe", ClassLetter = "S15", Operator = CompOperator.G });
      UTC.Add(7, new UThresholdInfo { Cat = 7, UThres = 15, TimeThres = Perc2Dec(0.023), Class = "Unsafe", ClassLetter = "S20", Operator = CompOperator.G });

      //UTC.Add(1, new UThresholdInfo { Cat = 1, UThres = 4, TimeThres = Percent(5), Class = "Frequent sitting", ClassLetter = "A", Operator = CompOperator.S });
      //UTC.Add(2, new UThresholdInfo { Cat = 2, UThres = 6, TimeThres = Percent(5), Class = "Occasional sitting", ClassLetter = "B", Operator = CompOperator.G });
      //UTC.Add(3, new UThresholdInfo { Cat = 3, UThres = 8, TimeThres = Percent(5), Class = "Standing", ClassLetter = "C", Operator = CompOperator.G });
      //UTC.Add(4, new UThresholdInfo { Cat = 4, UThres = 10, TimeThres = Percent(5), Class = "Walking", ClassLetter = "D", Operator = CompOperator.G });
      //UTC.Add(5, new UThresholdInfo { Cat = 5, UThres = 10, TimeThres = Percent(5), Class = "Uncomfortable", ClassLetter = "E", Operator = CompOperator.G });
      //UTC.Add(6, new UThresholdInfo { Cat = 6, UThres = 15, TimeThres = Percent(0.023), Class = "Unsafe", ClassLetter = "S15", Operator = CompOperator.G });
      //UTC.Add(7, new UThresholdInfo { Cat = 7, UThres = 15, TimeThres = Percent(0.023), Class = "Unsafe", ClassLetter = "S20", Operator = CompOperator.G });
    }
    else if (cmftidx == PCMetric.Davenport)
    {
      UTC.Add(1, new UThresholdInfo { Cat = 1, UThres = 3.6, TimeThres = Perc2Dec(1.5), Class = "Sitting Long", ClassLetter = "A", Operator = CompOperator.S });
      UTC.Add(2, new UThresholdInfo { Cat = 2, UThres = 5.3, TimeThres = Perc2Dec(1.5), Class = "Sitting Short", ClassLetter = "B", Operator = CompOperator.S });
      UTC.Add(3, new UThresholdInfo { Cat = 3, UThres = 7.6, TimeThres = Perc2Dec(1.5), Class = "Walking Leisurely", ClassLetter = "C", Operator = CompOperator.S });
      UTC.Add(4, new UThresholdInfo { Cat = 4, UThres = 9.8, TimeThres = Perc2Dec(1.5), Class = "Walking Fast", ClassLetter = "D", Operator = CompOperator.S });
      UTC.Add(5, new UThresholdInfo { Cat = 5, UThres = 9.8, TimeThres = Perc2Dec(1.5), Class = "Uncomfortable", ClassLetter = "E", Operator = CompOperator.GOE });
      UTC.Add(6, new UThresholdInfo { Cat = 6, UThres = 15.1, TimeThres = Perc2Dec(0.01), Class = "Dangerous", ClassLetter = "S", Operator = CompOperator.GOE });

      //UTC.Add(1, new UThresholdInfo { Cat = 1, UThres = 3.6, TimeThres = Percent(1.5), Class = "Sitting Long", ClassLetter = "A", Operator = CompOperator.S });
      //UTC.Add(2, new UThresholdInfo { Cat = 2, UThres = 5.3, TimeThres = Percent(1.5), Class = "Sitting Short", ClassLetter = "B", Operator = CompOperator.G });
      //UTC.Add(3, new UThresholdInfo { Cat = 3, UThres = 7.6, TimeThres = Percent(1.5), Class = "Walking Leisurely", ClassLetter = "C", Operator = CompOperator.G });
      //UTC.Add(4, new UThresholdInfo { Cat = 4, UThres = 9.8, TimeThres = Percent(1.5), Class = "Walking Fast", ClassLetter = "D", Operator = CompOperator.G });
      //UTC.Add(5, new UThresholdInfo { Cat = 5, UThres = 9.8, TimeThres = Percent(1.5), Class = "Uncomfortable", ClassLetter = "E", Operator = CompOperator.GOE });
      //UTC.Add(6, new UThresholdInfo { Cat = 6, UThres = 15.1, TimeThres = Percent(0.01), Class = "Dangerous", ClassLetter = "S", Operator = CompOperator.GOE });
    }
    else if (cmftidx == PCMetric.NEN8100Comfort)
    {
      UTC.Add(1, new UThresholdInfo { Cat = 1, UThres = 5, TimeThres = Perc2Dec(2.5), Class = "Sitting Long", ClassLetter = "A", Operator = CompOperator.S });
      UTC.Add(2, new UThresholdInfo { Cat = 2, UThres = 5, TimeThres = Perc2Dec(5), Class = "Sitting Short", ClassLetter = "B", Operator = CompOperator.S });
      UTC.Add(3, new UThresholdInfo { Cat = 3, UThres = 5, TimeThres = Perc2Dec(10), Class = "Walking Leisurely", ClassLetter = "C", Operator = CompOperator.S });
      UTC.Add(4, new UThresholdInfo { Cat = 4, UThres = 5, TimeThres = Perc2Dec(20), Class = "Walking Fast", ClassLetter = "D", Operator = CompOperator.S });
      UTC.Add(5, new UThresholdInfo { Cat = 5, UThres = 5, TimeThres = Perc2Dec(20), Class = "Uncomfortable", ClassLetter = "E", Operator = CompOperator.G });

      //UTC.Add(1, new UThresholdInfo { Cat = 1, UThres = 5, TimeThres = Percent(2.5), Class = "Sitting Long", ClassLetter = "A", Operator = CompOperator.S });
      //UTC.Add(2, new UThresholdInfo { Cat = 2, UThres = 5, TimeThres = Percent(5), Class = "Sitting Short", ClassLetter = "B", Operator = CompOperator.G });
      //UTC.Add(3, new UThresholdInfo { Cat = 3, UThres = 5, TimeThres = Percent(10), Class = "Walking Leisurely", ClassLetter = "C", Operator = CompOperator.G });
      //UTC.Add(4, new UThresholdInfo { Cat = 4, UThres = 5, TimeThres = Percent(20), Class = "Walking Fast", ClassLetter = "D", Operator = CompOperator.G });
      //UTC.Add(5, new UThresholdInfo { Cat = 5, UThres = 5, TimeThres = Percent(20), Class = "Uncomfortable", ClassLetter = "E", Operator = CompOperator.G });
    }
    else if (cmftidx == PCMetric.NEN8100Safety)
    {
      UTC.Add(1, new UThresholdInfo { Cat = 1, UThres = 15, TimeThres = Perc2Dec(0.05), Class = "No Risk", ClassLetter = "A", Operator = CompOperator.S });
      UTC.Add(2, new UThresholdInfo { Cat = 2, UThres = 15, TimeThres = Perc2Dec(0.3), Class = "Limited Risk", ClassLetter = "B", Operator = CompOperator.S });
      UTC.Add(3, new UThresholdInfo { Cat = 3, UThres = 15, TimeThres = Perc2Dec(0.3), Class = "Dangerous", ClassLetter = "C", Operator = CompOperator.G });

      //UTC.Add(1, new UThresholdInfo { Cat = 1, UThres = 15, TimeThres = Percent(0.05), Class = "No Risk", ClassLetter = "A", Operator = CompOperator.S });
      //UTC.Add(2, new UThresholdInfo { Cat = 2, UThres = 15, TimeThres = Percent(0.3), Class = "Limited Risk", ClassLetter = "B", Operator = CompOperator.G });
      //UTC.Add(3, new UThresholdInfo { Cat = 3, UThres = 15, TimeThres = Percent(0.3), Class = "Dangerous", ClassLetter = "C", Operator = CompOperator.G });
    }

    return UTC;
  }
# ---------- end c_script ----------
panel_9 = Panel(python.a)  # disabled
panel_10 = Panel([c_script.A, c_script.B, c_script.C, c_script.D, c_script.E, c_script.S])  # disabled
c_script_2 = CSharpScript(
    x=panel_8,
    Reference="C:\Users\pkastner\Documents\GitHub\Eddy3d\packages\MathNet.Numerics.4.11.0\lib\net461\MathNet.Numerics.dll")  # -> out, A, B, C, D, E, S; inputs x: list of Double; disabled
# ---------- c_script_2: C# usings ----------
using MathNet.Numerics.Distributions;
using System.Linq;
# ---------- c_script_2: C# ----------
    var THI = ThresholdInfo(PCMetric.Davenport);

    //  UTC.Add(1, new UThresholdInfo { Cat = 1, UThres = 3.6, TimeThres = Perc2Dec(1.5), Class = "Sitting Long", ClassLetter = "A", Operator = CompOperator.S });
    // UTC.Add(2, new UThresholdInfo { Cat = 2, UThres = 5.3, TimeThres = Perc2Dec(1.5), Class = "Sitting Short", ClassLetter = "B", Operator = CompOperator.S });
    // UTC.Add(3, new UThresholdInfo { Cat = 3, UThres = 7.6, TimeThres = Perc2Dec(1.5), Class = "Walking Leisurely", ClassLetter = "C", Operator = CompOperator.S });
    // UTC.Add(4, new UThresholdInfo { Cat = 4, UThres = 9.8, TimeThres = Perc2Dec(1.5), Class = "Walking Fast", ClassLetter = "D", Operator = CompOperator.S });
    // UTC.Add(5, new UThresholdInfo { Cat = 5, UThres = 9.8, TimeThres = Perc2Dec(1.5), Class = "Uncomfortable", ClassLetter = "E", Operator = CompOperator.GOE });
    //UTC.Add(6, new UThresholdInfo { Cat = 6, UThres = 15.1, TimeThres = Perc2Dec(0.01), Class = "Dangerous", ClassLetter = "S", Operator = CompOperator.GOE });




    var SS = CalcExceedance(x.ToArray(), THI);
   // var EE = x.Where(num => num > THI[5].UThres).Count() > THI[5].TimeThres;
  //  var DD = x.Where(num => num > THI[4].UThres).Count() > 1 - THI[4].TimeThres;
   // var CC = x.Where(num => num > THI[3].UThres).Count() > 1 - THI[3].TimeThres;
  //  var BB = x.Where(num => num > THI[2].UThres).Count() > 1 - THI[2].TimeThres;
   // var AA = x.Where(num => num > THI[1].UThres).Count() > 1 - THI[1].TimeThres;







   // A = AA;
   // B = BB;
   // C = CC;
   // D = DD;
    E = SS.ClassLetter;
    S = SS.Cat;
# ---------- c_script_2: C# additional code ----------
  public static double Perc2Dec(double input)
  {
    return input / 100;
  }
  public enum CompOperator
  {
    G, // Greater

    GOE,// GreaterOrEqual

    S // Smaller
  }

  public struct UThresholdInfo
  {
    public int Cat; // integer catefory

    public double UThres; // Velocity

    public double TimeThres; // in decimals

    public string Class; // Words

    public string ClassLetter; // Letter: e.g. A

    public CompOperator Operator; // ComparisonOperator
  }

  public enum PCMetric
  {
    LawsonGeneral,

    LawsonLDDC,

    Lawson2001,

    Davenport,

    NEN8100Comfort,

    NEN8100Safety,
  };


  public  Dictionary<int, UThresholdInfo> ThresholdInfo(PCMetric cmftidx)
  {
    Dictionary<int, UThresholdInfo> UTC = new Dictionary<int, UThresholdInfo>();

    if (cmftidx == PCMetric.LawsonGeneral)
    {
      // General Lawson

      //1 - A > 1.8 m / s < 2 % Sitting Long
      //2 - B > 3.6 m / s < 2 % Sitting Short
      //3 - C > 5.3 m / s < 2 % Walking Leisurely
      //4 - D > 7.6 m / s > 5 % Walking Fast
      //5 - E > 7.6 m / s >= 2 % Uncomfortable

      UTC.Add(1, new UThresholdInfo { Cat = 1, UThres = 1.8, TimeThres = Perc2Dec(2), Class = "Sitting Long", ClassLetter = "A", Operator = CompOperator.S });
      UTC.Add(2, new UThresholdInfo { Cat = 2, UThres = 3.6, TimeThres = Perc2Dec(2), Class = "Sitting Short", ClassLetter = "B", Operator = CompOperator.S });
      UTC.Add(3, new UThresholdInfo { Cat = 3, UThres = 5.3, TimeThres = Perc2Dec(2), Class = "Walking Leisurely", ClassLetter = "C", Operator = CompOperator.S });
      UTC.Add(4, new UThresholdInfo { Cat = 4, UThres = 7.6, TimeThres = Perc2Dec(5), Class = "Walking Fast", ClassLetter = "D", Operator = CompOperator.GOE });
      UTC.Add(5, new UThresholdInfo { Cat = 5, UThres = 7.6, TimeThres = Perc2Dec(2), Class = "Uncomfortable", ClassLetter = "E", Operator = CompOperator.GOE });

      //UTC.Add(1, new UThresholdInfo { Cat = 1, UThres = 1.8, TimeThres = Percent(2), Class = "Sitting Long", ClassLetter = "A", Operator = CompOperator.S });
      //UTC.Add(2, new UThresholdInfo { Cat = 2, UThres = 3.6, TimeThres = Percent(2), Class = "Sitting Short", ClassLetter = "B", Operator = CompOperator.G });
      //UTC.Add(3, new UThresholdInfo { Cat = 3, UThres = 5.3, TimeThres = Percent(2), Class = "Walking Leisurely", ClassLetter = "C", Operator = CompOperator.G });
      //UTC.Add(4, new UThresholdInfo { Cat = 4, UThres = 7.6, TimeThres = Percent(5), Class = "Walking Fast", ClassLetter = "D", Operator = CompOperator.GOE });
      //UTC.Add(5, new UThresholdInfo { Cat = 5, UThres = 7.6, TimeThres = Percent(2), Class = "Uncomfortable", ClassLetter = "E", Operator = CompOperator.GOE });
    }
    else if (cmftidx == PCMetric.LawsonLDDC)
    {
      // Lawson LDDC

      //1 - A > 2.5 m / s < 5 % Frequent sitting
      //2 - B > 4 m / s < 5 % Occasional sitting
      //3 - C > 6 m / s < 5 % Standing
      //4 - D > 8 m / s < 5 % Walking
      //5 - E > 8 m / s > 5 % Uncomfortable
      //6 - S > 15 m / s > 0.022 % Unsafe

      UTC.Add(1, new UThresholdInfo { Cat = 1, UThres = 2.5, TimeThres = Perc2Dec(5), Class = "Frequent sitting", ClassLetter = "A", Operator = CompOperator.S });
      UTC.Add(2, new UThresholdInfo { Cat = 2, UThres = 4, TimeThres = Perc2Dec(5), Class = "Occasional sitting", ClassLetter = "B", Operator = CompOperator.S });
      UTC.Add(3, new UThresholdInfo { Cat = 3, UThres = 6, TimeThres = Perc2Dec(5), Class = "Standing", ClassLetter = "C", Operator = CompOperator.S });
      UTC.Add(4, new UThresholdInfo { Cat = 4, UThres = 8, TimeThres = Perc2Dec(5), Class = "Walking", ClassLetter = "D", Operator = CompOperator.S });
      UTC.Add(5, new UThresholdInfo { Cat = 5, UThres = 8, TimeThres = Perc2Dec(5), Class = "Uncomfortable", ClassLetter = "E", Operator = CompOperator.G });
      UTC.Add(6, new UThresholdInfo { Cat = 6, UThres = 15, TimeThres = Perc2Dec(0.022), Class = "Unsafe", ClassLetter = "S", Operator = CompOperator.G });

      //UTC.Add(1, new UThresholdInfo { Cat = 1, UThres = 2.5, TimeThres = Percent(5), Class = "Frequent sitting", ClassLetter = "A", Operator = CompOperator.S });
      //UTC.Add(2, new UThresholdInfo { Cat = 2, UThres = 4, TimeThres = Percent(5), Class = "Occasional sitting", ClassLetter = "B", Operator = CompOperator.G });
      //UTC.Add(3, new UThresholdInfo { Cat = 3, UThres = 6, TimeThres = Percent(5), Class = "Standing", ClassLetter = "C", Operator = CompOperator.G });
      //UTC.Add(4, new UThresholdInfo { Cat = 4, UThres = 8, TimeThres = Percent(5), Class = "Walking", ClassLetter = "D", Operator = CompOperator.G });
      //UTC.Add(5, new UThresholdInfo { Cat = 5, UThres = 8, TimeThres = Percent(5), Class = "Uncomfortable", ClassLetter = "E", Operator = CompOperator.G });
      //UTC.Add(6, new UThresholdInfo { Cat = 6, UThres = 15, TimeThres = Percent(0.022), Class = "Unsafe", ClassLetter = "S", Operator = CompOperator.G });
    }
    else if (cmftidx == PCMetric.Lawson2001)
    {
      //Lawson 2001

      //1 - A > 4 m / s < 5 % Sitting
      //2 - B > 6 m / s < 5 % Standing
      //3 - C > 8 m / s < 5 % Strolling
      //4 - D > 10 m / s < 5 % Business Walking
      //5 - E > 10 m / s > 5 % Uncomfortable
      //6 - S15 > 15 m / s > 0.023 % Unsafe frail
      //7 - S20 > 20 m / s > 0.023 % Unsafe all

      UTC.Add(1, new UThresholdInfo { Cat = 1, UThres = 4, TimeThres = Perc2Dec(5), Class = "Frequent sitting", ClassLetter = "A", Operator = CompOperator.S });
      UTC.Add(2, new UThresholdInfo { Cat = 2, UThres = 6, TimeThres = Perc2Dec(5), Class = "Occasional sitting", ClassLetter = "B", Operator = CompOperator.S });
      UTC.Add(3, new UThresholdInfo { Cat = 3, UThres = 8, TimeThres = Perc2Dec(5), Class = "Standing", ClassLetter = "C", Operator = CompOperator.S });
      UTC.Add(4, new UThresholdInfo { Cat = 4, UThres = 10, TimeThres = Perc2Dec(5), Class = "Walking", ClassLetter = "D", Operator = CompOperator.S });
      UTC.Add(5, new UThresholdInfo { Cat = 5, UThres = 10, TimeThres = Perc2Dec(5), Class = "Uncomfortable", ClassLetter = "E", Operator = CompOperator.G });
      UTC.Add(6, new UThresholdInfo { Cat = 6, UThres = 15, TimeThres = Perc2Dec(0.023), Class = "Unsafe", ClassLetter = "S15", Operator = CompOperator.G });
      UTC.Add(7, new UThresholdInfo { Cat = 7, UThres = 15, TimeThres = Perc2Dec(0.023), Class = "Unsafe", ClassLetter = "S20", Operator = CompOperator.G });

      //UTC.Add(1, new UThresholdInfo { Cat = 1, UThres = 4, TimeThres = Percent(5), Class = "Frequent sitting", ClassLetter = "A", Operator = CompOperator.S });
      //UTC.Add(2, new UThresholdInfo { Cat = 2, UThres = 6, TimeThres = Percent(5), Class = "Occasional sitting", ClassLetter = "B", Operator = CompOperator.G });
      //UTC.Add(3, new UThresholdInfo { Cat = 3, UThres = 8, TimeThres = Percent(5), Class = "Standing", ClassLetter = "C", Operator = CompOperator.G });
      //UTC.Add(4, new UThresholdInfo { Cat = 4, UThres = 10, TimeThres = Percent(5), Class = "Walking", ClassLetter = "D", Operator = CompOperator.G });
      //UTC.Add(5, new UThresholdInfo { Cat = 5, UThres = 10, TimeThres = Percent(5), Class = "Uncomfortable", ClassLetter = "E", Operator = CompOperator.G });
      //UTC.Add(6, new UThresholdInfo { Cat = 6, UThres = 15, TimeThres = Percent(0.023), Class = "Unsafe", ClassLetter = "S15", Operator = CompOperator.G });
      //UTC.Add(7, new UThresholdInfo { Cat = 7, UThres = 15, TimeThres = Percent(0.023), Class = "Unsafe", ClassLetter = "S20", Operator = CompOperator.G });
    }
    else if (cmftidx == PCMetric.Davenport)
    {
      UTC.Add(1, new UThresholdInfo { Cat = 1, UThres = 3.6, TimeThres = Perc2Dec(1.5), Class = "Sitting Long", ClassLetter = "A", Operator = CompOperator.S });
      UTC.Add(2, new UThresholdInfo { Cat = 2, UThres = 5.3, TimeThres = Perc2Dec(1.5), Class = "Sitting Short", ClassLetter = "B", Operator = CompOperator.S });
      UTC.Add(3, new UThresholdInfo { Cat = 3, UThres = 7.6, TimeThres = Perc2Dec(1.5), Class = "Walking Leisurely", ClassLetter = "C", Operator = CompOperator.S });
      UTC.Add(4, new UThresholdInfo { Cat = 4, UThres = 9.8, TimeThres = Perc2Dec(1.5), Class = "Walking Fast", ClassLetter = "D", Operator = CompOperator.S });
      UTC.Add(5, new UThresholdInfo { Cat = 5, UThres = 9.8, TimeThres = Perc2Dec(1.5), Class = "Uncomfortable", ClassLetter = "E", Operator = CompOperator.GOE });
      UTC.Add(6, new UThresholdInfo { Cat = 6, UThres = 15.1, TimeThres = Perc2Dec(0.01), Class = "Dangerous", ClassLetter = "S", Operator = CompOperator.GOE });

      //UTC.Add(1, new UThresholdInfo { Cat = 1, UThres = 3.6, TimeThres = Percent(1.5), Class = "Sitting Long", ClassLetter = "A", Operator = CompOperator.S });
      //UTC.Add(2, new UThresholdInfo { Cat = 2, UThres = 5.3, TimeThres = Percent(1.5), Class = "Sitting Short", ClassLetter = "B", Operator = CompOperator.G });
      //UTC.Add(3, new UThresholdInfo { Cat = 3, UThres = 7.6, TimeThres = Percent(1.5), Class = "Walking Leisurely", ClassLetter = "C", Operator = CompOperator.G });
      //UTC.Add(4, new UThresholdInfo { Cat = 4, UThres = 9.8, TimeThres = Percent(1.5), Class = "Walking Fast", ClassLetter = "D", Operator = CompOperator.G });
      //UTC.Add(5, new UThresholdInfo { Cat = 5, UThres = 9.8, TimeThres = Percent(1.5), Class = "Uncomfortable", ClassLetter = "E", Operator = CompOperator.GOE });
      //UTC.Add(6, new UThresholdInfo { Cat = 6, UThres = 15.1, TimeThres = Percent(0.01), Class = "Dangerous", ClassLetter = "S", Operator = CompOperator.GOE });
    }
    else if (cmftidx == PCMetric.NEN8100Comfort)
    {
      UTC.Add(1, new UThresholdInfo { Cat = 1, UThres = 5, TimeThres = Perc2Dec(2.5), Class = "Sitting Long", ClassLetter = "A", Operator = CompOperator.S });
      UTC.Add(2, new UThresholdInfo { Cat = 2, UThres = 5, TimeThres = Perc2Dec(5), Class = "Sitting Short", ClassLetter = "B", Operator = CompOperator.S });
      UTC.Add(3, new UThresholdInfo { Cat = 3, UThres = 5, TimeThres = Perc2Dec(10), Class = "Walking Leisurely", ClassLetter = "C", Operator = CompOperator.S });
      UTC.Add(4, new UThresholdInfo { Cat = 4, UThres = 5, TimeThres = Perc2Dec(20), Class = "Walking Fast", ClassLetter = "D", Operator = CompOperator.S });
      UTC.Add(5, new UThresholdInfo { Cat = 5, UThres = 5, TimeThres = Perc2Dec(20), Class = "Uncomfortable", ClassLetter = "E", Operator = CompOperator.G });

      //UTC.Add(1, new UThresholdInfo { Cat = 1, UThres = 5, TimeThres = Percent(2.5), Class = "Sitting Long", ClassLetter = "A", Operator = CompOperator.S });
      //UTC.Add(2, new UThresholdInfo { Cat = 2, UThres = 5, TimeThres = Percent(5), Class = "Sitting Short", ClassLetter = "B", Operator = CompOperator.G });
      //UTC.Add(3, new UThresholdInfo { Cat = 3, UThres = 5, TimeThres = Percent(10), Class = "Walking Leisurely", ClassLetter = "C", Operator = CompOperator.G });
      //UTC.Add(4, new UThresholdInfo { Cat = 4, UThres = 5, TimeThres = Percent(20), Class = "Walking Fast", ClassLetter = "D", Operator = CompOperator.G });
      //UTC.Add(5, new UThresholdInfo { Cat = 5, UThres = 5, TimeThres = Percent(20), Class = "Uncomfortable", ClassLetter = "E", Operator = CompOperator.G });
    }
    else if (cmftidx == PCMetric.NEN8100Safety)
    {
      UTC.Add(1, new UThresholdInfo { Cat = 1, UThres = 15, TimeThres = Perc2Dec(0.05), Class = "No Risk", ClassLetter = "A", Operator = CompOperator.S });
      UTC.Add(2, new UThresholdInfo { Cat = 2, UThres = 15, TimeThres = Perc2Dec(0.3), Class = "Limited Risk", ClassLetter = "B", Operator = CompOperator.S });
      UTC.Add(3, new UThresholdInfo { Cat = 3, UThres = 15, TimeThres = Perc2Dec(0.3), Class = "Dangerous", ClassLetter = "C", Operator = CompOperator.G });

      //UTC.Add(1, new UThresholdInfo { Cat = 1, UThres = 15, TimeThres = Percent(0.05), Class = "No Risk", ClassLetter = "A", Operator = CompOperator.S });
      //UTC.Add(2, new UThresholdInfo { Cat = 2, UThres = 15, TimeThres = Percent(0.3), Class = "Limited Risk", ClassLetter = "B", Operator = CompOperator.G });
      //UTC.Add(3, new UThresholdInfo { Cat = 3, UThres = 15, TimeThres = Percent(0.3), Class = "Dangerous", ClassLetter = "C", Operator = CompOperator.G });
    }

    return UTC;
    }     public static UThresholdInfo CalcExceedance(double[] TemporalVelocityArray, Dictionary<int, UThresholdInfo> LTI)

  {
   // var pedestrianComfort = LTI[1];
    
      var pedestrianComfort = new UThresholdInfo();

    // start from the highest and start binning
    //        Parallel.ForEach(LTI.Values.Reverse(),
    //Entry =>
    //{
    foreach (var Entry in LTI.Values)
    {
      // Weibull estimate

      var Estimate = Weibull.Estimate(TemporalVelocityArray);

      var Kappa = Estimate.Shape;
      var Lambda = Estimate.Scale;

      // Treat all wind directions with equal weight, like suggested in https://www.sciencedirect.com/science/article/pii/S0360132316300415#fig22, eq. 14

      //double PercentagePerYear = (double)1 / simulatedWindDirections.Count();
      double P_Upot_Utr10m = Prob_Exceedance(1, Entry.UThres, Kappa, Lambda);

      double ExceedanceProbability = P_Upot_Utr10m;
      bool Exceedance = CheckExceedance(ExceedanceProbability, Entry);

      if (Exceedance)
      {
        pedestrianComfort = Entry;
        return pedestrianComfort;
      }
      // return pedestrianComfort;
    }

    //});
    return pedestrianComfort;
  }
  private static bool CheckExceedance(double ExceedanceProbability, UThresholdInfo TI)
  {
    if (TI.Operator == CompOperator.G)
    {
      return ExceedanceProbability > TI.TimeThres;
    }
    else if (TI.Operator == CompOperator.GOE)
    {
      return ExceedanceProbability >= TI.TimeThres;
    }
    else
    {
       return ExceedanceProbability < TI.TimeThres;
      //return ExceedanceProbability > 1 - TI.TimeThres;
    }
  }

  private static bool Match(int input, int compare_to)
  {
    return input == compare_to;
  }

  private static double Prob_Exceedance(double a_theta, double u, double k, double c)
  {
    // not in percentage
    // c = lambda
    return a_theta * Math.Exp(-Math.Pow((u / c), k));
  }
# ---------- end c_script_2 ----------
panel_11 = Panel([c_script_2.A, c_script_2.B, c_script_2.C, c_script_2.D, c_script_2.E, c_script_2.S])  # disabled

# ==== cluster MeshPlane
B = ClusterInput()
number = ClusterInput()
number_2 = Number(number)
settings_custom = SettingsCustom(
    StitchSeams=True,
    SimplePlanes=False,
    Refine=True,
    MinCount=16,
    MaxCount=400,
    AspectRatio=20,
    MaxDistance=0,
    MaxAngle=20,
    MinEdge=number_2,
    MaxEdge=number_2)
brep = ClusterInput()
mesh_brep = MeshBrep(Brep=brep, Settings=settings_custom)
deconstruct_mesh = DeconstructMesh(Mesh=mesh_brep)  # -> Vertices, Faces, Colours, Normals
brepsinc = PointInBreps(Brep=B, Point=deconstruct_mesh.Vertices, Strict=False)  # -> Inside, Index
not = GateNot(A=brepsinc.Inside)
cull = CullPattern(List=deconstruct_mesh.Vertices, CullPattern=not)
faces = ClusterOutput(deconstruct_mesh.Faces)
L = ClusterOutput(cull)
mesh = ClusterOutput(mesh_brep)

# ==== cluster Cluster
data = ClusterInput()
data_2 = Data(data)
data_3 = ClusterOutput(data_2)
bnd = Bounds(Numbers=data_2)
dedomain = DeconstructDomain(Domain=bnd)  # -> Start, End
S = ClusterOutput(dedomain.Start)
E = ClusterOutput(dedomain.End)

# ==== cluster Cluster_2
mesh = ClusterInput()
mesh_2 = Mesh(mesh)
mjoin = MeshJoin(Meshes=mesh_2)
M = ClusterOutput(mjoin)

# ==== cluster Cluster_4
C = ClusterInput()
cluster = Cluster_3(C=C)
T = ClusterInput()
move = Move(Geometry=cluster, Motion=T)  # -> Geometry, Transform
srf = ClusterOutput(cluster)

# ==== cluster Cluster_3
C = ClusterInput()
circle = CircleCNR(Center=C, Normal=Vector(0, 0, 1), Radius=2)
srf = Surface(circle)
srf_2 = ClusterOutput(srf)
