# Grasshopper definition 5_PressureOnBuildingFacade.gh (Grasshopper 1.0.7)
# plug-ins: VirtualWindTunnel

# ----
# 1. Geometry &
# Boundary Conditions
number_slider = Slider(45, range=0..100)
panel = Panel("C:\DIVA\WeatherData\USA_IL_Chicago-OHare.Intl.AP.725300_TMY3.epw")
geo = Geometry([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])
abl = ABL(WDir=number_slider, Uref=5, Zref=10, Z0=1, ZGround=0, Epw=panel)

# ----
# 2. Simulation Domain
domainbox = BoxShapedDomain(Geometry=geo, BoundaryCondition=abl, BlockSize=20)  # -> Domain, Mesh

# ----
# 3. Mesh & Simulation
button = Button()
mset = MeshSettings(AccBuilding=2, AccFeatures="4", AccRefinement=0, AccGround=2, NLayer="2", Mode=2)
rset = RunSettings(
    Iterations="100",
    WriteInterval=20,
    KeepTimeSteps=2,
    Turbulence=1,
    RelaxationFactors=0,
    Mode=0,
    CPUs="4",
    OperationSystem=0)
simulation = Simulation(
    SimulationDomain=domainbox.Domain,
    WorkingDirectory="C:\test",
    MeshSettings=mset,
    RunSettings=rset,
    RunMeshing=button,
    RunSimulation=Button(),
    runWithBlueCFD=True)
residuals = Residuals(Result=simulation, X=":", Y=":", Version=0, Run=Button(), visResiduals=True)

# ----
# 4. Probing points & probing
panel_2 = Panel("pressure100")
# Decompose and scale up Mesh
cluster = Cluster_2(data=geo)  # -> V, F
visprobes = VisualizeProbes(Result=simulation, ProbingPoints=cluster.V, NameOfInstance=panel_2, NameOfField=0, Run=Button(), Culling=True)  # -> PorbingPoints, ProbingResult

# ----
# 5. Post-processing
# 5.1. Paraview
# 5.2. Grasshopper
# Pressure coefficients
button_2 = Button()
cluster_2 = Cluster(data=visprobes.ProbingResult)  # -> S, E, data_3
paraview = Paraview(Result=simulation, ParaviewVersion=2, Run=button_2)
gradient = Gradient(
    LowerLimit="-1",
    UpperLimit=cluster_2.E,
    Parameter=cluster_2.data_3,
    stops=[0.103: RGB(0, 0, 255), 0.22: RGB(0, 170, 255), 0.305: RGB(0, 255, 255), 0.398: RGB(0, 255, 188), 0.504: RGB(0, 255, 106), 0.605: RGB(91, 255, 0), 0.699: RGB(184, 255, 0), 0.799: RGB(255, 255, 0), 0.898: RGB(255, 170, 0)])
conmesh = ConstructMesh(Vertices=cluster.V, Faces=cluster.F, Colours=gradient)

# ----
# 6. Clean
button_3 = Button()
clean = Clean(Directory="C:\test", Mode=2, Run=button_3)

# ==== cluster Cluster
data = ClusterInput()
data_2 = Data(data)
data_3 = ClusterOutput(data_2)
bnd = Bounds(Numbers=data_2)
dedomain = DeconstructDomain(Domain=bnd)  # -> Start, End
S = ClusterOutput(dedomain.Start)
E = ClusterOutput(dedomain.End)

# ==== cluster Cluster_2
data = ClusterInput()
data_2 = Data(data)
debrep = DeconstructBrep(Brep=data_2)  # -> flatten(Faces), Edges, Vertices
number_slider = Slider(2, range=0..10)
area = Area(Geometry=debrep.Faces)  # -> Area, Centroid
evalsrf = EvaluateSurface(Surface=debrep.Faces, Point=area.Centroid)  # -> Point, Normal, UDirection, VDirection, Frame
move = Move(Geometry=debrep.Faces, Motion=expr("x*0.1", evalsrf.Normal))  # -> Geometry, Transform
custom_mesh_settings = SettingsCustom(
    StitchSeams=True,
    SimplePlanes=False,
    Refine=True,
    MinCount=16,
    MaxCount=400,
    AspectRatio=20,
    MaxDistance=0,
    MaxAngle=20,
    MinEdge=number_slider,
    MaxEdge=number_slider)
Z = UnitZ(Factor=1)
dprod = DotProduct(VectorA=evalsrf.Normal, VectorB=Z, Unitize=False)
scale = Scale(Geometry=move.Geometry, Center=area.Centroid, Factor=Slider(0.99, range=0..1))  # -> Geometry, Transform
larger = LargerThan(FirstNumber=dprod, SecondNumber="0")  # -> LargerThan, OrEqualTo
dispatch = Dispatch(List=scale.Geometry, DispatchPattern=larger.OrEqualTo)  # -> ListA, ListB
mesh = MeshBrep(Brep=dispatch.ListA, Settings=custom_mesh_settings)
mjoin = MeshJoin(Meshes=mesh)
demesh = DeconstructMesh(Mesh=mjoin)  # -> Vertices, Faces, Colours, Normals
F = ClusterOutput(demesh.Faces)
V = ClusterOutput(demesh.Vertices)
