# Grasshopper definition 5_PressureOnBuildingFacade.ghx (Grasshopper 1.0.8)
# plug-ins: RhinoCodePluginGH, Eddy3D

# ----
# 0. Download Weather
panel = Panel("https://energyplus-weather.s3.amazonaws.com/asia_wmo_region_2/IND/IND_Ahmedabad.426470_IWEC/IND_Ahmedabad.426470_IWEC.epw")

geo = Geometry([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])

# ----
# 2. Simulation Domain
number_slider = Slider(50, range=0..1000)
number_slider_2 = Slider(300, range=0..1000)
number_slider_3 = Slider(80, range=0..1000)
panel_2 = Panel("10")

# ----
# 3. Mesh & Simulation
panel_3 = Panel("1500")
panel_4 = Panel("C:\Eddy3D-Cases\5_PressureOnBuildingFacade")

c_script = CSharpScript(url=panel, saveTo=panel_4)  # -> out, epwPath; inputs url: String, saveTo: String
# ---------- c_script: C# ----------
// Grasshopper Script Instance
#region Usings
using System;
using System.Linq;
using System.Collections;
using System.Collections.Generic;
using System.Drawing;
using System.IO;
using System.Net.Http;
using System.Threading.Tasks;

using Rhino;
using Rhino.Geometry;

using Grasshopper;
using Grasshopper.Kernel;
using Grasshopper.Kernel.Data;
using Grasshopper.Kernel.Types;
#endregion

public class Script_Instance : GH_ScriptInstance
{
    private void RunScript(string url, string saveTo, ref object epwPath)
    {
        try
        {
            // Validate inputs
            if (string.IsNullOrWhiteSpace(url))
            {
                Print("URL is invalid.");
                return;
            }

            if (string.IsNullOrWhiteSpace(saveTo) || !Directory.Exists(saveTo))
            {
                Print("Save folder is invalid.");
                return;
            }

            // Extract the file name from the URL
            string fileName = Path.GetFileName(new Uri(url).AbsolutePath);
            if (string.IsNullOrWhiteSpace(fileName))
            {
                Print("Failed to extract file name from URL.");
                return;
            }

            // Construct the full file path
            string filePath = Path.Combine(saveTo, fileName);

            // Check if the file already exists
            if (File.Exists(filePath))
            {
                Print($"File already exists at {filePath}, skipping download.");
                epwPath = filePath;
                return;
            }

            // Execute the asynchronous method synchronously
            Task.Run(async () =>
            {
                await FileDownloader.DownloadFileAsync(url, filePath);
            }).Wait();

            Print($"File downloaded successfully to {filePath}");
            epwPath = filePath;
        }
        catch (Exception ex)
        {
            Print($"Failed to download file: {ex.Message}");
        }
    }
}

public static class FileDownloader
{
    /// <summary>
    /// Asynchronously downloads a file from the specified URL and saves it to the given file path.
    /// </summary>
    /// <param name="url">The URL of the file to download.</param>
    /// <param name="filePath">The local file path to save the downloaded file.</param>
    public static async Task DownloadFileAsync(string url, string filePath)
    {
        // Validate inputs
        if (string.IsNullOrWhiteSpace(url))
            throw new ArgumentException("URL cannot be null or empty.", nameof(url));

        if (string.IsNullOrWhiteSpace(filePath))
            throw new ArgumentException("File path cannot be null or empty.", nameof(filePath));

        // Ensure the directory exists
        var directory = Path.GetDirectoryName(filePath);
        if (!string.IsNullOrEmpty(directory) && !Directory.Exists(directory))
        {
            Directory.CreateDirectory(directory);
        }

        try
        {
            // Download file using HttpClient
            using var httpClient = new HttpClient();
            using var response = await httpClient.GetAsync(url, HttpCompletionOption.ResponseHeadersRead);
            response.EnsureSuccessStatusCode();

            // Save the file
            await using var fileStream = new FileStream(filePath, FileMode.Create, FileAccess.Write, FileShare.None);
            await response.Content.CopyToAsync(fileStream);
        }
        catch (Exception ex)
        {
            Console.WriteLine($"Error downloading file: {ex.Message}");
            throw;
        }
    }
}
# ---------- end c_script ----------
panel_5 = Panel(c_script.out)

# ----
# 1. Geometry &
# Boundary Conditions
panel_6 = Panel("""0
45
90
135
180
225
270
315""")
abl = ABL(WDir=panel_6, Uref="10", Zref=10, Z0=1, ZGround=0, Epw=c_script.epwPath)

domaincyl = CylindricalDomain(Geometry=geo, BoundaryCondition=abl, BlockSize=20)  # -> Domain, Mesh
mset = MeshSettings(AccBuilding=2, AccFeatures="3", AccBBox=0, AccGround="3", MiscSettings=1, NumberOfLayers=4, Mode=2)
rset = RunSettings(
    NumberOfIterations=panel_3,
    WriteInterval="1",
    NumberOfTimestepsToKeep=3,
    TurbulenceModel=1,
    RelaxationFactors=3,
    SolutionAndAlgorithmControl=1,
    PotentialFoamInitialization=False,
    AgeOfAir=False,
    NumberOfCPUs="6",
    OperatingSystem=0)
simulation = Simulation(
    SimulationDomain=domaincyl.Domain,
    WorkingDirectory=panel_4,
    MeshSettings=mset,
    RunSettings=rset,
    RunMeshing=Button(),
    MakeTrees=False,
    RunSimulation=Button(),
    runWithBlueCFD=True)
residuals = VisualizeResiduals(Result=simulation, X=":", Y=":", Version=0, Run=Button(), visResiduals=True)

# ----
# 4.1. Decompose and scale up Mesh
cluster = Cluster_2(data=geo)  # -> V, F

# ----
# 4.2. Probing points & probing
panel_7 = Panel("pressure100")
visprobes = VisualizeProbes(Result=simulation, ProbingPoints=cluster.V, NameOfInstance=panel_7, NameOfField=1, Run=Button(), Run_2=False)  # -> PorbingPoints, ProbingResult

# ----
# 5. Post-processing
# 5.1. Change wind direction
number_slider_4 = Slider(2, range=0..10)
branch = TreeBranch(Tree=visprobes.ProbingResult, Path=number_slider_4, MaintainPaths=True)
cluster_2 = Cluster(data=branch)  # -> S, E, data_3
gradient = Gradient(
    LowerLimit="-1",
    UpperLimit="1",
    Parameter=cluster_2.data_3,
    stops=[0.103: RGB(0, 0, 255), 0.22: RGB(0, 170, 255), 0.305: RGB(0, 255, 255), 0.398: RGB(0, 255, 188), 0.504: RGB(0, 255, 106), 0.605: RGB(91, 255, 0), 0.699: RGB(184, 255, 0), 0.799: RGB(255, 255, 0), 0.898: RGB(255, 170, 0)])
conmesh = ConstructMesh(Vertices=cluster.V, Faces=cluster.F, Colours=gradient)

# ----
# 6. Clean
button = Button()
clean = Clean(Directory=simulation, Mode=2, Run=button)

# ==== cluster Cluster
data = ClusterInput()
data_2 = Data(data)
data_3 = ClusterOutput(data_2)
bnd = Bounds(Numbers=data_2)
dedomain = DeconstructDomain(Domain=bnd)  # -> Start, End
S = ClusterOutput(dedomain.Start)
E = ClusterOutput(dedomain.End)

# ==== cluster Cluster_2
data = ClusterInput()
data_2 = Data(data)
mesh = Mesh(data_2)
mjoin = MeshJoin(Meshes=mesh)
debrep = DeconstructBrep(Brep=data_2)  # -> flatten(Faces), Edges, Vertices
number_slider = Slider(2, range=0..10)
area = Area(Geometry=debrep.Faces)  # -> Area, Centroid
evalsrf = EvaluateSurface(Surface=debrep.Faces, Point=area.Centroid)  # -> Point, Normal, UDirection, VDirection, Frame
move = Move(Geometry=debrep.Faces, Motion=expr("x*0.1", evalsrf.Normal))  # -> Geometry, Transform
custom_mesh_settings = SettingsCustom(
    StitchSeams=True,
    SimplePlanes=False,
    Refine=True,
    MinCount=16,
    MaxCount=400,
    AspectRatio=20,
    MaxDistance=0,
    MaxAngle=20,
    MinEdge=number_slider,
    MaxEdge=number_slider)
Z = UnitZ(Factor=1)
dprod = DotProduct(VectorA=evalsrf.Normal, VectorB=Z, Unitize=False)
scale = Scale(Geometry=move.Geometry, Center=area.Centroid, Factor=Slider(0.99, range=0..1))  # -> Geometry, Transform
larger = LargerThan(FirstNumber=dprod, SecondNumber="0")  # -> LargerThan, OrEqualTo
dispatch = Dispatch(List=scale.Geometry, DispatchPattern=larger.OrEqualTo)  # -> ListA, ListB
mesh_2 = MeshBrep(Brep=dispatch.ListA, Settings=custom_mesh_settings)
mjoin_2 = MeshJoin(Meshes=mesh_2)
demesh = DeconstructMesh(Mesh=mjoin_2)  # -> Vertices, Faces, Colours, Normals
probing = Probing(BuildingMesh=mjoin, Points=demesh.Vertices, ConvertQuadsToTriangles_2=True)  # disabled
F = ClusterOutput(demesh.Faces)
V = ClusterOutput(demesh.Vertices)
