# Grasshopper definition 6_AnnualOutdoorComfort.ghx (Grasshopper 1.0.7)
# plug-ins: Eddy3D

panel = Panel("https://energyplus.net/weather-download/north_and_central_america_wmo_region_4/GTM//GTM_Huehuetenango.786270_SWERA/GTM_Huehuetenango.786270_SWERA.epw")
toggle = BooleanToggle(False)
toggle_2 = BooleanToggle(False)
button = Button()
button_2 = Button()
button_3 = Button()

# ----
# 2. Simulation Domain
number_slider = Slider(50, range=0..1000)

toggle_3 = BooleanToggle(False)
panel_2 = Panel("20")  # disabled
button_4 = Button()  # disabled

# ----
# 1. Geometry &
# Boundary Conditions
panel_3 = Panel("""0
45
90
135
180
225
270
315""")
geo = Geometry([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])

# ----
# 3. Mesh & Simulation
panel_4 = Panel("2")
mset = MeshSettings(AccBuilding=2, AccFeatures="3", AccRefinement=0, AccGround=2, NLayer=panel_4, Mode=2)

downloadepw = CSharpScript(epwURL=panel, folder="C:\test_cyl", download=Button())  # -> path; inputs epwURL: String, folder: String, download: Boolean
# ---------- downloadepw: C# usings ----------
using System.Net;
# ---------- downloadepw: C# ----------
    if (download == true){

      DownLoadFile(epwURL, folder + "\\weather.epw");



    }

    path = folder + "\\weather.epw";
# ---------- downloadepw: C# additional code ----------
  public static void DownLoadFile(string URL, string FilePath)
  {
    WebClient webClient = new WebClient();
    webClient.DownloadFile(URL, FilePath);
  }
# ---------- end downloadepw ----------

abl = ABL(WDir=panel_3, Uref=5, Zref=10, Z0=1, ZGround=0, Epw=downloadepw)

domaincyl = CylindricalDomain(
    Geometry=geo,
    BoundaryCondition=abl,
    BlockSize="10",
    SizeOfInnerRectangle=number_slider,
    SizeOfOuterRadius=Slider(300, range=0..1000),
    Height=Slider(80, range=0..1000))  # -> Domain, Mesh
rset = RunSettings(
    NumberOfIterations="60",
    WriteInterval=20,
    NumberOfTimestepsToKeep=3,
    TurbulenceModel=1,
    RelaxationFactors=1,
    SolutionAndAlgorithmControl=0,
    PotentialFoamInitialization=False,
    NumberOfCPUs="1",
    OperatingSystem=0)

simulation = Simulation(
    SimulationDomain=domaincyl.Domain,
    WorkingDirectory="C:\test_cyl",
    MeshSettings=mset,
    RunSettings=rset,
    RunMeshing=Button(),
    RunSimulation=Button(),
    runWithBlueCFD=True)
residuals = Residuals(Result=simulation, SelectionOfWindDirections=panel_3, X=":", Y=":", Version=1, Run=Button(), visResiduals=True)

# ----
# 4. Probing points & probing
button_5 = Button()
brep = Brep(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)
meshplane = MeshPlane(brep=brep, number=Slider(8, range=1..50))  # -> vertices, faces
point = Point(meshplane.vertices)
visprobes = VisualizeProbes(Res=simulation, Points=point, Name="test", Field=0, Run=button_5, Culling=True)  # -> Points, Result

c_script = CSharpScript(
    WorkingDir="C:\test_cyl",
    Run=Toggle(True),
    BuildingsAndGround=geo,
    Sensors=visprobes.Points,
    Reference="C:\Users\pkastner\Documents\GitHub\Eddy3d\Build\Build.Ilmerge\EddyLib.dll")  # -> out, A; inputs WorkingDir: String, Run: Boolean, BuildingsAndGround: list of Mesh, Sensors: list of Point3d
# ---------- c_script: C# usings ----------
using EddyLib;
# ---------- c_script: C# ----------
    var vf = new EddyLib.Radiance.ViewFactors(WorkingDir, BuildingsAndGround, Sensors.ToArray(), Run);
    A = vf.Values;
# ---------- end c_script ----------
panel_5 = Panel(c_script.A)
c_script_2 = CSharpScript(
    wDir="C:\test_cyl",
    geo=geo,
    probes=visprobes.Points,
    weatherP=downloadepw,
    radDir="C:\Program Files\Solemma\Common\Radiance\",
    f_svv=panel_5,
    f_bes="0.5",
    sol_trans="1",
    runDDS=Toggle(False),
    loadDDS=toggle_2,
    runMRT=toggle_2,
    Reference="C:\Users\pkastner\Documents\GitHub\Eddy3d\Build\Build.Ilmerge\EddyLib.dll")  # -> out, NProbes, NHours, DMRT, TEST; inputs wDir: String, geo: Mesh, probes: list of Point3d, weatherP: String, radDir: String, f_svv: list of Double, f_bes: Double, sol_trans: Double, runDDS: Boolean, loadDDS: Boolean, runMRT: Boolean
# ---------- c_script_2: C# usings ----------
using EddyLib;
using EddyLib.Radiance;





using System.Diagnostics;
using System.IO;
using System.Linq;
using System.Text;
using System.Threading.Tasks;
# ---------- c_script_2: C# ----------
    var weather = new EddyLib.Weather(weatherP);

    var skytemp = new Sky(weather.DewPointTemp, weather.DryBulbTemp, weather.SkyCover, weather.RelativeHumidity);

  //  var dds = new TwoPhaseDDS(wDir, geo, probes, weather, runDDS, loadDDS, radDir);

 //   var DDSTOTAL = dds.totalIll;

    DataTree < double > DMRTTree = new DataTree<double>();

    if(runMRT == true){

      //  System.Threading.Tasks.Parallel.For(0, 17, h =>
      //   {

      for (int h = 0; h < 8760; h++)
      {

        for (int p = 0; p < probes.Count; p++)
        {
          //  double dMRT  ;
          //  double ERF ;

          // SolarGain.ERF(weather.SolarElevation[h], weather.SolarAzi[h], SolarGain.Posture.seating, DDSTOTAL[h][p], sol_trans, f_svv[p], f_bes, 0.6, out ERF, out dMRT);
          // DMRTTree.Add((weather.DryBulbTemp[h] * (1 - f_svv[p])) + dMRT + (skytemp.Temp[h] * f_svv[p]), new Grasshopper.Kernel.Data.GH_Path(h));
          // DMRTTree.Add(0);

        }
      }

      //   });
    }


    string fileName = wDir + @"\MRT.bin";
    //  writeBin(fileName, (To2DArrayGen(DMRTTree)));

    //DMRT = DMRTTree;


    // NProbes = DDSTOTAL[1].Length.ToString();


    //  NHours = DDSTOTAL.Length.ToString();

    //DMRT = DDSTOTAL.Length.ToString();
    //  TEST = new SolarGain(weather.SolarElevation[6149], weather.SolarAzi[6149], 999, sol_trans, f_svv[0], f_bes).DeltaMRT;

    double dMRT  ;
    double ERF ;

    SolarGain.ERF(weather.SolarElevation[0], weather.SolarAzi[0], SolarGain.Posture.seating, 200, sol_trans, f_svv[0], f_bes, 0.6, out ERF, out dMRT);;

    TEST = dMRT;
# ---------- c_script_2: C# additional code ----------
  public static double[,] To2DArrayGen(DataTree<double> tree)
  {
    double[,] result = new double[tree.Branches.Count, tree.Branches[0].Count];



    for (int i = 0; i < tree.Branches.Count; i++)
    {
      for (int j = 0; j < tree.Branches[0].Count; j++)
      {
        if (tree.Branches[i].Count != tree.Branches[0].Count) throw new InvalidOperationException("The list cannot contain elements (lists) of different sizes.");
        result[i, j] = tree.Branches[i][j];   //[i];
      }
    }
    return result;
  }


  public static void writeBin(string fileName, double[,] values)
  {
    // [i, time j] points

    BinaryWriter bw;

    //create the file
    try
    {
      bw = new BinaryWriter(new FileStream(fileName, FileMode.Create));
    }
    catch (IOException e)
    {
      Console.WriteLine(e.Message + "\n Cannot create file.");
      return;
    }

    //writing into the file
    try
    {
      bw.Write((Int32) values.GetLength(0));
      bw.Write((Int32) values.GetLength(1));

      for (int i = 0; i < values.GetLength(0); i++)
      {
        for (int j = 0; j < values.GetLength(1); j++)
        {
          float fval = (float) values[i, j];
          bw.Write(fval);
        }
      }
    }
    catch (IOException e)
    {
      Console.WriteLine(e.Message + "\n Cannot write to file.");
      return;
    }
    bw.Close();
  }

  public static class CustomArray<T>
  {
    public static T[] GetColumn(T[,] matrix, int columnNumber)
    {
      return Enumerable.Range(0, matrix.GetLength(0))
        .Select(x => matrix[x, columnNumber])
        .ToArray();
    }

    public static T[] GetRow(T[,] matrix, int rowNumber)
    {
      return Enumerable.Range(0, matrix.GetLength(1))
        .Select(x => matrix[rowNumber, x])
        .ToArray();
    }
  }


  public static double[,] TransposeRowsAndColumns(double[,] arr)
  {
    int rowCount = arr.GetLength(0);
    int columnCount = arr.GetLength(1);
    double[,] transposed = new double[columnCount, rowCount];
    if (rowCount == columnCount)
    {
      transposed = (double[,]) arr.Clone();
      for (int i = 1; i < rowCount; i++)
      {
        for (int j = 0; j < i; j++)
        {
          double temp = transposed[i, j];
          transposed[i, j] = transposed[j, i];
          transposed[j, i] = temp;
        }
      }
    }
    else
    {
      for (int column = 0; column < columnCount; column++)
      {
        for (int row = 0; row < rowCount; row++)
        {
          transposed[column, row] = arr[row, column];
        }
      }
    }
    return transposed;
  }







  public class Sky


  {
    private double Sigma = 5.670374419e-8;
    public double[] Emissivity ;
    public double[] Temp;
    public double[] HZ_IR;
    private double Kelvin = 273.15;

    public  Sky(double[] T_dew, double[] T_DryBulb, double[] SkyCover, double[] RelHum , double SourceEmissivity = 1){

      var numberOfHours = T_DryBulb.Length;

      this.Emissivity = new double[numberOfHours];
      this.Temp = new double[numberOfHours];
      this.HZ_IR = new double[numberOfHours];



      for (int h = 0; h < numberOfHours; h++){



        this.Emissivity[h] = CalcEmissivity(T_dew[h], SkyCover[h]);
        // this.Emissivity[h] = CalcEmissivityEnergyPlus(3, T_dew[h], T_DryBulb[h],SkyCover[h],RelHum[h]);
        this.HZ_IR[h] = CalcHZ_IR(this.Emissivity[h], this.Sigma, T_DryBulb[h]);
        this.Temp[h] = CalcTemp(HZ_IR[h], SourceEmissivity);

      }

    }

    private double CalcHZ_IR(double Emissivity, double Sigma, double T_drybulb){


      return Emissivity * Sigma * Math.Pow((T_drybulb + 273.15), 4);
    }

    private double CalcEmissivity (double T_dew, double N){

      // N = SkyCover
      return (0.787 + 0.764 * Math.Log((T_dew + Kelvin) / Kelvin)) * (1 + (0.0224 * N) - ( 0.0035 * Math.Pow(N, 2)) + ( 0.00028 * Math.Pow(N, 3)));
    }


    private  double CalcEs(double T_celcius)
    {
      //!~ **********************************************
      //!~calculates saturation vapour pressure over water in hPa for input air temperature(ta) in celsius according to:
      //!~Hardy, R.; ITS-90 Formulations for Vapor Pressure, Frostpoint Temperature, Dewpoint Temperature and Enhancement Factors in the Range -100 to 100 °C;
      //!~Proceedings of Third International Symposium on Humidity and Moisture; edited by National Physical Laboratory(NPL), London, 1998, pp. 214-221
      //!~http://www.thunderscientific.com/tech_info/reflibrary/its90formulas.pdf (retrieved 2008-10-01)

      // es = saturation vapour pressure in Pa // T is temperature in K // g is list of
      // coefficients for curve fit

      double T_kelvin; //int I;
      double[] g = {
        -2.8365744E3,
        -6.028076559E3, 1.954263612E1,
        -2.737830188E-2, 1.6261698E-5, 7.0229056E-10,
        -1.8680009E-13, 2.7150305 };

      T_kelvin = T_celcius + 273.15; //! air temp in K double
      var es = g[7] * Math.Log(T_kelvin);


      // do i=0,6
      for (int i = 0; i < 6; i++)
      {
        es = es + g[i] * Math.Pow(T_kelvin, (i - 2));

      }
      //end do

      es = Math.Exp(es) * 0.01; //! *0.01: convert Pa to hPa

      return es;
    }



    private double CalcEmissivityEnergyPlus (int ESkyCalcType, double OSky, double DryBulb, double DewPoint, double RelHum){
      // Calculate Sky Emissivity
      // References:
      // M. Li, Y. Jiang and C. F. M. Coimbra,
      // "On the determination of atmospheric longwave irradiance under all-sky conditions,"
      // Solar Energy 144, 2017, pp. 40–48,
      // G. Clark and C. Allen, "The Estimation of Atmospheric Radiation for Clear and
      // Cloudy Skies," Proc. 2nd National Passive Solar Conference (AS/ISES), 1978, pp. 675-678.


      // var Pvsk = 6.105 * Math.Exp((17.27 * ((double)DryBulb + 273.15) - 4717.03) / (237.7 + (double)DryBulb));


      var TKelvin = 273.15;

      var ESky = 0.0;
      if (ESkyCalcType == 1) {
        double PartialPress = RelHum * CalcEs(DryBulb) * 0.01;
        ESky = 0.618 + 0.056 * Math.Pow(PartialPress, 0.5);
      } else if (ESkyCalcType == 2) {
        double PartialPress = RelHum * CalcEs(DryBulb) * 0.01;
        ESky = 0.685 + 0.000032 * PartialPress * Math.Exp(1699 / (DryBulb + TKelvin));
      } else if (ESkyCalcType == 3) {
        double TDewC = new List<double> (){DryBulb, DewPoint}.Min();
        ESky = 0.758 + 0.521 * (TDewC / 100) + 0.625 * Math.Pow((TDewC / 100), 2);
      } else {
        ESky = 0.787 + 0.764 * Math.Log((new List<double> (){DryBulb, DewPoint}.Min() + TKelvin) / TKelvin);
      }
      ESky = ESky * (1 + (0.0224 * OSky) - ( 0.0035 * Math.Pow(OSky, 2)) + ( 0.00028 * Math.Pow(OSky, 3)));
      return    ESky;
    }




    private double CalcTemp (double HZ_IR, double SourceEmissivity){

      return Math.Pow((HZ_IR / (SourceEmissivity * this.Sigma)), 0.25) - Kelvin;
    }

  }



  public class SolarGain
  {
    //// https://github.com/CenterForTheBuiltEnvironment/pythermalcomfort/blob/master/src/pythermalcomfort/models.py

    ////
    ////         Calculates the solar gain to the human body using the Effective Radiant Field (ERF) [1]_. The ERF is a measure of the net energy flux to or from the human body.
    ////         ERF is expressed in W over human body surface area [w/m2]. In addition, it calculates the delta mean radiant temperature. Which is the amount by which the mean radiant
    ////         temperature of the space should be increased if no solar radiation is present.
    ////         Parameters
    ////         ----------
    ////         sol_altitude : float
    ////             Solar altitude, degrees from horizontal [deg]. Ranges between 0 and 90.
    ////         sol_azimuth : float
    ////             Solar azimuth, degrees clockwise from North [deg]. Ranges between 0 and 180.
    ////         posture : str
    ////             Default 'seated' list of available options 'standing', 'supine' or 'seated'
    ////         sol_radiation_dir : float
    ////             Direct-beam solar radiation, [W/m2]. Ranges between 200 and 1000. See Table C2-3 of ASHRAE 55 2017 [1]_.
    ////         sol_transmittance : float
    ////             Total solar transmittance, ranges from 0 to 1. The total solar transmittance of window systems, including glazing unit, blinds, and other façade treatments, shall be determined using one of the following methods:
    ////             i) Provided by manufacturer or from the National Fenestration Rating Council approved Lawrence Berkeley National Lab International Glazing Database.
    ////             ii) Glazing unit plus venetian blinds or other complex or unique shades shall be calculated using National Fenestration Rating Council approved software or Lawrence Berkeley National Lab Complex Glazing Database.
    ////         f_svv : float
    ////             Fraction of sky vault exposed to body, ranges from 0 to 1.
    ////         f_bes : float
    ////             Fraction of the possible body surface exposed to sun, ranges from 0 to 1. See Table C2-2 and equation C-7 ASHRAE 55 2017 [1]_.
    ////         asw: float
    ////             The average short-wave absorptivity of the occupant. It will range widely, depending on the color of the occupant’s skin as well as the color and amount of clothing covering the body.
    ////             A value of 0.7 shall be used unless more specific information about the clothing or skin color of the occupants is available.
    ////             Note: Short-wave absorptivity typically ranges from 0.57 to 0.84, depending on skin and clothing color. More information is available in Blum (1945).
    ////         floor_reflectance: float
    ////             Floor refectance. It is assumed to be constant and equal to 0.6.
    ////         Notes
    ////         -----
    ////         More information on the calculation procedure can be found in Appendix C of [1]_.
    ////         Returns
    ////         -------
    ////         erf: float
    ////             Solar gain to the human body using the Effective Radiant Field [W/m2]
    ////         delta_mrt: float
    ////             Delta mean radiant temperature. The amount by which the mean radiant temperature of the space should be increased if no solar radiation is present.
    ////         Examples
    ////         --------
    ////         .. code-block:: python
    ////             >>> from pythermalcomfort.models import solar_gain
    ////             >>> results = solar_gain(sol_altitude=0, sol_azimuth=120, sol_radiation_dir=800, sol_transmittance=0.5, f_svv=0.5, f_bes=0.5, asw=0.7, posture='seated')
    ////             >>> print(results)
    ////             {'erf': 42.9, 'delta_mrt': 10.3}
    ////

    //public double DeltaMRT;

    //public double ERF;

    //public SolarGain(
    //  double sol_altitude,
    //  double sol_azimuth,
    //  double sol_radiation_dir,
    //  double sol_transmittance,
    //  double f_svv,
    //  double f_bes,
    //  double asw = 0.7,
    //  string posture = "seated",
    //  double floor_reflectance = 0.6)
    //{
    //    posture = posture.ToLower();
    //    if (!new List<string> {
    //  "standing",
    //  "supine",
    //  "seated"
    //  }.Contains(posture))
    //    {
    //        Exception e = new Exception("Posture has to be either standing, supine or seated");
    //    }

    //    var deg_to_rad = 0.0174532925;
    //    var hr = 6;
    //    var i_diff = 0.2 * sol_radiation_dir;

    //    /// Edit Patrick
    //    /// Break when larger than 180

    //    if (sol_azimuth > 180.0)
    //    {
    //        sol_azimuth = 360.0 - sol_azimuth;
    //    }

    //    /// Edit Patrick

    //    var fp_table = new List<List<double>> {
    //    new List<double> {  0.25,  0.25,  0.23, 0.19, 0.15, 0.1,  0.06 }, new List<double> { 0.25, 0.25, 0.23, 0.18, 0.15, 0.1, 0.06 }, new List<double> { 0.24, 0.24, 0.22, 0.18, 0.14, 0.1, 0.06 }, new List<double> { 0.22, 0.22, 0.2, 0.17, 0.13, 0.09, 0.06 }, new List<double> { 0.21, 0.21, 0.18, 0.15, 0.12, 0.08, 0.06 }, new List<double> { 0.18, 0.18, 0.17, 0.14, 0.11, 0.08, 0.06 }, new List<double> { 0.17, 0.17, 0.16, 0.13, 0.11, 0.08, 0.06 }, new List<double> { 0.18, 0.18, 0.16, 0.13, 0.11, 0.08, 0.06 }, new List<double> { 0.2, 0.2, 0.18, 0.15, 0.12, 0.08, 0.06 }, new List<double> { 0.22, 0.22, 0.2, 0.16, 0.13, 0.09, 0.06 }, new List<double> { 0.24, 0.24, 0.21, 0.17, 0.13, 0.09, 0.06 }, new List<double> { 0.25, 0.25, 0.22, 0.18, 0.14, 0.09, 0.06 }, new List<double> { 0.25, 0.25, 0.22, 0.18, 0.14, 0.09, 0.06}
    //    };
    //    if (posture == "seated")
    //    {
    //        fp_table = new List<List<double>>{
    //      new List<double> { 0.2, 0.23, 0.21, 0.21, 0.18, 0.16, 0.12 }, new List<double> { 0.2, 0.23, 0.2, 0.2, 0.19, 0.16, 0.12 }, new List<double> { 0.2, 0.23, 0.21, 0.2, 0.18, 0.15, 0.12 }, new List<double> { 0.19, 0.23, 0.2, 0.2, 0.18, 0.15, 0.12 }, new List<double> { 0.18, 0.21, 0.19, 0.19, 0.17, 0.14, 0.12 }, new List<double> { 0.16, 0.2, 0.18, 0.18, 0.16, 0.13, 0.12 }, new List<double> { 0.15, 0.18, 0.17, 0.17, 0.15, 0.13, 0.12 }, new List<double> { 0.16, 0.18, 0.16, 0.16, 0.14, 0.13, 0.12 }, new List<double> { 0.18, 0.18, 0.16, 0.14, 0.14, 0.12, 0.12 }, new List<double> { 0.19, 0.18, 0.15, 0.13, 0.13, 0.12, 0.12 }, new List<double> { 0.21, 0.18, 0.14, 0.12, 0.12, 0.12, 0.12 }, new List<double> { 0.21, 0.17, 0.13, 0.11, 0.11, 0.12, 0.12 }, new List<double> { 0.21, 0.17, 0.12, 0.11, 0.11, 0.11, 0.12 }
    //      };
    //    }
    //    if (posture == "supine")
    //    {
    //        var alt_temp = sol_altitude;
    //        sol_altitude = Math.Abs(90 - sol_azimuth);
    //        sol_azimuth = alt_temp;
    //    }
    //    var alt_range = new List<int> {
    //    0, 15, 30, 45, 60, 75, 90
    //    };
    //    var az_range = new List<int> {
    //    0, 15, 30, 45, 60, 75, 90, 105, 120, 135, 150, 165, 180
    //    };
    //    var alt_i = Find_span(alt_range, sol_altitude);
    //    var az_i = Find_span(az_range, sol_azimuth);
    //    double fp11 = fp_table[az_i][alt_i];
    //    double fp12 = fp_table[az_i][alt_i + 1];
    //    double fp21 = fp_table[az_i + 1][alt_i];
    //    double fp22 = fp_table[az_i + 1][alt_i + 1];
    //    var az1 = az_range[az_i];
    //    var az2 = az_range[az_i + 1];
    //    var alt1 = alt_range[alt_i];
    //    var alt2 = alt_range[alt_i + 1];
    //    var fp = fp11 * (az2 - sol_azimuth) * (alt2 - sol_altitude);
    //    fp += fp21 * (sol_azimuth - az1) * (alt2 - sol_altitude);
    //    fp += fp12 * (az2 - sol_azimuth) * (sol_altitude - alt1);
    //    fp += fp22 * (sol_azimuth - az1) * (sol_altitude - alt1);
    //    fp /= (az2 - az1) * (alt2 - alt1);
    //    var f_eff = 0.725;
    //    if (posture == "seated")
    //    {
    //        f_eff = 0.696;
    //    }
    //    var sw_abs = asw;
    //    var lw_abs = 0.95;
    //    var e_diff = f_eff * f_svv * 0.5 * sol_transmittance * i_diff;
    //    var e_direct = fp * sol_transmittance * f_bes * sol_radiation_dir;
    //    var e_refl = f_eff * f_svv * 0.5 * sol_transmittance * (sol_radiation_dir * Math.Sin(sol_altitude * deg_to_rad) + i_diff) * floor_reflectance;
    //    var e_solar = e_diff + e_direct + e_refl;
    //    var erf = e_solar * (sw_abs / lw_abs);
    //    var d_mrt = erf / (hr * f_eff);

    //    this.ERF = Math.Round(erf, 1);
    //    this.DeltaMRT = Math.Round(d_mrt, 1);

    //    // print(fp, e_diff, e_direct, e_refl, e_solar, erf, d_mrt)
    //}

    //public static int Find_span(List<int> arr, double x)

    //{
    //    for (int i = 0; i < arr.Count - 1; i++)
    //    {
    //        if (arr[i + 1] >= x && x >= arr[i])
    //        {
    //            return i;
    //        }
    //    }

    //    // Last element in Python, arr.Count in C#
    //    return arr.Count;
    //}





    public enum Posture
    {
      supine,

      seating,

      standing
    };

    public static void ERF(double alt, double az, Posture posture, double Idir, double tsol, double fsvv, double fbes, double asa, out double ERF, out double dMRT, double tsol_factor = 1.0)
    {
      //  ERF function to estimate the impact of solar radiation on occupant comfort
      //  INPUTS:
      //  alt : altitude of sun in degrees [0, 90]
      //  az : azimuth of sun in degrees [0, 180]
      //  posture: posture of occupant ('seated', 'standing', or 'supine')
      //  Idir : direct beam intensity (normal)
      //  tsol: total solar transmittance (SC * 0.87)
      //  fsvv : sky vault view fraction : fraction of sky vault in occupant's view [0, 1]
      //  fbes : fraction body exposed to sun [0, 1]
      //  asa : avg shortwave abs : average shortwave absorptivity of body [0, 1]
      //  tsol_factor : (optional) correction to tsol based on angle of incidence

      var DEG_TO_RAD = 0.0174532925;
      var hr = 6;
      var Idiff = 0.2 * Idir;

      // Floor reflectance
      var Rfloor = 0.6;

      var fp = Get_fp(alt, az, posture);

      var feff = 0.0;

      if (posture == Posture.standing || posture == Posture.supine)
      {
        feff = 0.725;
      }

        // (posture == Posture.seating)
      else
      {
        feff = 0.696;
      }

      var sw_abs = asa;
      var lw_abs = 0.95;

      var E_diff = feff * fsvv * 0.5 * tsol * Idiff;
      var E_direct = fp * tsol * fbes * Idir;
      var E_refl = feff * fsvv * 0.5 * tsol * (Idir * Math.Sin(alt * DEG_TO_RAD) + Idiff) * Rfloor;

      var E_solar = E_diff + E_direct + E_refl;
      ERF = E_solar * (sw_abs / lw_abs);
      dMRT = ERF / (hr * feff);
    }

    private static int Find_span(int[] arr, double x)
    {
      // for ordered array arr and value x, find the left index
      // of the closed interval that the value falls in.

      for (var i = 0; i < arr.Length - 1; i++)
      {
        if (x <= arr[i + 1] && x >= arr[i])
        {
          return i;
        }
      }
      return -1;
    }

    private static double Get_fp(double alt, double az, Posture posture)
    {
      //  This function calculates the projected sunlit fraction (fp)
      //  given a seated or standing posture, a solar altitude, and a
      //  solar horizontal angle relative to the person (SHARP). fp
      //  values are taken from Thermal Comfort, Fanger 1970, Danish
      //  Technical Press.

      //  alt : altitude of sun in degrees [0, 90] Integer
      //  az : azimuth of sun in degrees [0, 180] Integer

      // fix inputs

      if (alt > 90)
      {
        alt = 90;
      }
      if (az > 180)
      {
        az = 360 - az;
      }

      // fix inputs

      var jDim = 7;
      var iDim = 13;

      var fp_table = new double[iDim][];

      for (int ii = 0; ii < iDim; ii++)
      {
        fp_table[ii] = new double[jDim];
      }

      if (posture == Posture.standing || posture == Posture.supine)
      {
        fp_table[0] = new double[] { 0.25, 0.25, 0.23, 0.19, 0.15, 0.10, 0.06 };
        fp_table[1] = new double[] { 0.25, 0.25, 0.23, 0.18, 0.15, 0.10, 0.06 };
        fp_table[2] = new double[] { 0.24, 0.24, 0.22, 0.18, 0.14, 0.10, 0.06 };
        fp_table[3] = new double[] { 0.22, 0.22, 0.20, 0.17, 0.13, 0.09, 0.06 };
        fp_table[4] = new double[] { 0.21, 0.21, 0.18, 0.15, 0.12, 0.08, 0.06 };
        fp_table[5] = new double[] { 0.18, 0.18, 0.17, 0.14, 0.11, 0.08, 0.06 };
        fp_table[6] = new double[] { 0.17, 0.17, 0.16, 0.13, 0.11, 0.08, 0.06 };
        fp_table[7] = new double[] { 0.18, 0.18, 0.16, 0.13, 0.11, 0.08, 0.06 };
        fp_table[8] = new double[] { 0.20, 0.20, 0.18, 0.15, 0.12, 0.08, 0.06 };
        fp_table[9] = new double[] { 0.22, 0.22, 0.20, 0.16, 0.13, 0.09, 0.06 };
        fp_table[10] = new double[] { 0.24, 0.24, 0.21, 0.17, 0.13, 0.09, 0.06 };
        fp_table[11] = new double[] { 0.25, 0.25, 0.22, 0.18, 0.14, 0.09, 0.06 };
        fp_table[12] = new double[] { 0.25, 0.25, 0.22, 0.18, 0.14, 0.09, 0.06 };
      }
      else if (posture == Posture.seating)
      {
        fp_table[0] = new double[] { 0.20, 0.23, 0.21, 0.21, 0.18, 0.16, 0.12 };

        // typo in original code
        fp_table[1] = new double[] { 0.203232, 0.228288, 0.204624, 0.200448, 0.186528, 0.157992, 0.123192 };
        fp_table[2] = new double[] { 0.20, 0.23, 0.21, 0.20, 0.18, 0.15, 0.12 };
        fp_table[3] = new double[] { 0.19, 0.23, 0.20, 0.20, 0.18, 0.15, 0.12 };
        fp_table[4] = new double[] { 0.18, 0.21, 0.19, 0.19, 0.17, 0.14, 0.12 };
        fp_table[5] = new double[] { 0.16, 0.20, 0.18, 0.18, 0.16, 0.13, 0.12 };
        fp_table[6] = new double[] { 0.15, 0.18, 0.17, 0.17, 0.15, 0.13, 0.12 };
        fp_table[7] = new double[] { 0.16, 0.18, 0.16, 0.16, 0.14, 0.13, 0.12 };
        fp_table[8] = new double[] { 0.18, 0.18, 0.16, 0.14, 0.14, 0.12, 0.12 };
        fp_table[9] = new double[] { 0.19, 0.18, 0.15, 0.13, 0.13, 0.12, 0.12 };
        fp_table[10] = new double[] { 0.21, 0.18, 0.14, 0.12, 0.12, 0.12, 0.12 };
        fp_table[11] = new double[] { 0.21, 0.17, 0.13, 0.11, 0.11, 0.12, 0.12 };
        fp_table[12] = new double[] { 0.21, 0.17, 0.12, 0.11, 0.11, 0.11, 0.12 };
        };

      if (posture == Posture.supine)
      {
        // transpose alt and az for a supine person
        var alt_temp = alt;
        alt = Math.Abs(90 - az);
        az = alt_temp;
      }

      double fp;
      var alt_range = new int[] { 0, 15, 30, 45, 60, 75, 90 };
      var az_range = new int[] { 0, 15, 30, 45, 60, 75, 90, 105, 120, 135, 150, 165, 180 };

      var alt_i = Find_span(alt_range, alt);
      var az_i = Find_span(az_range, az);

      var fp11 = fp_table[az_i][alt_i];
      var fp12 = fp_table[az_i][alt_i + 1];
      var fp21 = fp_table[az_i + 1][alt_i];
      var fp22 = fp_table[az_i + 1][alt_i + 1];

      var az1 = az_range[az_i];
      var az2 = az_range[az_i + 1];
      var alt1 = alt_range[alt_i];
      var alt2 = alt_range[alt_i + 1];

      // bilinear interpolation
      fp = fp11 * (az2 - az) * (alt2 - alt);
      fp += fp21 * (az - az1) * (alt2 - alt);
      fp += fp12 * (az2 - az) * (alt - alt1);
      fp += fp22 * (az - az1) * (alt - alt1);
      fp /= (az2 - az1) * (alt2 - alt1);

      return fp;
    }

    //private function get_fp_real(alt, az, posture)
    //{
    //    //  alt : altitude of sun in degrees [0, 90] Integer
    //    //  az : azimuth of sun in degrees [0, 180] Integer

    //    if (posture == 'standing' | posture == 'supine')
    //    {
    //        var fp_table = [[0.25375, 0.25375, 0.22765, 0.18705, 0.14935, 0.1044, 0.05945],

    //            [0.24795, 0.24795, 0.22475, 0.1827, 0.145, 0.1015, 0.05945],

    //            [0.23925, 0.23925, 0.2175, , 0.1769, 0.13775, 0.0957, 0.05945],

    //            [0.22475, 0.22475, 0.199375, 0.1653, 0.126875, 0.0899, 0.05945],

    //            [0.205175, 0.205175, 0.181975, 0.1508, , 0.116, 0.08265, 0.05945],

    //            [0.1827, 0.1827, 0.1653, 0.1363, 0.10875, 0.0783, 0.05945],

    //            [0.16675, 0.16675, 0.15515, 0.1305, 0.1073, 0.0783, 0.05945],

    //            [0.17545, 0.17545, 0.16095, 0.1305, 0.110925, 0.0812, 0.05945],

    //            [0.19865, 0.19865, 0.177625, 0.147175, 0.119625, 0.0841, 0.05945],

    //            [0.2204, 0.2204, 0.19575, 0.1595, 0.12615, 0.087725, 0.05945],

    //            [0.2378, 0.2378, 0.21025, 0.16965, 0.132675, 0.090625, 0.05945],

    //            [0.2494, 0.2494, 0.2204, 0.1769, 0.13775, 0.0928, 0.05945],

    //            [0.251575, 0.251575, 0.2233, 0.17835, 0.138475, 0.0928, 0.05945]];
    //    }
    //    else if (posture == 'seated')
    //    {
    //        var fp_table = [[0.20184, 0.225504, 0.21228, 0.210888, 0.182352, 0.155904, 0.123192],

    //            [0.203232, 0.228288, 0.204624, 0.200448, 0.186528, 0.157992, 0.123192],

    //            [0.200448, 0.231072, 0.207408, 0.20184, 0.183744, 0.154512, 0.123192],

    //            [0.190704, 0.226896, 0.204624, 0.201144, 0.175392, 0.148944, 0.123192],

    //            [0.176784, 0.214368, 0.19488, 0.192096, 0.167736, 0.140592, 0.123192],

    //            [0.16008, 0.196272, 0.182352, 0.18096, 0.162168, 0.134328, 0.123192],

    //            [0.150336, 0.18096, 0.172608, 0.169824, 0.15312, 0.129456, 0.123192],

    //            [0.162864, 0.179568, 0.164256, 0.157992, 0.144768, 0.12528, 0.123192],

    //            [0.182352, 0.18096, 0.155904, 0.144768, 0.136416, 0.122496, 0.123192],

    //            [0.19488, 0.18096, 0.14616, 0.133632, 0.128064, 0.11832, 0.123192],

    //            [0.207408, 0.178176, 0.135024, 0.121104, 0.116928, 0.116928, 0.123192],

    //            [0.212976, 0.174, 0.12528, 0.108576, 0.108576, 0.115536, 0.123192],

    //            [0.2088, 0.16704, 0.116928, 0.105792, 0.105792, 0.114144, 0.123192]];
    //    }

    //    if (posture == 'supine')
    //    {
    //        // transpose alt and az for a supine person
    //        alt_temp = alt;
    //        alt = Math.abs(90 - az)
    //        az = alt_temp;
    //    }

    //    var fp;
    //    var alt_range = [0, 15, 30, 45, 60, 75, 90];
    //    var az_range = [0, 15, 30, 45, 60, 75, 90, 105, 120, 135, 150, 165, 180];

    //    var alt_i = find_span(alt_range, alt);
    //    var az_i = find_span(az_range, az);

    //    var fp11 = fp_table[az_i][alt_i];
    //    var fp12 = fp_table[az_i][alt_i + 1];
    //    var fp21 = fp_table[az_i + 1][alt_i];
    //    var fp22 = fp_table[az_i + 1][alt_i + 1];

    //    var az1 = az_range[az_i];
    //    var az2 = az_range[az_i + 1];
    //    var alt1 = alt_range[alt_i];
    //    var alt2 = alt_range[alt_i + 1];

    //    // bilinear interpolation
    //    fp = fp11 * (az2 - az) * (alt2 - alt);
    //    fp += fp21 * (az - az1) * (alt2 - alt);
    //    fp += fp12 * (az2 - az) * (alt - alt1);
    //    fp += fp22 * (az - az1) * (alt - alt1);
    //    fp /= (az2 - az1) * (alt2 - alt1);

    //    return fp;
    //}
  }


  public class TwoPhaseDDS
  {
    //annualR_dc.ill + -s -1 output/annualR_dcd.ill + output/annual_dir.ill > output/annual_total.ill

    public double[][] dcill;

    public double[][] dcdill;

    public double[][] dirill;

    public double[][] totalIll;

    public string command;






    public TwoPhaseDDS(string baseWorkingDir, Mesh BuildingGeometry, List<Point3d> probes, Weather weather,bool run,bool load, string RadianceDir = @"C:\Program Files\Radiance")

    {

      var numberOfProbes = probes.Count;


      //var skySubDivDiff = SkySubdivision.r1;
      var skySubDivDiff = SkySubdivision.r2;
      var skySubDivDir = SkySubdivision.r4;

      if (!Directory.Exists(baseWorkingDir))
      {
        Directory.CreateDirectory(baseWorkingDir);
      }

      //export RAD for DAYSIM
      if (!Directory.Exists(baseWorkingDir + @"Rad\"))
      {
        Directory.CreateDirectory(baseWorkingDir + @"Rad\");
      }

      if (!Directory.Exists(baseWorkingDir + @"Output\"))
      {
        Directory.CreateDirectory(baseWorkingDir + @"Output\");
      }

      // User geometry data here

      string radMat = @"
        void plastic Generic_20
        0
        0
        5 0.2 0.2 0.2 0 0
        ";

      string radMatBlack = @"
        void plastic Black
        0
        0
        5 0 0 0 0 0
        ";
      Mesh daysimMesh = new Mesh();
      daysimMesh.Append(BuildingGeometry);

      // Todo: add ground plane to the above mesh

      // Make sure this understands userdata

      RadianceFiles.MeshProc(daysimMesh, baseWorkingDir + @"\scene.rad", "Generic_20", radMat);
      RadianceFiles.MeshProc(daysimMesh, baseWorkingDir + @"\sceneBlack.rad", "Black", radMatBlack);

      // Write Probes

      RadianceFiles.writePTS(baseWorkingDir + @"\sensors.pts", probes);

      // Weather
      var weaname = RadianceFiles.Epw2Wea(weather.epwFilePath, baseWorkingDir + @"\Rad\Output");

      // Sky
      //Skies.Write(baseWorkingDir + @"Rad\skyglow.rad", skySubDivDiff);
      Skies.Write(baseWorkingDir + @"Rad\skyglow" + (skySubDivDir - 1) + ".rad", (skySubDivDir - 1));
      Skies.Write(baseWorkingDir + @"Rad\skyglow" + (skySubDivDiff - 1) + ".rad", (skySubDivDiff - 1));

      //Utilities.StartProcess.StartProcessCMDNT(arg, false, true, false, true, probingComplete);


      if (run == true){

        using (Process process = new Process())
        {
          process.StartInfo.UseShellExecute = false;
          process.StartInfo.RedirectStandardOutput = true;
          process.StartInfo.RedirectStandardError = true;
          process.StartInfo.WorkingDirectory = baseWorkingDir + @"\Rad\";
          process.StartInfo.FileName = Path.Combine(Environment.SystemDirectory, "cmd.exe");
          process.StartInfo.RedirectStandardError = true;

          // Redirects the standard input so that commands can be sent to the shell.
          process.StartInfo.RedirectStandardInput = true;

          // Runs the specified command and exits the shell immediately.
          //process.StartInfo.Arguments = @"/c ""dir""";

          //process.OutputDataReceived += ProcessOutputDataHandler;
          //process.ErrorDataReceived += ProcessErrorDataHandler;

          process.Start();
          process.BeginOutputReadLine();
          process.BeginErrorReadLine();

          // Send a directory command and an exit command to the shell
          process.StandardInput.WriteLine(CommandLineArgsNew(RadianceDir, baseWorkingDir, probes.Count, weaname, weather.epwFilePath, 3, 5000, skySubDivDiff, skySubDivDir, Environment.ProcessorCount - 1));
          process.StandardInput.WriteLine("exit");

          process.WaitForExit();
        }

      }

      this.command = CommandLineArgsNew(RadianceDir, baseWorkingDir, probes.Count, weaname, weather.epwFilePath, 3, 5000, skySubDivDiff, skySubDivDir, Environment.ProcessorCount - 1);

      // this.dcill = LoadDDSIll(baseWorkingDir + @"\Output\annualR_dc.ill");
      //this.dcdill = LoadDDSIll(baseWorkingDir + @"\Output\annualR_dcd.ill");
      //this.dirill = LoadDDSIll(baseWorkingDir + @"\Output\annual_dir.ill");

      if(load){


        this.totalIll = LoadDDSIll(baseWorkingDir + @"\Output\annual_total.ill");

      }

      //  this.Values = new double[8760, numberOfProbes];

      //  this.dcill = new double[8760, numberOfProbes];
      //  this.dcdill = new double[8760, numberOfProbes];
      //  this.dirill = new double[8760, numberOfProbes];
      //  this.totalIll = new double[8760, numberOfProbes];

      /*


      System.Threading.Tasks.Parallel.For(0, 20, h =>
      {
      for (int p = 0; p < ; p++)
      {

      //this.Values[h, p] = GetMRTForPointViaKessling(weather, h, DiffRad[h][p], DirRad[h][p])[0];

      // this.dcill[h, p] = Ldcill[h][p];
      // this.dcdill[h, p] = Ldcdill[h][p];
      // this.dirill[h, p] = Ldirill[h][p];
      //  this.totalIll[h, p] = LtotalIll[h][p];


      }
      });


      */





    }


    private static double[][] LoadDDSIll(string illFileName) // total illuminance data
    {
      // [x][] time
      // [][x] points
      string[] illLines = System.IO.File.ReadAllLines(illFileName).Skip(9).ToArray();
      return illLines.Select(l => Array.ConvertAll<string, double>(l.Split(new[] { ' ' }).Skip(1).ToArray(), Double.Parse)).ToArray();

      //string[] lines = System.IO.File.ReadAllLines(illFileName);
      //double[][] values = new double[lines.Length][];

      /* for (int h = 0; h < lines.Length; h++)
      {
      string[] hourData = lines[h].Split(' ').Skip(4).ToArray();
      double[] hourDataDouble = Array.ConvertAll<string, double>(hourData, Double.Parse);
      values[h] = hourDataDouble;
      }
      return values;*/
    }

    public static string CommandLineArgsNew(string RadianceDir, string baseWorkingDir, int sensorCnt, string weaname, string epwpath, int ab, int ad, SkySubdivision diffSky, SkySubdivision dirSky, int n)
    {
      int skysubdiv = (int) diffSky;
      int skysubdivdirect = (int) diffSky;

      string command = @"

        cd " + baseWorkingDir + @"

        REM ###################################
        REM Pre
        REM ###################################

        REM Convert epw to wea tape
        REM -----------------------------------
        epw2wea """ + epwpath + @""" ""output/" + weaname + @".wea""

        REM Make the OCTREE
        REM -----------------------------------
        REM takes an array of rad files and combines them into one octree
        oconv scene.rad > output/scene.oct
        oconv sceneBlack.rad > output/sceneBlack.oct

        REM ###################################
        REM 1 Perform an annual daylight coefficient simulation.
        REM ###################################

        REM Create daylight coefficient matrix for R1 sky (145patches)
        REM -----------------------------------
        REM -I+ denotes that the simulation is being performed for calculating irradiance instead of radiance
        REM The 48 in -y 48 is equal to the number of lines in the file sensors.pts
        REM The number of processors assigned for the simulation can be set with -n 4
        rfluxmtx -I+ -y " + sensorCnt + @" -lw 0.0001 -ab " + ab + @"  -ad " + ad + @" -n " + n + @" - Rad/skyglowR" + (skysubdiv) +@".rad -i output/scene.oct < sensors.pts > output/dc_r" + skysubdiv + @".mtx

        REM Generates SkyVector for whole year.
        REM-----------------------------------
        REM -m controls the sky subdivision
        REM Use -O1 to switch to solar rad
        REM The −d option may be used to produce a sun -only matrix, with no sky contributions. Alternatively, the −s option may be used to exclude any direct solar component from the output.
        gendaymtx -m " + skysubdiv + @" -O1 ""output/" + weaname + @".wea"" > ""output/" + weaname + @".smx""

        REM Create Illum
        REM Illuminace Weights == 47.4 119.9 11.6  // For Radiation 0.265 0.670 0.065 ???
        REM -----------------------------------
        dctimestep output/dc_r" + skysubdiv + @".mtx ""output/" + weaname + @".smx"" | rmtxop -fa -t -c 0.265 0.670 0.065 - > ""output/annualR_dc.ill""

        REM ###################################
        REM 2 Perform an annual direct-only daylight coefficients simulation.
        REM ###################################

        rfluxmtx -I+ -y " + sensorCnt + @" -lw 0.0001 -ab " + ab + @" -ad " + ad + @" -n " + n + @" - Rad/skyglowR" + (skysubdiv) +@".rad -i output/sceneBlack.oct < sensors.pts > output/dcd_r" + skysubdiv + @".mtx

        gendaymtx -m " + skysubdiv + @" -O1 -d ""output/" + weaname + @".wea"" > ""output/" + weaname + @"d.smx""

        dctimestep output/dcd_r" + skysubdiv + @".mtx ""output/" + weaname + @"d.smx"" | rmtxop -fa -t -c 0.265 0.670 0.065 -> ""output/annualR_dcd.ill""

        REM ###################################
        REM 3 Perform an annual sun-coefficients simulation.
        REM ###################################
        echo void light solar 0 0 3 1e6 1e6 1e6 > output/suns.rad
        REM Create solar discs and corresponding modifiers for 2305 suns corresponding to a Reinhart MF:4 subdivision.
        REM 0.533 solar disc size as angle
        cnt " + (144 * skysubdivdirect * skysubdivdirect + 1) + @" | rcalc -e MF:4 -f ""C:\DIVA\Radiance\lib\reinsrc.cal"" -e Rbin=recno -o ""solar source sun 0 0 4 ${Dx} ${Dy} ${Dz} 0.533"" >> ""output/suns.rad""

        REM Put suns in scene...
        oconv sceneBlack.rad output/suns.rad > output/sceneBlackSuns.oct

        REM Calculate illuminance sun coefficients for illuminance calculations.
        rcontrib -I+ -ab 1 -y " + sensorCnt + @" -n 16 -ad 256 -lw 1.0e-3 -dc 1 -dt 0 -dj 0 -faf -e MF:" + skysubdivdirect + @" -f """ + RadianceDir + @"\lib\reinhart.cal"" -b rbin -bn Nrbins -m solar ""output/sceneBlackSuns.oct"" < sensors.pts > ""output/cdsDDS.mtx""

        REM - 5 option indicates 5phase method mode - solar disc angele must follow that input
        REM The -d option in the SMX messes it all up-- you can't include -d and -5 together.
        gendaymtx -5 0.533 -m " + skysubdivdirect + @" -O1 ""output/" + weaname + @".wea"" > ""output/sunM" + skysubdivdirect + @".smx""

        dctimestep ""output/cdsDDS.mtx"" ""output/sunM" + skysubdivdirect + @".smx"" | rmtxop -fa -t -c 0.265 0.670 0.065 - > ""output/annual_dir.ill""

        REM ###################################
        REM 4 Combine Results
        REM ###################################
        rmtxop ""output/annualR_dc.ill"" + -s -1 ""output/annualR_dcd.ill"" + ""output/annual_dir.ill"" > ""output/annual_total.ill""

        pause

        ";
      return command;
    }


  }
# ---------- end c_script_2 ----------
panel_6 = Panel(c_script_2.NHours)
panel_7 = Panel(c_script_2.out)
panel_8 = Panel(c_script_2.TEST)

# ----
# 6. Clean
button_6 = Button()
clean = Clean(Directory="C:\test_cyl", Mode=2, Run=button_6)

# ----
# Write your custom MRT file here!
c_script_3 = CSharpScript(points=visprobes.Points, MRT=panel_2)  # -> out, A; inputs points: list of Double, MRT: Double; disabled
# ---------- c_script_3: C# usings ----------
using System.Linq;
# ---------- c_script_3: C# ----------
    var tree = new DataTree<double>();

    var numberOfPoints = points.Count;

    for (int h = 0; h < 8760 ; h++){
      List<double> hv = Enumerable.Repeat(MRT, numberOfPoints).ToList();
      tree.AddRange(hv, new GH_Path(h));
      //  for(int p = 0; p < numberOfPoints; p++){


      //  }

    }

    A = tree;
# ---------- end c_script_3 ----------
bin = CSharpScript(caseFolder="C:\test_cyl", Tree=c_script_3.A, Run=button_4)  # inputs caseFolder: String, Tree: tree of Double, Run: Boolean; disabled
# ---------- bin: C# usings ----------
using System.IO;
using System.Linq;
# ---------- bin: C# ----------
    if (Run == true)
    {


      string fileName = "\\MRT.bin";


      writeBin(caseFolder + fileName, To2DArrayGen(Tree));



    }
# ---------- bin: C# additional code ----------
  public static double[,] To2DArrayGen(DataTree<double> tree)
  {
    double[,] result = new double[tree.Branches.Count, tree.Branches[0].Count];



    for (int i = 0; i < tree.Branches.Count; i++)
    {
      for (int j = 0; j < tree.Branches[0].Count; j++)
      {
        if (tree.Branches[i].Count != tree.Branches[0].Count) throw new InvalidOperationException("The list cannot contain elements (lists) of different sizes.");
        result[i, j] = tree.Branches[i][j];   //[i];
      }
    }
    return result;
  }


  public static void writeBin(string fileName, double[,] values)
  {
    // [i, time j] points

    BinaryWriter bw;

    //create the file
    try
    {
      bw = new BinaryWriter(new FileStream(fileName, FileMode.Create));
    }
    catch (IOException e)
    {
      Console.WriteLine(e.Message + "\n Cannot create file.");
      return;
    }

    //writing into the file
    try
    {
      bw.Write((Int32) values.GetLength(0));
      bw.Write((Int32) values.GetLength(1));

      for (int i = 0; i < values.GetLength(0); i++)
      {
        for (int j = 0; j < values.GetLength(1); j++)
        {
          float fval = (float) values[i, j];
          bw.Write(fval);
        }
      }
    }
    catch (IOException e)
    {
      Console.WriteLine(e.Message + "\n Cannot write to file.");
      return;
    }
    bw.Close();
  }
# ---------- end bin ----------

# ----
# 5. Post-processing
# Don't click run if you provide your own data.
# Multi-directional / annual wind vectors
# 5.2. Grasshopper
button_7 = Button()
dir = Slider(2, range=0..7)  # disabled
points = Data(visprobes.Points)  # disabled
vectors = Data(visprobes.Result)  # disabled
mean_radiant_temperature = MeanRadiantTemperature(SimulationResult=simulation, ProbingPoints=visprobes.Points, SimulationMode=0, Run=button_7)
choose_dir = TreeBranch(Tree=vectors, Path=dir, MaintainPaths=True)  # disabled
number_slider_2 = Slider(6, range=0..10)  # disabled
cluster = Cluster(data=choose_dir)  # -> S, E, data_3; disabled
gradient = Gradient(
    LowerLimit=cluster.S,
    UpperLimit=number_slider_2,
    Parameter=cluster.data_3,
    stops=[0.103: RGB(0, 0, 255), 0.22: RGB(0, 170, 255), 0.305: RGB(0, 255, 255), 0.398: RGB(0, 255, 188), 0.504: RGB(0, 255, 106), 0.605: RGB(91, 255, 0), 0.699: RGB(184, 255, 0), 0.799: RGB(255, 255, 0), 0.898: RGB(255, 170, 0)])  # disabled
dedata = DeconstructData(In=mean_radiant_temperature, Hours=Slider(1700, range=0..10000))
number_slider_3 = Slider(3, range=0..10)  # disabled
vdisex = VectorDisplayEx(Point=points, Vector=choose_dir, Colour=gradient, Width=number_slider_3)  # disabled
cluster_2 = Cluster_2(C=visprobes.Points, R=Slider(2, range=0..10))

wind_factors = WindFactors(Result=simulation, ProbingPoints=visprobes.Points, WindVelocity=visprobes.Result, Run=Button(), Interpolation=True)  # -> WindFactorsSpatial, WindFactorsAnnual; disabled
outdoor_thermal_comfort = OutdoorThermalComfort(
    SimulationResult=simulation,
    ProbingPoints=visprobes.Points,
    WindFactorsAnnual=wind_factors.WindFactorsAnnual,
    MeanRadiantTemperature=mean_radiant_temperature,
    Run=Button())  # -> UniversalThermalClimateIndexCObject, ComfortableHours; disabled
cluster_3 = Cluster_3(D=dedata)  # -> flatten(am)

cluster_4 = Cluster(data=cluster_3)  # -> S, E, data_3
gradient_2 = Gradient(
    LowerLimit=Slider(0, range=0..100),
    UpperLimit=Slider(25, range=0..100),
    Parameter=cluster_4.data_3,
    stops=[0.103: RGB(0, 0, 255), 0.22: RGB(0, 170, 255), 0.305: RGB(0, 255, 255), 0.398: RGB(0, 255, 188), 0.504: RGB(0, 255, 106), 0.605: RGB(91, 255, 0), 0.699: RGB(184, 255, 0), 0.799: RGB(255, 255, 0), 0.898: RGB(255, 170, 0)])
preview = CustomPreview(Geometry=cluster_2, Material=gradient_2)

# ==== cluster MeshPlane
number = ClusterInput()
number_2 = Number(number)
settings_custom = SettingsCustom(
    StitchSeams=True,
    SimplePlanes=False,
    Refine=True,
    MinCount=16,
    MaxCount=400,
    AspectRatio=20,
    MaxDistance=0,
    MaxAngle=20,
    MinEdge=number_2,
    MaxEdge=number_2)
brep = ClusterInput()
mesh_brep = MeshBrep(Brep=brep, Settings=settings_custom)
deconstruct_mesh = DeconstructMesh(Mesh=mesh_brep)  # -> Vertices, Faces, Colours, Normals
faces = ClusterOutput(deconstruct_mesh.Faces)
vertices = ClusterOutput(deconstruct_mesh.Vertices)

# ==== cluster Cluster
data = ClusterInput()
data_2 = Data(data)
data_3 = ClusterOutput(data_2)
bnd = Bounds(Numbers=data_2)
dedomain = DeconstructDomain(Domain=bnd)  # -> Start, End
S = ClusterOutput(dedomain.Start)
E = ClusterOutput(dedomain.End)

# ==== cluster Cluster_2
C = ClusterInput()
R = ClusterInput()
circle = CircleCNR(Center=C, Normal=Vector(0, 0, 1), Radius=R)
srf = Surface(circle)
srf_2 = ClusterOutput(srf)

# ==== cluster Cluster_3
D = ClusterInput()
flip = FlipMatrix(Data=D)
avr = Average(Input=flip)
am = ClusterOutput(avr)
