# Grasshopper definition 7_IndoorCase.ghx (Grasshopper 1.0.8)
# plug-ins: Eddy3D

temperature = Panel("20")
velocity = Panel("1")
brep = Brep(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)
vec = VectorXYZ(XComponent=0, YComponent=velocity, ZComponent=0)  # -> Vector, Length
bbox = BoundingBox(Content=brep, Plane=PlaneXY(0, 0, 0))  # -> Box, Box_2
srf = Surface(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)

# ---- group: probing plane
srf_2 = Surface(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)
brep_to_grid_points = BrepToGridPoints(Geometry=srf_2, Spacing="0.2", Run=Toggle(True))  # -> Points, Status

# ----
srf_3 = Surface(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)
ol = Outlet(Geo=srf, Vel=Vector(0, 0, 0))
volume = Volume(Geometry=bbox.Box_2)  # -> Volume, Centroid
geo = Geometry(Geo=brep, Temp=temperature)
il = Inlet(Geo=srf_3, Vel=vec.Vector, Temp=temperature)
idom = IndoorDomain(
    Geo=geo,
    Inlet=il,
    Outlet=ol,
    Directory="C:\Eddy3D-Cases\IndoorCase\",
    PointInside=volume.Centroid,
    CellSize=".5",
    Iterations="1000",
    CPUs="2",
    Run=Button())
probe_simulation = ProbeSimulation(
    Result=idom,
    ProbingPoints=brep_to_grid_points.Points,
    NameOfInstance="probing",
    InterpolationScheme=3,
    NameOfField=0,
    Run=Button())  # -> ProbingPoints, ProbingResult
bounds = Bounds(Numbers=probe_simulation.ProbingResult)
vlen = VectorLength(Vector=probe_simulation.ProbingResult)
deconstruct_domain = DeconstructDomain(Domain=bounds)  # -> Start, End
gradient = Gradient(
    LowerLimit=deconstruct_domain.Start,
    UpperLimit=deconstruct_domain.End,
    Parameter=vlen,
    stops=[0: RGB(234, 38, 0), 0.25: RGB(234, 126, 0), 0.5: RGB(254, 244, 84), 0.75: RGB(173, 203, 249), 1: RGB(75, 107, 169)])
amplitude = Amplitude(Vector=probe_simulation.ProbingResult, Amplitude="0.1")
vdisex = VectorDisplayEx(Point=probe_simulation.ProbingPoints, Vector=amplitude, Colour=gradient, Width="3")
