# Grasshopper definition 7_IndoorExample.ghx (Grasshopper 1.0.7)
# plug-ins: Eddy3D

# ----
# Eddy3D Indoor Example
# Step 1: Imput Geometry
number_slider = Slider(49, range=0..100)
geo = Geometry(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)
geo_2 = Geometry(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)
facen = FaceNormals(Mesh=geo)  # -> Centers, Normals
geo_3 = Geometry(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)
geo_4 = Geometry(Geo=geo_2, Temp=number_slider)
ol = Outlet(Geo=geo_3, Vel=Vector(0, 0, 0))
il = Inlet(Geo=geo, Vel=facen.Normals, Temp=Slider(20, range=0..100))
pt = Point(Point(-1.876191958, -1.534687347, 1.727068955))

# ---- group: For any new case, please make sure to put it in a "0" subfolder.
panel = Panel("C:\temp\EddyProject\0\")

# ----
# Step 2: Run Simulation
number_slider_2 = Slider(2, range=0..10)
idom = IndoorDomain(
    Geo=geo_4,
    Inlet=il,
    Outlet=ol,
    Directory=panel,
    PointInside=pt,
    CellSize=number_slider_2,
    Iterations=Slider(100, range=0..100),
    Run=Toggle(False))  # -> Domain, Result

c_script = CSharpScript(Reference="C:\Eddy3D\EddyLib.dll")  # -> Res
# ---------- c_script: C# usings ----------
using EddyLib;
using EddyLib.BCs;
using System.Linq;
# ---------- c_script: C# ----------
    var point0 = new Rhino.Geometry.Point3d(0, 0, 0);
    var point1 = new Rhino.Geometry.Point3d(20, 0, 0);
    var point2 = new Rhino.Geometry.Point3d(0, 20, 0);
    var point3 = new Rhino.Geometry.Point3d(20, 20, 0);
    var point4 = new Rhino.Geometry.Point3d(0, 0, 40);
    var point5 = new Rhino.Geometry.Point3d(20, 0, 40);
    var point6 = new Rhino.Geometry.Point3d(0, 20, 40);
    var point7 = new Rhino.Geometry.Point3d(20, 20, 40);
    Rhino.Geometry.Box box1 = new Rhino.Geometry.Box(Rhino.Geometry.Plane.WorldXY, new List<Rhino.Geometry.Point3d>() { point0, point1, point2, point3, point4, point5, point6, point7 });
    Rhino.Geometry.MeshingParameters mp = new Rhino.Geometry.MeshingParameters();
    var m = Mesh.CreateFromBrep(box1.ToBrep(), mp);

    Rhino.Geometry.Mesh mm = new Rhino.Geometry.Mesh();

    foreach (Rhino.Geometry.Mesh im in m)
    {
      mm.Append(im);
    }



    var windDirList = new List<int>() { 0 };
    BoundaryCondition bcond = new ABL(windDirList, 5, 10, 1, 0, "");

    OFCylDomain DOMCYL = new OFCylDomain(mm, new Mesh(), bcond, 5, 50, 300, 80);




    var DOM = (EddyLib.Indoor.IndoorDomain) Dom;

    var RUNSETTINGS = new OFRunSettings(1000, 20, 5, fvSchemes.Optimized, 1, SimEngine.BlueCFD, OSType.Windows10, TurbModel.RNGkEpsilon, RelaxationFactors.Optimized, false, false);
    var MESHSETTINGS = new OFMeshSettings();


    var baseWorkingDirectory = DOM.WorkingDir;


    MESHSETTINGS.meshStlDir = baseWorkingDirectory + @"\\constant\triSurface\";
    MESHSETTINGS.meshPolyMeshDir = baseWorkingDirectory + @"\\constant\polyMesh\";
    MESHSETTINGS.meshSystemDir = baseWorkingDirectory + @"\\system\";
    MESHSETTINGS.meshConstantDir = baseWorkingDirectory + @"\\constant\";
    MESHSETTINGS.meshWorkingDir = baseWorkingDirectory + @"\\";


    // MESHSETTINGS.meshStlFilenameBuildings = baseWorkingDirectory + @"\\constant\triSurface\building.stl";
    //MESHSETTINGS.meshStlFilenameGround = baseWorkingDirectory + @"\\constant\triSurface\ground.stl";
    // MESHSETTINGS.meshStlFilenameGroundPerim = baseWorkingDirectory + @"\\constant\triSurface\ground_perim.stl";
    // MESHSETTINGS.meshBoundaryConditionsDirectory = baseWorkingDirectory + @"\\0.org\";


    var RES = new EddyLib.OFResult(DOMCYL, RUNSETTINGS, MESHSETTINGS, DOM.WorkingDir.Replace("0\\", ""));

    Res = RES;
# ---------- end c_script ----------

# ----
# Step 3: Probing
brep = Brep(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)
brep_2 = Brep(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)
cluster = Cluster(B=brep_2, cutter=geo_2, relay=Slider(0.5, range=0..1))  # -> V, M
probing = Probing(Result=idom.Result, ProbingPoints=cluster.V, NameOfField=0, Run=Button())  # -> PorbingPoints, ProbingResult
vdisex = VectorDisplayEx(Point=probing.PorbingPoints, Vector=probing.ProbingResult, Colour=RGB(0, 0, 0), Width=2)

cluster_2 = Cluster_2(V=probing.ProbingResult, M=cluster.M)

# ==== cluster Cluster
relay = ClusterInput()
cutter = ClusterInput()
B = ClusterInput()
split = SplitBrep(Brep=B, Cutter=cutter)
custom_mesh_settings = SettingsCustom(
    StitchSeams=True,
    SimplePlanes=False,
    Refine=True,
    MinCount=16,
    MaxCount=400,
    AspectRatio=20,
    MaxDistance=0,
    MaxAngle=20,
    MinEdge=relay,
    MaxEdge=relay)
item = ListItem(List=split, Index="1", Wrap=True)
mesh = MeshBrep(Brep=item, Settings=custom_mesh_settings)
demesh = DeconstructMesh(Mesh=mesh)  # -> Vertices, Faces, Colours, Normals
M = ClusterOutput(mesh)
V = ClusterOutput(demesh.Vertices)

# ==== cluster Cluster_2
V = ClusterInput()
vlen = VectorLength(Vector=V)
smaller = SmallerThan(FirstNumber=vlen, SecondNumber="1")  # -> SmallerThan, OrEqualTo
bnd = Bounds(Numbers=smaller.SmallerThan)
dedomain = DeconstructDomain(Domain=bnd)  # -> Start, End
panel = Panel(vlen)
gradient = Gradient(
    LowerLimit=dedomain.Start,
    UpperLimit=dedomain.End,
    Parameter=vlen,
    stops=[0: RGB(234, 38, 0), 0.25: RGB(234, 126, 0), 0.5: RGB(254, 244, 84), 0.75: RGB(173, 203, 249), 1: RGB(75, 107, 169)])
M = ClusterInput()
mcol = MeshColours(Mesh=M, Colours=gradient)
cm = ClusterOutput(mcol)  # Colorized Mesh
