# Grasshopper definition 8_IndoorCovidCase_Restaurant.ghx (Grasshopper 1.0.7)
# plug-ins: Eddy3D

# Eddy3D Indoor COVID-19 Example
# Step 1: Imput Geometry
# Temperature
temp = Slider(33, range=27..35)
ac_outlet = Brep([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])
# Momentum Source
# (Fan- In)
ac_inlet = Brep([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])
# Volumetric Heat Sources(People)
volume = Brep([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])
# Momentum Sink (Furniture)
volume_2 = Brep([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])
# Viral Emitter
# Momentum Source
# (Fan-Out)
infected_emitter_mesh = Brep(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)
# Volume
volume_3 = Brep([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])
# Point Inside Volume
pt = Point(Point(3.152091326, -9.490595055, 0.4314200966))
# Inlets
ventilation_inlet_bathroom = Brep(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)
# Inlets
ventilation_inlet_fire_stair_door = Brep(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)
# Outlets
ventilation_outlet = Brep(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)

mesh_join = MeshJoin(Meshes=volume)
mesh = Mesh(mesh_join)
vhs = VolumetricHeatSource(Geo=mesh, Power=Slider(30, range=0..100), Name="volumetricHeatSource")

mesh_join_2 = MeshJoin(Meshes=volume_2)
msink = MomentumSink(Geo=mesh_join_2, Name="momentumSink")

mesh_join_3 = MeshJoin(Meshes=ac_outlet)
mesh_join_4 = MeshJoin(Meshes=ac_inlet)
mesh_2 = Mesh(mesh_join_4)
mesh_3 = Mesh(mesh_join_3)
ms = MomentumSource(Geo=[mesh_3, mesh_2], Ubar="{0,0,0.25}", Name="momentumSource")

mesh_join_5 = MeshJoin(Meshes=infected_emitter_mesh)
mesh_4 = Mesh(mesh_join_5)
viralem = ViralEmitter(Geo=mesh_4, Name="ViralEmitter", InjectionRate="2", Type=0)

ol = Outlet(Geo=ventilation_outlet, Vel=Vector(0, 0, 0))

ventilation_inlet_fire_stair_door_2 = Panel("-1.08")
facen = FaceNormals(Mesh=ventilation_inlet_bathroom)  # -> flatten(Centers), Normals
multiplication = Multiplication(A=facen.Normals, B=ventilation_inlet_fire_stair_door_2)  # -> flatten(Result)

join = BrepJoin(Breps=volume_3)  # -> Breps, Closed
geo = Geometry(Geo=join.Breps, Temp=temp)

il = Inlet(Geo=ventilation_inlet_bathroom, Vel=multiplication, Temp=temp)  # -> flatten(Inlet)
il_2 = Inlet(Geo=ventilation_inlet_fire_stair_door, Vel=multiplication, Temp=temp)  # -> flatten(Inlet)

# ---- group: For any new case, please make sure to put it in a "0" subfolder.
# Step 2: Run Simulation
panel = Panel("C:\IndoorTestName\0\")

# ----
indoordomain = IndoorDomain(
    Geo=geo,
    Outlet=ol,
    FunctionObjects=[viralem, ms, vhs, msink],
    Directory=panel,
    PointInside=pt,
    CellSize=Slider(0.3, range=0..1),
    Iterations=Slider(50, range=0..10000),
    Run=Toggle(False))  # -> Domain, Result

probing = Probing(NameOfField=0, Run_2=False)  # -> PorbingPoints, ProbingResult
probing_2 = Probing(ConvertQuadsToTriangles=False)
brep = Brep(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)

# ----
# Step 3: Probing
number_slider = Slider(0.5, range=0..1)
c_script = CSharpScript(Dom=indoordomain.Domain, Reference="C:\Eddy3D\EddyLib.dll")  # -> Res
# ---------- c_script: C# usings ----------
using EddyLib;
using EddyLib.BCs;
using System.Linq;
# ---------- c_script: C# ----------
    var point0 = new Rhino.Geometry.Point3d(0, 0, 0);
    var point1 = new Rhino.Geometry.Point3d(20, 0, 0);
    var point2 = new Rhino.Geometry.Point3d(0, 20, 0);
    var point3 = new Rhino.Geometry.Point3d(20, 20, 0);
    var point4 = new Rhino.Geometry.Point3d(0, 0, 40);
    var point5 = new Rhino.Geometry.Point3d(20, 0, 40);
    var point6 = new Rhino.Geometry.Point3d(0, 20, 40);
    var point7 = new Rhino.Geometry.Point3d(20, 20, 40);
    Rhino.Geometry.Box box1 = new Rhino.Geometry.Box(Rhino.Geometry.Plane.WorldXY, new List<Rhino.Geometry.Point3d>() { point0, point1, point2, point3, point4, point5, point6, point7 });
    Rhino.Geometry.MeshingParameters mp = new Rhino.Geometry.MeshingParameters();
    var m = Mesh.CreateFromBrep(box1.ToBrep(), mp);

    Rhino.Geometry.Mesh mm = new Rhino.Geometry.Mesh();

    foreach (Rhino.Geometry.Mesh im in m)
    {
      mm.Append(im);
    }



    var windDirList = new List<int>() { 0 };
    BoundaryCondition bcond = new ABL(windDirList, 5, 10, 1, 0, "");

    OFCylDomain DOMCYL = new OFCylDomain(mm, new Mesh(), bcond, 5, 50, 300, 80);




    var DOM = (EddyLib.Indoor.IndoorDomain) Dom;

    var RUNSETTINGS = new OFRunSettings(1000, 20, 5, fvSchemes.Optimized, 1, SimEngine.BlueCFD, OSType.Windows10, TurbModel.RNGkEpsilon, RelaxationFactors.Optimized, false, false);
    var MESHSETTINGS = new OFMeshSettings();


    var baseWorkingDirectory = DOM.WorkingDir;


    MESHSETTINGS.meshStlDir = baseWorkingDirectory + @"\\constant\triSurface\";
    MESHSETTINGS.meshPolyMeshDir = baseWorkingDirectory + @"\\constant\polyMesh\";
    MESHSETTINGS.meshSystemDir = baseWorkingDirectory + @"\\system\";
    MESHSETTINGS.meshConstantDir = baseWorkingDirectory + @"\\constant\";
    MESHSETTINGS.meshWorkingDir = baseWorkingDirectory + @"\\";


    // MESHSETTINGS.meshStlFilenameBuildings = baseWorkingDirectory + @"\\constant\triSurface\building.stl";
    //MESHSETTINGS.meshStlFilenameGround = baseWorkingDirectory + @"\\constant\triSurface\ground.stl";
    // MESHSETTINGS.meshStlFilenameGroundPerim = baseWorkingDirectory + @"\\constant\triSurface\ground_perim.stl";
    // MESHSETTINGS.meshBoundaryConditionsDirectory = baseWorkingDirectory + @"\\0.org\";


    var RES = new EddyLib.OFResult(DOMCYL, RUNSETTINGS, MESHSETTINGS, DOM.WorkingDir.Replace("0\\", ""));

    Res = RES;
# ---------- end c_script ----------
cluster = Cluster(B=brep, relay=number_slider)
probing_3 = Probing(Result=c_script, ProbingPoints=cluster, NameOfInstance="test", NameOfField=0, Run=Toggle(False), Run_2=False)  # -> PorbingPoints, ProbingResult
vlen = VectorLength(Vector=probing_3.ProbingResult)
vdisex = VectorDisplayEx(Point=probing_3.PorbingPoints, Vector=probing_3.ProbingResult, Colour=RGB(0, 0, 0), Width=2)
panel_2 = Panel(vlen)

# ==== cluster Cluster
relay = ClusterInput()
custom_mesh_settings = SettingsCustom(
    StitchSeams=True,
    SimplePlanes=False,
    Refine=True,
    MinCount=16,
    MaxCount=400,
    AspectRatio=20,
    MaxDistance=0,
    MaxAngle=20,
    MinEdge=relay,
    MaxEdge=relay)
B = ClusterInput()
mesh = MeshBrep(Brep=B, Settings=custom_mesh_settings)
demesh = DeconstructMesh(Mesh=mesh)  # -> Vertices, Faces, Colours, Normals
V = ClusterOutput(demesh.Vertices)
