# Grasshopper definition 99_Restaurant_EDDY_COVIDgh_Validation.ghx (Grasshopper 1.0.7)
# plug-ins: MeshEdit Components, Eddy3D, HAL for Grasshopper

document_path = CSharpScript()  # -> out, A
# ---------- document_path: C# usings ----------
using System.IO;
# ---------- document_path: C# ----------
    GH_Document gh_d = owner.OnPingDocument();

    if (gh_d.IsFilePathDefined)
    {
      Print("A path is defined.");
      A = System.IO.Path.GetDirectoryName(gh_d.FilePath);
    }
    else
    {
      Print("No path defined.");
    }
# ---------- end document_path ----------
# EDDY COVID-19:
# 
# Restaurant Validation Experiment:
# 
# Reference:
# https://www.medrxiv.org/content/10.1101/2020.04.16.20067728v1.full.pdf
# https://www.ncbi.nlm.nih.gov/pmc/articles/PMC7323555/
# 
# Ventilation Rates used:
# - high ventilation
# flow rate = 212  ft^2/min  (1.08m/s)
# - low ventilation
# flow rate = 15  ft^2/min (0.08m/s)
# 
# Emitter:
#  -located at  (1 m, 0.5 m,
# 1.6 m)
# - injection direction of (0, 1, 0)
# - average emission flow 0.21m/s
# - size tracer gas pipe= 8-mm inner diameter
# - speed =1.5 m/s
# 
# -temperature =32–34 °C
# 
# -Five coil AC unit: from Daiking website:
# https://www.daikinkuwait.com/content/dam/document-library/
# catalogues/as/fan-coil-units/fwd-at/FWV_FWL_FWM_FWD_
# FWB_EPCE04-25B_Catalogues_English.pdf
# 
# Measured Air flow:
# non-ABC zone = 1.04 L/s per patron
# ABC zone =  0.75 L/s per patron
sessionsettings = SessionSettings()

ventilation_inlet_bathroom = Brep(<brep referenced from the Rhino model>)
ventilation_inlet_bathroom_2 = Panel("-1.08")
ventilation_inlet_fire_stair_door = Panel("-1.08")
face_normals = FaceNormals(Mesh=ventilation_inlet_bathroom)  # -> flatten(Centers), Normals
multiplication = Multiplication(A=face_normals.Normals, B=ventilation_inlet_fire_stair_door)  # -> flatten(Result)
vector_display_ex = VectorDisplayEx(Point=face_normals.Centers, Vector=multiplication, Colour=RGB(255, 0, 0), Width=2)

ventilation_inlet_fire_stair_door_2 = Brep(<brep referenced from the Rhino model>)
ventilation_inlet_fire_stair_door_3 = Panel("-1.08")
face_normals_2 = FaceNormals(Mesh=ventilation_inlet_fire_stair_door_2)  # -> flatten(Centers), Normals
multiplication_2 = Multiplication(A=face_normals_2.Normals, B=ventilation_inlet_fire_stair_door_3)  # -> flatten(Result)
vector_display_ex_2 = VectorDisplayEx(Point=face_normals_2.Centers, Vector=multiplication_2, Colour=RGB(255, 0, 0), Width=2)

# ----
# Point locations to measure concentration
# Values from the Restaurant Paper
normalized_measured_concentration = Panel("""1
0.87
0.98
0
0
0
0
0
0
0.55
0
0
0
0
0.58
0.7
0.86
0.73""")
normalized_predicted_concentration = Panel("""1
1.04
0.93
1
0.62
0.47
0.42
0.42
0.32
0.52
0.57
0.5
0.55
0.63
0.54
0.56
0.5
0.85""")
_09 = Point(<point referenced from the Rhino model>)
_04 = Point(<point referenced from the Rhino model>)
_06 = Point(<point referenced from the Rhino model>)
_08 = Point(<point referenced from the Rhino model>)
_10 = Point(<point referenced from the Rhino model>)
_13 = Point(<point referenced from the Rhino model>)
_17 = Point(<point referenced from the Rhino model>)
_18 = Point(<point referenced from the Rhino model>)
_05 = Point(<point referenced from the Rhino model>)
_07 = Point(<point referenced from the Rhino model>)
_11 = Point(<point referenced from the Rhino model>)
_12 = Point(<point referenced from the Rhino model>)
_14 = Point(<point referenced from the Rhino model>)
_16 = Point(<point referenced from the Rhino model>)
pta = Point(<point referenced from the Rhino model>)
ptb = Point(<point referenced from the Rhino model>)
ptc = Point(<point referenced from the Rhino model>)
_15 = Point(<point referenced from the Rhino model>)
pt = Point([pta, ptb, ptc, _04, _05, _06, _07, _08, _09, _10, _11, _12, _13, _14, _15, _16, _17, _18])

# ----
# Validation Case
volume = Brep([<brep referenced from the Rhino model> x32])
brep_join = BrepJoin(Breps=volume)  # -> Breps, Closed

infected_emitter_mesh = Brep(<brep referenced from the Rhino model>)
face_normals_3 = FaceNormals(Mesh=infected_emitter_mesh)  # -> Centers, Normals
tracer_gas_emission_speed = Panel("-1.5")
multiplication_3 = Multiplication(A=face_normals_3.Normals, B=tracer_gas_emission_speed)
vector_display_ex_3 = VectorDisplayEx(Vector=multiplication_3, Colour=RGB(255, 0, 0), Width=2)

ventilation_outlet = Brep(<brep referenced from the Rhino model>)
face_normals_4 = FaceNormals(Mesh=ventilation_outlet)  # -> Centers, Normals
vector_display_ex_4 = VectorDisplayEx(Point=face_normals_4.Centers, Vector=face_normals_4.Normals, Colour=RGB(255, 0, 0), Width=2)

panel = Panel("230")
panel_2 = Panel("320")
panel_3 = Panel("400")
m_3_h = Panel("170")

convert_1_h_1_s = Panel("3600")
ac_outlet = Brep([<brep referenced from the Rhino model> x5])
mesh_area = MeshArea(Mesh=ac_outlet)  # -> Area, Centroid
division = Division(A="900", B=mesh_area.Area)
division_2 = Division(A=division, B=convert_1_h_1_s)
panel_4 = Panel("""{0,1,0}
{-1,0,0}
{-1,0,0}
{-1,0,0}
{-1,0,0}""")
multiplication_4 = Multiplication(A=mesh_area.Area, B=division_2)
multiplication_5 = Multiplication(A=panel_4, B=multiplication_4)
vector_display_ex_5 = VectorDisplayEx(Vector=multiplication_5, Colour=RGB(255, 0, 0), Width=2)

ac_inlet = Brep([<brep referenced from the Rhino model> x5])
face_normals_5 = FaceNormals(Mesh=ac_inlet)  # -> Centers, Normals
multiplication_6 = Multiplication(A=multiplication_4, B=-1)
multiplication_7 = Multiplication(A=face_normals_5.Normals, B=multiplication_6)
vector_display_ex_6 = VectorDisplayEx(Vector=multiplication_7, Colour=RGB(255, 0, 0), Width=2)

panel_5 = Panel(division)

# ----
# Plane to Simulate Age of Air and CO2 concentration
age_of_air_simulation_plane_mouth_height = Brep(<brep referenced from the Rhino model>)

temp = Slider(33, range=27..35)
pt_2 = Point(Point(3.152091326, -9.490595055, 0.4314200966))
mesh = Mesh(infected_emitter_mesh)
il = Inlet(Geo=ventilation_inlet_bathroom, Vel=multiplication, Temp=temp)  # -> flatten(Inlet)
il_2 = Inlet(Geo=ventilation_inlet_fire_stair_door_2, Vel=multiplication, Temp=temp)  # -> flatten(Inlet)
geo = Geometry(Geo=brep_join.Breps, Temp=temp)
ol = Outlet(Geo=ventilation_outlet, Vel=Vector(0, 0, 0))
vhs = VolumetricHeatSource(Geo=mesh, Power=Slider(0, range=0..100))

# ---- group: For any new case, please make sure to put it in a "0" subfolder.
panel_6 = Panel("C:\CovidRestaurant\0\")

# ----
number_slider = Slider(100, range=0..100)  # disabled
indoordomain = IndoorDomain(
    Geo=geo,
    Inlet=[il, il_2],
    Outlet=ol,
    Directory=panel_6,
    PointInside=pt_2,
    CellSize=Slider(0.3, range=0..1),
    Iterations=Slider(2000, range=0..10000))
c_script = CSharpScript(x=indoordomain, Reference="C:\Users\zorot\Documents\GitHub\Eddy3d\Eddy\bin\EddyLib.dll")  # -> out, A
# ---------- c_script: C# usings ----------
    using System.Linq;
using EddyLib;
using EddyLib.Indoor;
using  EddyLib.Indoor.Dicts;
using System.Text;
# ---------- c_script: C# ----------
    var dom = (EddyLib.Indoor.IndoorDomain) x;

    var res = new ControlDict(dom);

    A = res.InternalDict;
# ---------- c_script: C# additional code ----------
  public class ControlDict : EddyLib.Indoor.Dicts.GenericDict

  {
    public List<String> InternalDict = new List<string>();

    public ControlDict(IndoorDomain IndoorDom)
    {
      this.DictionaryName = "controlDict";

      this.Location = DictLocation.system;
      this.FC = FieldClass.dictionary;

      this.Header = GetHeader(this);

      this.InternalDict.Add(CppMapSerializerDyn2.Serialize(GetDict(IndoorDom)));

      string[] parts = {
        this.Header, "\n",
        String.Join("\n", this.InternalDict.ToArray())
        };

      this.FullDictString = parts.Aggregate((partialPhrase, word) => "{partialPhrase} {word}");







    }

    private static Dictionary < string, dynamic> GetDict(IndoorDomain IndoorDom)
    {
      Dictionary < string, dynamic> Dict = new Dictionary<string, dynamic>();

      Dictionary < string, dynamic> InternalDict = new Dictionary<string, dynamic>();

      Dictionary < string, dynamic> FunctionObjectlDict = new Dictionary<string, dynamic>();

      // Dict.Add("controlDict", InternalDict);

      InternalDict.Add("application", "extractFromSurface");
      InternalDict.Add("startFrom", "startTime");
      InternalDict.Add("startTime", "0");
      InternalDict.Add("stopAt", "endTime");
      InternalDict.Add("endTime", IndoorDom.endTime);

      InternalDict.Add("deltaT", 1);
      InternalDict.Add("writeControl", "timeStep");
      InternalDict.Add("writeInterval", 10);
      InternalDict.Add("purgeWrite", 10);
      InternalDict.Add("writeFormat", "binary");
      InternalDict.Add("writePrecision", 9);
      InternalDict.Add("writeCompression", "off");
      InternalDict.Add("timeFormat", "general");
      InternalDict.Add("timePrecision", 6);
      InternalDict.Add("runTimeModifiable", "true");

      /*
      InternalDict.Add("functions", FunctionObjectlDict);

      if (IndoorDom.FOs.OfType<VolumetricHeatSource>().Any())

      {
        FunctionObjectlDict.Add("#includeFunc", "volumetricHeatSources");
      }

  */

      return InternalDict;
    }
  }



  public class CppMapSerializerDyn2
  {
    public static string Serialize(Dictionary<string, dynamic> dict)
    {
      StringBuilder sb = new StringBuilder();

      foreach (KeyValuePair<string, dynamic> evl in dict)
      {
        // 4. Dictionary<string, List<Dictionary<string, Dictionary<string, string>>>> dicts

        if (evl.Key is String && evl.Value is List<Dictionary<string, dynamic>>)
        {
          sb.AppendLine(Serialize(evl.Value));
        }

        // 1. Dictionary<string, string> dict
        else if (evl.Key is String && evl.Value is String)
        {
          DictToString(evl, ref sb);
        }
          // 3. Dictionary<string, int> dicts
        else if (evl.Key is String && evl.Value is Int32)
        {
          DictToString(evl, ref sb);
        }  
          
          
          // 2. Dictionary<string, Dictionary<string, string>> dicts
        else if (evl.Key is String && evl.Value is Dictionary<string, dynamic>)
        {
          DictToString(evl.Key, evl.Value, ref sb);
        }
      
      }

      return sb.ToString();
    }

    public static string Serialize(List<Dictionary<string, dynamic>> dicts)
    {
      StringBuilder sb = new StringBuilder();

      // 3. List<Dictionary<string, Dictionary<string, string>>> dicts
      foreach (var dict in dicts)
      {
        foreach (KeyValuePair<string, dynamic> evl in dict)
        {
          // 1. Dictionary<string, string> dict
          if (evl.Key is String && evl.Value is String)
          {
            DictToString(evl, ref sb);
          }
            // 2. Dictionary<string, Dictionary<string, string>> dicts
          else if (evl.Key is String && evl.Value is Dictionary<string, dynamic>)
          {
            DictToString(evl.Value, ref sb);
          }
        }
      }

      return sb.ToString();
    }

    private static void DictToString(List<Dictionary<string, dynamic>> dicts, ref StringBuilder sb)
    {
    foreach (var dict in dicts)
    {
    foreach (KeyValuePair<string, dynamic> evl in dict)
    {
    sb.AppendLine();
    sb.AppendLine(evl.Key);
    sb.AppendLine("{");

    //  foreach (var dict in dict[evl.Key]) {
    if (evl.Key is String && evl.Value is String)
    {
    DictToString(evl.Key, evl.Value, ref sb);
  }
  // }
  sb.AppendLine("}");
}
            }
        }

        private static void DictToString(string name, Dictionary<string, dynamic> dict, ref StringBuilder sb)
        {
            sb.AppendLine("\t" + name);

            sb.AppendLine("\t" + "{");

            foreach (KeyValuePair<string, dynamic> evl in dict)
            {
                if (evl.Key is String && evl.Value is String)
                {
                    sb.AppendLine("\t" + "\t" + evl.Key + "\t" + evl.Value + ";");
                }
                else if (evl.Key is String && evl.Value is Int32)
                {
                    sb.AppendLine("\t" + "\t" + evl.Key + "\t" + evl.Value.ToString() + ";");
                }
                else
                {
                    sb.AppendLine("\t" + "\t" + evl.Key);

                    sb.AppendLine("\t" + "\t" + "{");

                    sb.AppendLine("\t" + "\t" + "\t" + Serialize(evl.Value));

                    sb.AppendLine("\t" + "\t" + "}");
                }
            }

            sb.AppendLine("\t" + "}");
        }

        private static void DictToString(KeyValuePair<string, dynamic> evl, ref StringBuilder sb)
        {
            if (evl.Key is String)
            {

                if (evl.Value is String)
                {

                    sb.AppendLine(evl.Key + "\t " + evl.Value + ";");
                }
                else
                {

                    sb.AppendLine(evl.Key + "\t " + evl.Value.ToString() + ";");
                }
            }
        }
    }
# ---------- end c_script ----------
brep = Brep(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)
c_script_2 = CSharpScript(Overwrite="featureAngle    250;")  # -> Out, A
panel_7 = Panel(c_script.A)
panel_8 = Panel("Person1")  # disabled
person = Geometry(<brep referenced from the Rhino model>)  # disabled
mesh_2 = Mesh(person)  # disabled
vhs_2 = VolumetricHeatSource(Geo=mesh_2, Power=number_slider, Name=panel_8, Type=0)  # disabled
c_script_3 = CSharpScript(Dom=indoordomain, Reference="C:\Users\zorot\Documents\GitHub\Eddy3d\Eddy\bin\EddyLib.dll")  # -> Res; disabled
# ---------- c_script_3: C# usings ----------
using EddyLib;
using EddyLib.BCs;
using System.Linq;
# ---------- c_script_3: C# ----------
    var point0 = new Rhino.Geometry.Point3d(0, 0, 0);
    var point1 = new Rhino.Geometry.Point3d(20, 0, 0);
    var point2 = new Rhino.Geometry.Point3d(0, 20, 0);
    var point3 = new Rhino.Geometry.Point3d(20, 20, 0);
    var point4 = new Rhino.Geometry.Point3d(0, 0, 40);
    var point5 = new Rhino.Geometry.Point3d(20, 0, 40);
    var point6 = new Rhino.Geometry.Point3d(0, 20, 40);
    var point7 = new Rhino.Geometry.Point3d(20, 20, 40);
    Rhino.Geometry.Box box1 = new Rhino.Geometry.Box(Rhino.Geometry.Plane.WorldXY, new List<Rhino.Geometry.Point3d>() { point0, point1, point2, point3, point4, point5, point6, point7 });
    Rhino.Geometry.MeshingParameters mp = new Rhino.Geometry.MeshingParameters();
    var m = Mesh.CreateFromBrep(box1.ToBrep(), mp);

    Rhino.Geometry.Mesh mm = new Rhino.Geometry.Mesh();

    foreach (Rhino.Geometry.Mesh im in m)
    {
      mm.Append(im);
    }



    var windDirList = new List<int>() { 0 };
    BoundaryCondition bcond = new ABL(windDirList, 5, 10, 1, 0, "");

    OFCylDomain DOMCYL = new OFCylDomain(mm, new Mesh(), bcond, 5, 50, 300, 80);




    var DOM = (EddyLib.Indoor.IndoorDomain) Dom;

    var RUNSETTINGS = new OFRunSettings(1000, 20, 5, fvSchemes.Optimized, 1, SimEngine.BlueCFD, OSType.Windows10, TurbModel.RNGkEpsilon, RelaxationFactors.Optimized, false, false);
    var MESHSETTINGS = new OFMeshSettings();


    var baseWorkingDirectory = DOM.WorkingDir;


    MESHSETTINGS.meshStlDir = baseWorkingDirectory + @"\\constant\triSurface\";
    MESHSETTINGS.meshPolyMeshDir = baseWorkingDirectory + @"\\constant\polyMesh\";
    MESHSETTINGS.meshSystemDir = baseWorkingDirectory + @"\\system\";
    MESHSETTINGS.meshConstantDir = baseWorkingDirectory + @"\\constant\";
    MESHSETTINGS.meshWorkingDir = baseWorkingDirectory + @"\\";


    // MESHSETTINGS.meshStlFilenameBuildings = baseWorkingDirectory + @"\\constant\triSurface\building.stl";
    //MESHSETTINGS.meshStlFilenameGround = baseWorkingDirectory + @"\\constant\triSurface\ground.stl";
    // MESHSETTINGS.meshStlFilenameGroundPerim = baseWorkingDirectory + @"\\constant\triSurface\ground_perim.stl";
    // MESHSETTINGS.meshBoundaryConditionsDirectory = baseWorkingDirectory + @"\\0.org\";


    var RES = new EddyLib.OFResult(DOMCYL, RUNSETTINGS, MESHSETTINGS, DOM.WorkingDir.Replace("0\\", ""));

    Res = RES;
# ---------- end c_script_3 ----------
cluster = Cluster(B=brep, relay=Slider(0.5, range=0..1))

c_script_4 = CSharpScript(path=panel_6, fileName="decomposeParDict")  # -> out, A; inputs path: String, fileName: String
# ---------- c_script_4: C# usings ----------
using System.IO;
using System.Linq;
using System.Data;
using System.Drawing;
using System.Reflection;
using System.Windows.Forms;
using System.Xml;
using System.Xml.Linq;
using System.Runtime.InteropServices;

using Rhino.DocObjects;
using Rhino.Collections;
using GH_IO;
using GH_IO.Serialization;
# ---------- c_script_4: C# ----------
    String filePath = path + @"\system\" + fileName;


    A = filePath;



    File.Delete(filePath);

    using(var tw = new StreamWriter(filePath)) // new StreamWriter(path, true) for append
    {
      tw.Write(@"// * * * * * * * * * //
        FoamFile
        {
        version 0.5;
        format ascii;
        root ""ROOT"";
        case ""CASE"";

        class dictionary;
        object xxx;
        }
        method scotch;
        numberOfSubdomains 8;
        scotchCoeffs
        {
        }"


        );








      tw.Close();


    }
# ---------- end c_script_4 ----------
c_script_5 = CSharpScript(path=panel_6, fileName="run_mesh.bat")  # -> out, A; inputs path: String, fileName: String
# ---------- c_script_5: C# ----------
    String filePath = path + @"\" + fileName;


    A = filePath;



    File.Delete(filePath);

    using(var tw = new StreamWriter(filePath)) // new StreamWriter(path, true) for append
    {
      tw.Write(@"call ""C:\Program Files\blueCFD-Core-2017\\setvars.bat""
        set PATH=%HOME%msys64\usr\bin;%PATH%
        cd " + path + @"

        blockMesh.exe
        surfaceFeatureExtract
        decomposePar -force
        mpiexec -np 8 snappyHexMesh -overwrite -parallel
        reconstructParMesh -constant
        renumberMesh -overwrite"


        );






      tw.Write("\"");
      tw.WriteLine("\n");
      tw.WriteLine("PAUSE");


      tw.Close();


    }
# ---------- end c_script_5 ----------
c_script_6 = CSharpScript(path=panel_6, fileName="run_topoSet.bat")  # -> out, A; inputs path: String, fileName: String
# ---------- c_script_6: C# ----------
    String filePath = path + @"\" + fileName;


    A = filePath;



    File.Delete(filePath);

    using(var tw = new StreamWriter(filePath)) // new StreamWriter(path, true) for append
    {
      tw.Write(@"call ""C:\Program Files\blueCFD-Core-2017\\setvars.bat""
        set PATH=%HOME%msys64\usr\bin;%PATH%
        cd " + path + @"

        topoSet"
        );






      tw.Write("\"");
      tw.WriteLine("\n");
      tw.WriteLine("PAUSE");


      tw.Close();


    }
# ---------- end c_script_6 ----------
c_script_7 = CSharpScript(path=panel_6, fileName="run_sim.bat")  # -> out, A; inputs path: String, fileName: String
# ---------- c_script_7: C# ----------
    String filePath = path + @"\" + fileName;


    A = filePath;



    File.Delete(filePath);

    using(var tw = new StreamWriter(filePath)) // new StreamWriter(path, true) for append
    {
      tw.Write(@"call ""C:\Program Files\blueCFD-Core-2017\\setvars.bat""
        set PATH=%HOME%msys64\usr\bin;%PATH%
        cd " + path + @"

        renumberMesh -overwrite
        decomposePar -force
        mpiexec -np 8 buoyantSimpleFoam -parallel
        reconstructPar");






      tw.Write("\"");
      tw.WriteLine("\n");
      tw.WriteLine("PAUSE");


      tw.Close();


    }
# ---------- end c_script_7 ----------

probing = Probing(Result=c_script_3, ProbingPoints=cluster, NameOfInstance="test", NameOfField=0, Run=Button())  # -> PorbingPoints, ProbingResult
vlen = VectorLength(Vector=probing.ProbingResult)
vdisex = VectorDisplayEx(Point=probing.PorbingPoints, Vector=probing.ProbingResult, Colour=RGB(0, 0, 0), Width=2)
panel_9 = Panel(vlen)

# ==== cluster Cluster
relay = ClusterInput()
custom_mesh_settings = SettingsCustom(
    StitchSeams=True,
    SimplePlanes=False,
    Refine=True,
    MinCount=16,
    MaxCount=400,
    AspectRatio=20,
    MaxDistance=0,
    MaxAngle=20,
    MinEdge=relay,
    MaxEdge=relay)
B = ClusterInput()
mesh = MeshBrep(Brep=B, Settings=custom_mesh_settings)
demesh = DeconstructMesh(Mesh=mesh)  # -> Vertices, Faces, Colours, Normals
V = ClusterOutput(demesh.Vertices)
