# Grasshopper definition 99_ValidationCaseJiang2003.ghx (Grasshopper 1.0.7)
# plug-ins: VirtualWindTunnel

# Wind tunnel data
cluster = Cluster()
divide = DivideCurve(Curve=cluster, Count="50", Kinks=False)  # -> Points, Tangents, Parameters
# Mesh
panel = Panel("0.25")
# Jiang et al., 2003
# Uy/U_ref
panel_2 = Panel("""0.1015
0.1869
0.2631
0.329
0.3837
0.4262
0.4554
0.4722
0.4733
0.4509
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""")
# z/H
panel_3 = Panel("""0.0408164
0.0816328
0.1224488
0.1632652
0.2040816
0.244898
0.2857144
0.3265308
0.3673468
0.408164
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""")
cluster_2 = Cluster_2(Y=panel_2, A=panel_3)
# Box-shaped simulation domain
panel_4 = Panel("180")
abl = ABL(WDir=panel_4, Uref="12", Zref="0.5", Z0="0.005", ZGround=0)
geo = Geometry(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)
rset = RunSettings(
    Iterations=1000,
    WriteInterval=20,
    KeepTimeSteps=2,
    Turbulence=2,
    RelaxationFactors=0,
    Mode=0,
    CPUs="2",
    OperationSystem=0)
domainbox = BoxShapedDomain(Geometry=geo, BoundaryCondition=abl, BlockSize="0.25")  # -> Domain, Mesh
# Cylindrical simulation domain
domaincyl = CylindricalDomain(Geometry=geo, BCond=abl, BlockSize=panel)  # -> Domain, Mesh
cellsize = CellSize(SimulationDomain=domaincyl.Domain, BlockSize=panel, DesiredCellSize="0.003")
mset = MeshSettings(
    AccBuilding=cellsize,
    AccFeatures=cellsize,
    AccRefinement=cellsize,
    AccGround=cellsize,
    NLayer=Slider(2, range=0..10),
    Mode=2)
simulation = Simulation(
    SimulationDomain=domainbox.Domain,
    WorkingDirectory="C:\ValidationJiang2003Box",
    MeshSettings=mset,
    RunSettings=rset,
    RunMeshing=Button(),
    RunSimulation=Button(),
    runWithBlueCFD=True)
residuals = Residuals(Result=simulation, X=":", Y=":", Version=1, Run=Button(), visResiduals=True)
clean = Clean(ResultDirectory=simulation, Mode=2, Run=Button())
paraview = Paraview(Result=simulation, ParaviewVersion=2, Run=Button())
visprobes = VisualizeProbes(Res=simulation, Points=divide.Points, Name="Validation", Field=0, Run=Button(), Culling=True)  # -> Points, Result
cluster_3 = Cluster_3(V_2=visprobes.Points, V=visprobes.Result)  # -> Z, R
pt = ConstructPoint(XCoordinate=0, YCoordinate=cluster_3.R, ZCoordinate=cluster_3.Z)
graph = QuickGraph([pt, cluster_2], SortOrder=0)
mset_2 = MeshSettings(
    AccBuilding=cellsize,
    AccFeatures=cellsize,
    AccRefinement=cellsize,
    AccGround=cellsize,
    NLayer=Slider(2, range=0..10),
    Mode=2)
rset_2 = RunSettings(
    Iterations="8",
    WriteInterval=20,
    KeepTimeSteps=2,
    Turbulence=2,
    RelaxationFactors=0,
    Mode=0,
    CPUs="8",
    OperationSystem=0)
simulation_2 = Simulation(
    SimulationDomain=domaincyl.Domain,
    WorkingDirectory="C:\ValidationJiang2003Cyl",
    MeshSettings=mset_2,
    RunSettings=rset_2,
    RunMeshing=Button(),
    RunSimulation=Button(),
    runWithBlueCFD=True)
residuals_2 = Residuals(Result=simulation_2, X=":", Y=":", Version=1, Run=Button(), visResiduals=True)
clean_2 = Clean(Directory=simulation_2, Mode=2, Run=Button())
paraview_2 = Paraview(Result=simulation_2, ParaviewVersion=2, Run=Button())
visprobes_2 = VisualizeProbes(Res=simulation_2, Points=divide.Points, Name="Validation", Field=0, Run=Button(), Culling=True)  # -> Points, Result
cluster_4 = Cluster_3(V_2=visprobes_2.Points, V=visprobes_2.Result)  # -> Z, R
pt_2 = ConstructPoint(XCoordinate=0, YCoordinate=cluster_4.R, ZCoordinate=cluster_4.Z)
graph_2 = QuickGraph([pt_2, cluster_2], SortOrder=0)

# ==== cluster Cluster
pt = ConstructPoint(XCoordinate="0.125", YCoordinate="0.125", ZCoordinate="0.5")
pt_2 = ConstructPoint(XCoordinate="0.125", YCoordinate="0.125", ZCoordinate="0.01")
ln = Line(StartPoint=pt_2, EndPoint=pt)
L = ClusterOutput(ln)

# ==== cluster Cluster_2
Y = ClusterInput()
A = ClusterInput()
division = Division(A=A, B="4")
pt = ConstructPoint(XCoordinate="0.125", YCoordinate=Y, ZCoordinate=division)
pt_2 = ClusterOutput(pt)

# ==== cluster Cluster_3
V = ClusterInput()
V_2 = ClusterInput()
devec = DeconstructVector(Vector=V)  # -> XComponent, YComponent, ZComponent
devec_2 = DeconstructVector(Vector=V_2)  # -> XComponent, YComponent, ZComponent
division = Division(A=devec.YComponent, B="12")
Z = ClusterOutput(devec_2.ZComponent)
R = ClusterOutput(division)
