# Grasshopper definition 9_ML_SimpleWindAnalysisCylDomain_DynamicDomain.ghx (Grasshopper 1.0.8)
# plug-ins: Pufferfish, Eddy3D, LunchBox

templates = Templates()
panel = Panel("""0
45
90
135
180
225
270
315""")

# ----
# 1. Geometry &
# Boundary Conditions
number_slider = Slider(270, range=0..359)
abl = ABL(WDir=panel, Uref="5", Zref="10", Z0=1, ZGround=0)

# ---- group: BUILDINGS
buildings = Geometry([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])

# ----
# COST CFD Practice
bounding_box = BoundingBox(Content=buildings, Plane=PlaneXY(0, 0, 0), UnionBox=True)  # -> Box, Box_2
deconstruct_box = DeconstructBox(Box=bounding_box.Box)  # -> Plane, X, Y, Z
deconstruct_domain = DeconstructDomain(Domain=deconstruct_box.Z)  # -> Start, End
subtraction = Subtraction(A=deconstruct_domain.End, B=deconstruct_domain.Start)
multiplication = Multiplication(A=subtraction, B="15")

plane_surface = PlaneSurface(Plane=deconstruct_box.Plane, XSize=deconstruct_box.X, YSize=deconstruct_box.Y)
area = Area(Geometry=plane_surface)  # -> Area, Centroid

# ----
# 2. Simulation Domain
panel_2 = Panel(multiplication)
pedestrian_level = Panel("1.8")
division = Division(A=panel_2, B=3)
unit_z = UnitZ(Factor=pedestrian_level)
circle = Circle(Plane=area.Centroid, Radius=panel_2)

# ---- group: TERRAIN
surface = Surface(circle)

# ----
move = Move(Geometry=surface, Motion=unit_z)  # -> Geometry, Transform
cylindrical_domain = CylindricalDomain(
    Geometry=buildings,
    Terrain=surface,
    BoundaryCondition=abl,
    BlockSize="10",
    SizeOfOuterRadius=expr("x*.99", panel_2),
    Height=division,
    RadialMultiplier=Slider(1, range=0..1),
    DivisionsX=Slider(2, range=0..10))  # -> Domain, Mesh
area_2 = Area(Geometry=move.Geometry)  # -> Area, Centroid

# ---- group: Analysis grid
scale = Scale(Geometry=move.Geometry, Center=area_2.Centroid, Factor=0.5)  # -> Geometry, Transform

# ----
# 3. Mesh & Simulation
panel_3 = Panel("C:\Eddy3D-Cases\ML")
rset = RunSettings(
    NumberOfIterations="500",
    WriteInterval=500,
    NumberOfTimestepsToKeep=3,
    TurbulenceModel=3,
    RelaxationFactors=0,
    SolutionAndAlgorithmControl=1,
    PotentialFoamInitialization=False,
    AgeOfAir=False,
    NumberOfCPUs="24",
    OperatingSystem=0)

mesh_settings = MeshSettings(AccBuilding="2", AccBuildingMax="4", AccFeatures=2, AccBBox=0, AccGround="3", MiscSettings=1, NumberOfLayers=4, Mode=1)

simulation = Simulation(
    SimulationDomain=cylindrical_domain.Domain,
    WorkingDirectory=panel_3,
    MeshSettings=mesh_settings,
    RunSettings=rset,
    RunMeshing=Button(),
    MakeTrees=False,
    RunSimulation=Button(),
    runWithBlueCFD=True)
residuals = VisualizeResiduals(Result=simulation, X=":", Y=":", Version=0, Run=Button(), visResiduals=True)

# ----
# 4. Probing points & probing
brep_to_grid_points = BrepToGridPoints(Breps=scale.Geometry, Spacing="2")  # -> Points, Status
probing = Probing(
    Result=simulation,
    ProbingPoints=brep_to_grid_points.Points,
    NameOfInstance="ttt",
    InterpolationScheme=3,
    NameOfField=0,
    Run=Button())  # -> ProbingPoints, ProbingResult

# ----
# 7. Dataset Preparation
vector_length = VectorLength(Vector=probing.ProbingResult)
division_2 = Division(A=vector_length, B="5")
dataset_curator = DatasetCurator(
    Points=probing.ProbingPoints,
    Buildings=buildings,
    Case_dir=panel_3,
    U_ref="5",
    Z_ref="10",
    Pedestrian_level=pedestrian_level,
    Wind_dir=number_slider)  # -> SDF, Bldg_height, Z_relative, U_at_z, X_coords, Y_coords, Dir_sin, Dir_cos; disabled
vector_xyz = VectorXYZ(XComponent=dataset_curator.Dir_sin, YComponent=dataset_curator.Dir_cos, ZComponent=0)  # -> Vector, Length
replace_nulls = ReplaceNulls(Items=division_2, Replacements="0")  # -> Items, Count
number = Number(replace_nulls.Items)
vector_display_ex = VectorDisplayEx(Point=brep_to_grid_points.Points, Vector=vector_xyz.Vector, Colour=RGB(0, 0, 0), Width=2)
expression = Expression(x=number, Expression="Round(x,2)")
entwine = Entwine(
    Branch00=dataset_curator.SDF,
    Branch01=dataset_curator.Bldg_height,
    Branch02=dataset_curator.Z_relative,
    Branch03=dataset_curator.U_at_z,
    Branch04=dataset_curator.X_coords,
    Branch05=dataset_curator.Y_coords,
    Branch06=dataset_curator.Dir_sin,
    Branch07=dataset_curator.Dir_cos,
    Branch08=expression,
    FlattenInputs=True)
round_to_decimal_place = RoundToDecimalPlace(NumberX=expression, DecimalPlace="1", RoundType=0)  # -> Rounded, Difference
concatenate = Concatenate(Fragment_A=panel_3, subfolder="\Dataset\", Fragment_B=number_slider, extension=".xlsx")
panel_4 = Panel("""SDF
Bldg_height
Z_relative
U_at_z
X_coords
Y_coords
dir_sin
dir_cos
mag_U""")
text_tag = TextTag(Location=probing.ProbingPoints, Text=round_to_decimal_place.Rounded, Colour=ColourSwatch(SwatchColor=RGB(255, 255, 255)))
excel_writer = ExcelWriter(
    WriteExcelData=Toggle(False),
    WorkbookPath=concatenate,
    WorksheetName="Sheet1",
    ColumnHeadings=panel_4,
    Data=entwine,
    ClearSheet=True,
    DataStruct=False)

# ----
# 6. Clean
button = Button()
clean = Clean(Directory=panel_3, Mode=2, Run=button)

# ----
# 5. Post-processing
# 5.1. Paraview
# 5.2. Grasshopper
# Wind vectors
points = Data(probing.ProbingPoints)
vectors = Data(probing.ProbingResult)
cluster = Cluster(data=vectors)  # -> S, E, data_3
gradient = Gradient(
    LowerLimit=cluster.S,
    UpperLimit=cluster.E,
    Parameter=cluster.data_3,
    stops=[0.103: RGB(0, 0, 255), 0.22: RGB(0, 170, 255), 0.305: RGB(0, 255, 255), 0.398: RGB(0, 255, 188), 0.504: RGB(0, 255, 106), 0.605: RGB(91, 255, 0), 0.699: RGB(184, 255, 0), 0.799: RGB(255, 255, 0), 0.898: RGB(255, 170, 0)])

paraview = Paraview(Result=simulation, ParaviewVersion=1, Run=Button())
amplitude = Amplitude(Vector=vectors, Amplitude=Slider(3, range=0..10))

vdisex = VectorDisplayEx(Point=points, Vector=amplitude, Colour=gradient, Width=Slider(2, range=0..10))

# ==== cluster Cluster
data = ClusterInput()
data_2 = Data(data)
data_3 = ClusterOutput(data_2)
bnd = Bounds(Numbers=data_2)
dedomain = DeconstructDomain(Domain=bnd)  # -> Start, End
S = ClusterOutput(dedomain.Start)
E = ClusterOutput(dedomain.End)
