# Grasshopper definition Wind_Factors_No_Interpolation_patch.ghx (Grasshopper 1.0.8)
# plug-ins: RhinoCodePluginGH, Eddy3D

# 0. Download Weather
panel = Panel("https://energyplus-weather.s3.amazonaws.com/asia_wmo_region_2/IND/IND_Ahmedabad.426470_IWEC/IND_Ahmedabad.426470_IWEC.epw")
templates = Templates()
c_script = CSharpScript(url=panel)  # -> out, epwPath; inputs url: String, saveTo: String
# ---------- c_script: C# ----------
// Grasshopper Script Instance
#region Usings
using System;
using System.Linq;
using System.Collections;
using System.Collections.Generic;
using System.Drawing;
using System.IO;
using System.Net.Http;
using System.Threading.Tasks;

using Rhino;
using Rhino.Geometry;

using Grasshopper;
using Grasshopper.Kernel;
using Grasshopper.Kernel.Data;
using Grasshopper.Kernel.Types;
#endregion

public class Script_Instance : GH_ScriptInstance
{
private void RunScript(string url, string saveTo, ref object epwPath)
{
  epwPath = null;

  try
  {
    // --- Validate URL ---
    if (string.IsNullOrWhiteSpace(url))
    {
      Print("URL is invalid.");
      return;
    }

    string urlFileName;
    try { urlFileName = System.IO.Path.GetFileName(new Uri(url).LocalPath); }
    catch { Print("URL is invalid."); return; }
    if (string.IsNullOrWhiteSpace(urlFileName)) urlFileName = "download.epw";

    // --- Decide destination path ---
    string filePath;

    if (string.IsNullOrWhiteSpace(saveTo))
    {
      // Use GH file's directory
      var ghDoc  = GrasshopperDocument; // <-- use this in C# Script
      var ghPath = ghDoc?.FilePath;

      if (string.IsNullOrEmpty(ghPath))
      {
        // fallback to Rhino document folder if available
        var rhPath = Rhino.RhinoDoc.ActiveDoc?.Path;
        var rhDir  = string.IsNullOrEmpty(rhPath) ? null : System.IO.Path.GetDirectoryName(rhPath);
        if (string.IsNullOrEmpty(rhDir))
        {
          Print("Grasshopper file is unsaved. Please save the .gh file or provide a destination path.");
          return;
        }
        Print("Grasshopper file is unsaved; saving to the Rhino document folder.");
        filePath = System.IO.Path.Combine(rhDir, urlFileName);
      }
      else
      {
        var ghDir = System.IO.Path.GetDirectoryName(ghPath);
        filePath  = System.IO.Path.Combine(ghDir, urlFileName);
      }
    }
    else
    {
      // Accept either a folder or a full file path
      string raw = saveTo.Trim().Trim('"');
      raw = Environment.ExpandEnvironmentVariables(raw);

      var ghDoc  = GrasshopperDocument; // <-- use this here too
      var ghPath = ghDoc?.FilePath;
      string baseRoot = !string.IsNullOrEmpty(ghPath)
        ? System.IO.Path.GetDirectoryName(ghPath)
        : System.IO.Directory.GetCurrentDirectory();

      string candidate = raw;
      if (!System.IO.Path.IsPathRooted(candidate))
        candidate = System.IO.Path.GetFullPath(System.IO.Path.Combine(baseRoot, candidate));

      bool endsWithSlash =
        candidate.EndsWith(System.IO.Path.DirectorySeparatorChar.ToString()) ||
        candidate.EndsWith(System.IO.Path.AltDirectorySeparatorChar.ToString());

      bool treatAsFolder = endsWithSlash || System.IO.Directory.Exists(candidate);

      if (treatAsFolder)
      {
        System.IO.Directory.CreateDirectory(candidate);
        filePath = System.IO.Path.Combine(candidate, urlFileName);
      }
      else
      {
        string dir = System.IO.Path.GetDirectoryName(candidate);
        if (!string.IsNullOrEmpty(dir)) System.IO.Directory.CreateDirectory(dir);
        filePath = candidate;
      }
    }

    // --- Skip download if exists ---
    if (System.IO.File.Exists(filePath))
    {
      Print($"File already exists at {filePath}, skipping download.");
      epwPath = filePath;
      return;
    }

    // --- Download synchronously ---
    using (var http = new System.Net.Http.HttpClient())
    using (var resp = http.GetAsync(url, System.Net.Http.HttpCompletionOption.ResponseHeadersRead).Result)
    {
      resp.EnsureSuccessStatusCode();
      using (var fs = new System.IO.FileStream(filePath, System.IO.FileMode.Create, System.IO.FileAccess.Write, System.IO.FileShare.None))
      {
        resp.Content.CopyToAsync(fs).Wait();
      }
    }

    Print($"File downloaded successfully to {filePath}");
    epwPath = filePath;
  }
  catch (Exception ex)
  {
    Print($"Failed to download file: {ex.Message}");
  }
}


}

public static class FileDownloader
{
    /// <summary>
    /// Asynchronously downloads a file from the specified URL and saves it to the given file path.
    /// </summary>
    /// <param name="url">The URL of the file to download.</param>
    /// <param name="filePath">The local file path to save the downloaded file.</param>
    public static async Task DownloadFileAsync(string url, string filePath)
    {
        // Validate inputs
        if (string.IsNullOrWhiteSpace(url))
            throw new ArgumentException("URL cannot be null or empty.", nameof(url));

        if (string.IsNullOrWhiteSpace(filePath))
            throw new ArgumentException("File path cannot be null or empty.", nameof(filePath));

        // Ensure the directory exists
        var directory = Path.GetDirectoryName(filePath);
        if (!string.IsNullOrEmpty(directory) && !Directory.Exists(directory))
        {
            Directory.CreateDirectory(directory);
        }

        try
        {
            // Download file using HttpClient
            using var httpClient = new HttpClient();
            using var response = await httpClient.GetAsync(url, HttpCompletionOption.ResponseHeadersRead);
            response.EnsureSuccessStatusCode();

            // Save the file
            await using var fileStream = new FileStream(filePath, FileMode.Create, FileAccess.Write, FileShare.None);
            await response.Content.CopyToAsync(fileStream);
        }
        catch (Exception ex)
        {
            Console.WriteLine($"Error downloading file: {ex.Message}");
            throw;
        }
    }
}
# ---------- end c_script ----------
panel_2 = Panel("""0
45
90
135
180
225
270
315""")
panel_3 = Panel("""5
6
4
3
5
4
6
5""")

# ----
# 1. Geometry &
# Boundary Conditions
abl = ABL(WDir=panel_2, Uref=panel_3, Zref="10", Z0=1, ZGround=0, Epw=c_script.epwPath)

buildings = Geometry([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])
circle = Circle(Plane=PlaneXY(0, 0, 0), Radius=Slider(150, range=0..1000))
unit_z = UnitZ(Factor=Slider(2, range=0..10))

# ---- group: Ground
surface = Surface(circle)

# ----
move = Move(Geometry=surface, Motion=unit_z)  # -> Geometry, Transform
# 2. Simulation Domain
domcyl = CylindricalDomain(
    Buildings=buildings,
    BoundaryCondition=abl,
    CellSize="10",
    RadialMultiplier=Slider(1, range=0..1),
    XDivisions=Slider(2, range=0..10))  # -> Domain, PreviewMesh

# ----
# 6. Clean
button = Button()
clean = Clean(Mode=2, Run=button)

# ----
# 3. Mesh & Simulation
panel_4 = Panel("C:\Eddy3D-Cases\WFTest")
rset = RunSettings(
    NumberOfIterations="50",
    WriteInterval=20,
    NumberOfTimestepsToKeep=3,
    TurbulenceModel=3,
    RelaxationFactors=0,
    SolutionAndAlgorithmControl=0,
    PotentialFoamInitialization=False,
    AgeOfAir=False,
    NumberOfCPUs="8",
    OperatingSystem=0)

mset = MeshSettings(
    BuildingMinLevel="2",
    BuildingMaxLevel="4",
    FeatureLevel=2,
    BoundingBoxLevel=0,
    GroundLevel="3",
    MiscSettings=1,
    BoundaryLayers=4,
    CellsBetweenLevels=4,
    MeshMode=1)

simulation = Simulation(
    SimulationDomain=domcyl.Domain,
    WorkingDirectory=panel_4,
    MeshSettings=mset,
    RunSettings=rset,
    RunMeshing=Button(),
    MakeTrees=False,
    RunSimulation=Button())

residuals = VisualizeResiduals(Result=simulation, X=":", Y=":", Version=0, Run=Button(), visResiduals=True)

# ----
# 4. Probing points & probing
brep_to_grid_points = BrepToGridPoints(Breps=move.Geometry, Spacing="5", Run=True)  # -> Points, Status
probing = Probing(
    Result=simulation,
    ProbingPoints=brep_to_grid_points.Points,
    NameOfInstance="ttt",
    InterpolationScheme=3,
    NameOfField=0,
    Run=Button())  # -> ProbingPoints, ProbingResult

# ---- group: Diagnostic
c_script_2 = CSharpScript(RES=simulation)  # -> out, Report, UniqueIdx, Counts, Mapping; disabled
# ---------- c_script_2: C# ----------
using System;
using System.Linq;
using System.Collections;
using System.Collections.Generic;
using System.Reflection;

public class Script_Instance : GH_ScriptInstance
{
  private void RunScript(
		object RES,
		ref object Report,
		ref object UniqueIdx,
		ref object Counts,
		ref object Mapping)
  {
    if (RES == null)
    {
      Report = "RES is null";
      UniqueIdx = null;
      Counts = null;
      Mapping = null;
      return;
    }

    try
    {
      // --- Navigate: RES -> Domain -> BCond ---
      object domain = GetMember(RES, "Domain");
      if (domain == null)
      {
        Report = "Cannot access RES.Domain";
        return;
      }

      object bcond = GetMember(domain, "BCond");
      if (bcond == null)
      {
        Report = "Cannot access RES.Domain.BCond";
        return;
      }

      // --- Read ClstSimDirIndices (int[8760]) ---
      int[] idx = ToIntArray(GetMember(bcond, "ClstSimDirIndices"));
      if (idx == null)
      {
        Report = "BCond.ClstSimDirIndices is null (not computed / not stored)";
        UniqueIdx = null;
        Counts = null;
        Mapping = null;
        return;
      }

      // --- Read CFD directions list (WindDirections) ---
      int[] simDirs = ToIntArray(GetMember(bcond, "WindDirections"));
      if (simDirs == null)
      {
        simDirs = new int[0];
      }

      // --- Compute distribution ---
      var unique = idx.Distinct().OrderBy(i => i).ToArray();

      var countLines = unique
        .Select(i => $"{i}: {idx.Count(v => v == i)} hours")
        .ToArray();

      var mapLines = unique
        .Select(i =>
        {
          if (i >= 0 && i < simDirs.Length)
            return $"{i} -> {simDirs[i]}°";
          return $"{i} -> (out of range, simDirs length = {simDirs.Length})";
        })
        .ToArray();

      // --- Build report ---
      bool allZero = unique.Length == 1 && unique[0] == 0;
      int n = idx.Length;

      string headline = allZero
        ? "⚠️ ClstSimDirIndices looks UNINITIALIZED (all hours mapped to index 0)"
        : "✅ ClstSimDirIndices looks OK (multiple direction indices used)";

      string simDirsInfo = simDirs.Length > 0
        ? $"Simulated CFD directions: {simDirs.Length} dirs => [{string.Join(", ", simDirs)}]"
        : "Simulated CFD directions: NOT FOUND (BCond.WindDirections is null/empty)";

      Report =
        headline + "\n" +
        $"Hours in mapping array: {n}\n" +
        simDirsInfo + "\n" +
        $"Unique indices count: {unique.Length}\n" +
        $"Unique indices: [{string.Join(", ", unique)}]";

      UniqueIdx = unique;
      Counts = countLines;
      Mapping = mapLines;
    }
    catch (Exception ex)
    {
      Report = "Error while reading BCond fields:\n" + ex.Message;
      UniqueIdx = null;
      Counts = null;
      Mapping = null;
    }
  }

  // ----- Helpers -----

  // Reads a public property or field by name (returns null if not found)
  private static object GetMember(object obj, string name)
  {
    if (obj == null) return null;
    var t = obj.GetType();

    var prop = t.GetProperty(name, BindingFlags.Public | BindingFlags.Instance);
    if (prop != null) return prop.GetValue(obj, null);

    var field = t.GetField(name, BindingFlags.Public | BindingFlags.Instance);
    if (field != null) return field.GetValue(obj);

    return null;
  }

  // Converts various IEnumerable / arrays to int[]
  private static int[] ToIntArray(object obj)
  {
    if (obj == null) return null;

    // already int[]
    if (obj is int[]) return (int[])obj;

    // IEnumerable (list, array, etc.)
    if (obj is IEnumerable enumerable)
    {
      var list = new List<int>();
      foreach (var x in enumerable)
      {
        if (x == null) continue;

        try
        {
          list.Add(Convert.ToInt32(x));
        }
        catch
        {
          // ignore non-convertible values
        }
      }
      return list.ToArray();
    }

    // single value
    try
    {
      return new[] { Convert.ToInt32(obj) };
    }
    catch
    {
      return null;
    }
  }
}
# ---------- end c_script_2 ----------

# ---- group: ADDED COMPONENT
c_script_3 = CSharpScript(RES=simulation)  # -> out, RES_patched, UniqueIdx, UniqueDirs, Counts
# ---------- c_script_3: C# ----------
using System;
using System.Linq;
using System.Collections;
using System.Reflection;

public class Script_Instance : GH_ScriptInstance
{
  private void RunScript(
		object RES,
		ref object RES_patched,
		ref object UniqueIdx,
		ref object UniqueDirs,
		ref object Counts)
  {
    if (RES == null)
    {
      RES_patched = null;
      UniqueIdx = "RES is null";
      UniqueDirs = null;
      Counts = null;
      return;
    }

    dynamic res = RES;
    dynamic bcond = res.Domain.BCond;

    // --- CFD simulated directions ---
    int[] simDirs = ((IEnumerable)bcond.WindDirections)
      .Cast<object>()
      .Select(o => Convert.ToInt32(o))
      .ToArray();

    // --- EPW path ---
    string epwPath = Convert.ToString(bcond.epwFilePath);
    if (string.IsNullOrWhiteSpace(epwPath))
    {
      RES_patched = RES;
      UniqueIdx = "bcond.epwFilePath is empty";
      UniqueDirs = null;
      Counts = null;
      return;
    }

    // 1) Create EddyLib.Weather(epwPath)
    Type weatherType = FindType("EddyLib.Weather");
    if (weatherType == null)
    {
      RES_patched = RES;
      UniqueIdx = "Cannot find type EddyLib.Weather (EddyLib assembly not loaded?)";
      UniqueDirs = null;
      Counts = null;
      return;
    }

    object weatherObj = Activator.CreateInstance(weatherType, epwPath);

    // 2) Call EddyLib.OutdoorComfort.WindSystem.GetClosestWindDirs(weather, simDirs)
    Type windSystemType = FindType("EddyLib.OutdoorComfort.WindSystem");
    if (windSystemType == null)
    {
      RES_patched = RES;
      UniqueIdx = "Cannot find type EddyLib.OutdoorComfort.WindSystem";
      UniqueDirs = null;
      Counts = null;
      return;
    }

    MethodInfo mapMethod = windSystemType.GetMethod(
      "GetClosestWindDirs",
      BindingFlags.Public | BindingFlags.Static
    );

    if (mapMethod == null)
    {
      RES_patched = RES;
      UniqueIdx = "Cannot find method WindSystem.GetClosestWindDirs(...)";
      UniqueDirs = null;
      Counts = null;
      return;
    }

    // result: Tuple<int[], int[], int[], double>
    object tupleObj = mapMethod.Invoke(null, new object[] { weatherObj, simDirs });

    if (tupleObj == null)
    {
      RES_patched = RES;
      UniqueIdx = "GetClosestWindDirs returned null";
      UniqueDirs = null;
      Counts = null;
      return;
    }

    // Read tuple items via reflection (Item1..Item4)
    int[] indices   = (int[])tupleObj.GetType().GetProperty("Item1").GetValue(tupleObj, null);
    int[] dirs      = (int[])tupleObj.GetType().GetProperty("Item2").GetValue(tupleObj, null);
    int[] offsets   = (int[])tupleObj.GetType().GetProperty("Item3").GetValue(tupleObj, null);
    double avgOff   = (double)tupleObj.GetType().GetProperty("Item4").GetValue(tupleObj, null);

    // 3) Write back into BC object (these are public fields/properties in EddyLib)
    bcond.ClstSimDirIndices = indices;
    bcond.ClstSimDirs = dirs;
    bcond.WindDirOffset = offsets;
    bcond.WindDirOffSetAverage = avgOff;

    // --- Debug output ---
    var unique = indices.Distinct().OrderBy(i => i).ToArray();

    var map = unique
      .Where(i => i >= 0 && i < simDirs.Length)
      .Select(i => string.Format("{0} -> {1}°", i, simDirs[i]))
      .ToArray();

    var counts = unique
      .Select(i => string.Format("{0}: {1} hours", i, indices.Count(v => v == i)))
      .ToArray();

    RES_patched = RES;
    UniqueIdx = unique;
    UniqueDirs = map;
    Counts = counts;
  }

  // Finds a type in any loaded assembly
  private static Type FindType(string fullName)
  {
    foreach (var asm in AppDomain.CurrentDomain.GetAssemblies())
    {
      try
      {
        var t = asm.GetType(fullName, false, false);
        if (t != null) return t;
      }
      catch { }
    }
    return null;
  }
}
# ---------- end c_script_3 ----------

# ----
panel_5 = Panel([c_script_2.UniqueIdx, c_script_2.Counts, c_script_2.Mapping, c_script_2.Report])  # disabled
panel_6 = Panel([c_script_3.UniqueIdx, c_script_3.UniqueDirs, c_script_3.Counts])

# ----
# 5. Post-processing
# 5.1. Paraview
# Multi-directional / annual wind vectors
# 5.2. Grasshopper
# Set to -1 for average of entire year (takes 30 s to compute)
dir = Slider(0, range=0..7)
button_2 = Button()  # disabled
vectors = Data(probing.ProbingResult)
points = Data(probing.ProbingPoints)
paraview = Paraview(Result=simulation, ParaviewVersion=2, Run=button_2)  # disabled
choose_dir = TreeBranch(Tree=vectors, Path=dir, MaintainPaths=True)
wind_factors = WindFactors(Result=c_script_3.RES_patched, ProbingPoints=points, WindVelocity=vectors, Run=Button(), Interpolation=True)  # -> WindFactorsSpatial, WindFactorsAnnual
cluster = Cluster(data=choose_dir)  # -> S, E, data_3
gradient = Gradient(
    LowerLimit=cluster.S,
    UpperLimit=cluster.E,
    Parameter=cluster.data_3,
    stops=[0.103: RGB(0, 0, 255), 0.22: RGB(0, 170, 255), 0.305: RGB(0, 255, 255), 0.398: RGB(0, 255, 188), 0.504: RGB(0, 255, 106), 0.605: RGB(91, 255, 0), 0.699: RGB(184, 255, 0), 0.799: RGB(255, 255, 0), 0.898: RGB(255, 170, 0)])
dedata = DeconstructDataObjects(Data=wind_factors.WindFactorsAnnual, Select=Slider(1, range=0..10))
flip = FlipMatrix(Data=dedata)
vdisex = VectorDisplayEx(Point=points, Vector=choose_dir, Colour=gradient, Width=Slider(3, range=0..10))
avr = Average(Input=flip)  # -> flatten(ArithmeticMean)
cluster_2 = Cluster(data=avr)  # -> S, E, data_3
cluster_3 = Cluster_3(C=points, T=Vector(0, 0, 10))
gradient_2 = Gradient(
    LowerLimit=cluster_2.S,
    UpperLimit=cluster_2.E,
    Parameter=cluster_2.data_3,
    stops=[0.103: RGB(0, 0, 255), 0.22: RGB(0, 170, 255), 0.305: RGB(0, 255, 255), 0.398: RGB(0, 255, 188), 0.504: RGB(0, 255, 106), 0.605: RGB(91, 255, 0), 0.699: RGB(184, 255, 0), 0.799: RGB(255, 255, 0), 0.898: RGB(255, 170, 0)])
preview = CustomPreview(Geometry=cluster_3, Material=gradient_2)

pedestrian_wind_comfort = PedestrianWindComfort(
    WindFactorsSpatial=wind_factors.WindFactorsSpatial,
    WindFactorsAnnual=wind_factors.WindFactorsAnnual,
    WindComfortMetric=4,
    Weibull_Fit=True)  # -> WindComfortRank, WindComfortClassLetter, WindComfortClass; disabled
cir = Circle(Plane=probing.ProbingPoints, Radius=1)  # disabled
srf = Surface(cir)  # disabled

# ----
# Wind Comfort Metrics
cluster_4 = Cluster(data=pedestrian_wind_comfort.WindComfortRank)  # -> S, E, data_3; disabled
gradient_3 = Gradient(
    LowerLimit=cluster_4.S,
    UpperLimit=cluster_4.E,
    Parameter=cluster_4.data_3,
    stops=[0.103: RGB(0, 0, 255), 0.22: RGB(0, 170, 255), 0.305: RGB(0, 255, 255), 0.398: RGB(0, 255, 188), 0.504: RGB(0, 255, 106), 0.605: RGB(91, 255, 0), 0.699: RGB(184, 255, 0), 0.799: RGB(255, 255, 0), 0.898: RGB(255, 170, 0)])  # disabled
tag = TextTag(Location=probing.ProbingPoints, Text=pedestrian_wind_comfort.WindComfortClassLetter)  # disabled
preview_2 = CustomPreview(Geometry=srf, Material=gradient_3)  # disabled

# ==== cluster Cluster
data = ClusterInput()
data_2 = Data(data)
data_3 = ClusterOutput(data_2)
bnd = Bounds(Numbers=data_2)
dedomain = DeconstructDomain(Domain=bnd)  # -> Start, End
S = ClusterOutput(dedomain.Start)
E = ClusterOutput(dedomain.End)

# ==== cluster Cluster_3
C = ClusterInput()
cluster = Cluster_2(C=C)
T = ClusterInput()
move = Move(Geometry=cluster, Motion=T)  # -> Geometry, Transform
srf = ClusterOutput(cluster)

# ==== cluster Cluster_2
C = ClusterInput()
circle = CircleCNR(Center=C, Normal=Vector(0, 0, 1), Radius=2)
srf = Surface(circle)
srf_2 = ClusterOutput(srf)
