# Grasshopper definition 99_Restaurant_EDDY_COVIDgh_Validation.ghx (Grasshopper 1.0.7)
# plug-ins: MeshEdit Components, Eddy3D, HAL for Grasshopper

document_path = CSharpScript()  # -> out, A
# ---------- document_path: C# usings ----------
using System.IO;
# ---------- document_path: C# ----------
    GH_Document gh_d = owner.OnPingDocument();

    if (gh_d.IsFilePathDefined)
    {
      Print("A path is defined.");
      A = System.IO.Path.GetDirectoryName(gh_d.FilePath);
    }
    else
    {
      Print("No path defined.");
    }
# ---------- end document_path ----------
# EDDY COVID-19:
# 
# Restaurant Validation Experiment:
# 
# Reference:
# https://www.medrxiv.org/content/10.1101/2020.04.16.20067728v1.full.pdf
# https://www.ncbi.nlm.nih.gov/pmc/articles/PMC7323555/
# 
# Ventilation Rates used:
# - high ventilation
# flow rate = 212  ft^2/min  (1.08m/s)
# - low ventilation
# flow rate = 15  ft^2/min (0.08m/s)
# 
# Emitter:
#  -located at  (1 m, 0.5 m,
# 1.6 m)
# - injection direction of (0, 1, 0)
# - average emission flow 0.21m/s
# - size tracer gas pipe= 8-mm inner diameter
# - speed =1.5 m/s
# 
# -temperature =32–34 °C
# 
# -Five coil AC unit: from Daiking website:
# https://www.daikinkuwait.com/content/dam/document-library/
# catalogues/as/fan-coil-units/fwd-at/FWV_FWL_FWM_FWD_
# FWB_EPCE04-25B_Catalogues_English.pdf
# 
# Measured Air flow:
# non-ABC zone = 1.04 L/s per patron
# ABC zone =  0.75 L/s per patron
sessionsettings = SessionSettings()

# ----
# Probe Points
# Point locations to measure concentration
# Values from the Restaurant Paper
normalized_measured_concentration = Panel("""1
0.87
0.98
0
0
0
0
0
0
0.55
0
0
0
0
0.58
0.7
0.86
0.73""")
normalized_predicted_concentration = Panel("""1
1.04
0.93
1
0.62
0.47
0.42
0.42
0.32
0.52
0.57
0.5
0.55
0.63
0.54
0.56
0.5
0.85""")
_09 = Point(<point referenced from the Rhino model>)
_13 = Point(<point referenced from the Rhino model>)
_18 = Point(<point referenced from the Rhino model>)
_04 = Point(<point referenced from the Rhino model>)
_05 = Point(<point referenced from the Rhino model>)
_06 = Point(<point referenced from the Rhino model>)
_07 = Point(<point referenced from the Rhino model>)
_08 = Point(<point referenced from the Rhino model>)
_10 = Point(<point referenced from the Rhino model>)
_11 = Point(<point referenced from the Rhino model>)
_12 = Point(<point referenced from the Rhino model>)
_14 = Point(<point referenced from the Rhino model>)
_17 = Point(<point referenced from the Rhino model>)
pta = Point(<point referenced from the Rhino model>)
ptb = Point(<point referenced from the Rhino model>)
ptc = Point(<point referenced from the Rhino model>)
_15 = Point(<point referenced from the Rhino model>)
_16 = Point(<point referenced from the Rhino model>)
pt = Point([pta, ptb, ptc, _04, _05, _06, _07, _08, _09, _10, _11, _12, _13, _14, _15, _16, _17, _18])

# ----
# Volumetric Heat Sources(Plates)
volume = Brep([<brep referenced from the Rhino model> x91])
join = BrepJoin(Breps=volume)  # -> Breps, Closed

# ----
# Volumetric Heat Sources(People)
volume_2 = Brep([<brep referenced from the Rhino model> x1334])
join_2 = BrepJoin(Breps=volume_2)  # -> Breps, Closed

# ----
# Momentum Sink (Furniture)
volume_3 = Brep([<brep referenced from the Rhino model> x18])
join_3 = BrepJoin(Breps=volume_3)  # -> Breps, Closed

# ----
# Viral Emitter
infected_emitter_mesh = Brep(<brep referenced from the Rhino model>)
facen = FaceNormals(Mesh=infected_emitter_mesh)  # -> Centers, Normals
tracer_gas_emission_speed = Panel("-1.5")
multiplication = Multiplication(A=facen.Normals, B=tracer_gas_emission_speed)
vdisex = VectorDisplayEx(Vector=multiplication, Colour=RGB(255, 0, 0), Width=2)

# ----
# Validation Case
# Volume
volume_4 = Brep([<brep referenced from the Rhino model> x32])
join_4 = BrepJoin(Breps=volume_4)  # -> Breps, Closed

ventilation_inlet_fire_stair_door = Brep(<brep referenced from the Rhino model>)
ventilation_inlet_bathroom = Panel("-1.08")
ventilation_inlet_fire_stair_door_2 = Panel("-1.08")
facen_2 = FaceNormals(Mesh=ventilation_inlet_fire_stair_door)  # -> flatten(Centers), Normals
multiplication_2 = Multiplication(A=facen_2.Normals, B=ventilation_inlet_fire_stair_door_2)  # -> flatten(Result)
vdisex_2 = VectorDisplayEx(Point=facen_2.Centers, Vector=multiplication_2, Colour=RGB(255, 0, 0), Width=2)

# ----
# Inlets
ventilation_inlet_bathroom_2 = Brep(<brep referenced from the Rhino model>)
ventilation_inlet_fire_stair_door_3 = Panel("-1.08")
facen_3 = FaceNormals(Mesh=ventilation_inlet_bathroom_2)  # -> flatten(Centers), Normals
multiplication_3 = Multiplication(A=facen_3.Normals, B=ventilation_inlet_fire_stair_door_3)  # -> flatten(Result)
vdisex_3 = VectorDisplayEx(Point=facen_3.Centers, Vector=multiplication_3, Colour=RGB(255, 0, 0), Width=2)

# ----
# Outlets
ventilation_outlet = Brep(<brep referenced from the Rhino model>)
facen_4 = FaceNormals(Mesh=ventilation_outlet)  # -> Centers, Normals
vdisex_4 = VectorDisplayEx(Point=facen_4.Centers, Vector=facen_4.Normals, Colour=RGB(255, 0, 0), Width=2)

panel = Panel("230")
panel_2 = Panel("320")
panel_3 = Panel("400")
m_3_h = Panel("170")

# ----
# Fan (Momentum Source) In
convert_1_h_1_s = Panel("3600")
# Fan (Momentum Source) Out
ac_outlet = Brep([<brep referenced from the Rhino model> x5])
area = MeshArea(Mesh=ac_outlet)  # -> Area, Centroid
division = Division(A="900", B=area.Area)
division_2 = Division(A=division, B=convert_1_h_1_s)
panel_4 = Panel("""{0,1,0}
{-1,0,0}
{-1,0,0}
{-1,0,0}
{-1,0,0}""")
multiplication_4 = Multiplication(A=area.Area, B=division_2)
multiplication_5 = Multiplication(A=panel_4, B=multiplication_4)
vdisex_5 = VectorDisplayEx(Vector=multiplication_5, Colour=RGB(255, 0, 0), Width=2)

ac_inlet = Brep([<brep referenced from the Rhino model> x5])
facen_5 = FaceNormals(Mesh=ac_inlet)  # -> Centers, Normals
multiplication_6 = Multiplication(A=multiplication_4, B=-1)
multiplication_7 = Multiplication(A=facen_5.Normals, B=multiplication_6)
vdisex_6 = VectorDisplayEx(Vector=multiplication_7, Colour=RGB(255, 0, 0), Width=2)

panel_5 = Panel(division)
# Temperature
temp = Slider(33, range=27..35)

# ----
# Plane to Simulate Age of Air and CO2 concentration
age_of_air_simulation_plane_mouth_height = Brep(<brep referenced from the Rhino model>)

join_5 = BrepJoin(Breps=ac_inlet)  # -> Breps, Closed
mesh_join = MeshJoin(Meshes=infected_emitter_mesh)
mesh_join_2 = MeshJoin(Meshes=ac_outlet)
panel_6 = Panel(join_2.Breps)
mesh_join_3 = MeshJoin(Meshes=volume)
panel_7 = Panel(volume_2)
panel_8 = Panel(join.Breps)
panel_9 = Panel(join_3.Breps)
mesh_join_4 = MeshJoin(Meshes=ac_inlet)
panel_10 = Panel(join_5.Breps)
mesh_join_5 = MeshJoin(Meshes=volume_2)
mesh_join_6 = MeshJoin(Meshes=volume_3)
join_6 = BrepJoin(Breps=ac_outlet)  # -> Breps, Closed
join_7 = BrepJoin(Breps=infected_emitter_mesh)  # -> Breps, Closed

co2em = CO2Emitter(Name="CO2Emitter", InjectionRate="2", Type=0)
panel_11 = Panel(co2em)

mesh = Mesh(volume_3)
panel_12 = Panel(join_6.Breps)
vector = Vector(multiplication_7)
panel_13 = Panel(join_7.Breps)
panel_14 = Panel(vector)
panel_15 = Panel(mesh_join_5)
mesh_2 = Mesh(mesh_join_2)

il = Inlet(Geo=ventilation_inlet_bathroom_2, Vel=multiplication_3, Temp=temp)  # -> flatten(Inlet)
il_2 = Inlet(Geo=ventilation_inlet_fire_stair_door, Vel=multiplication_3, Temp=temp)  # -> flatten(Inlet)

mesh_3 = Mesh(mesh_join)
ol = Outlet(Geo=ventilation_outlet, Vel=Vector(0, 0, 0))
geo = Geometry(Geo=join_4.Breps, Temp=temp)
pt_2 = Point(Point(3.152091326, -9.490595055, 0.4314200966))
mesh_4 = Mesh(mesh_join_4)
mesh_5 = Mesh(mesh_join_5)
vhs = VolumetricHeatSource(Geo=mesh_5, Power=Slider(30, range=0..100), Name="volumetricHeatSource")
ms = MomentumSource(Geo=[mesh_2, mesh_4], Ubar="{0,0,0.25}", Name="momentumSource")
viralem = ViralEmitter(Geo=mesh_3, Name="ViralEmitter", InjectionRate="2", Type=0)
msink = MomentumSink(Geo=mesh_join_6, Name="momentumSink")
panel_16 = Panel(vhs)
panel_17 = Panel(ms)
panel_18 = Panel(viralem)
panel_19 = Panel(msink)

# ---- group: For any new case, please make sure to put it in a "0" subfolder.
panel_20 = Panel("C:\CovidRestaurant22\0\")

# ----
panel_21 = Panel("run_mesh.bat")  # disabled
panel_22 = Panel("run_sim.bat")  # disabled
panel_23 = Panel("decomposeParDict")  # disabled
panel_24 = Panel("run_topoSet.bat")  # disabled
c_script = CSharpScript(path=panel_20, fileName=panel_23)  # -> out, A; inputs path: String, fileName: String; disabled
# ---------- c_script: C# usings ----------
using System.IO;
using System.Linq;
using System.Data;
using System.Drawing;
using System.Reflection;
using System.Windows.Forms;
using System.Xml;
using System.Xml.Linq;
using System.Runtime.InteropServices;

using Rhino.DocObjects;
using Rhino.Collections;
using GH_IO;
using GH_IO.Serialization;
# ---------- c_script: C# ----------
    String filePath = path + @"\system\" + fileName;


    A = filePath;



    File.Delete(filePath);

    using(var tw = new StreamWriter(filePath)) // new StreamWriter(path, true) for append
    {
      tw.Write(@"// * * * * * * * * * //
        FoamFile
        {
        version 0.5;
        format ascii;
        root ""ROOT"";
        case ""CASE"";

        class dictionary;
        object xxx;
        }
        method scotch;
        numberOfSubdomains 8;
        scotchCoeffs
        {
        }"


        );








      tw.Close();


    }
# ---------- end c_script ----------
c_script_2 = CSharpScript(path=panel_20, fileName=panel_21)  # -> out, A; inputs path: String, fileName: String; disabled
# ---------- c_script_2: C# ----------
    String filePath = path + @"\" + fileName;


    A = filePath;



    File.Delete(filePath);

    using(var tw = new StreamWriter(filePath)) // new StreamWriter(path, true) for append
    {
      tw.Write(@"call ""C:\Program Files\blueCFD-Core-2017\\setvars.bat""
        set PATH=%HOME%msys64\usr\bin;%PATH%
        cd " + path + @"

        blockMesh.exe
        surfaceFeatureExtract
        decomposePar -force
        mpiexec -np 8 snappyHexMesh -overwrite -parallel
        reconstructParMesh -constant
        renumberMesh -overwrite"


        );






      tw.Write("\"");
      tw.WriteLine("\n");
      tw.WriteLine("PAUSE");


      tw.Close();


    }
# ---------- end c_script_2 ----------
c_script_3 = CSharpScript(path=panel_20, fileName=panel_24)  # -> out, A; inputs path: String, fileName: String; disabled
# ---------- c_script_3: C# ----------
    String filePath = path + @"\" + fileName;


    A = filePath;



    File.Delete(filePath);

    using(var tw = new StreamWriter(filePath)) // new StreamWriter(path, true) for append
    {
      tw.Write(@"call ""C:\Program Files\blueCFD-Core-2017\\setvars.bat""
        set PATH=%HOME%msys64\usr\bin;%PATH%
        cd " + path + @"

        topoSet"
        );






      tw.Write("\"");
      tw.WriteLine("\n");
      tw.WriteLine("PAUSE");


      tw.Close();


    }
# ---------- end c_script_3 ----------
c_script_4 = CSharpScript(path=panel_20, fileName=panel_22)  # -> out, A; inputs path: String, fileName: String; disabled
# ---------- c_script_4: C# ----------
    String filePath = path + @"\" + fileName;


    A = filePath;



    File.Delete(filePath);

    using(var tw = new StreamWriter(filePath)) // new StreamWriter(path, true) for append
    {
      tw.Write(@"call ""C:\Program Files\blueCFD-Core-2017\\setvars.bat""
        set PATH=%HOME%msys64\usr\bin;%PATH%
        cd " + path + @"

        renumberMesh -overwrite
        decomposePar -force
        mpiexec -np 8 buoyantSimpleFoam -parallel
        reconstructPar");






      tw.Write("\"");
      tw.WriteLine("\n");
      tw.WriteLine("PAUSE");


      tw.Close();


    }
# ---------- end c_script_4 ----------

idom = IndoorDomain(
    Geo=geo,
    Inlet=[il, il_2],
    Outlet=ol,
    FunctionObjects=[viralem, ms, msink, vhs],
    Directory=panel_20,
    PointInside=pt_2,
    CellSize=Slider(0.3, range=0..1),
    Iterations=Slider(300, range=0..10000),
    RunMeshing=Toggle(True),
    MakeFOS=Toggle(False),
    RunSimulation=Toggle(False))
number_slider = Slider(0.5, range=0..1)
brep = Brep(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)

brep_2 = Brep(<brep referenced from the Rhino model>)  # disabled
brep_3 = Brep(<brep referenced from the Rhino model>)  # disabled
brep_4 = Brep(<brep referenced from the Rhino model>)  # disabled
mesh_6 = Mesh(brep_2)  # disabled
mesh_7 = Mesh(brep_3)  # disabled
mesh_8 = Mesh(brep_4)  # disabled
panel_25 = Panel("20")  # disabled
ol_2 = Outlet(Geo=mesh_7, Vel=Vector(0, 0, 0))  # disabled
geo_2 = Geometry(Geo=mesh_8, Temp=panel_25)  # disabled
# Trash
panel_26 = Panel("-1")  # disabled
Y = UnitY(Factor=panel_26)  # disabled
il_3 = Inlet(Geo=mesh_6, Vel=Y, Temp=panel_25)  # disabled
c_script_5 = CSharpScript(i=il_3, o=ol_2, w=geo_2, Reference="C:\Users\zorot\Documents\GitHub\Eddy3d\Eddy\bin\EddyLib.dll")  # -> out, A; disabled
# ---------- c_script_5: C# usings ----------
using System.Linq;
using EddyLib;
using EddyLib.Indoor;
using  EddyLib.Indoor.Dicts;
using System.Text;
using System.Diagnostics;
# ---------- c_script_5: C# ----------
    //var dom = (EddyLib.Indoor.IndoorDomain) x;

    double refLevel = 3;

    Point3d pt = new Point3d(1, 1, 1);

    Point3d pt0 = new Point3d(0, 0, 0);
    Point3d pt1 = new Point3d(10, 10, 10);
    BoundingBox boundingB = new BoundingBox(pt0, pt1);



    EddyLib.Indoor.IndoorBC.Inlet inl = (EddyLib.Indoor.IndoorBC.Inlet) i;
    EddyLib.Indoor.IndoorBC.Outlet outl = (EddyLib.Indoor.IndoorBC.Outlet) o;
    EddyLib.Indoor.IndoorBC.Wall wall = (EddyLib.Indoor.IndoorBC.Wall) w;



    inl.Id = "Inlet_1";
    outl.Id = "Outlet_1";
    wall.Id = "Wall_1";

    List < EddyLib.Indoor.IndoorBC.Inlet > inlList = new List < EddyLib.Indoor.IndoorBC.Inlet > ();
    inlList.Add(inl);


    List < EddyLib.Indoor.IndoorBC.Outlet > outlList = new  List < EddyLib.Indoor.IndoorBC.Outlet > (){outl};


    List < EddyLib.Indoor.IndoorBC.Wall > wallList = new List < EddyLib.Indoor.IndoorBC.Wall >(){wall};

    var res = new SnappyHexMeshDict(refLevel, pt, boundingB, inlList, outlList, wallList);

    A = res.FullDictString.ToString();
# ---------- c_script_5: C# additional code ----------
  public  class SnappyHexMeshDict : EddyLib.Indoor.Dicts.GenericDict
  {
    private Point3d locationInMesh;


    public List<String> InternalDict = new List<string>();


  public Dictionary<string, dynamic> GeometryDict { get; set; }

public Dictionary<string, dynamic> GeometrySubDict { get; set; }


public SnappyHexMeshDict(double refineMentLevel, Point3d pointInsideDomain, BoundingBox BBox, List<EddyLib.Indoor.IndoorBC.Inlet> inlet, List<EddyLib.Indoor.IndoorBC.Outlet> outlet, List<EddyLib.Indoor.IndoorBC.Wall> wall)
{
  this.DictionaryName = "snappyHexMeshDict";
  this.Location = DictLocation.system;
  this.FC = FieldClass.dictionary;
  this.Header = GetHeader(this);
  this.locationInMesh = pointInsideDomain;

  this.GeometrySubDict = new Dictionary<string, dynamic>();

  foreach (IndoorBC i in inlet) { this.GeometrySubDict.Add(i.Id.ToString(), GetGeometryDict(i)); };
  foreach (IndoorBC i in outlet) { this.GeometrySubDict.Add(i.Id.ToString(), GetGeometryDict(i)); };
  foreach (IndoorBC i in wall) { this.GeometrySubDict.Add(i.Id.ToString(), GetGeometryDict(i)); };

  this.GeometryDict = new Dictionary<string, dynamic>();
  GeometryDict.Add("geometry", GeometrySubDict);


  this.InternalDict.Add(CppMapSerializerDyn2.Serialize(GetSettingsDict()));
  this.InternalDict.Add(CppMapSerializerDyn2.Serialize(this.GeometryDict));
  this.InternalDict.Add(CppMapSerializerDyn2.Serialize(GetSnapControlsDict()));
  this.InternalDict.Add(CppMapSerializerDyn2.Serialize(GetCastellatedMeshControls(this.locationInMesh, wall, inlet, outlet)));
  this.InternalDict.Add(CppMapSerializerDyn2.Serialize(GetAddLayersControls()));
  this.InternalDict.Add(CppMapSerializerDyn2.Serialize(GetMeshQualityControls()));


  string[] parts = { this.Header, "\n",
    String.Join("\n", this.InternalDict.ToArray())
    };


  //    string[] parts = { this.Header, "\n",
  //      CppMapSerializerDyn2.Serialize(GetSettingsDict()),"\n",
  //      CppMapSerializerDyn2.Serialize(this.GeometryDict),"\n",
  //      CppMapSerializerDyn2.Serialize(GetSnapControlsDict()),"\n",
  //      CppMapSerializerDyn2.Serialize(GetCastellatedMeshControls(this.locationInMesh, wall, inlet, outlet)),"\n",
  //      CppMapSerializerDyn2.Serialize(GetAddLayersControls()),"\n",
  //      CppMapSerializerDyn2.Serialize(GetMeshQualityControls()),"\n"
  //      };



  this.FullDictString = parts.Aggregate((partialPhrase, word) => "{partialPhrase} {word}");
}

public static Dictionary<string,dynamic> GetGeometryDict(IndoorBC input)
{

  Dictionary < string, dynamic> Dict = new Dictionary<string, dynamic>();

  Dictionary < string, dynamic> InternalDict = new Dictionary<string, dynamic>();

  Dict.Add(input.Id + ".stl", InternalDict);

  InternalDict.Add("type", input.OFGeometryType);
  InternalDict.Add("name", input.Id);

  return Dict;
}

private static Dictionary<string, dynamic> GetSettingsDict()
{
  Dictionary < string, dynamic> InternalDict = new Dictionary<string, dynamic>();

  InternalDict.Add("castellatedMesh", "true");
  InternalDict.Add("snap", "true");
  InternalDict.Add("addLayers", "false");
  InternalDict.Add("singleRegionName", " true");
  InternalDict.Add("mergePatchFaces", "true");
  InternalDict.Add("keepPatches", "false");
  InternalDict.Add("mergeTolerance", "1e-8");
  InternalDict.Add("debug", "0");

  return InternalDict;
}

private static Dictionary<string, dynamic> GetSnapControlsDict()
{
  Dictionary < string, dynamic> Dict = new Dictionary<string, dynamic>();

  Dictionary < string, dynamic> InternalDict = new Dictionary<string, dynamic>();

  Dict.Add("snapControls", InternalDict);

  InternalDict.Add("nSmoothPatch          ", "3");
  InternalDict.Add("nSmoothInternal       ", "3");
  InternalDict.Add("tolerance             ", "4.0");
  InternalDict.Add("nSolveIter            ", "30");
  InternalDict.Add("nRelaxIter            ", "5");
  InternalDict.Add("nFeatureSnapIter      ", "10");
  InternalDict.Add("nFaceSplitInterval    ", "5");
  InternalDict.Add("detectBaffles         ", "true");
  InternalDict.Add("releasePoints         ", "false");
  InternalDict.Add("stringFeatures        ", "true");
  InternalDict.Add("avoidDiagonal         ", "false");
  InternalDict.Add("concaveAngle          ", "45");
  InternalDict.Add("minAreaRatio          ", "0.3");
  InternalDict.Add("detectNearSurfacesSnap", "true");
  InternalDict.Add("strictRegionSnap      ", "false");
  InternalDict.Add("ExplicitFeatureSnap   ", "true");
  InternalDict.Add("ImplicitFeatureSnap   ", "false");

  return Dict;
}

private static Dictionary<string, dynamic> GetAddLayersControls()
{
  Dictionary < string, dynamic> Dict1 = new Dictionary<string, dynamic>();

  Dictionary < string, dynamic> Dict2 = new Dictionary<string, dynamic>();

  Dictionary < string, dynamic> Dict3 = new Dictionary<string, dynamic>();

  Dict1.Add("addLayersControls", Dict2);

  Dict2.Add("relativeSizes", "true");
  Dict2.Add("firstLayerThickness", "0.3");
  Dict2.Add("expansionRatio", "1.3");
  Dict2.Add("minThickness", "0.3");
  Dict2.Add("nGrow", "0");
  Dict2.Add("featureAngle", "150");
  Dict2.Add("nSmoothSurfaceNormals", "10");
  Dict2.Add("nSmoothNormals", "15");
  Dict2.Add("nSmoothThickness", "10");
  Dict2.Add("maxFaceThicknessRatio", "0.5");
  Dict2.Add("minMedialAxisAngle", "90");
  Dict2.Add("maxThicknessToMedialRatio", "0.3");
  Dict2.Add("nRelaxIter", "5");
  Dict2.Add("nRelaxedIter", "25");
  Dict2.Add("nLayerIter", "50");
  Dict2.Add("nBufferCellsNoExtrude", "0");
  Dict2.Add("slipFeatureAngle", "30");
  Dict2.Add("mergePatchFacesAngle", "45");
  Dict2.Add("concaveAngle", "30");
  Dict2.Add("layerTerminationAngle", "30");
  Dict2.Add("nSmoothDisplacement", "0");

  Dict2.Add("layers", Dict3);

  return Dict1;
}

private static Dictionary<string, dynamic> GetMeshQualityControls()
{
  Dictionary < string, dynamic> Dict1 = new Dictionary<string, dynamic>();

  Dictionary < string, dynamic> Dict2 = new Dictionary<string, dynamic>();

  Dictionary < string, dynamic> Dict3 = new Dictionary<string, dynamic>();

  Dict1.Add("meshQualityControls", Dict2);

  Dict2.Add("maxNonOrtho", "65");
  Dict2.Add("maxBoundarySkewness", "20");
  Dict2.Add("maxInternalSkewness", "4");
  Dict2.Add("maxConcave", "80");
  Dict2.Add("minFlatness", "0.5");
  Dict2.Add("minVol", "1e-13");
  Dict2.Add("minTetQuality", "1e-15");
  Dict2.Add("minArea", "1e-9");
  Dict2.Add("minTwist", "0.02");
  Dict2.Add("minDeterminant", "0.001");
  Dict2.Add("minFaceWeight", "0.05");
  Dict2.Add("minVolRatio", "0.01");
  Dict2.Add("minTriangleTwist", "- 1");
  Dict2.Add("nSmoothScale", "4");
  Dict2.Add("errorReduction", "0.75");

  Dict2.Add("relaxed", Dict3);

  return Dict1;
}

private static Dictionary<string, dynamic> GetCastellatedMeshControls(Point3d locationInMesh, List<IndoorBC.Wall> wall, List<IndoorBC.Inlet> inlet, List<IndoorBC.Outlet> outlet)
{

  Dictionary < string, dynamic> Dict1 = new Dictionary<string, dynamic>();
  Dictionary < string, dynamic> Dict2 = new Dictionary<string, dynamic>();
  Dictionary < string, dynamic> Dict3 = new Dictionary<string, dynamic>();


  Dict1.Add("castellatedMeshControls", Dict2);

  //mesh details
  Dict2.Add("locationInMesh", GenericDict.InParenthesis(locationInMesh.ToString().Replace(',', ' ')));
  Dict2.Add("maxLocalCells", "50000000");
  Dict2.Add("maxGlobalCells", "60000000");
  Dict2.Add("minRefinementCells", "50");
  Dict2.Add("nCellsBetweenLevels", "2");
  Dict2.Add("resolveFeatureAngle", "60");
  Dict2.Add("maxLoadUnbalance", "1");
  Dict2.Add("allowFreeStandingZoneFaces", "false");

  //mesh features
  Dict2.Add("features", new MeshFeatureObject(inlet, outlet, wall).ToString());

  //refinement surfaces
  Dict2.Add("refinementSurfaces", new MeshRefinementObject(inlet, outlet, wall).ToString());

  //refinement regions
  Dict2.Add("refinementRegions", Dict3);
  Dict3.Add(" ", " ");


  return Dict1;
}

public  class MeshFeatureObject
{

  private  List<IndoorBC.Inlet> inlet { get; set; }
  private List<IndoorBC.Outlet> outlet { get; set; }
  private List<IndoorBC.Wall> wall { get; set; }


  public MeshFeatureObject(List<IndoorBC.Inlet> inlet, List<IndoorBC.Outlet> outlet, List<IndoorBC.Wall> wall)
  {
    this.inlet = inlet;
    this.outlet = outlet;
    this.wall = wall;

  }

  public override string ToString()
  {

    StringBuilder sb = new StringBuilder();
    sb.Append(@"{");

    foreach (IndoorBC i in inlet) { sb.AppendLine(@"file """ + i.Id + @".eMesh"";
        level " + i.refinementLevel + @";"); }
    foreach (IndoorBC i in outlet) { sb.AppendLine(@"file """ + i.Id + @".eMesh"";
        level " + i.refinementLevel + @";"); }
    foreach (IndoorBC i in wall) { sb.AppendLine(@"file """ + i.Id + @".eMesh"";
        level " + i.refinementLevel + @";"); }

    sb.Append(@"}");

    return GenericDict.InParenthesis(sb.ToString());
  }
}

        //Mesh Refinement Object
public  class MeshRefinementObject
{

  private List<IndoorBC.Inlet> inlet { get; set; }
  private List<IndoorBC.Outlet> outlet { get; set; }
  private List<IndoorBC.Wall> wall { get; set; }


  public MeshRefinementObject(List<IndoorBC.Inlet> inlet, List<IndoorBC.Outlet> outlet, List<IndoorBC.Wall> wall)
  {
    this.inlet = inlet;
    this.outlet = outlet;
    this.wall = wall;

  }

  public override string ToString()
  {

    StringBuilder sb = new StringBuilder();
    sb.Append(@"{");

    //DICTIONARY WAY
    //foreach (IndoorBC i in inlet) { CppMapSerializerDyn.Serialize(MakeDict_RefinementSurfaces(i)); }
    //foreach (IndoorBC i in outlet) { CppMapSerializerDyn.Serialize(MakeDict_RefinementSurfaces(i)); }
    //foreach (IndoorBC i in wall) { CppMapSerializerDyn.Serialize(MakeDict_RefinementSurfaces(i)); }

    //OTHER WAY - sting intead of Dict refinement surfaces
    foreach (IndoorBC i in inlet) { sb.AppendLine(GetRefinementSurfaces(i)); }
    foreach (IndoorBC i in outlet) { sb.AppendLine(GetRefinementSurfaces(i)); }
    foreach (IndoorBC i in wall) { sb.AppendLine(GetRefinementSurfaces(i)); }

    sb.Append(@"}");

    return GenericDict.InParenthesis(sb.ToString());
  }

  public static string GetRefinementSurfaces(IndoorBC bc)
  {
    return string.Format(@"{0}
      {{
      level           ({1} {1});
      patchInfo
      {{
      type            {2};
      }}
      }}", bc.Id, bc.refinementLevel.ToString(), bc.bcType.ToString());

  }
}
}


public class CppMapSerializerDyn2
{
  public static string Serialize(Dictionary<string, dynamic> dict)
  {
    StringBuilder sb = new StringBuilder();

    foreach (KeyValuePair<string, dynamic> evl in dict)
    {
      // 0. Dictionary<string, List<Dictionary<string, Dictionary<string, string>>>> dicts

      if (evl.Key is String && evl.Value is Dictionary<string, dynamic>)
      {
        sb.AppendLine(Serialize(evl.Value));
      }

      // 1. Dictionary<string, string> dict
      else if (evl.Key is String && (evl.Value is String || evl.Value is Int32))
      {
        DictToString(evl, ref sb);

      }
      // 2. Dictionary<string, Dictionary<string, string>> dicts
      //      else if (evl.Key is String && evl.Value is Dictionary<string, dynamic>)
      //      {
      //        sb.AppendLine(Serialize(evl.Value));
      //      }


    }

    return sb.ToString();
  }

  private static void DictToString(string name, Dictionary<string, dynamic> dict, ref StringBuilder sb)
  {
  sb.AppendLine("\t" + name);

  sb.AppendLine("\t" + "{");

  foreach (KeyValuePair<string, dynamic> evl in dict)
  {
  if (evl.Key is String && evl.Value is String)
  {

  sb.AppendLine("\t" + "\t" + evl.Key + "\t" + evl.Value + ";");
}
                else if (evl.Key is String && evl.Value is Int32)
                {
                    sb.AppendLine("\t" + "\t" + evl.Key + "\t" + evl.Value.ToString() + ";");
                }

//  else if (evl.Key is String && evl.Value is MeshFeatureObject)
//                {
//                    sb.AppendLine("\t" + "\t" + evl.Key);
//
//                    sb.AppendLine("\t" + "\t" + "{");
//// Problem line
//                    sb.AppendLine("\t" + "\t" + "\t" + Serialize(evl.Value.ToString()));
//
//  //                  sb.AppendLine("\t" + "\t" + "}");
// //               }


                else if (evl.Key is String && evl.Value is Dictionary<string, dynamic>)
                {
                    sb.AppendLine("\t" + "\t" + evl.Key);

                    sb.AppendLine("\t" + "\t" + "{");
// Problem line
                    sb.AppendLine("\t" + "\t" + "\t" + Serialize(evl.Value));

                    sb.AppendLine("\t" + "\t" + "}");
                }
            }

            sb.AppendLine("\t" + "}");
 }

private static void DictToString(KeyValuePair<string, dynamic> evl, ref StringBuilder sb)
        {
            if (evl.Key is String)
            {
                if (evl.Value is String)
                {
                    sb.AppendLine(evl.Key + "\t " + evl.Value + ";");
                }
                else
                {
                    sb.AppendLine(evl.Key + "\t " + evl.Value.ToString() + ";");
                }
            }
        }
}
# ---------- end c_script_5 ----------
c_script_6 = CSharpScript()  # -> Out, A
c_script_7 = CSharpScript()  # -> Out, A
panel_27 = Panel(c_script_5.A)  # disabled
panel_28 = Panel(c_script_5.out)  # disabled
c_script_8 = CSharpScript(i=il_3, o=ol_2, w=geo_2, Reference="C:\Users\zorot\Documents\GitHub\Eddy3d\Eddy\bin\EddyLib.dll")  # -> out, A; disabled
# ---------- c_script_8: C# ----------
    //var dom = (EddyLib.Indoor.IndoorDomain) x;

    double refLevel = 3;

    Point3d pt = new Point3d(1, 1, 1);

    Point3d pt0 = new Point3d(0, 0, 0);
    Point3d pt1 = new Point3d(10, 10, 10);
    BoundingBox boundingB = new BoundingBox(pt0, pt1);



    EddyLib.Indoor.IndoorBC.Inlet inl = (EddyLib.Indoor.IndoorBC.Inlet) i;
    EddyLib.Indoor.IndoorBC.Outlet outl = (EddyLib.Indoor.IndoorBC.Outlet) o;
    EddyLib.Indoor.IndoorBC.Wall wall = (EddyLib.Indoor.IndoorBC.Wall) w;



    inl.Id = "Inlet_1";
    outl.Id = "Outlet_1";
    wall.Id = "Wall_1";

    List < EddyLib.Indoor.IndoorBC.Inlet > inlList = new List < EddyLib.Indoor.IndoorBC.Inlet > ();
    inlList.Add(inl);


    List < EddyLib.Indoor.IndoorBC.Outlet > outlList = new  List < EddyLib.Indoor.IndoorBC.Outlet > (){outl};


    List < EddyLib.Indoor.IndoorBC.Wall > wallList = new List < EddyLib.Indoor.IndoorBC.Wall >(){wall};

    var res = new SnappyHexMeshDict(refLevel, pt, boundingB, inlList, outlList, wallList);

    A = res.FullDictString.ToString();
# ---------- c_script_8: C# additional code ----------
  public  class SnappyHexMeshDict : EddyLib.Indoor.Dicts.GenericDict
  {
    private Point3d locationInMesh;


    public List<String> InternalDict = new List<string>();


  public Dictionary<string, dynamic> GeometryDict { get; set; }

public List<Dictionary<string, dynamic>> GeometrySubDict { get; set; }


public SnappyHexMeshDict(double refineMentLevel, Point3d pointInsideDomain, BoundingBox BBox, List<EddyLib.Indoor.IndoorBC.Inlet> inlet, List<EddyLib.Indoor.IndoorBC.Outlet> outlet, List<EddyLib.Indoor.IndoorBC.Wall> wall)
{
  this.DictionaryName = "snappyHexMeshDict";
  this.Location = DictLocation.system;
  this.FC = FieldClass.dictionary;
  this.Header = GetHeader(this);
  this.locationInMesh = pointInsideDomain;

  this.GeometrySubDict = new List<Dictionary<string, dynamic>>();

  foreach (IndoorBC i in inlet) { this.GeometrySubDict.Add(GetGeometryDict(i)); };
  foreach (IndoorBC i in outlet) { this.GeometrySubDict.Add(GetGeometryDict(i)); };
  foreach (IndoorBC i in wall) { this.GeometrySubDict.Add(GetGeometryDict(i)); };

  this.GeometryDict = new Dictionary<string, dynamic>();
  GeometryDict.Add("geometry", GeometrySubDict);


  this.InternalDict.Add(CppMapSerializerDyn2.Serialize(GetSettingsDict()));
  this.InternalDict.Add(CppMapSerializerDyn2.Serialize(this.GeometryDict));
  this.InternalDict.Add(CppMapSerializerDyn2.Serialize(GetSnapControlsDict()));
  this.InternalDict.Add(CppMapSerializerDyn2.Serialize(GetCastellatedMeshControls(this.locationInMesh, wall, inlet, outlet)));
  this.InternalDict.Add(CppMapSerializerDyn2.Serialize(GetAddLayersControls()));
  this.InternalDict.Add(CppMapSerializerDyn2.Serialize(GetMeshQualityControls()));


  string[] parts = { this.Header, "\n",
    String.Join("\n", this.InternalDict.ToArray())
    };


  //    string[] parts = { this.Header, "\n",
  //      CppMapSerializerDyn2.Serialize(GetSettingsDict()),"\n",
  //      CppMapSerializerDyn2.Serialize(this.GeometryDict),"\n",
  //      CppMapSerializerDyn2.Serialize(GetSnapControlsDict()),"\n",
  //      CppMapSerializerDyn2.Serialize(GetCastellatedMeshControls(this.locationInMesh, wall, inlet, outlet)),"\n",
  //      CppMapSerializerDyn2.Serialize(GetAddLayersControls()),"\n",
  //      CppMapSerializerDyn2.Serialize(GetMeshQualityControls()),"\n"
  //      };



  this.FullDictString = parts.Aggregate((partialPhrase, word) => "{partialPhrase} {word}");
}

public static Dictionary<string,dynamic> GetGeometryDict(IndoorBC input)
{

  Dictionary < string, dynamic> Dict = new Dictionary<string, dynamic>();

  Dictionary < string, dynamic> InternalDict = new Dictionary<string, dynamic>();

  Dict.Add(input.Id + ".stl", InternalDict);

  InternalDict.Add("type", input.OFGeometryType);
  InternalDict.Add("name", input.Id);

  return Dict;
}

private static Dictionary<string, dynamic> GetSettingsDict()
{
  Dictionary < string, dynamic> InternalDict = new Dictionary<string, dynamic>();

  InternalDict.Add("castellatedMesh", "true");
  InternalDict.Add("snap", "true");
  InternalDict.Add("addLayers", "false");
  InternalDict.Add("singleRegionName", " true");
  InternalDict.Add("mergePatchFaces", "true");
  InternalDict.Add("keepPatches", "false");
  InternalDict.Add("mergeTolerance", "1e-8");
  InternalDict.Add("debug", "0");

  return InternalDict;
}

private static Dictionary<string, dynamic> GetSnapControlsDict()
{
  Dictionary < string, dynamic> Dict = new Dictionary<string, dynamic>();

  Dictionary < string, dynamic> InternalDict = new Dictionary<string, dynamic>();

  Dict.Add("snapControls", InternalDict);

  InternalDict.Add("nSmoothPatch          ", "3");
  InternalDict.Add("nSmoothInternal       ", "3");
  InternalDict.Add("tolerance             ", "4.0");
  InternalDict.Add("nSolveIter            ", "30");
  InternalDict.Add("nRelaxIter            ", "5");
  InternalDict.Add("nFeatureSnapIter      ", "10");
  InternalDict.Add("nFaceSplitInterval    ", "5");
  InternalDict.Add("detectBaffles         ", "true");
  InternalDict.Add("releasePoints         ", "false");
  InternalDict.Add("stringFeatures        ", "true");
  InternalDict.Add("avoidDiagonal         ", "false");
  InternalDict.Add("concaveAngle          ", "45");
  InternalDict.Add("minAreaRatio          ", "0.3");
  InternalDict.Add("detectNearSurfacesSnap", "true");
  InternalDict.Add("strictRegionSnap      ", "false");
  InternalDict.Add("ExplicitFeatureSnap   ", "true");
  InternalDict.Add("ImplicitFeatureSnap   ", "false");

  return Dict;
}

private static Dictionary<string, dynamic> GetAddLayersControls()
{
  Dictionary < string, dynamic> Dict1 = new Dictionary<string, dynamic>();

  Dictionary < string, dynamic> Dict2 = new Dictionary<string, dynamic>();

  Dictionary < string, dynamic> Dict3 = new Dictionary<string, dynamic>();

  Dict1.Add("addLayersControls", Dict2);

  Dict2.Add("relativeSizes", "true");
  Dict2.Add("firstLayerThickness", "0.3");
  Dict2.Add("expansionRatio", "1.3");
  Dict2.Add("minThickness", "0.3");
  Dict2.Add("nGrow", "0");
  Dict2.Add("featureAngle", "150");
  Dict2.Add("nSmoothSurfaceNormals", "10");
  Dict2.Add("nSmoothNormals", "15");
  Dict2.Add("nSmoothThickness", "10");
  Dict2.Add("maxFaceThicknessRatio", "0.5");
  Dict2.Add("minMedialAxisAngle", "90");
  Dict2.Add("maxThicknessToMedialRatio", "0.3");
  Dict2.Add("nRelaxIter", "5");
  Dict2.Add("nRelaxedIter", "25");
  Dict2.Add("nLayerIter", "50");
  Dict2.Add("nBufferCellsNoExtrude", "0");
  Dict2.Add("slipFeatureAngle", "30");
  Dict2.Add("mergePatchFacesAngle", "45");
  Dict2.Add("concaveAngle", "30");
  Dict2.Add("layerTerminationAngle", "30");
  Dict2.Add("nSmoothDisplacement", "0");

  Dict2.Add("layers", Dict3);

  return Dict1;
}

private static Dictionary<string, dynamic> GetMeshQualityControls()
{
  Dictionary < string, dynamic> Dict1 = new Dictionary<string, dynamic>();

  Dictionary < string, dynamic> Dict2 = new Dictionary<string, dynamic>();

  Dictionary < string, dynamic> Dict3 = new Dictionary<string, dynamic>();

  Dict1.Add("meshQualityControls", Dict2);

  Dict2.Add("maxNonOrtho", "65");
  Dict2.Add("maxBoundarySkewness", "20");
  Dict2.Add("maxInternalSkewness", "4");
  Dict2.Add("maxConcave", "80");
  Dict2.Add("minFlatness", "0.5");
  Dict2.Add("minVol", "1e-13");
  Dict2.Add("minTetQuality", "1e-15");
  Dict2.Add("minArea", "1e-9");
  Dict2.Add("minTwist", "0.02");
  Dict2.Add("minDeterminant", "0.001");
  Dict2.Add("minFaceWeight", "0.05");
  Dict2.Add("minVolRatio", "0.01");
  Dict2.Add("minTriangleTwist", "- 1");
  Dict2.Add("nSmoothScale", "4");
  Dict2.Add("errorReduction", "0.75");

  Dict2.Add("relaxed", Dict3);

  return Dict1;
}

private static Dictionary<string, dynamic> GetCastellatedMeshControls(Point3d locationInMesh, List<IndoorBC.Wall> wall, List<IndoorBC.Inlet> inlet, List<IndoorBC.Outlet> outlet)
{

  Dictionary < string, dynamic> Dict1 = new Dictionary<string, dynamic>();
  Dictionary < string, dynamic> Dict2 = new Dictionary<string, dynamic>();
  Dictionary < string, dynamic> Dict3 = new Dictionary<string, dynamic>();


  Dict1.Add("castellatedMeshControls", Dict2);

  //mesh details
  Dict2.Add("locationInMesh", GenericDict.InParenthesis(locationInMesh.ToString().Replace(',', ' ')));
  Dict2.Add("maxLocalCells", "50000000");
  Dict2.Add("maxGlobalCells", "60000000");
  Dict2.Add("minRefinementCells", "50");
  Dict2.Add("nCellsBetweenLevels", "2");
  Dict2.Add("resolveFeatureAngle", "60");
  Dict2.Add("maxLoadUnbalance", "1");
  Dict2.Add("allowFreeStandingZoneFaces", "false");

  //mesh features
  Dict2.Add("features", new MeshFeatureObject(inlet, outlet, wall).ToString());

  //refinement surfaces
  Dict2.Add("refinementSurfaces", new MeshRefinementObject(inlet, outlet, wall).ToString());

  //refinement regions
  Dict2.Add("refinementRegions", Dict3);
  Dict3.Add(" ", " ");


  return Dict1;
}

public  class MeshFeatureObject
{

  private  List<IndoorBC.Inlet> inlet { get; set; }
  private List<IndoorBC.Outlet> outlet { get; set; }
  private List<IndoorBC.Wall> wall { get; set; }


  public MeshFeatureObject(List<IndoorBC.Inlet> inlet, List<IndoorBC.Outlet> outlet, List<IndoorBC.Wall> wall)
  {
    this.inlet = inlet;
    this.outlet = outlet;
    this.wall = wall;

  }

  public override string ToString()
  {

    StringBuilder sb = new StringBuilder();
    sb.Append(@"{");

    foreach (IndoorBC i in inlet) { sb.AppendLine(@"file """ + i.Id + @".eMesh"";
        level " + i.refinementLevel + @";"); }
    foreach (IndoorBC i in outlet) { sb.AppendLine(@"file """ + i.Id + @".eMesh"";
        level " + i.refinementLevel + @";"); }
    foreach (IndoorBC i in wall) { sb.AppendLine(@"file """ + i.Id + @".eMesh"";
        level " + i.refinementLevel + @";"); }

    sb.Append(@"}");

    return GenericDict.InParenthesis(sb.ToString());
  }
}

        //Mesh Refinement Object
public  class MeshRefinementObject
{

  private List<IndoorBC.Inlet> inlet { get; set; }
  private List<IndoorBC.Outlet> outlet { get; set; }
  private List<IndoorBC.Wall> wall { get; set; }


  public MeshRefinementObject(List<IndoorBC.Inlet> inlet, List<IndoorBC.Outlet> outlet, List<IndoorBC.Wall> wall)
  {
    this.inlet = inlet;
    this.outlet = outlet;
    this.wall = wall;

  }

  public override string ToString()
  {

    StringBuilder sb = new StringBuilder();
    sb.Append(@"{");

    //DICTIONARY WAY
    //foreach (IndoorBC i in inlet) { CppMapSerializerDyn.Serialize(MakeDict_RefinementSurfaces(i)); }
    //foreach (IndoorBC i in outlet) { CppMapSerializerDyn.Serialize(MakeDict_RefinementSurfaces(i)); }
    //foreach (IndoorBC i in wall) { CppMapSerializerDyn.Serialize(MakeDict_RefinementSurfaces(i)); }

    //OTHER WAY - sting intead of Dict refinement surfaces
    foreach (IndoorBC i in inlet) { sb.AppendLine(GetRefinementSurfaces(i)); }
    foreach (IndoorBC i in outlet) { sb.AppendLine(GetRefinementSurfaces(i)); }
    foreach (IndoorBC i in wall) { sb.AppendLine(GetRefinementSurfaces(i)); }

    sb.Append(@"}");

    return GenericDict.InParenthesis(sb.ToString());
  }

  public static string GetRefinementSurfaces(IndoorBC bc)
  {
    return string.Format(@"{0}
      {{
      level           ({1} {1});
      patchInfo
      {{
      type            {2};
      }}
      }}", bc.Id, bc.refinementLevel.ToString(), bc.bcType.ToString());

  }
}
}


public class CppMapSerializerDyn2
{
  public static string Serialize(Dictionary<string, dynamic> dict)
  {
    StringBuilder sb = new StringBuilder();

    foreach (KeyValuePair<string, dynamic> evl in dict)
    {
      // 0. Dictionary<string, List<Dictionary<string, Dictionary<string, string>>>> dicts

      if (evl.Key is String && evl.Value is Dictionary<string, dynamic>)
      {
        sb.AppendLine(Serialize(evl.Value));
      }

      // 1. Dictionary<string, string> dict
      else if (evl.Key is String && (evl.Value is String || evl.Value is Int32))
      {
        DictToString(evl, ref sb);

      }
      // 2. Dictionary<string, Dictionary<string, string>> dicts
      //      else if (evl.Key is String && evl.Value is Dictionary<string, dynamic>)
      //      {
      //        sb.AppendLine(Serialize(evl.Value));
      //      }


    }

    return sb.ToString();
  }

  private static void DictToString(string name, Dictionary<string, dynamic> dict, ref StringBuilder sb)
  {
  sb.AppendLine("\t" + name);

  sb.AppendLine("\t" + "{");

  foreach (KeyValuePair<string, dynamic> evl in dict)
  {
  if (evl.Key is String && evl.Value is String)
  {

  sb.AppendLine("\t" + "\t" + evl.Key + "\t" + evl.Value + ";");
}
                else if (evl.Key is String && evl.Value is Int32)
                {
                    sb.AppendLine("\t" + "\t" + evl.Key + "\t" + evl.Value.ToString() + ";");
                }

//  else if (evl.Key is String && evl.Value is MeshFeatureObject)
//                {
//                    sb.AppendLine("\t" + "\t" + evl.Key);
//
//                    sb.AppendLine("\t" + "\t" + "{");
//// Problem line
//                    sb.AppendLine("\t" + "\t" + "\t" + Serialize(evl.Value.ToString()));
//
//  //                  sb.AppendLine("\t" + "\t" + "}");
// //               }


                else if (evl.Key is String && evl.Value is Dictionary<string, dynamic>)
                {
                    sb.AppendLine("\t" + "\t" + evl.Key);

                    sb.AppendLine("\t" + "\t" + "{");
// Problem line
                    sb.AppendLine("\t" + "\t" + "\t" + Serialize(evl.Value));

                    sb.AppendLine("\t" + "\t" + "}");
                }
            }

            sb.AppendLine("\t" + "}");
 }

private static void DictToString(KeyValuePair<string, dynamic> evl, ref StringBuilder sb)
        {
            if (evl.Key is String)
            {
                if (evl.Value is String)
                {
                    sb.AppendLine(evl.Key + "\t " + evl.Value + ";");
                }
                else
                {
                    sb.AppendLine(evl.Key + "\t " + evl.Value.ToString() + ";");
                }
            }
        }
}
# ---------- end c_script_8 ----------
panel_29 = Panel(c_script_8.out)  # disabled
panel_30 = Panel(c_script_8.A)  # disabled
c_script_9 = CSharpScript(x=idom, Reference="C:\Users\zorot\Documents\GitHub\Eddy3d\Eddy\bin\EddyLib.dll")  # -> out, A; disabled
# ---------- c_script_9: C# usings ----------
    using System.Linq;
using EddyLib;
using EddyLib.Indoor;
using  EddyLib.Indoor.Dicts;
using System.Text;
# ---------- c_script_9: C# ----------
    var dom = (EddyLib.Indoor.IndoorDomain) x;

    var res = new ControlDict(dom);

    A = res.InternalDict;
# ---------- c_script_9: C# additional code ----------
  public class ControlDict : EddyLib.Indoor.Dicts.GenericDict

  {
    public List<String> InternalDict = new List<string>();

    public ControlDict(IndoorDomain IndoorDom)
    {
      this.DictionaryName = "controlDict";

      this.Location = DictLocation.system;
      this.FC = FieldClass.dictionary;

      this.Header = GetHeader(this);

      this.InternalDict.Add(CppMapSerializerDyn2.Serialize(GetDict(IndoorDom)));

      string[] parts = {
        this.Header, "\n",
        String.Join("\n", this.InternalDict.ToArray())
        };

      this.FullDictString = parts.Aggregate((partialPhrase, word) => "{partialPhrase} {word}");







    }

    private static Dictionary < string, dynamic> GetDict(IndoorDomain IndoorDom)
    {
      Dictionary < string, dynamic> Dict = new Dictionary<string, dynamic>();

      Dictionary < string, dynamic> InternalDict = new Dictionary<string, dynamic>();

      Dictionary < string, dynamic> FunctionObjectlDict = new Dictionary<string, dynamic>();

      // Dict.Add("controlDict", InternalDict);

      InternalDict.Add("application", "extractFromSurface");
      InternalDict.Add("startFrom", "startTime");
      InternalDict.Add("startTime", "0");
      InternalDict.Add("stopAt", "endTime");
      InternalDict.Add("endTime", IndoorDom.endTime);

      InternalDict.Add("deltaT", 1);
      InternalDict.Add("writeControl", "timeStep");
      InternalDict.Add("writeInterval", 10);
      InternalDict.Add("purgeWrite", 10);
      InternalDict.Add("writeFormat", "binary");
      InternalDict.Add("writePrecision", 9);
      InternalDict.Add("writeCompression", "off");
      InternalDict.Add("timeFormat", "general");
      InternalDict.Add("timePrecision", 6);
      InternalDict.Add("runTimeModifiable", "true");

      /*
      InternalDict.Add("functions", FunctionObjectlDict);

      if (IndoorDom.FOs.OfType<VolumetricHeatSource>().Any())

      {
        FunctionObjectlDict.Add("#includeFunc", "volumetricHeatSources");
      }

  */

      return InternalDict;
    }
  }



  public class CppMapSerializerDyn2
  {
    public static string Serialize(Dictionary<string, dynamic> dict)
    {
      StringBuilder sb = new StringBuilder();

      foreach (KeyValuePair<string, dynamic> evl in dict)
      {
        // 4. Dictionary<string, List<Dictionary<string, Dictionary<string, string>>>> dicts

        if (evl.Key is String && evl.Value is List<Dictionary<string, dynamic>>)
        {
          sb.AppendLine(Serialize(evl.Value));
        }

        // 1. Dictionary<string, string> dict
        else if (evl.Key is String && evl.Value is String)
        {
          DictToString(evl, ref sb);
        }
          // 3. Dictionary<string, int> dicts
        else if (evl.Key is String && evl.Value is Int32)
        {
          DictToString(evl, ref sb);
        }


          // 2. Dictionary<string, Dictionary<string, string>> dicts
        else if (evl.Key is String && evl.Value is Dictionary<string, dynamic>)
        {
          DictToString(evl.Key, evl.Value, ref sb);
        }

      }

      return sb.ToString();
    }

    public static string Serialize(List<Dictionary<string, dynamic>> dicts)
    {
      StringBuilder sb = new StringBuilder();

      // 3. List<Dictionary<string, Dictionary<string, string>>> dicts
      foreach (var dict in dicts)
      {
        foreach (KeyValuePair<string, dynamic> evl in dict)
        {
          // 1. Dictionary<string, string> dict
          if (evl.Key is String && evl.Value is String)
          {
            DictToString(evl, ref sb);
          }
            // 2. Dictionary<string, Dictionary<string, string>> dicts
          else if (evl.Key is String && evl.Value is Dictionary<string, dynamic>)
          {
            DictToString(evl.Value, ref sb);
          }
        }
      }

      return sb.ToString();
    }

    private static void DictToString(List<Dictionary<string, dynamic>> dicts, ref StringBuilder sb)
    {
    foreach (var dict in dicts)
    {
    foreach (KeyValuePair<string, dynamic> evl in dict)
    {
    sb.AppendLine();
    sb.AppendLine(evl.Key);
    sb.AppendLine("{");

    //  foreach (var dict in dict[evl.Key]) {
    if (evl.Key is String && evl.Value is String)
    {
    DictToString(evl.Key, evl.Value, ref sb);
  }
  // }
  sb.AppendLine("}");
}
            }
        }

        private static void DictToString(string name, Dictionary<string, dynamic> dict, ref StringBuilder sb)
        {
            sb.AppendLine("\t" + name);

            sb.AppendLine("\t" + "{");

            foreach (KeyValuePair<string, dynamic> evl in dict)
            {
                if (evl.Key is String && evl.Value is String)
                {
                    sb.AppendLine("\t" + "\t" + evl.Key + "\t" + evl.Value + ";");
                }
                else if (evl.Key is String && evl.Value is Int32)
                {
                    sb.AppendLine("\t" + "\t" + evl.Key + "\t" + evl.Value.ToString() + ";");
                }
                else
                {
                    sb.AppendLine("\t" + "\t" + evl.Key);

                    sb.AppendLine("\t" + "\t" + "{");

                    sb.AppendLine("\t" + "\t" + "\t" + Serialize(evl.Value));

                    sb.AppendLine("\t" + "\t" + "}");
                }
            }

            sb.AppendLine("\t" + "}");
        }

        private static void DictToString(KeyValuePair<string, dynamic> evl, ref StringBuilder sb)
        {
            if (evl.Key is String)
            {

                if (evl.Value is String)
                {

                    sb.AppendLine(evl.Key + "\t " + evl.Value + ";");
                }
                else
                {

                    sb.AppendLine(evl.Key + "\t " + evl.Value.ToString() + ";");
                }
            }
        }
    }
# ---------- end c_script_9 ----------
panel_31 = Panel(c_script_9.A)  # disabled
cluster = Cluster(B=brep, relay=number_slider)  # disabled
c_script_10 = CSharpScript(i=il_3, o=ol_2, w=geo_2, Reference="C:\Users\zorot\Documents\GitHub\Eddy3d\Eddy\bin\EddyLib.dll")  # -> out, A; disabled
# ---------- c_script_10: C# ----------
    //var dom = (EddyLib.Indoor.IndoorDomain) x;

    double refLevel = 3;

    Point3d pt = new Point3d(1, 1, 1);

    Point3d pt0 = new Point3d(0, 0, 0);
    Point3d pt1 = new Point3d(10, 10, 10);
    BoundingBox boundingB = new BoundingBox(pt0, pt1);

    EddyLib.Indoor.IndoorBC.Inlet inl = (EddyLib.Indoor.IndoorBC.Inlet) i;
    EddyLib.Indoor.IndoorBC.Outlet outl = (EddyLib.Indoor.IndoorBC.Outlet) o;
    EddyLib.Indoor.IndoorBC.Wall wall = (EddyLib.Indoor.IndoorBC.Wall) w;

    inl.Id = "Inlet_1";
    outl.Id = "Outlet_1";
    wall.Id = "Wall_1";

    List < EddyLib.Indoor.IndoorBC.Inlet > inlList = new List < EddyLib.Indoor.IndoorBC.Inlet > ();
    inlList.Add(inl);


    List < EddyLib.Indoor.IndoorBC.Outlet > outlList = new  List < EddyLib.Indoor.IndoorBC.Outlet > (){outl};


    List < EddyLib.Indoor.IndoorBC.Wall > wallList = new List < EddyLib.Indoor.IndoorBC.Wall >(){wall};

    var res = new SnappyHexMeshDict(refLevel, pt, boundingB, inlList, outlList, wallList);

    A = res.FullDictString.ToString();
# ---------- c_script_10: C# additional code ----------
  public  class SnappyHexMeshDict : EddyLib.Indoor.Dicts.GenericDict
  {
    private Point3d locationInMesh;


    //public List<String> InternalDict = new List<string>();


    //public Dictionary<string, dynamic> GeometryDict { get; set; }

  public Dictionary<string, dynamic> GeometrySubDict { get; set; }


  public SnappyHexMeshDict(double refineMentLevel, Point3d pointInsideDomain, BoundingBox BBox, List<EddyLib.Indoor.IndoorBC.Inlet> inlet, List<EddyLib.Indoor.IndoorBC.Outlet> outlet, List<EddyLib.Indoor.IndoorBC.Wall> wall)
  {
    this.DictionaryName = "snappyHexMeshDict";
    this.Location = DictLocation.system;
    this.FC = FieldClass.dictionary;
    this.Header = GetHeader(this);
    this.locationInMesh = pointInsideDomain;

    this.GeometrySubDict = new Dictionary<string, dynamic>();

    foreach (IndoorBC i in inlet) { this.GeometrySubDict.Add(i.Id.ToString(), GetGeometryDict(i)); };
    foreach (IndoorBC i in outlet) { this.GeometrySubDict.Add(i.Id.ToString(), GetGeometryDict(i)); };
    foreach (IndoorBC i in wall) { this.GeometrySubDict.Add(i.Id.ToString(), GetGeometryDict(i)); };

    //this.GeometryDict = new Dictionary<string, dynamic>();
    //GeometryDict.Add("geometry", GeometrySubDict);


    //  this.InternalDict.Add(CppMapSerializerDyn2.Serialize(GetSettingsDict()));
    //  this.InternalDict.Add(CppMapSerializerDyn2.Serialize(this.GeometryDict));
    //  this.InternalDict.Add(CppMapSerializerDyn2.Serialize(GetSnapControlsDict()));
    //  this.InternalDict.Add(CppMapSerializerDyn2.Serialize(GetCastellatedMeshControls(this.locationInMesh, wall, inlet, outlet)));
    //  this.InternalDict.Add(CppMapSerializerDyn2.Serialize(GetAddLayersControls()));
    //  this.InternalDict.Add(CppMapSerializerDyn2.Serialize(GetMeshQualityControls()));


    //  string[] parts = { this.Header, "\n",
    //    String.Join("\n", this.InternalDict.ToArray())
    //    };


    string[] parts = { this.Header, "\n",
      CppMapSerializerDyn2.Serialize(GetSettingsDict()),"\n",
      CppMapSerializerDyn2.Serialize(this.GeometrySubDict),"\n",
      //        CppMapSerializerDyn2.Serialize(GetSnapControlsDict()),"\n",
      //        CppMapSerializerDyn2.Serialize(GetCastellatedMeshControls(this.locationInMesh, wall, inlet, outlet)),"\n",
      //        CppMapSerializerDyn2.Serialize(GetAddLayersControls()),"\n",
      //        CppMapSerializerDyn2.Serialize(GetMeshQualityControls()),"\n"
      };

    this.FullDictString = parts.Aggregate((partialPhrase, word) => "{partialPhrase} {word}");
  }


  public static Dictionary<string,dynamic> GetGeometryDict(IndoorBC input)
  {

    Dictionary < string, dynamic> Dict = new Dictionary<string, dynamic>();

    Dictionary < string, dynamic> InternalDict = new Dictionary<string, dynamic>();

    Dict.Add(input.Id + ".stl", InternalDict);

    InternalDict.Add("type", input.OFGeometryType);
    InternalDict.Add("name", input.Id);

    return Dict;
  }

  public static Dictionary<string, dynamic> GetSettingsDict()
  {
    Dictionary < string, dynamic> InternalDict = new Dictionary<string, dynamic>();

    InternalDict.Add("castellatedMesh", "true");
    InternalDict.Add("snap", "true");
    InternalDict.Add("addLayers", "false");
    InternalDict.Add("singleRegionName", " true");
    InternalDict.Add("mergePatchFaces", "true");
    InternalDict.Add("keepPatches", "false");
    InternalDict.Add("mergeTolerance", "1e-8");
    InternalDict.Add("debug", "0");

    return InternalDict;
  }

}


public class CppMapSerializerDyn2
{
  public static string Serialize(Dictionary<string, dynamic> dict)
  {
    StringBuilder sb = new StringBuilder();

    foreach (KeyValuePair<string, dynamic> evl in dict)
    {
      // 0. Dictionary<string, List<Dictionary<string, Dictionary<string, string>>>> dicts

      if (evl.Key is String && evl.Value is Dictionary<string, dynamic>)
      {
        sb.AppendLine(Serialize(evl.Value));
      }

      // 1. Dictionary<string, string> dict
      else if (evl.Key is String && (evl.Value is String || evl.Value is Int32))
      {
        DictToString(evl, ref sb);

      }
      // 2. Dictionary<string, Dictionary<string, string>> dicts
      //      else if (evl.Key is String && evl.Value is Dictionary<string, dynamic>)
      //      {
      //        sb.AppendLine(Serialize(evl.Value));
      //      }


    }

    return sb.ToString();
  }

  private static void DictToString(string name, Dictionary<string, dynamic> dict, ref StringBuilder sb)
  {
  sb.AppendLine("\t" + name);

  sb.AppendLine("\t" + "{");

  foreach (KeyValuePair<string, dynamic> evl in dict)
  {
  if (evl.Key is String && evl.Value is String)
  {

  sb.AppendLine("\t" + "\t" + evl.Key + "\t" + evl.Value + ";");
}
                else if (evl.Key is String && evl.Value is Int32)
                {
                    sb.AppendLine("\t" + "\t" + evl.Key + "\t" + evl.Value.ToString() + ";");
                }


                else if (evl.Key is String && evl.Value is Dictionary<string, dynamic>)
                {
                    sb.AppendLine("\t" + "\t" + evl.Key);

                    sb.AppendLine("\t" + "\t" + "{");
// Problem line
                    sb.AppendLine("\t" + "\t" + "\t" + Serialize(evl.Value));

                    sb.AppendLine("\t" + "\t" + "}");
                }
            }

            sb.AppendLine("\t" + "}");
 }

private static void DictToString(KeyValuePair<string, dynamic> evl, ref StringBuilder sb)
        {
            if (evl.Key is String)
            {
                if (evl.Value is String)
                {
                    sb.AppendLine(evl.Key + "\t " + evl.Value + ";");
                }
                else
                {
                    sb.AppendLine(evl.Key + "\t " + evl.Value.ToString() + ";");
                }
            }
        }
}
# ---------- end c_script_10 ----------
c_script_11 = CSharpScript(Overwrite="featureAngle    250;")  # -> Out, A
panel_32 = Panel(c_script_10.A)  # disabled
panel_33 = Panel(c_script_10.out)  # disabled

cluster_2 = Cluster(B=brep, relay=number_slider)
c_script_12 = CSharpScript(Dom=idom, Reference="C:\Users\zorot\Documents\GitHub\Eddy3d\Eddy\bin\EddyLib.dll")  # -> Res
# ---------- c_script_12: C# usings ----------
using EddyLib;
using EddyLib.BCs;
using System.Linq;
# ---------- c_script_12: C# ----------
    var point0 = new Rhino.Geometry.Point3d(0, 0, 0);
    var point1 = new Rhino.Geometry.Point3d(20, 0, 0);
    var point2 = new Rhino.Geometry.Point3d(0, 20, 0);
    var point3 = new Rhino.Geometry.Point3d(20, 20, 0);
    var point4 = new Rhino.Geometry.Point3d(0, 0, 40);
    var point5 = new Rhino.Geometry.Point3d(20, 0, 40);
    var point6 = new Rhino.Geometry.Point3d(0, 20, 40);
    var point7 = new Rhino.Geometry.Point3d(20, 20, 40);
    Rhino.Geometry.Box box1 = new Rhino.Geometry.Box(Rhino.Geometry.Plane.WorldXY, new List<Rhino.Geometry.Point3d>() { point0, point1, point2, point3, point4, point5, point6, point7 });
    Rhino.Geometry.MeshingParameters mp = new Rhino.Geometry.MeshingParameters();
    var m = Mesh.CreateFromBrep(box1.ToBrep(), mp);

    Rhino.Geometry.Mesh mm = new Rhino.Geometry.Mesh();

    foreach (Rhino.Geometry.Mesh im in m)
    {
      mm.Append(im);
    }



    var windDirList = new List<int>() { 0 };
    BoundaryCondition bcond = new ABL(windDirList, 5, 10, 1, 0, "");

    OFCylDomain DOMCYL = new OFCylDomain(mm, new Mesh(), bcond, 5, 50, 300, 80);




    var DOM = (EddyLib.Indoor.IndoorDomain) Dom;

    var RUNSETTINGS = new OFRunSettings(1000, 20, 5, fvSchemes.Optimized, 1, SimEngine.BlueCFD, OSType.Windows10, TurbModel.RNGkEpsilon, RelaxationFactors.Optimized, false, false);
    var MESHSETTINGS = new OFMeshSettings();


    var baseWorkingDirectory = DOM.WorkingDir;


    MESHSETTINGS.meshStlDir = baseWorkingDirectory + @"\\constant\triSurface\";
    MESHSETTINGS.meshPolyMeshDir = baseWorkingDirectory + @"\\constant\polyMesh\";
    MESHSETTINGS.meshSystemDir = baseWorkingDirectory + @"\\system\";
    MESHSETTINGS.meshConstantDir = baseWorkingDirectory + @"\\constant\";
    MESHSETTINGS.meshWorkingDir = baseWorkingDirectory + @"\\";


    // MESHSETTINGS.meshStlFilenameBuildings = baseWorkingDirectory + @"\\constant\triSurface\building.stl";
    //MESHSETTINGS.meshStlFilenameGround = baseWorkingDirectory + @"\\constant\triSurface\ground.stl";
    // MESHSETTINGS.meshStlFilenameGroundPerim = baseWorkingDirectory + @"\\constant\triSurface\ground_perim.stl";
    // MESHSETTINGS.meshBoundaryConditionsDirectory = baseWorkingDirectory + @"\\0.org\";


    var RES = new EddyLib.OFResult(DOMCYL, RUNSETTINGS, MESHSETTINGS, DOM.WorkingDir.Replace("0\\", ""));

    Res = RES;
# ---------- end c_script_12 ----------
button = Button()
probing = Probing(Result=c_script_12, ProbingPoints=cluster_2, NameOfInstance="test", NameOfField=0, Run=button)  # -> PorbingPoints, ProbingResult
wprobes = WProbes(Result=c_script_12, NameOfInstance="test", Run=button)
paraview = OpenParaview(ParaviewVersion=2)
c_script_13 = CSharpScript()  # -> out, A
# ---------- c_script_13: C# ----------
    var p = new Person("Tom");
    A = p;
# ---------- c_script_13: C# additional code ----------
  class Person{


    public string Name = "";
    public Person(string Name){

      this.Name = Name;
    }



  }
# ---------- end c_script_13 ----------
vlen = VectorLength(Vector=probing.ProbingResult)
vdisex_7 = VectorDisplayEx(Point=probing.PorbingPoints, Vector=probing.ProbingResult, Colour=RGB(0, 0, 0), Width=2)
panel_34 = Panel(c_script_13.A)
panel_35 = Panel(vlen)

# ==== cluster Cluster
relay = ClusterInput()
custom_mesh_settings = SettingsCustom(
    StitchSeams=True,
    SimplePlanes=False,
    Refine=True,
    MinCount=16,
    MaxCount=400,
    AspectRatio=20,
    MaxDistance=0,
    MaxAngle=20,
    MinEdge=relay,
    MaxEdge=relay)
B = ClusterInput()
mesh = MeshBrep(Brep=B, Settings=custom_mesh_settings)
demesh = DeconstructMesh(Mesh=mesh)  # -> Vertices, Faces, Colours, Normals
V = ClusterOutput(demesh.Vertices)
