# Grasshopper definition AnalysisSystem.gh (Grasshopper 1.0.7)
# plug-ins: Eddy3D

number_slider = Slider(4, range=0..10)
number_slider_2 = Slider(6, range=0..10)
c_script = CSharpScript()  # -> out, A, B, C; inputs x: list of Double
# ---------- c_script: C# usings ----------
using System.Linq;
# ---------- c_script: C# ----------
    var date1 = new DateTime(2021, 6, 1, 3, 0, 0);
    var date2 = new DateTime(2021, 6, 3, 9, 0, 0);

    var date3 = new DateTime(2021, 9, 1, 11, 0, 0);
    var date4 = new DateTime(2021, 10, 3, 9, 0, 0);

    var diff1 = new TimeDiff(date2, date1);
    var diff2 = new TimeDiff(date4, date3);

    var TimeSpanList = new List<TimeDiff>(){diff1, diff2};

    var a = new AnalysisSystem(TimeSpanList);

    A = diff1.HOY;

    var hours = a.AnalysisHourBins;

    Grasshopper.DataTree<int> AS_Tree = new DataTree<int>();

    for (int i = 0; i < hours.GetLength(0); i++)
    {

      for (int j = 0; j < hours[i].GetLength(0); j++)
      {
        AS_Tree.Add(hours[i][j], new GH_Path(i));

      }
    }


    C = AS_Tree;
# ---------- c_script: C# additional code ----------
  public class TimeDiff{

    public TimeSpan TS {get;set;}
    public double HOY{get;set;}
    public DateTime BeginYear = new DateTime(2021, 1, 1, 1, 1, 1);

    public  TimeDiff(DateTime dt2, DateTime dt1){

      if (dt2 < dt1){
        var ts = dt1 - BeginYear;
        this.HOY = ts.TotalHours;
        this.TS = (dt1 - BeginYear) - (dt2 - BeginYear);

      }
      else{
        var ts = dt2 - BeginYear;
        this.HOY = ts.TotalHours;
        this.TS = (dt2 - BeginYear) - (dt1 - BeginYear);

      }




    }
  }

  public class AnalysisSystem{


    public int[][] AnalysisHourBins {get;set;}


    public  AnalysisSystem(List<TimeDiff> TimeSpans)
    {
      this.AnalysisHourBins = new int[TimeSpans.Count][];

      for (int i = 0; i < TimeSpans.Count;i++){

        var hoursInBin = (int) TimeSpans[i].TS.TotalHours;

        AnalysisHourBins[i] = new int[hoursInBin];


        for (int j = 0; j < hoursInBin ;j++){

          AnalysisHourBins[i][j] = (int) TimeSpans[i].HOY + j;


        }

      }

    }
  }
# ---------- end c_script ----------
date = ConstructDate(Year=2021, Month=number_slider, Day=19, Hour=12, Minute=0, Second=0)
date_2 = ConstructDate(Year=2021, Month=number_slider, Day=number_slider_2, Hour=12, Minute=0, Second=0)
panel = Panel(c_script.A)
abseason = AnalysisBinsSeason(Season=0)
abdaytime = AnalysisBinsDayTime(ABSeason=abseason, DayTime=0)
ab = AnalysisBins(From=date_2, To=date)
abseason_2 = AnalysisBinsSeason(Season=2)
abseason_3 = AnalysisBinsSeason(Season=0)
hoy = HOY(M=number_slider, D=number_slider_2, H=number_slider_2)
panel_2 = Panel(c_script.C)
as = AnalysisSystem(AnalysisBins=abdaytime)
as_2 = AnalysisSystem(AnalysisBins=[abseason_3, abdaytime, abseason_2, ab])
c_script_2 = CSharpScript()  # -> out, A, B
# ---------- c_script_2: C# ----------
    DateTime dt1 = new DateTime(2021, 12, 1);
    DateTime dt2 = new DateTime(2022, 3, 1);

    TimeSpan a = dt1 - dt2;
    TimeSpan b = dt2 - dt1;

    A = a.TotalHours;
    B = b.TotalHours;
# ---------- end c_script_2 ----------
panel_3 = Panel(as_2)
panel_4 = Panel(as)
panel_5 = Panel(c_script_2.B)
panel_6 = Panel(c_script_2.A)
