# Grasshopper definition 7_Restaurant_ValidationCase_BETA.ghx (Grasshopper 1.0.7)
# plug-ins: Eddy3D, HAL for Grasshopper

# EDDY COVID-19:
# 
# Restaurant Validation Experiment:
# 
# Reference:
# https://www.medrxiv.org/content/10.1101/2020.04.16.20067728v1.full.pdf
# https://www.ncbi.nlm.nih.gov/pmc/articles/PMC7323555/
# 
# Ventilation Rates used:
# - high ventilation
# flow rate = 212  ft^2/min  (1.08m/s)
# - low ventilation
# flow rate = 15  ft^2/min (0.08m/s)
# 
# Emitter:
#  -located at  (1 m, 0.5 m,
# 1.6 m)
# - injection direction of (0, 1, 0)
# - average emission flow 0.21m/s
# - size tracer gas pipe= 8-mm inner diameter
# - speed =1.5 m/s
# 
# -temperature =32–34 °C
# 
# -Five coil AC unit: from Daiking website:
# https://www.daikinkuwait.com/content/dam/document-library/
# catalogues/as/fan-coil-units/fwd-at/FWV_FWL_FWM_FWD_
# FWB_EPCE04-25B_Catalogues_English.pdf
# 
# Measured Air flow:
# non-ABC zone = 1.04 L/s per patron
# ABC zone =  0.75 L/s per patron
sessionsettings = SessionSettings()

# ----
# Probe Points
# Point locations to measure concentration
# Values from the Restaurant Paper
normalized_measured_concentration = Panel("""1
0.87
0.98
0
0
0
0
0
0
0.55
0
0
0
0
0.58
0.7
0.86
0.73""")
normalized_predicted_concentration = Panel("""1
1.04
0.93
1
0.62
0.47
0.42
0.42
0.32
0.52
0.57
0.5
0.55
0.63
0.54
0.56
0.5
0.85""")
_09 = Point(<point referenced from the Rhino model>)
_13 = Point(<point referenced from the Rhino model>)
_18 = Point(<point referenced from the Rhino model>)
_04 = Point(<point referenced from the Rhino model>)
_05 = Point(<point referenced from the Rhino model>)
_06 = Point(<point referenced from the Rhino model>)
_07 = Point(<point referenced from the Rhino model>)
_08 = Point(<point referenced from the Rhino model>)
_10 = Point(<point referenced from the Rhino model>)
_11 = Point(<point referenced from the Rhino model>)
_12 = Point(<point referenced from the Rhino model>)
_14 = Point(<point referenced from the Rhino model>)
_17 = Point(<point referenced from the Rhino model>)
pta = Point(<point referenced from the Rhino model>)
ptb = Point(<point referenced from the Rhino model>)
ptc = Point(<point referenced from the Rhino model>)
_15 = Point(<point referenced from the Rhino model>)
_16 = Point(<point referenced from the Rhino model>)
pt = Point([pta, ptb, ptc, _04, _05, _06, _07, _08, _09, _10, _11, _12, _13, _14, _15, _16, _17, _18])

# ----
# Volumetric Heat Sources(Plates)
volume = Brep([<brep referenced from the Rhino model> x91])

# ----
# Volumetric Heat Sources(People)
volume_2 = Brep([<brep referenced from the Rhino model> x1334])

# ----
# Momentum Sink (Furniture)
volume_3 = Brep([<brep referenced from the Rhino model> x18])

# ----
# Viral Emitter
infected_emitter_mesh = Brep(<brep referenced from the Rhino model>)
facen = FaceNormals(Mesh=infected_emitter_mesh)  # -> Centers, Normals
tracer_gas_emission_speed = Panel("-1.5")
multiplication = Multiplication(A=facen.Normals, B=tracer_gas_emission_speed)
vdisex = VectorDisplayEx(Vector=multiplication, Colour=RGB(255, 0, 0), Width=2)

# ----
# Validation Case
# Volume
volume_4 = Brep([<brep referenced from the Rhino model> x32])
join = BrepJoin(Breps=volume_4)  # -> Breps, Closed

ventilation_inlet_fire_stair_door = Brep(<brep referenced from the Rhino model>)
ventilation_inlet_bathroom = Panel("-1.08")
ventilation_inlet_fire_stair_door_2 = Panel("-1.08")
facen_2 = FaceNormals(Mesh=ventilation_inlet_fire_stair_door)  # -> flatten(Centers), Normals
multiplication_2 = Multiplication(A=facen_2.Normals, B=ventilation_inlet_fire_stair_door_2)  # -> flatten(Result)
vdisex_2 = VectorDisplayEx(Point=facen_2.Centers, Vector=multiplication_2, Colour=RGB(255, 0, 0), Width=2)

# ----
# Inlets
ventilation_inlet_bathroom_2 = Brep(<brep referenced from the Rhino model>)
ventilation_inlet_fire_stair_door_3 = Panel("-1.08")
facen_3 = FaceNormals(Mesh=ventilation_inlet_bathroom_2)  # -> flatten(Centers), Normals
multiplication_3 = Multiplication(A=facen_3.Normals, B=ventilation_inlet_fire_stair_door_3)  # -> flatten(Result)
vdisex_3 = VectorDisplayEx(Point=facen_3.Centers, Vector=multiplication_3, Colour=RGB(255, 0, 0), Width=2)

# ----
# Outlets
ventilation_outlet = Brep(<brep referenced from the Rhino model>)
facen_4 = FaceNormals(Mesh=ventilation_outlet)  # -> Centers, Normals
vdisex_4 = VectorDisplayEx(Point=facen_4.Centers, Vector=facen_4.Normals, Colour=RGB(255, 0, 0), Width=2)

panel = Panel("230")
panel_2 = Panel("320")
panel_3 = Panel("400")
m_3_h = Panel("170")

# ----
# Temperature
temp = Slider(33, range=27..35)
mesh_join = MeshJoin(Meshes=volume)

# ----
# Plane to Simulate Age of Air and CO2 concentration
age_of_air_simulation_plane_mouth_height = Brep(<brep referenced from the Rhino model>)

mesh_join_2 = MeshJoin(Meshes=infected_emitter_mesh)
panel_4 = Panel(volume_2)
mesh_join_3 = MeshJoin(Meshes=volume_2)
mesh_join_4 = MeshJoin(Meshes=volume_3)
join_2 = BrepJoin(Breps=infected_emitter_mesh)  # -> Breps, Closed
panel_5 = Panel(join_2.Breps)
panel_6 = Panel(mesh_join_3)

il = Inlet(Geo=ventilation_inlet_bathroom_2, Vel=multiplication_3, Temp=temp)  # -> flatten(Inlet)
il_2 = Inlet(Geo=ventilation_inlet_fire_stair_door, Vel=multiplication_3, Temp=temp)  # -> flatten(Inlet)

mesh = Mesh(mesh_join_2)
ol = Outlet(Geo=ventilation_outlet, Vel=Vector(0, 0, 0))
geo = Geometry(Geo=join.Breps, Temp=temp)
pt_2 = Point(Point(3.152091326, -9.490595055, 0.4314200966))
mesh_2 = Mesh(mesh_join_3)
vhs = VolumetricHeatSource(Geo=mesh_2, Power=Slider(30, range=0..100), Name="volumetricHeatSource")
viralem = ViralEmitter(Geo=mesh, Name="ViralEmitter", InjectionRate="2", Type=0)
msink = MomentumSink(Geo=mesh_join_4, Name="momentumSink")
panel_7 = Panel(vhs)
panel_8 = Panel(viralem)
panel_9 = Panel(msink)

# ---- group: For any new case, please make sure to put it in a "0" subfolder.
panel_10 = Panel("C:\CovidRestaurant22\0\")

# ----
toggle = BooleanToggle(False)
brep = Brep(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)
cluster = Cluster(B=brep, relay=Slider(0.5, range=0..1))

# ----
# Fan (Momentum Source) In
convert_1_h_1_s = Panel("3600")
# Fan (Momentum Source) Out
ac_outlet = Brep([<brep referenced from the Rhino model> x5])
panel_11 = Panel("""{0,1,0}
{-1,0,0}
{-1,0,0}
{-1,0,0}
{-1,0,0}""")

area = Area(Geometry=ac_outlet)  # -> Area, Centroid

division = Division(A="900", B=area.Area)
division_2 = Division(A=division, B=convert_1_h_1_s)
multiplication_4 = Multiplication(A=area.Area, B=division_2)
multiplication_5 = Multiplication(A=panel_11, B=multiplication_4)
vdisex_5 = VectorDisplayEx(Vector=multiplication_5, Colour=RGB(255, 0, 0), Width=2)

ac_inlet = Brep([<brep referenced from the Rhino model> x5])
facen_5 = FaceNormals(Mesh=ac_inlet)  # -> Centers, Normals
multiplication_6 = Multiplication(A=multiplication_4, B=-1)
multiplication_7 = Multiplication(A=facen_5.Normals, B=multiplication_6)
vdisex_6 = VectorDisplayEx(Vector=multiplication_7, Colour=RGB(255, 0, 0), Width=2)

panel_12 = Panel(division)
mesh_join_5 = MeshJoin(Meshes=ac_outlet)
mesh_join_6 = MeshJoin(Meshes=ac_inlet)
vector = Vector(multiplication_7)
panel_13 = Panel(vector)
mesh_3 = Mesh(mesh_join_5)
mesh_4 = Mesh(mesh_join_6)
ms = MomentumSource(Geo=[mesh_3, mesh_4], Ubar="{0,0,0.25}", Name="momentumSource")
panel_14 = Panel(ms)
indoordomain = IndoorDomain(
    Geo=geo,
    Inlet=[il, il_2],
    Outlet=ol,
    FunctionObjects=[viralem, ms, vhs, msink],
    Directory=panel_10,
    PointInside=<missing>,
    CellSize=<missing>,
    Iterations=<missing>,
    Run=<missing>)
idom = IndoorDomain(
    Geo=geo,
    Inlet=[il, il_2],
    Outlet=ol,
    FunctionObjects=[viralem, ms, msink, vhs],
    Directory=panel_10,
    PointInside=pt_2,
    CellSize=Slider(0.3, range=0..1),
    Iterations=Slider(300, range=0..10000),
    RunMeshing=Toggle(False),
    MakeFOS=Toggle(False),
    RunSimulation=Toggle(False))
c_script = CSharpScript(Dom=idom, Reference="C:\Eddy3D\EddyLib.dll")  # -> Res
# ---------- c_script: C# usings ----------
using EddyLib;
using EddyLib.BCs;
using System.Linq;
# ---------- c_script: C# ----------
    var point0 = new Rhino.Geometry.Point3d(0, 0, 0);
    var point1 = new Rhino.Geometry.Point3d(20, 0, 0);
    var point2 = new Rhino.Geometry.Point3d(0, 20, 0);
    var point3 = new Rhino.Geometry.Point3d(20, 20, 0);
    var point4 = new Rhino.Geometry.Point3d(0, 0, 40);
    var point5 = new Rhino.Geometry.Point3d(20, 0, 40);
    var point6 = new Rhino.Geometry.Point3d(0, 20, 40);
    var point7 = new Rhino.Geometry.Point3d(20, 20, 40);
    Rhino.Geometry.Box box1 = new Rhino.Geometry.Box(Rhino.Geometry.Plane.WorldXY, new List<Rhino.Geometry.Point3d>() { point0, point1, point2, point3, point4, point5, point6, point7 });
    Rhino.Geometry.MeshingParameters mp = new Rhino.Geometry.MeshingParameters();
    var m = Mesh.CreateFromBrep(box1.ToBrep(), mp);

    Rhino.Geometry.Mesh mm = new Rhino.Geometry.Mesh();

    foreach (Rhino.Geometry.Mesh im in m)
    {
      mm.Append(im);
    }



    var windDirList = new List<int>() { 0 };
    BoundaryCondition bcond = new ABL(windDirList, 5, 10, 1, 0, "");

    OFCylDomain DOMCYL = new OFCylDomain(mm, new Mesh(), bcond, 5, 50, 300, 80);




    var DOM = (EddyLib.Indoor.IndoorDomain) Dom;

    var RUNSETTINGS = new OFRunSettings(1000, 20, 5, fvSchemes.Optimized, 1, SimEngine.BlueCFD, OSType.Windows10, TurbModel.RNGkEpsilon, RelaxationFactors.Optimized, false, false);
    var MESHSETTINGS = new OFMeshSettings();


    var baseWorkingDirectory = DOM.WorkingDir;


    MESHSETTINGS.meshStlDir = baseWorkingDirectory + @"\\constant\triSurface\";
    MESHSETTINGS.meshPolyMeshDir = baseWorkingDirectory + @"\\constant\polyMesh\";
    MESHSETTINGS.meshSystemDir = baseWorkingDirectory + @"\\system\";
    MESHSETTINGS.meshConstantDir = baseWorkingDirectory + @"\\constant\";
    MESHSETTINGS.meshWorkingDir = baseWorkingDirectory + @"\\";


    // MESHSETTINGS.meshStlFilenameBuildings = baseWorkingDirectory + @"\\constant\triSurface\building.stl";
    //MESHSETTINGS.meshStlFilenameGround = baseWorkingDirectory + @"\\constant\triSurface\ground.stl";
    // MESHSETTINGS.meshStlFilenameGroundPerim = baseWorkingDirectory + @"\\constant\triSurface\ground_perim.stl";
    // MESHSETTINGS.meshBoundaryConditionsDirectory = baseWorkingDirectory + @"\\0.org\";


    var RES = new EddyLib.OFResult(DOMCYL, RUNSETTINGS, MESHSETTINGS, DOM.WorkingDir.Replace("0\\", ""));

    Res = RES;
# ---------- end c_script ----------
probing = Probing(Result=c_script, ProbingPoints=cluster, NameOfInstance="test", NameOfField=0, Run=Button())  # -> PorbingPoints, ProbingResult
vlen = VectorLength(Vector=probing.ProbingResult)
vdisex_7 = VectorDisplayEx(Point=probing.PorbingPoints, Vector=probing.ProbingResult, Colour=RGB(0, 0, 0), Width=2)
panel_15 = Panel(vlen)

# ==== cluster Cluster
relay = ClusterInput()
custom_mesh_settings = SettingsCustom(
    StitchSeams=True,
    SimplePlanes=False,
    Refine=True,
    MinCount=16,
    MaxCount=400,
    AspectRatio=20,
    MaxDistance=0,
    MaxAngle=20,
    MinEdge=relay,
    MaxEdge=relay)
B = ClusterInput()
mesh = MeshBrep(Brep=B, Settings=custom_mesh_settings)
demesh = DeconstructMesh(Mesh=mesh)  # -> Vertices, Faces, Colours, Normals
V = ClusterOutput(demesh.Vertices)
