# Grasshopper definition 8_Restaurant_ValidationCase_BETA.ghx (Grasshopper 1.0.7)
# plug-ins: HAL for Grasshopper, Eddy3D

# Eddy3D Indoor COVID-19 Example
sessionsettings = SessionSettings()
# Step 1: Imput Geometry
# Temperature
temp = Slider(33, range=27..35)
ac_outlet = Brep([<brep referenced from the Rhino model> x5])
# Momentum Source
# (Fan- In)
ac_inlet = Brep([<brep referenced from the Rhino model> x5])
# Momentum Sink (Furniture)
volume = Brep([<brep referenced from the Rhino model> x18])
# Viral Emitter
# Momentum Source
# (Fan-Out)
infected_emitter_mesh = Brep(<brep referenced from the Rhino model>)
# Volumetric Heat Sources(People)
volume_2 = Brep([<brep referenced from the Rhino model> x1334])
# Volume
volume_3 = Brep([<brep referenced from the Rhino model> x32])
# Point Inside Volume
pt = Point(Point(3.152091326, -9.490595055, 0.4314200966))
# Inlets
ventilation_inlet_bathroom = Brep(<brep referenced from the Rhino model>)
# Outlets
ventilation_outlet = Brep(<brep referenced from the Rhino model>)
# Inlets
ventilation_inlet_fire_stair_door = Brep(<brep referenced from the Rhino model>)

mesh_join = MeshJoin(Meshes=volume_2)
mesh = Mesh(mesh_join)
vhs = VolumetricHeatSource(Geo=mesh, Power=Slider(30, range=0..100), Name="volumetricHeatSource")

mesh_join_2 = MeshJoin(Meshes=volume)
msink = MomentumSink(Geo=mesh_join_2, Name="momentumSink")

mesh_join_3 = MeshJoin(Meshes=ac_outlet)
mesh_join_4 = MeshJoin(Meshes=ac_inlet)
mesh_2 = Mesh(mesh_join_4)
mesh_3 = Mesh(mesh_join_3)
ms = MomentumSource(Geo=[mesh_3, mesh_2], Ubar="{0,0,0.25}", Name="momentumSource")

mesh_join_5 = MeshJoin(Meshes=infected_emitter_mesh)
mesh_4 = Mesh(mesh_join_5)
viralem = ViralEmitter(Geo=mesh_4, Name="ViralEmitter", InjectionRate="2", Type=0)

ol = Outlet(Geo=ventilation_outlet, Vel=Vector(0, 0, 0))

ventilation_inlet_fire_stair_door_2 = Panel("-1.08")
facen = FaceNormals(Mesh=ventilation_inlet_bathroom)  # -> flatten(Centers), Normals
multiplication = Multiplication(A=facen.Normals, B=ventilation_inlet_fire_stair_door_2)  # -> flatten(Result)

join = BrepJoin(Breps=volume_3)  # -> Breps, Closed
geo = Geometry(Geo=join.Breps, Temp=temp)

il = Inlet(Geo=ventilation_inlet_bathroom, Vel=multiplication, Temp=temp)  # -> flatten(Inlet)
il_2 = Inlet(Geo=ventilation_inlet_fire_stair_door, Vel=multiplication, Temp=temp)  # -> flatten(Inlet)

# ---- group: For any new case, please make sure to put it in a "0" subfolder.
# Step 2: Run Simulation
panel = Panel("C:\EddyCovidCaseName\0\")

# ----
idom = IndoorDomain(
    Geo=geo,
    Inlet=[il, il_2],
    Outlet=ol,
    FunctionObjects=[viralem, ms, msink, vhs],
    Directory=panel,
    PointInside=pt,
    CellSize=Slider(0.3, range=0..1),
    Iterations=Slider(300, range=0..10000),
    RunMeshing=Toggle(False),
    MakeFOS=Toggle(False),
    RunSimulation=Toggle(False))
brep = Brep(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)

c_script = CSharpScript(Dom=idom, Reference="C:\Eddy3D\EddyLib.dll")  # -> Res
# ---------- c_script: C# usings ----------
using EddyLib;
using EddyLib.BCs;
using System.Linq;
# ---------- c_script: C# ----------
    var point0 = new Rhino.Geometry.Point3d(0, 0, 0);
    var point1 = new Rhino.Geometry.Point3d(20, 0, 0);
    var point2 = new Rhino.Geometry.Point3d(0, 20, 0);
    var point3 = new Rhino.Geometry.Point3d(20, 20, 0);
    var point4 = new Rhino.Geometry.Point3d(0, 0, 40);
    var point5 = new Rhino.Geometry.Point3d(20, 0, 40);
    var point6 = new Rhino.Geometry.Point3d(0, 20, 40);
    var point7 = new Rhino.Geometry.Point3d(20, 20, 40);
    Rhino.Geometry.Box box1 = new Rhino.Geometry.Box(Rhino.Geometry.Plane.WorldXY, new List<Rhino.Geometry.Point3d>() { point0, point1, point2, point3, point4, point5, point6, point7 });
    Rhino.Geometry.MeshingParameters mp = new Rhino.Geometry.MeshingParameters();
    var m = Mesh.CreateFromBrep(box1.ToBrep(), mp);

    Rhino.Geometry.Mesh mm = new Rhino.Geometry.Mesh();

    foreach (Rhino.Geometry.Mesh im in m)
    {
      mm.Append(im);
    }



    var windDirList = new List<int>() { 0 };
    BoundaryCondition bcond = new ABL(windDirList, 5, 10, 1, 0, "");

    OFCylDomain DOMCYL = new OFCylDomain(mm, new Mesh(), bcond, 5, 50, 300, 80);




    var DOM = (EddyLib.Indoor.IndoorDomain) Dom;

    var RUNSETTINGS = new OFRunSettings(1000, 20, 5, fvSchemes.Optimized, 1, SimEngine.BlueCFD, OSType.Windows10, TurbModel.RNGkEpsilon, RelaxationFactors.Optimized, false, false);
    var MESHSETTINGS = new OFMeshSettings();


    var baseWorkingDirectory = DOM.WorkingDir;


    MESHSETTINGS.meshStlDir = baseWorkingDirectory + @"\\constant\triSurface\";
    MESHSETTINGS.meshPolyMeshDir = baseWorkingDirectory + @"\\constant\polyMesh\";
    MESHSETTINGS.meshSystemDir = baseWorkingDirectory + @"\\system\";
    MESHSETTINGS.meshConstantDir = baseWorkingDirectory + @"\\constant\";
    MESHSETTINGS.meshWorkingDir = baseWorkingDirectory + @"\\";


    // MESHSETTINGS.meshStlFilenameBuildings = baseWorkingDirectory + @"\\constant\triSurface\building.stl";
    //MESHSETTINGS.meshStlFilenameGround = baseWorkingDirectory + @"\\constant\triSurface\ground.stl";
    // MESHSETTINGS.meshStlFilenameGroundPerim = baseWorkingDirectory + @"\\constant\triSurface\ground_perim.stl";
    // MESHSETTINGS.meshBoundaryConditionsDirectory = baseWorkingDirectory + @"\\0.org\";


    var RES = new EddyLib.OFResult(DOMCYL, RUNSETTINGS, MESHSETTINGS, DOM.WorkingDir.Replace("0\\", ""));

    Res = RES;
# ---------- end c_script ----------
# Step 3: Probing
panel_2 = Panel("test")
cluster = Cluster(B=brep, relay=Slider(0.5, range=0..1))
probing = Probing(Result=c_script, ProbingPoints=cluster, NameOfInstance=panel_2, NameOfField=0, Run=Button())  # -> PorbingPoints, ProbingResult
vlen = VectorLength(Vector=probing.ProbingResult)
vdisex = VectorDisplayEx(Point=probing.PorbingPoints, Vector=probing.ProbingResult, Colour=RGB(0, 0, 0), Width=2)
panel_3 = Panel(vlen)

# ==== cluster Cluster
relay = ClusterInput()
custom_mesh_settings = SettingsCustom(
    StitchSeams=True,
    SimplePlanes=False,
    Refine=True,
    MinCount=16,
    MaxCount=400,
    AspectRatio=20,
    MaxDistance=0,
    MaxAngle=20,
    MinEdge=relay,
    MaxEdge=relay)
B = ClusterInput()
mesh = MeshBrep(Brep=B, Settings=custom_mesh_settings)
demesh = DeconstructMesh(Mesh=mesh)  # -> Vertices, Faces, Colours, Normals
V = ClusterOutput(demesh.Vertices)
