# Grasshopper definition 8_IndoorCovidCase_BaseFile.gh (Grasshopper 1.0.7)
# plug-ins: Eddy3D, Heteroptera

brep = Brep([<brep referenced from the Rhino model> x6])
brep_2 = Brep([<brep referenced from the Rhino model> x12])
brep_3 = Brep([<brep referenced from the Rhino model> x5])
brep_4 = Brep([<brep referenced from the Rhino model> x2])
brep_5 = Brep(<brep referenced from the Rhino model>)
brep_6 = Brep([<brep referenced from the Rhino model> x12])
brep_7 = Brep(<brep referenced from the Rhino model>)
brep_8 = Brep(<brep referenced from the Rhino model>)
brep_9 = Brep(<brep referenced from the Rhino model>)
brep_10 = Brep(<brep referenced from the Rhino model>)
crv = Curve([<curve referenced from the Rhino model> x18])
crv_2 = Curve([<curve referenced from the Rhino model> x7])
crv_3 = Curve([<curve referenced from the Rhino model> x9])
crv_4 = Curve([<curve referenced from the Rhino model> x18])
brep_11 = Brep(<brep referenced from the Rhino model>)
volume = Brep([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])
number_slider = Slider(0.73, range=0..1)  # disabled
panel = Panel(""".25
.50
.80""")  # disabled
Z = UnitZ(Factor="1.5")
extr = Extrude(Base=crv_2, Direction=Z)
crv_5 = Curve(<curve referenced from the Rhino model>)  # disabled
crv_6 = Curve(<curve referenced from the Rhino model>)  # disabled
ventilation_inlet_bathroom = Brep(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)
# Viral Emitter
# Momentum Source
# (Fan-Out)
infected_emitter_mesh = Brep(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)
# Outlets
ventilation_outlet = Brep(<brep referenced from the Rhino model>)
ac_outlet = Brep([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])
# Momentum Sink (Partitions)
volume_2 = Brep(extr)
# Momentum Source
# (Fan- In)
ac_inlet = Brep([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])
# Eddy3D Indoor COVID-19 Example
# Step 1: Imput Geometry
# Temperature
temp = Slider(33, range=27..35)
# Volumetric Heat Sources(People)
volume_3 = Brep([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])
# Momentum Sink (Furniture)
volume_4 = Brep([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])

# ----
# Volume
# Point Inside Volume
brep_12 = Brep(<brep referenced from the Rhino model>)

# ----
# Inlets
pt = Point(Point(3.152091326, -9.490595055, 0.4314200966))
tweencrv = TweenCurve(CurveA=crv_6, CurveB=crv_5, Factor=panel, BlendType=0)  # disabled
crv_7 = Curve([<curve referenced from the Rhino model> x15])
panel_2 = Panel(""".30
.40
.60
.80""")  # disabled
crv_8 = Curve(<curve referenced from the Rhino model>)
crv_9 = Curve(<curve referenced from the Rhino model>)  # disabled
crv_10 = Curve(<curve referenced from the Rhino model>)  # disabled
crv_11 = Curve([<curve referenced from the Rhino model> x15])
center = Center(Geometry=crv_11)  # -> Center, Dimension
Z_2 = UnitZ(Factor="1.5")

mesh_join = MeshJoin(Meshes=volume_2)
msink = MomentumSink(Geo=mesh_join, Name="momentumSink")

mesh_join_2 = MeshJoin(Meshes=volume_3)
mesh = Mesh(mesh_join_2)
vhs = VolumetricHeatSource(Geo=mesh, Power=Slider(100, range=0..100), Name="volumetricHeatSource", Type=0)

mesh_join_3 = MeshJoin(Meshes=volume_4)
msink_2 = MomentumSink(Geo=mesh_join_3, Name="momentumSink")

mesh_join_4 = MeshJoin(Meshes=infected_emitter_mesh)
mesh_2 = Mesh(mesh_join_4)
viralem = ViralEmitter(Geo=mesh_2, Name="ViralEmitter", InjectionRate="2", Type=0)

ol = Outlet(Geo=ventilation_outlet, Vel=Vector(0, 0, 0))

join = BrepJoin(Breps=brep_12)  # -> Breps, Closed
geo = Geometry(Geo=join.Breps, Temp=temp)

ventilation_inlet_fire_stair_door = Panel("-1.08")
facen = FaceNormals(Mesh=ventilation_inlet_bathroom)  # -> flatten(Centers), Normals
multiplication = Multiplication(A=facen.Normals, B=ventilation_inlet_fire_stair_door)  # -> flatten(Result)

scale = Scale(Geometry=crv_11, Center=center.Center, Factor=Slider(0.31, range=0..1))  # -> Geometry, Transform
tweencrv_2 = TweenCurve(CurveA=crv_10, CurveB=crv_9, Factor=panel_2, BlendType=0)  # disabled
extr_2 = Extrude(Base=crv_8, Direction=Z_2)
srf = Surface(crv_8)

# ---- group: Inlet
move = Move(Geometry=scale.Geometry, Motion="{0,0,0.1}")  # -> graft(Geometry), Transform

# ---- group: Outlet
move_2 = Move(Geometry=scale.Geometry, Motion="{0,0,3}")  # -> graft(Geometry), Transform

# ----
panel_3 = Panel("{0,0,0.25}")
move_3 = Move(Geometry=crv_11, Motion="{0,0,1.5}")  # -> graft(Geometry), Transform

il = Inlet(Geo=ventilation_inlet_bathroom, Vel=multiplication, Temp=temp)  # -> flatten(Inlet)

loft = Loft(
    Curves=[move_2.Geometry, move_3.Geometry],
    Options={Adjust=False, Closed=False, LoftEnds=0, LoftSimp=0, LoftType=0, Rebuild=10, Refit=0.01})
merge = Merge(Data1=vhs, Data2=msink_2)
merge_2 = Merge(Data1=il)
join_2 = BrepJoin(Breps=flatten([extr_2, srf, loft]))  # -> Breps, Closed

# ---- group: For any new case, please make sure to put it in a "0" subfolder.
# Step 2: Run Simulation
panel_4 = Panel("C:\Users\zoemd\OneDrive\Documents\Cornell\SP2022\THESIS\Part1_DesignCaseStudy\RestaurantDesign\Design_Case_Study\0\")

# ----
brep_13 = Brep(brep_12)
cluster = Cluster_2(S=brep_13)
G = Geometry()  # disabled
C = Cloud()  # disabled
panel_5 = Panel("4")  # disabled
data = Data()  # disabled
cps = ClosestPoints(Point=G, Cloud=C, Count=panel_5)  # -> ClosestPoint, CPIndex, Distance; disabled
item = ListItem(List=data, Index=cps.CPIndex, Wrap=True)  # disabled
c_script = CSharpScript()  # -> out, A; inputs startPt: Point3d, pts: list of Point3d, vecs: list of Vector3d, num: Int32; disabled
# ---------- c_script: C# ----------
    streamline(num, startPt, pts, vecs);
# ---------- c_script: C# additional code ----------
  public void streamline (int iter, Point3d sP, List<Point3d> points, List<Vector3d> vectors)
  {


  }
# ---------- end c_script ----------
shift = ShiftList(List=cps.ClosestPoint, Shift=1, Wrap=True)  # disabled
devec = DeconstructVector(Vector=item)  # -> XComponent, YComponent, ZComponent; disabled
dist = Distance(PointA=cps.ClosestPoint, PointB=shift)  # disabled
wav = WeightedAverage(Input=devec.XComponent, Weights=cps.Distance)  # disabled
wav_2 = WeightedAverage(Input=devec.YComponent, Weights=cps.Distance)  # disabled
wav_3 = WeightedAverage(Input=devec.ZComponent, Weights=cps.Distance)  # disabled
extremums = MinMax(Number=dist)  # -> Minimum, Maximum; disabled
vec = VectorXYZ(XComponent=wav, YComponent=wav_2, ZComponent=wav_3)  # -> Vector, Length; disabled
unit = UnitVector(Vector=vec.Vector)  # disabled
amp = Amplitude(Vector=unit, Amplitude=extremums.Minimum)  # disabled
move_4 = Move(Geometry=G, Motion=amp)  # -> Geometry, Transform; disabled
vlen = VectorLength(Vector=amp)  # disabled
G_2 = Geometry(move_4.Geometry)  # disabled
V = Vector(amp)  # disabled

mesh_join_5 = MeshJoin(Meshes=ac_outlet)
mesh_join_6 = MeshJoin(Meshes=ac_inlet)

weld = WeldMesh(Mesh=mesh_join_5, Angle=3.141592654)
weld_2 = WeldMesh(Mesh=mesh_join_6, Angle=3.141592654)
facen_2 = FaceNormals(Mesh=weld)  # -> Centers, Normals
facen_3 = FaceNormals(Mesh=weld_2)  # -> Centers, Normals
amp_2 = Amplitude(Vector=facen_2.Normals, Amplitude="0.25")
amp_3 = Amplitude(Vector=facen_3.Normals, Amplitude="-0.25")

mesh_3 = Mesh(weld_2)
mesh_4 = Mesh(weld)
ms = MomentumSource(Geo=mesh_3, Ubar=amp_3, Name="fanIn")

vdis = VectorDisplay(Anchor=facen_2.Centers, Vector=facen_2.Normals)
ms_2 = MomentumSource(Geo=mesh_4, Ubar=amp_2, Name="fanOut")
vdis_2 = VectorDisplay(Anchor=facen_3.Centers, Vector=amp_3)
merge_3 = Merge(Data1=viralem, Data2=ms_2, Data3=ms, Data4=merge)

indoordomain = IndoorDomain(
    Geo=geo,
    Inlet=merge_2,
    Outlet=ol,
    FunctionObjects=merge_3,
    Directory=panel_4,
    PointInside=pt,
    CellSize=Slider(0.3, range=0..1),
    Iterations=Slider(10, range=0..10000),
    Run=Toggle(False))  # -> Domain, Result; disabled

# ----
# Step 3: Probing
number_slider_2 = Slider(0.5, range=0..1)
cluster_2 = Cluster(B=cluster, relay=number_slider_2)  # -> D, V, M
probing = Probing(Result=indoordomain.Result, ProbingPoints=cluster_2.V, NameOfInstance="Vel", NameOfField=0, Run=Toggle(False))  # -> PorbingPoints, ProbingResult

probing_2 = Probing(Result=indoordomain.Result, ProbingPoints=cluster_2.V, NameOfInstance="Aoa", NameOfField=8, Run=Toggle(False))  # -> PorbingPoints, ProbingResult
gradient = Gradient(
    LowerLimit="0",
    UpperLimit=Slider(100, range=0..100),
    Parameter=probing_2.ProbingResult,
    stops=[0: RGB(59, 76, 192), 0.5: RGB(221, 221, 221), 1: RGB(180, 4, 38)])
move_5 = Move(Geometry=cluster_2.M, Motion=Vector(0, 0, 10))  # -> Geometry, Transform
mcol = MeshColours(Mesh=move_5.Geometry, Colours=gradient)

vlen_2 = VectorLength(Vector=probing.ProbingResult)
gradient_2 = Gradient(
    LowerLimit=0,
    UpperLimit="1",
    Parameter=vlen_2,
    stops=[0: RGB(68, 1, 84), 0.14: RGB(70, 50, 127), 0.29: RGB(54, 92, 141), 0.43: RGB(39, 127, 142), 0.57: RGB(31, 161, 135), 0.71: RGB(74, 194, 109), 0.86: RGB(159, 218, 58), 1: RGB(253, 231, 37)])
amp_4 = Amplitude(Vector=probing.ProbingResult, Amplitude=Slider(0.47, range=0..1))

vdisex = VectorDisplayEx(Point=probing.PorbingPoints, Vector=amp_4, Colour=gradient_2, Width=2)

# ==== cluster Cluster
relay = ClusterInput()
custom_mesh_settings = SettingsCustom(
    StitchSeams=True,
    SimplePlanes=False,
    Refine=True,
    MinCount=16,
    MaxCount=400,
    AspectRatio=20,
    MaxDistance=0,
    MaxAngle=20,
    MinEdge=relay,
    MaxEdge=relay)
B = ClusterInput()
mesh = MeshBrep(Brep=B, Settings=custom_mesh_settings)
demesh = DeconstructMesh(Mesh=mesh)  # -> Vertices, Faces, Colours, Normals
item = ListItem(List=demesh.Vertices, Index=0, Wrap=True)  # -> Item, Item1
M = ClusterOutput(mesh)  # M
V = ClusterOutput(demesh.Vertices)
dist = Distance(PointA=item.Item, PointB=item.Item1)
D = ClusterOutput(dist)

# ==== cluster Cluster_2
number_slider = Slider(2.4, range=0..10)
S = ClusterInput()
contour = ContourEx(Shape=S, Plane=PlaneXY(0, 0, 0), Offsets=Slider(0, range=0..1))  # -> flatten(Contours)
join = JoinCurves(Curves=contour, Preserve=False)
item = ListItem(List=join, Index=Slider(1, range=0..10), Wrap=True)
offset = OffsetCurve(Curve=item, Distance=Slider(0.1, range=-1..2), Plane=PlaneXY(0, 0, 0), Corners=1)
Z = UnitZ(Factor=Slider(1.5, range=0..10))
move = Move(Geometry=offset, Motion=Z)  # -> Geometry, Transform
join_2 = JoinCurves(Curves=move.Geometry, Preserve=False)
C = ClusterOutput(join_2)
