# Grasshopper definition FluidX3D.gh (Grasshopper 1.0.8)
# plug-ins: Eddy3D

abl = ABLFlow()
brep = Brep([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])
fxset = FluidX3DRunSettings(VRAMBudgetMB=1000, SimulationTimeS=180, ExportEveryS=10, GroundElevation=0)
dombox = BoxDomain(Buildings=brep, BoundaryCondition=abl, CellSize=20)  # -> Domain, PreviewMesh
install = InstallEngines(InstallEnergyPlus=False, InstallRadiance=False, InstallBlueCFD=False, InstallFluidX3D=Button())
panel = Panel(install)
windsim = WindSimulation(
    SimulationDomain=dombox.Domain,
    WorkingDirectory="C:\Users\pkastner\AppData\Local\Eddy3D\Cases",
    RunSettings=fxset,
    RunMeshing=False,
    MakeTrees=False,
    RunSimulation=Button(),
    SelectedEngine=2)  # -> SimulationResult, MeshDone, SimDone, MeshRemainingTime, SimulationRemainingTime
brep_2 = Brep(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)
dom = ConstructDomain(DomainStart=0, DomainEnd=Slider(26, range=0..30))
cluster = Cluster_3(G=brep_2, tc=Slider(10000, range=0..10000))
fxprobe = FluidX3DProbeVTK(
    SimulationResult=windsim.SimulationResult,
    ProbePoints=cluster,
    QField=0,
    TimeMode=0,
    TargetTimeS=0,
    TimeIntervalS=dom,
    Run=Toggle(True))  # -> ProbePoints, UByTime, RhoByTime, UAverage, RhoAverage, SampledTimes, SampledSteps, SampledFiles, OutsideCount
cluster_2 = Cluster_2(T=fxprobe.UByTime, P=Slider(1, range=0..10))
cluster_3 = Cluster(data=cluster_2)  # -> S, E, data_3
gradient = Gradient(
    LowerLimit=cluster_3.S,
    UpperLimit=cluster_3.E,
    Parameter=cluster_3.data_3,
    stops=[0.103: RGB(0, 0, 255), 0.22: RGB(0, 170, 255), 0.305: RGB(0, 255, 255), 0.398: RGB(0, 255, 188), 0.504: RGB(0, 255, 106), 0.605: RGB(91, 255, 0), 0.699: RGB(184, 255, 0), 0.799: RGB(255, 255, 0), 0.898: RGB(255, 170, 0)])
vdisex = VectorDisplayEx(Point=fxprobe.ProbePoints, Vector=cluster_2, Colour=gradient, Width=Slider(3, range=0..10))

# ==== cluster Cluster
data = ClusterInput()
data_2 = Data(data)
data_3 = ClusterOutput(data_2)
bnd = Bounds(Numbers=data_2)
dedomain = DeconstructDomain(Domain=bnd)  # -> Start, End
S = ClusterOutput(dedomain.Start)
E = ClusterOutput(dedomain.End)

# ==== cluster Cluster_2
T = ClusterInput()
P = ClusterInput()
simplify = SimplifyTree(Tree=T, Front=False)
branch = TreeBranch(Tree=simplify, Path=P, MaintainPaths=True)
B = ClusterOutput(branch)

# ==== cluster Cluster_3
tc = ClusterInput()
qrsettings = QuadRemeshSettings(TargetCount=tc, AdaptiveSize=0, AdaptiveCount=False, HardEdges=False, SeamEdges=0, Symmetry=0, GuideCurves=0)
G = ClusterInput()
qrmesh = QuadRemesh(Geometry=G, Settings=qrsettings)
demesh = DeconstructMesh(Mesh=qrmesh)  # -> Vertices, Faces, Colours, Normals
V = ClusterOutput(demesh.Vertices)
