# Grasshopper definition GAN_Prediction.gh (Grasshopper 1.0.8)
# plug-ins: Eddy3D

geo = Geometry([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])
ganpredict = GANWindPrediction(
    BuildingGeometry=geo,
    WindDirection=0,
    Run=Button(),
    APIURL="https://sustainableurbansystemslab-eddy3d-gan.hf.space",
    HeightScale=3,
    DistanceScale=100)  # -> WindSpeed, Mesh
mesh = Mesh(ganpredict.Mesh)
