# Grasshopper definition 2phaseComparison.gh (Grasshopper 1.0.7)
# plug-ins: DIVA Daylight

panel = Panel("-aa .15 -ab 2 -ad 5000 -ar 256 -as 64 -dr 2 -ds .2 -lr 6 -lw .004 -dc .75 -dp 2048 -dt .05 -ms 0.063 -st .01")
brep = Brep(<brep referenced from the Rhino model>)
brep_2 = Brep(<brep referenced from the Rhino model>)
panel_2 = Panel("C:\Users\pkastner\Google Drive\Patrick\2PhaseComparison\output\annualR.ill")
panel_3 = Panel("C:\Users\Timur\Desktop\2PhaseComparison\output\annualR.ill")
toggle = BooleanToggle(True)
obj = SceneObject(
    Geometry=brep_2,
    BooleanValue_0=False,
    BooleanValue_1=False,
    Color_0=RGBA(0, 0, 0, 0),
    Color_1=RGBA(0, 0, 0, 0),
    Hidden_0=False,
    Hidden_1=False,
    IntegerValue_0=-2147483648,
    IntegerValue_1=-2147483648,
    IntervalMax_0=-1.797693135e+308,
    IntervalMax_1=-1.797693135e+308,
    IntervalMin_0=-1.797693135e+308,
    IntervalMin_1=-1.797693135e+308,
    Name_0="Geometry",
    Name_1="Material",
    NumberValue_0=-1.797693135e+308,
    NumberValue_1=-1.797693135e+308,
    OutputHidden_0=False,
    OutputName_0="Scene Object",
    TextValuePersistent_1="GenericOpaqueWhite_50",
    TextValueVolatile_1="GenericOpaqueWhite_50")
grid = DaylightingGrid(
    Geometry=brep,
    Spacing="0.5",
    BooleanValue_0=False,
    BooleanValue_1=False,
    BooleanValue_10=False,
    BooleanValue_11=False,
    BooleanValue_12=False,
    BooleanValue_13=False,
    BooleanValue_14=False,
    BooleanValue_15=False,
    BooleanValue_16=False,
    BooleanValue_17=False,
    BooleanValue_18=False,
    BooleanValue_19=False,
    BooleanValue_2=False,
    BooleanValue_20=False,
    BooleanValue_21=False,
    BooleanValue_22=False,
    BooleanValue_3=False,
    BooleanValue_4=False,
    BooleanValue_5=False,
    BooleanValue_6=False,
    BooleanValue_7=False,
    BooleanValue_8=False,
    BooleanValue_9=False,
    Color_0=RGBA(0, 0, 0, 0),
    Color_1=RGBA(0, 0, 0, 0),
    Color_10=RGBA(0, 0, 0, 0),
    Color_11=RGBA(0, 0, 0, 0),
    Color_12=RGBA(0, 0, 0, 0),
    Color_13=RGBA(0, 0, 0, 0),
    Color_14=RGBA(0, 0, 0, 0)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)
rad_map = RadiationMap(
    Name="2phaseComparison",
    Grids=grid,
    Objects=obj,
    RhinoScene=False,
    Location="New.York",
    RadianceParam=panel,
    Method="Daysim",
    ExportRAD=toggle,
    ExportOCT=toggle,
    ExportDAT=toggle,
    Run=Button(),
    BooleanValue_0=False,
    BooleanValue_1=False,
    BooleanValue_10=False,
    BooleanValue_11=False,
    BooleanValue_12=False,
    BooleanValue_13=True,
    BooleanValue_14=True,
    BooleanValue_15=True,
    BooleanValue_16=False,
    BooleanValue_17=False,
    BooleanValue_18=False,
    BooleanValue_19=False,
    BooleanValue_2=False,
    BooleanValue_3=False,
    BooleanValue_4=False,
    BooleanValue_5=False,
    BooleanValue_6=False,
    BooleanValue_7=False,
    BooleanValue_8=False,
    BooleanValue_9=False,
    Color_0=RGBA(0, 0, 0, 0),
    Color_1=RGBA(0, 0, 0, 0),
    Color_10=RGBA(0, 0, 0, 0),
    Color_11=RGBA(0, 0, 0, 0),
    Color_12=RGBA(0, 0, 0, 0),
    Color_13=RGBA(0, 0, 0, 0),
    Color_14=RGBA(0, 0, 0, 0),
    Color_15=RGBA(0, 0, 0, 0),
    Color_16=RGBA(0, 0, 0, 0),
    Color_17=RGBA(0, 0, 0, 0)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)  # -> Out, SolarEnergy, EnergyDensity, Grid
number_slider = Slider(3, range=1..12)
number_slider_2 = Slider(21, range=1..30)
number_slider_3 = Slider(10, range=0..24)
hoy = HourOfYear(Month=number_slider, Day=number_slider_2, Hour=number_slider_3)  # -> HourOfYear, DayOfYear
c_script = CSharpScript(x=panel_2, h=hoy.HourOfYear)  # -> out, A; inputs x: String, h: Int32
# ---------- c_script: C# usings ----------
using System.IO;
using System.Linq;
# ---------- c_script: C# ----------
    string[] s = File.ReadAllLines(x).Skip(7).ToArray();

    string[] data = s[h].Trim().Split(' ');

    A = data;
# ---------- end c_script ----------
grid_v = GridViewer(
    Grid=rad_map.Grid,
    Month=number_slider,
    Day=number_slider_2,
    Hour=number_slider_3,
    BooleanValue_0=False,
    BooleanValue_1=False,
    BooleanValue_10=False,
    BooleanValue_11=False,
    BooleanValue_12=False,
    BooleanValue_13=False,
    BooleanValue_14=False,
    BooleanValue_15=False,
    BooleanValue_16=False,
    BooleanValue_17=False,
    BooleanValue_18=False,
    BooleanValue_19=False,
    BooleanValue_2=False,
    BooleanValue_20=False,
    BooleanValue_3=False,
    BooleanValue_4=False,
    BooleanValue_5=False,
    BooleanValue_6=False,
    BooleanValue_7=False,
    BooleanValue_8=False,
    BooleanValue_9=False,
    Color_0=RGBA(0, 0, 0, 0),
    Color_1=RGBA(0, 0, 0, 0),
    Color_10=RGBA(0, 0, 0, 0),
    Color_11=RGBA(0, 0, 0, 0),
    Color_12=RGBA(0, 0, 0, 0),
    Color_13=RGBA(0, 0, 0, 0),
    Color_14=RGBA(0, 0, 0, 0),
    Color_15=RGBA(0, 0, 0, 0),
    Color_16=RGBA(0, 0, 0, 0)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)  # -> Faces, SensorPts, SensorVec, SensorData
num = Number(c_script.A)
c_script_2 = CSharpScript(x=grid_v.SensorPts, y=grid_v.SensorVec)  # -> out, A; inputs x: Point3d, y: Vector3d
# ---------- c_script_2: C# ----------
    A = x.X + " " + x.Y + " " + x.Z + " " + y.X + " " + y.Y + " " + y.Z;
# ---------- end c_script_2 ----------
avr = Average(Input=grid_v.SensorData)
avr_2 = Average(Input=num)
panel_4 = Panel(c_script_2.A)
bnd = Bounds(Numbers=grid_v.SensorData)
panel_5 = Panel(avr)
panel_6 = Panel(avr_2)
bnd_2 = Bounds(Numbers=num)
dedomain = DeconstructDomain(Domain=bnd)  # -> Start, End
dedomain_2 = DeconstructDomain(Domain=bnd_2)  # -> Start, End
gradient = Gradient(
    LowerLimit=dedomain.Start,
    UpperLimit=dedomain.End,
    Parameter=grid_v.SensorData,
    stops=[0: RGB(0, 128, 0), 0.5: RGB(255, 255, 0), 1: RGB(255, 0, 0)])
gradient_2 = Gradient(
    LowerLimit=dedomain_2.Start,
    UpperLimit=dedomain_2.End,
    Parameter=num,
    stops=[0: RGB(0, 128, 0), 0.5: RGB(255, 255, 0), 1: RGB(255, 0, 0)])
pi = Pi(Factor=1)
division = Division(A=avr_2, B=pi)
Y = UnitY(Factor=Slider(14, range=0..20))
move = Move(Geometry=grid_v.Faces, Motion=Y)  # -> Geometry, Transform
preview = CustomPreview(Geometry=grid_v.Faces, Material=gradient)
preview_2 = CustomPreview(Geometry=move.Geometry, Material=gradient_2)
