# Grasshopper definition Radiation.gh (Grasshopper 1.0.7)
# plug-ins: Eddy3D

custom_mesh_settings = SettingsCustom(
    StitchSeams=True,
    SimplePlanes=False,
    Refine=True,
    MinCount=16,
    MaxCount=400,
    AspectRatio=20,
    MaxDistance=0,
    MaxAngle=20,
    MinEdge=0,
    MaxEdge=Slider(2, range=0..10))
brep = Brep(<brep referenced from the Rhino model>)
geo = Geometry(<brep referenced from the Rhino model>)
mesh = MeshBrep(Brep=brep, Settings=custom_mesh_settings)
button = Button()
mesh_2 = Mesh(geo)
rad = Radiation(
    Name="TEST",
    Dir="C:\Temp\Eddy3d",
    Weather="C:\DIVA\WeatherData\AUS_NT.Darwin.Airport.941200_RMY.epw",
    Model=mesh_2,
    Probes=mesh,
    Run=Toggle(True))
rad_2 = Radiation(Path=rad, Hour=12)  # -> Result, Meshes, Hour
