# Grasshopper definition TestingBoxDomainDimensions.gh (Grasshopper 1.0.7)
# plug-ins: Eddy3D

number_slider = Slider(49, range=0..100)
geo = Geometry(<brep referenced from the Rhino model>)
abl_flow = ABLFlow(
    WindDirections=number_slider,
    ReferenceVelocityAtZref_m_s=5,
    ReferenceHeight_m=10,
    SurfaceRoughnessHeight_m=1,
    MinimumZCoordinate_m=0)
geo_2 = Geometry(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)
c_script = CSharpScript(Angle=number_slider, BuildingGeometry=geo_2, Reference=["C:\Eddy3D\EddyLib.dll", "C:\Eddy3D\Newtonsoft.Json.dll"])  # -> out, A, B; inputs Angle: Int32, BuildingGeometry: Mesh
# ---------- c_script: C# usings ----------
using System.Linq;

using System.Drawing;

using Newtonsoft.Json;
using System.IO;
using System.Reflection;
using System.Text;
# ---------- c_script: C# ----------
    EddyLib.BCs.BoundaryCondition bCond = new EddyLib.BCs.BoundaryCondition();

    List<GeometryBase> buildings = new List<GeometryBase> ();

    double blockDimension = 20;

    

    Mesh buildingGeometry = new Mesh();
    MeshingParameters mp = new MeshingParameters();





    foreach (GeometryBase b in buildings)
    {
      if (b.ObjectType == Rhino.DocObjects.ObjectType.Mesh)
      {
        Mesh obj = (Mesh) b;
        buildingGeometry.Append(obj);
      }
      else if (b.ObjectType == Rhino.DocObjects.ObjectType.Brep || b.ObjectType == Rhino.DocObjects.ObjectType.Extrusion || b.ObjectType == Rhino.DocObjects.ObjectType.Surface)
      {
        Brep obj = (Brep) b;
        Mesh[] m = Mesh.CreateFromBrep(obj, mp);
        foreach (Mesh mm in m)
        {
          buildingGeometry.Append(mm);
        }
      }
    }
   

    // For radiation simulation

    buildingGeometry.UserDictionary.Set("type", "Building");


    // Check if lowest point in Domain is z_low < 0, then we cannot use a ABL


   double width;

   double length;

   double height;

   double Length_BBox;

   double Width_BBox;

   double Height_BBox;

   double Width_SBox;

   double Length_SBox;

   double Height_SBox;

   int CellsAlongWidth;

   int CellsAlongLength;

   int CellsAlongHeight;

   Mesh DomainMeshGround;

   Mesh DomainMeshGroundPerim;

   Box SBox;





   string info;

   double test;
    
    
   Point3d CenterGround;

   Point3d LocationInMesh;

   double[] FrontageBuildingAreas = new double[360];

   double MaxFrontageBuildingArea;

   Bitmap[] FrontagePNGs = new Bitmap[360];

   Cylinder RefinementCylinder;

   Box BBox;

  

   Mesh TerrainMesh;

   Mesh DomainMesh;

   Mesh[] DomainMeshIntersection;

  


   int NumberOFCellsInMesh;

   List<double> Runtimes = new List<double>();

   bool hasTerrain;

   double MaxHeightBuilding;
    
    
    
    
    
    Vector3d windDirVector = Dir2Vec(Angle);
    windDirVector.Unitize();

    // Rotate the Plane based on wind vector area

    var bb = BuildingGeometry.GetBoundingBox(true);

    var centerBottomOfBuildings = new Point3d(bb.Center.X, bb.Center.Y, bb.Min.Z);
    Plane orientedPlane = OFBaseDomain.GetOrientedBasePlane(windDirVector, centerBottomOfBuildings);

    orientedPlane.Origin = centerBottomOfBuildings;

    var l = new List<Mesh>();
    l.Add(BuildingGeometry);
    
  width = 0;
  length = 0;
  height = 0;
  
    
    BBox = OFBaseDomain.UnionB(l, orientedPlane);
    
      

    var corners = new List<Point3d>();

    foreach (Point3d pt in BBox.GetCorners())
    {
      corners.Add(pt);
    }

    var MinHeightBBox = corners[0].Z;
    var MaxHeightBBox = corners[4].Z;
    MaxHeightBuilding = MaxHeightBBox;
    
    
    Length_BBox = corners[0].DistanceTo(corners[1]);
    Width_BBox = corners[0].DistanceTo(corners[3]);
    Height_BBox = corners[0].DistanceTo(corners[4]);

    Bitmap FrontageImage;
    MaxFrontageBuildingArea = OFBaseDomain.GetProjectedBuildingArea(Angle, BuildingGeometry, out FrontageImage);
    FrontagePNGs[Angle] = FrontageImage;

    // Order important Z --> Y --> X

    // Z
    double scaleZ = height == 0 ? 5 * Height_BBox : height;

    // X; take blocking ratio into account

    double WidthDueToBlockingRatio = ((RequiredInletArea(MaxFrontageBuildingArea) / (6 * Height_BBox)) - (MaxFrontageBuildingArea / MaxHeightBuilding)) / 2;

    double scaleRectDomainXUser = 0;

    if (width != 0)
    {
      scaleRectDomainXUser = width / 2;
    }

    double scaleX = width == 0 ? WidthDueToBlockingRatio : scaleRectDomainXUser;

    // Y
    double scaleYDownStream = length == 0 ? 15 * Height_BBox : length / 3 * 2;
    double scaleYUpStream = length == 0 ? 5 * Height_BBox : length / 3 * 1;

    var yTransUpStr = Transform.Translation(scaleYUpStream * -windDirVector);
    var yTransDownStr = Transform.Translation(scaleYDownStream * windDirVector);

    var NormalToWindDir = Vector3d.CrossProduct(windDirVector, Vector3d.ZAxis);
    NormalToWindDir.Unitize();

    var xTransMinusX = Transform.Translation((scaleX) *-NormalToWindDir);
    var xTransPlusX = Transform.Translation((scaleX) *NormalToWindDir);

    var zTrans = Transform.Translation((scaleZ) *Vector3d.ZAxis);

    Point3d P0 = corners[0];
    Point3d P1 = corners[1];
    Point3d P2 = corners[2];
    Point3d P3 = corners[3];
    Point3d P4 = corners[4];
    Point3d P5 = corners[5];
    Point3d P6 = corners[6];
    Point3d P7 = corners[7];

    // Move all in y

    P0.Transform(yTransUpStr);
    P1.Transform(yTransUpStr);
    P4.Transform(yTransUpStr);
    P5.Transform(yTransUpStr);

    P2.Transform(yTransDownStr);
    P3.Transform(yTransDownStr);
    P6.Transform(yTransDownStr);
    P7.Transform(yTransDownStr);

    // Move all in x

    P0.Transform(xTransMinusX);
    P3.Transform(xTransMinusX);
    P7.Transform(xTransMinusX);
    P4.Transform(xTransMinusX);

    P1.Transform(xTransPlusX);
    P5.Transform(xTransPlusX);
    P2.Transform(xTransPlusX);
    P6.Transform(xTransPlusX);

    // Move all in z

    P4.Transform(zTrans);
    P5.Transform(zTrans);
    P6.Transform(zTrans);
    P7.Transform(zTrans);
    
    
    
    
    // Z If terrain is used, scale down Z to make sure all points are inside the domain
    // Zinter is call divisionsZ for CylDomain which is an int instead of an Interval



    // Update Dimensions now that we know the terrain

    Height_BBox = MaxHeightBBox - MinHeightBBox;

    IEnumerable<Point3d> Corners = new List<Point3d> { P0, P1, P2, P3, P4, P5, P6, P7 };
    SBox = new Box(orientedPlane, Corners);

    // Compute dimension of simulation domain

    Width_SBox = Math.Abs(SBox.X.Max - SBox.X.Min);
    Length_SBox = Math.Abs(SBox.Y.Max - SBox.Y.Min);
    Height_SBox = Math.Abs(SBox.Z.Max - SBox.Z.Min);

  

   
      double tolerance = 0.01;

      // Create ground meshes

      MeshingParameters mpGround = MeshingParameters.Default;

      // Inner Ground Mesh

      var plg1 = new Rectangle3d(orientedPlane, corners[0], corners[2]);

      DomainMeshGround = ConvertToQuads(Mesh.CreateFromPlanarBoundary(plg1.ToNurbsCurve(), mpGround, tolerance));

      // 4 Surrounding Ground Meshes

      IEnumerable<Point3d> p2 = new List<Point3d> { P0, corners[0], corners[1], P1, P0 };
      var plg2 = new Rhino.Geometry.Polyline(p2);

      IEnumerable<Point3d> p3 = new List<Point3d> { P1, corners[1], corners[2], P2, P1 };
      var plg3 = new Rhino.Geometry.Polyline(p3);

      IEnumerable<Point3d> p4 = new List<Point3d> { P2, corners[2], corners[3], P3, P2 };
      var plg4 = new Rhino.Geometry.Polyline(p4);

      IEnumerable<Point3d> p5 = new List<Point3d> { P3, corners[3], corners[0], P0, P3, };
      var plg5 = new Rhino.Geometry.Polyline(p5);

      DomainMeshGroundPerim = new Mesh();
      DomainMeshGroundPerim.Append(Mesh.CreateFromPlanarBoundary(plg2.ToPolylineCurve(), mpGround, tolerance));
      DomainMeshGroundPerim.Append(Mesh.CreateFromPlanarBoundary(plg3.ToPolylineCurve(), mpGround, tolerance));
      DomainMeshGroundPerim.Append(Mesh.CreateFromPlanarBoundary(plg4.ToPolylineCurve(), mpGround, tolerance));
      DomainMeshGroundPerim.Append(Mesh.CreateFromPlanarBoundary(plg5.ToPolylineCurve(), mpGround, tolerance));
    

    // Create final Mesh

    CellsAlongWidth = (int) ((Math.Abs(Width_SBox)) / blockDimension);
    CellsAlongLength = (int) ((Math.Abs(Length_SBox)) / blockDimension);
    CellsAlongHeight = (int) ((Math.Abs(Height_SBox)) / blockDimension);

    CenterGround = centerBottomOfBuildings;

    Brep booooox = SBox.ToBrep();

    MeshingParameters mpBox = new MeshingParameters();

    mpBox.MinimumEdgeLength = blockDimension;
    mpBox.MaximumEdgeLength = blockDimension;

    var bbb = Mesh.CreateFromBrep(booooox, mpBox);

    var bbbb = new Mesh();

    foreach (Mesh m in bbb)
    {
      bbbb.Append(m);
    }

    DomainMesh = bbbb;

    // Show only intersection of domain and terrain

    IEnumerable<Mesh> first = new List<Mesh>() { DomainMesh };
   // IEnumerable<Mesh> second = new List<Mesh>() { TerrainMesh };
  //  DomainMeshIntersection = Mesh.CreateBooleanIntersection(first, second);
    
    
    B = booooox;
    

  //  A = DomainMesh;
# ---------- c_script: C# additional code ----------
  public class OFBoxDomain : OFBaseDomain
  {
    //BoundingBox
    public double width;

    public double length;

    public double height;

    public double Length_BBox;

    public double Width_BBox;

    public double Height_BBox;

    public double Width_SBox;

    public double Length_SBox;

    public double Height_SBox;

    public int CellsAlongWidth;

    public int CellsAlongLength;

    public int CellsAlongHeight;

    public Mesh DomainMeshGround;

    public Mesh DomainMeshGroundPerim;

    public Box SBox;

    //public Mesh BoxWithDivs;

    public double blockDimension;

    public string info;

    public double test;

    public OFBoxDomain(Mesh BuildingGeometry, Mesh terrainMesh,  double blockDimension, double angle, double length = 0, double width = 0, double height = 0)
    {
 
      this.BuildingGeometry = BuildingGeometry;
      this.blockDimension = blockDimension;

      // Box-shaped tunnel can only have 1 windDir which is the 1st windDir

      Vector3d windDirVector = Dir2Vec(angle);
      windDirVector.Unitize();

      // Rotate the Plane based on wind vector area

      var bb = BuildingGeometry.GetBoundingBox(true);

      var centerBottomOfBuildings = new Point3d(bb.Center.X, bb.Center.Y, bb.Min.Z);
      Plane orientedPlane = GetOrientedBasePlane(windDirVector, centerBottomOfBuildings);

      orientedPlane.Origin = centerBottomOfBuildings;

      var l = new List<Mesh>();
      l.Add(BuildingGeometry);
      this.BBox = UnionB(l, orientedPlane);

      var corners = new List<Point3d>();

      foreach (Point3d pt in BBox.GetCorners())
      {
        corners.Add(pt);
      }

      var MinHeightBBox = corners[0].Z;
      var MaxHeightBBox = corners[4].Z;
      this.MaxHeightBuilding = MaxHeightBBox;

      Length_BBox = corners[0].DistanceTo(corners[1]);
      Width_BBox = corners[0].DistanceTo(corners[3]);
      Height_BBox = corners[0].DistanceTo(corners[4]);

      Bitmap FrontageImage;
      this.MaxFrontageBuildingArea = OFBaseDomain.GetProjectedBuildingArea((int)Math.Round(angle), BuildingGeometry, out FrontageImage);
      this.FrontagePNGs[(int)Math.Round(angle)] = FrontageImage;

      // Order important Z --> Y --> X

      // Z
      double scaleZ = height == 0 ? 5 * Height_BBox : height;

      // X; take blocking ratio into account

      double WidthDueToBlockingRatio = ((RequiredInletArea(MaxFrontageBuildingArea) / (6 * Height_BBox)) - (MaxFrontageBuildingArea / MaxHeightBuilding)) / 2;

      double scaleRectDomainXUser = 0;

      if (width != 0)
      {
        scaleRectDomainXUser = width / 2;
      }

      double scaleX = width == 0 ? WidthDueToBlockingRatio : scaleRectDomainXUser;

      // Y
      double scaleYDownStream = length == 0 ? 15 * Height_BBox : length / 3 * 2;
      double scaleYUpStream = length == 0 ? 5 * Height_BBox : length / 3 * 1;

      var yTransUpStr = Transform.Translation(scaleYUpStream * -windDirVector);
      var yTransDownStr = Transform.Translation(scaleYDownStream * windDirVector);

      var NormalToWindDir = Vector3d.CrossProduct(windDirVector, Vector3d.ZAxis);
      NormalToWindDir.Unitize();

      var xTransMinusX = Transform.Translation((scaleX) *-NormalToWindDir);
      var xTransPlusX = Transform.Translation((scaleX) *NormalToWindDir);

      var zTrans = Transform.Translation((scaleZ) *Vector3d.ZAxis);

      Point3d P0 = corners[0];
      Point3d P1 = corners[1];
      Point3d P2 = corners[2];
      Point3d P3 = corners[3];
      Point3d P4 = corners[4];
      Point3d P5 = corners[5];
      Point3d P6 = corners[6];
      Point3d P7 = corners[7];

      // Move all in y

      P0.Transform(yTransUpStr);
      P1.Transform(yTransUpStr);
      P4.Transform(yTransUpStr);
      P5.Transform(yTransUpStr);

      P2.Transform(yTransDownStr);
      P3.Transform(yTransDownStr);
      P6.Transform(yTransDownStr);
      P7.Transform(yTransDownStr);

      // Move all in x

      P0.Transform(xTransMinusX);
      P3.Transform(xTransMinusX);
      P7.Transform(xTransMinusX);
      P4.Transform(xTransMinusX);

      P1.Transform(xTransPlusX);
      P5.Transform(xTransPlusX);
      P2.Transform(xTransPlusX);
      P6.Transform(xTransPlusX);

      // Move all in z

      P4.Transform(zTrans);
      P5.Transform(zTrans);
      P6.Transform(zTrans);
      P7.Transform(zTrans);

      // Z If terrain is used, scale down Z to make sure all points are inside the domain
      // Zinter is call divisionsZ for CylDomain which is an int instead of an Interval

      if (terrainMesh.Faces.Count > 0)
      {
        this.hasTerrain = true;
      }

      // zInter is with respect to the CenterGround of the Plane
      if (hasTerrain)
      {
        double zMinTerrain = OFBaseDomain.GetZMinTerrain(terrainMesh, BBox, orientedPlane);

        var zTransTerrain = Transform.Translation((Math.Abs(zMinTerrain - centerBottomOfBuildings.Z)) * -Vector3d.ZAxis);

        P0.Transform(zTransTerrain);
        P1.Transform(zTransTerrain);
        P2.Transform(zTransTerrain);
        P3.Transform(zTransTerrain);

        MinHeightBBox = zMinTerrain;
      }

      // Update Dimensions now that we know the terrain

      Height_BBox = MaxHeightBBox - MinHeightBBox;

      IEnumerable<Point3d> Corners = new List<Point3d> { P0, P1, P2, P3, P4, P5, P6, P7 };
      SBox = new Box(orientedPlane, Corners);

      // Compute dimension of simulation domain

      Width_SBox = Math.Abs(SBox.X.Max - SBox.X.Min);
      Length_SBox = Math.Abs(SBox.Y.Max - SBox.Y.Min);
      Height_SBox = Math.Abs(SBox.Z.Max - SBox.Z.Min);

      // Pick location in Mesh

      SetLocationInMesh(BuildingGeometry, scaleZ);

      // Add terrain to ground mesh if it exists
      if (hasTerrain)
      {
        this.TerrainMesh = terrainMesh;
        this.DomainMeshGround = terrainMesh;
      }
      else
      {
        double tolerance = 0.01;

        // Create ground meshes

        MeshingParameters mpGround = MeshingParameters.Default;

        // Inner Ground Mesh

        var plg1 = new Rectangle3d(orientedPlane, corners[0], corners[2]);

        DomainMeshGround = ConvertToQuads(Mesh.CreateFromPlanarBoundary(plg1.ToNurbsCurve(), mpGround, tolerance));

        // 4 Surrounding Ground Meshes

        IEnumerable<Point3d> p2 = new List<Point3d> { P0, corners[0], corners[1], P1, P0 };
        var plg2 = new Rhino.Geometry.Polyline(p2);

        IEnumerable<Point3d> p3 = new List<Point3d> { P1, corners[1], corners[2], P2, P1 };
        var plg3 = new Rhino.Geometry.Polyline(p3);

        IEnumerable<Point3d> p4 = new List<Point3d> { P2, corners[2], corners[3], P3, P2 };
        var plg4 = new Rhino.Geometry.Polyline(p4);

        IEnumerable<Point3d> p5 = new List<Point3d> { P3, corners[3], corners[0], P0, P3, };
        var plg5 = new Rhino.Geometry.Polyline(p5);

        DomainMeshGroundPerim = new Mesh();
        DomainMeshGroundPerim.Append(Mesh.CreateFromPlanarBoundary(plg2.ToPolylineCurve(), mpGround, tolerance));
        DomainMeshGroundPerim.Append(Mesh.CreateFromPlanarBoundary(plg3.ToPolylineCurve(), mpGround, tolerance));
        DomainMeshGroundPerim.Append(Mesh.CreateFromPlanarBoundary(plg4.ToPolylineCurve(), mpGround, tolerance));
        DomainMeshGroundPerim.Append(Mesh.CreateFromPlanarBoundary(plg5.ToPolylineCurve(), mpGround, tolerance));
      }

      // Create final Mesh

      CellsAlongWidth = (int) ((Math.Abs(Width_SBox)) / blockDimension);
      CellsAlongLength = (int) ((Math.Abs(Length_SBox)) / blockDimension);
      CellsAlongHeight = (int) ((Math.Abs(Height_SBox)) / blockDimension);

      this.CenterGround = centerBottomOfBuildings;

      Brep booooox = SBox.ToBrep();

      MeshingParameters mpBox = new MeshingParameters();

      mpBox.MinimumEdgeLength = blockDimension;
      mpBox.MaximumEdgeLength = blockDimension;

      var bbb = Mesh.CreateFromBrep(booooox, mpBox);

      var bbbb = new Mesh();

      foreach (Mesh m in bbb)
      {
        bbbb.Append(m);
      }

      this.DomainMesh = bbbb;

      // Show only intersection of domain and terrain

      IEnumerable<Mesh> first = new List<Mesh>() { DomainMesh };
      IEnumerable<Mesh> second = new List<Mesh>() { TerrainMesh };
      this.DomainMeshIntersection = Mesh.CreateBooleanIntersection(first, second);

 



      ToString();
    }

    private void SetLocationInMesh(Mesh BuildingGeo, double scaleZ)
    {
      var vec = new Vector3d(0, 0, 0.1 * scaleZ);
      var moveUP = Transform.Translation(vec);
      var bg = BuildingGeo.GetBoundingBox(true).GetCorners()[7];

      LocationInMesh = new Point3d(SBox.Center.X, SBox.Center.Y, bg.Z);
      LocationInMesh.Transform(moveUP);
    }

    public   double RequiredInletArea(double FrontageFacadeArea)
    {
      // Required area for 3 % blocking ratio
      return 100 / 3 * (FrontageFacadeArea);
    }

   
  }
  
  // class for all common domain properties, every domain type inherits this
  public abstract class OFBaseDomain
  {
    public Point3d CenterGround;

    public Point3d LocationInMesh;

    public double[] FrontageBuildingAreas = new double[360];

    public double MaxFrontageBuildingArea;

    public Bitmap[] FrontagePNGs = new Bitmap[360];

    public Cylinder RefinementCylinder;

    public Box BBox;

    // 3 Main meshes

    public Mesh TerrainMesh;

    public Mesh DomainMesh;

    public Mesh[] DomainMeshIntersection;

    public Mesh BuildingGeometry;

    //public BoundaryCondition BCond;

    //  public List<Tree> Trees;

    public int NumberOFCellsInMesh;

    public List<double> Runtimes = new List<double>();

    public bool hasTerrain;

    public double MaxHeightBuilding;

    public static Plane GetOrientedBasePlane(Vector3d windDir, Point3d CenterGround)
    {
      var up = Vector3d.ZAxis;
      var forward = windDir;
      forward.Unitize();
      var right = Vector3d.CrossProduct(forward, up);
      right.Unitize();

      var orientedBasePlane = new Plane(CenterGround, right, forward);

      return orientedBasePlane;
    }

    public static BoundingBox GetRefinementBox(Plane localSystem, Mesh buildings, double padding = 0)
    {
      Plane worldXY = Plane.WorldXY;
      Transform xform = Transform.ChangeBasis(worldXY, localSystem);
      var refBox = BoundingBox.Empty;
      BoundingBox boundingBox = buildings.GetBoundingBox(xform);
      refBox.Union(boundingBox);
      refBox.Max = new Point3d(refBox.Max.X + padding, refBox.Max.Y + padding, refBox.Max.Z + padding);
      refBox.Min = new Point3d(refBox.Min.X - padding, refBox.Min.Y - padding, refBox.Min.Z);

      return boundingBox;
    }

    public Cylinder GetRefinementCyl(Point3d center, Mesh buildings, double paddingXY = 0, double paddingZ = 0.3)
    {
      BoundingBox bb = buildings.GetBoundingBox(true);
      var pt = new Point3d(bb.Max.X, bb.Max.Y, center.Z);
      var radiusRefBox = (center - pt).Length;
      var cyl = new Cylinder(new Circle(center, radiusRefBox + paddingXY), bb.Max.Z + paddingZ);
      return cyl;
    }

    public static double GetZMinTerrain(Mesh terrain, BoundingBox Box, Plane orientedlocalPlane)
    {
      // If terrain is used, scale down Z to make sure all points are inside the domain Zinter
      // is call divisionsZ for CylDomain which is an int instead of an Interval

      Plane worldXY = Plane.WorldXY;
      Transform xform = Transform.ChangeBasis(worldXY, orientedlocalPlane);
      var refBox = BoundingBox.Empty;
      BoundingBox bboxTerrain = terrain.GetBoundingBox(xform);

      double zDomain = Box.Min.Z;

      //BoundingBox bboxTerrain = terrain.GetBoundingBox(orientedlocalPlane);

      if (terrain.Faces.Count > 0)
      {
        if (bboxTerrain.Min.Z < zDomain)
        {
          zDomain = bboxTerrain.Min.Z;
        }
      }

      return zDomain;
    }

    public static double GetZMinTerrain(Mesh terrain, Box Box, Plane orientedlocalPlane)
    {
      // If terrain is used, scale down Z to make sure all points are inside the domain Zinter
      // is call divisionsZ for CylDomain which is an int instead of an Interval

      Plane worldXY = Plane.WorldXY;
      Transform xform = Transform.ChangeBasis(worldXY, orientedlocalPlane);
      var refBox = BoundingBox.Empty;
      BoundingBox bboxTerrain = terrain.GetBoundingBox(xform);

      double zDomain = Box.Z.Min;

      //BoundingBox bboxTerrain = terrain.GetBoundingBox(orientedlocalPlane);

      if (terrain.Faces.Count > 0)
      {
        if (bboxTerrain.Min.Z < zDomain)
        {
          zDomain = bboxTerrain.Min.Z;
        }
      }

      return zDomain;
    }

    public static Box UnionB(List<Mesh> list, Plane pl)
    {
      Transform val = Transform.ChangeBasis(Plane.WorldXY, pl);

      Point3d val3;
      Point3d val4;
      Interval val5 = default(Interval);
      Point3d val7;
      Point3d val8;
      Interval val9 = default(Interval);
      Point3d val11;
      Point3d val12;
      Interval val13 = default(Interval);

      List<Box> list2 = new List<Box>();
      List<Box> list3 = new List<Box>();
      int num2 = list.Count - 1;
      Box item = default(Box);
      Box item2 = default(Box);
      for (int j = 0; j <= num2; j++)
      {
        if (list[j] == null)
        {
          list2.Add(Box.Unset);
          list3.Add(Box.Unset);
          continue;
        }
        BoundingBox boundingBox2 = list[j].GetBoundingBox(val);
        Plane val15 = pl;
        val12 = boundingBox2.Min;
        double x2 = ((Point3d) (val12)).X;
        val11 = ((BoundingBox) (boundingBox2)).Max;
        val13 = new Interval(x2, ((Point3d) (val11)).X);
        Interval val16 = val13;
        val8 = ((BoundingBox) (boundingBox2)).Min;
        double y2 = ((Point3d) (val8)).Y;
        val7 = ((BoundingBox) (boundingBox2)).Max;
        val9 = new Interval(y2, val7.Y);
        Interval val17 = val9;
        val4 = ((BoundingBox) (boundingBox2)).Min;
        double z2 = ((Point3d) (val4)).Z;
        val3 = ((BoundingBox) (boundingBox2)).Max;
        val5 = new Interval(z2, ((Point3d) (val3)).Z);
        item = new Box(val15, val16, val17, val5);
        list2.Add(item);
        item2 = new Box(boundingBox2);
        list3.Add(item2);
      }

      return item;
    }

    public static double GetProjectedBuildingArea(int windDir, Mesh buildings, out Bitmap FrontageImage)
    {
      // Spacing in meters between rays
      //Todo: checked this number how correct it is
      double spacing = 10;

      Vector3d windDirVec = Dir2Vec(windDir);

      var up = Vector3d.ZAxis;
      var forward = windDirVec;
      forward.Unitize();
      var right = Vector3d.CrossProduct(forward, up);
      right.Unitize();

      var CenterGround = buildings.GetBoundingBox(true).Center + 0.5 * -Vector3d.ZAxis * (buildings.GetBoundingBox(true).Max.Z - buildings.GetBoundingBox(true).Min.Z);

      BoundingBox empty = BoundingBox.Empty;
      BoundingBox boundingBox = buildings.GetBoundingBox(true);
      empty.Union(boundingBox);

      //var startPoint = new Point3d(empty.Min.X, empty.Min.Y, empty.Min.Z);

      Plane local = new Plane(CenterGround, right, forward);

      var BBox = empty;

      var xMin = BBox.Min.X;
      var xMax = BBox.Max.X;
      var yMin = BBox.Min.Y;
      var yMax = BBox.Max.Y;
      var zMin = BBox.Min.Z;
      var zMax = BBox.Max.Z;

      var dimX = xMax - xMin;

      //var dimY = yMax - yMin;
      //var dimZ = zMax - zMin;

      Interval intervalX = new Interval(empty.Min.X, empty.Max.X);
      Interval intervalZ = new Interval(empty.Min.Z, empty.Max.Z);

      // condition ? consequent : alternative

      int x = (int) Math.Round(intervalX.Length / spacing) == 0 ? 1 : (int) Math.Round(intervalX.Length / spacing);
      int z = (int) Math.Round(intervalZ.Length / spacing) == 0 ? 1 : (int) Math.Round(intervalZ.Length / spacing);

      if (x > 5000 || z > 5000)
      {
        new System.ArgumentException("Simulation domain either too large or too far from the origin.");
      }

      double incrX = intervalX.Length / x;
      double incrZ = intervalZ.Length / z;
      double raylen = 9999;

      List<Point3d> points = new List<Point3d>();
      List<Ray3d> rays = new List<Ray3d>();

      //testVecs = new List<Vector3d>();

      List<bool> hits = new List<bool>();
      int hitcount = 0;

      using (var FI = new Bitmap(x, z))

      {
        for (int zz = 0; zz < z; zz++)
        {
          for (int xx = 0; xx < x; xx++)
          {
            var centerZ = (0.5 * incrZ);
            var centerX = (0.5 * incrX);

            var pt = local.PointAt(centerX + xx * incrX - 0.5 * dimX, -50, centerZ + zz * incrZ);

            points.Add(pt);

            var ray = new Ray3d(pt, local.YAxis * raylen);
            var vec = new Vector3d(local.YAxis * raylen);

            rays.Add(ray);

            //testVecs.Add(vec);

            double d = Rhino.Geometry.Intersect.Intersection.MeshRay(buildings, ray);
            if (d > 0)
            {
              hitcount++;
              hits.Add(true);

              FI.SetPixel(xx, zz, Color.Black);
            }
            else
            {
              hits.Add(false);
              FI.SetPixel(xx, zz, Color.White);
            }
          }
        }

        FrontageImage = FI;

        //Needs to be rotated and flipped to represend the view from the wind direction
        FrontageImage.RotateFlip(RotateFlipType.Rotate180FlipX);
      }

      return incrX * incrZ * hitcount;
    }

    public static double GetProjectedBuildingArea(int windDir, Mesh buildings, out Bitmap FrontageImage, out List<Vector3d> testVecs)
    {
      // Spacing in meters between rays
      double spacing = 2;

      Vector3d windDirVec = Dir2Vec(windDir);

      var up = Vector3d.ZAxis;
      var forward = windDirVec;
      forward.Unitize();
      var right = Vector3d.CrossProduct(forward, up);
      right.Unitize();

      var CenterGround = buildings.GetBoundingBox(true).Center + 0.5 * -Vector3d.ZAxis * (buildings.GetBoundingBox(true).Max.Z - buildings.GetBoundingBox(true).Min.Z);

      BoundingBox empty = BoundingBox.Empty;
      BoundingBox boundingBox = buildings.GetBoundingBox(true);
      empty.Union(boundingBox);

      //var startPoint = new Point3d(empty.Min.X, empty.Min.Y, empty.Min.Z);

      Plane local = new Plane(CenterGround, right, forward);

      var BBox = empty;

      var xMin = BBox.Min.X;
      var xMax = BBox.Max.X;
      var yMin = BBox.Min.Y;
      var yMax = BBox.Max.Y;
      var zMin = BBox.Min.Z;
      var zMax = BBox.Max.Z;

      var dimX = xMax - xMin;
      var dimY = yMax - yMin;
      var dimZ = zMax - zMin;

      Interval intervalX = new Interval(empty.Min.X, empty.Max.X);

      //Interval intervalY = new Interval(empty.Min.Y, empty.Max.Y);
      Interval intervalZ = new Interval(empty.Min.Z, empty.Max.Z);

      int x = (int) Math.Round(intervalX.Length / spacing);
      int z = (int) Math.Round(intervalZ.Length / spacing);

      double incrX = intervalX.Length / x;
      double incrZ = intervalZ.Length / z;
      double raylen = 9999;

      List<Point3d> points = new List<Point3d>();
      List<Ray3d> rays = new List<Ray3d>();
      testVecs = new List<Vector3d>();

      List<bool> hits = new List<bool>();
      int hitcount = 0;

      using (var FI = new Bitmap(x, z))

      {
        for (int zz = 0; zz < z; zz++)
        {
          for (int xx = 0; xx < x; xx++)
          {
            //var pt = local.PointAt((0.5 * incrX) + xx * incrX, -0.1, (0.5 * incrZ) + zz * incrZ);
            var centerZ = (0.5 * incrZ);
            var centerX = (0.5 * incrX);

            var pt = local.PointAt(centerX + xx * incrX - 0.5 * dimX, -50, centerZ + zz * incrZ);

            points.Add(pt);

            var ray = new Ray3d(pt, local.YAxis * raylen);
            var vec = new Vector3d(local.YAxis * raylen);

            rays.Add(ray);
            testVecs.Add(vec);

            double d = Rhino.Geometry.Intersect.Intersection.MeshRay(buildings, ray);
            if (d > 0)
            {
              hitcount++;
              hits.Add(true);

              FI.SetPixel(xx, zz, Color.Black);
            }
            else
            {
              hits.Add(false);
              FI.SetPixel(xx, zz, Color.White);
            }
          }
        }

        FrontageImage = FI;

        //Needs to be rotated and flipped to represend the view from the wind direction
        FrontageImage.RotateFlip(RotateFlipType.Rotate180FlipX);
      }

      return incrX * incrZ * hitcount;
    }
  }
  public static Vector3d Dir2Vec(double d)
  {
    return new Vector3d(-1 * Math.Sin(d * Math.PI / 180), -1 * Math.Cos(d * Math.PI / 180), 0);
  }
  public static Mesh ConvertToQuads(Mesh m)
  {
    if (m.Faces.Count > 0)
    {
      m.Faces.ConvertTrianglesToQuads(Math.PI / 90, .875);
    }

    return m;
  }
  
  public   double RequiredInletArea(double FrontageFacadeArea)
  {
    // Required area for 3 % blocking ratio
    return 100 / 3 * (FrontageFacadeArea);
  }
# ---------- end c_script ----------
geo_3 = Geometry(c_script.B)
debrep = DeconstructBrep(Brep=geo_3)  # -> Faces, Edges, Vertices
cluster = Cluster_2(data=debrep.Vertices)  # -> am, am_2
cluster_2 = Cluster(G=geo_2, C=geo_2, d=number_slider)
debrep_2 = DeconstructBrep(Brep=cluster_2)  # -> Faces, Edges, Vertices
geo_4 = Geometry(cluster.am)
geo_5 = Geometry(cluster.am_2)
domainbox = BoxShapedDomain(Geometry=geo_2, BoundaryCondition=abl_flow, BlockSize=20)  # -> Domain, Mesh; disabled
cluster_3 = Cluster_3(data=debrep_2.Vertices)  # -> am, am_2
geo_6 = Geometry(cluster_3.am_2)
geo_7 = Geometry(cluster_3.am)
dist = Distance(PointA=geo_7, PointB=geo_4)
dist_2 = Distance(PointA=geo_6, PointB=geo_5)
panel = Panel(dist_2)
panel_2 = Panel(dist)
height = Height(relay=debrep_2.Vertices)
panel_3 = Panel(height)
division = Division(A=panel_2, B=panel_3)
division_2 = Division(A=panel, B=panel_3)
round = Round(Number=division)  # -> Nearest, Floor, Ceiling
round_2 = Round(Number=division_2)  # -> Nearest, Floor, Ceiling
panel_4 = Panel(round.Nearest)
panel_5 = Panel(round_2.Nearest)

# ==== cluster Cluster
C = ClusterInput()
G = ClusterInput()
d = ClusterInput()
area = Area(Geometry=G)  # -> Area, Centroid
c_script = CSharpScript(d=d)  # -> out, A; inputs d: Double
# ---------- c_script: C# ----------
 A= new Vector3d(-1 * Math.Sin(d * Math.PI / 180), -1 * Math.Cos(d * Math.PI / 180), 0);
# ---------- end c_script ----------
pl = PlaneNormal(Origin=area.Centroid, ZAxis=c_script.A)
bbox = BoundingBox(Content=C, Plane=pl, UnionBox=True)  # -> Box, Box_2
B = ClusterOutput(bbox.Box)

# ==== cluster Cluster_2
data = ClusterInput()
data_2 = Data(data)
item = ListItem(List=data_2, Index=Slider(1, range=0..10), Wrap=True)
item_2 = ListItem(List=data_2, Index=Slider(0, range=0..10), Wrap=True)
item_3 = ListItem(List=data_2, Index=Slider(3, range=0..10), Wrap=True)
item_4 = ListItem(List=data_2, Index=Slider(2, range=0..10), Wrap=True)
avr = Average(Input=[item_2, item])
avr_2 = Average(Input=[item_3, item_4])
am = ClusterOutput(avr)
am_2 = ClusterOutput(avr_2)

# ==== cluster Cluster_3
data = ClusterInput()
data_2 = Data(data)
item = ListItem(List=data_2, Index=Slider(1, range=0..10), Wrap=True)
item_2 = ListItem(List=data_2, Index=Slider(0, range=0..10), Wrap=True)
item_3 = ListItem(List=data_2, Index=Slider(4, range=0..10), Wrap=True)
item_4 = ListItem(List=data_2, Index=Slider(5, range=0..10), Wrap=True)
avr = Average(Input=[item_2, item])
avr_2 = Average(Input=[item_3, item_4])
am = ClusterOutput(avr)
am_2 = ClusterOutput(avr_2)

# ==== cluster Height
relay = ClusterInput()
pdecon = Deconstruct(Point=relay)  # -> XComponent, YComponent, ZComponent
python = GhPythonScript(x=pdecon.ZComponent)  # -> out, a; inputs x: list
# ---------- python: Python ----------
__author__ = "pkastner"
__version__ = "2022.02.18"

import rhinoscriptsyntax as rs

a = max(x)
# ---------- end python ----------
a = ClusterOutput(python.a)
