# Grasshopper definition WriteProbesBinary.gh (Grasshopper 1.0.7)

panel = Panel("C:\Eddy3D-Cases\4_AnnualWindAnalysis\postProcessing\180_ttt_total(p)_coeff.bin")
panel_2 = Panel("5345239")
panel_3 = Panel("C:\Eddy3D-Cases\4_AnnualWindAnalysis\postProcessing\0_ttt_U.bin")
random = Random(Range=Domain(0, 1), Number=Slider(64215, range=0..100000), Seed=2)
scalars = Data(random)
vectors = Data([Vector(-0.21894431, -0.83682152, -0.0012242044), Vector(-0.20873081, -0.81733104, 0.0041043576), Vector(-0.19734577, -0.81864068, 0.0058977115), Vector(-0.17545902, -0.80483783, 0.0060361008), Vector(-0.15116654, -0.809466, 0.0042398597), Vector(-0.12207071, -0.80679375, 0.00090724877)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])
c_script = CSharpScript(path="C:\Eddy3D-Cases\4_AnnualWindAnalysis\0_ttt_scalar.bin")  # -> out, A; inputs path: String
# ---------- c_script: C# usings ----------
using System.Diagnostics;
using System.Globalization;
using System.IO;
using System.Linq;
using System.Text;
# ---------- c_script: C# ----------
    A = loadBinScalars(path);
# ---------- c_script: C# additional code ----------
  public static double[] loadBinScalars(string filename) //, out int iDim, out int jDim)
  {
    // [i, time j] points

    double[] data;

    //   int numberOfWindDirs;

    //reading from the file
    // 1.
    using (BinaryReader b = new BinaryReader(
        File.Open(filename, FileMode.Open)))
    {
      // 2. Position and length variables.
      int pos = 0;

      // 2A. Use BaseStream.
      int length = (int) b.BaseStream.Length;

      int iDim = b.ReadInt32();

      data = new double[iDim];
      pos += sizeof(int);


      int i = 0;

      while (pos < length)
      {
        float x = b.ReadSingle();
        data[i] = (x);

        pos += sizeof(float);



        i++;
      }
    }

    return data;
  }
# ---------- end c_script ----------
c_script_2 = CSharpScript(path="C:\Eddy3D-Cases\4_AnnualWindAnalysis\0_ttt_scalar.bin", values=scalars)  # -> out, A; inputs path: String, values: list of Double
# ---------- c_script_2: C# ----------
    var scals = new double[values.Count];

    for (int i = 0; i < values.Count; i++){

      scals[i] = values[i];
    }

    A = scals;
    writeBinScalars(path, scals);
# ---------- c_script_2: C# additional code ----------
  public static void writeBinScalars(string fileName, double[] values)
  {


    BinaryWriter bw;

    //create the file
    try
    {
      bw = new BinaryWriter(new FileStream(fileName, FileMode.Create));
    }
    catch (IOException e)
    {
      Console.WriteLine(e.Message + "\n Cannot create file.");
      return;
    }

    //writing into the file
    try
    {
      // Write array dimensions
      bw.Write((Int32) values.GetLength(0));
      // bw.Write((Int32) values.GetLength(1));

      // Write wind directions
      /*  bw.Write(windDirs.Length);
      for (int w = 0; w < windDirs.Length; w++)
      {
      int dir = windDirs[w];
      bw.Write(dir);
      }*/

      for (int i = 0; i < values.GetLength(0); i++)
      {
        //  for (int j = 0; j < values.GetLength(1); j++)
        //  {
        float val = (float) values[i];


        bw.Write(val);

        // }
      }
    }
    catch (IOException e)
    {
      Console.WriteLine(e.Message + "\n Cannot write to file.");
      return;
    }
    bw.Close();
  }
# ---------- end c_script_2 ----------
c_script_3 = CSharpScript(path="C:\Eddy3D-Cases\4_AnnualWindAnalysis\0_ttt.bin", values=vectors)  # -> out, A; inputs path: String, values: list of Vector3d
# ---------- c_script_3: C# ----------
   
    var vecs = new Vector3d[values.Count];
    
    for (int i = 0; i < values.Count; i++){
      
      vecs[i] = values[i]; 
    }
   
    A = vecs;
    writeBinVectors(path, vecs);
# ---------- c_script_3: C# additional code ----------
  public static void writeBinVectors(string fileName, Vector3d[] values)
  {
  

    BinaryWriter bw;

    //create the file
    try
    {
      bw = new BinaryWriter(new FileStream(fileName, FileMode.Create));
    }
    catch (IOException e)
    {
      Console.WriteLine(e.Message + "\n Cannot create file.");
      return;
    }

    //writing into the file
    try
    {
      // Write array dimensions
      bw.Write((Int32) values.GetLength(0));
     // bw.Write((Int32) values.GetLength(1));

      // Write wind directions
    /*  bw.Write(windDirs.Length);
      for (int w = 0; w < windDirs.Length; w++)
      {
        int dir = windDirs[w];
        bw.Write(dir);
      }*/

      for (int i = 0; i < values.GetLength(0); i++)
      {
      //  for (int j = 0; j < values.GetLength(1); j++)
      //  {
          float fvalX = (float) values[i].X;
          float fvalY = (float) values[i].Y;
          float fvalZ = (float) values[i].Z;

          bw.Write(fvalX);
          bw.Write(fvalY);
          bw.Write(fvalZ);
       // }
      }
    }
    catch (IOException e)
    {
      Console.WriteLine(e.Message + "\n Cannot write to file.");
      return;
    }
    bw.Close();
  }
# ---------- end c_script_3 ----------
c_script_4 = CSharpScript(path=panel_3)  # -> out, A; inputs path: String
# ---------- c_script_4: C# ----------
    A = loadBinDVectors(path);
# ---------- c_script_4: C# additional code ----------
  public static Vector3d[] loadBinDVectors(string filename) //, out int iDim, out int jDim)
  {
    // [i, time j] points

    Vector3d[] data;

    //   int numberOfWindDirs;

    //reading from the file
    // 1.
    using (BinaryReader b = new BinaryReader(
        File.Open(filename, FileMode.Open)))
    {
      // 2. Position and length variables.
      int pos = 0;

      // 2A. Use BaseStream.
      int length = (int) b.BaseStream.Length;

      int iDim = b.ReadInt32();

      data = new Vector3d[iDim];
      pos += sizeof(int);


      int i = 0;

      while (pos < length)
      {
        float x = b.ReadSingle();
        data[i].X = (x);

        float y = b.ReadSingle();
        data[i].Y = (y);

        float z = b.ReadSingle();
        data[i].Z = (z);

        pos += sizeof(float);
        pos += sizeof(float);
        pos += sizeof(float);


        i++;
      }
    }

    return data;
  }
# ---------- end c_script_4 ----------
panel_4 = Panel(c_script_4.A)
panel_5 = Panel(c_script.A)
button = Button()
button_2 = Button()
