# Grasshopper definition testingEddyRadSim_v2_PK.gh (Grasshopper 1.0.7)
# plug-ins: ClimateStudioGH, Eddy3D

panel = Panel("""void plastic PlasterFloor_70
0
0
5 0.7 0.7 0.7 0 0 """)
treeset = TreeSettings()
surfset = SurfaceSettings(
    Name="BADABUM",
    Thickness=0.1,
    Conductivity=2.3,
    Density=2400,
    SpecificHeat=840,
    ThermalAbsorptance=0.9,
    SolarAbsorptance=0.7,
    VisibleAbsorptance=0.7,
    Surface=panel)
vegset = VegetationSettings(Name="bla", HeightPlants=0.5, LeafAreaIndex=5, LeafReflectivity=0.2, LeafEmissivity=0.95, MinimumStomatalResistance=180)
panel_2 = Panel(surfset)
panel_3 = Panel(vegset)
brep = Brep([<brep referenced from the Rhino model> x6])
brep_2 = Brep(<brep referenced from the Rhino model>)
brep_3 = Brep(<brep referenced from the Rhino model>)
brep_4 = Brep(<brep referenced from the Rhino model>)
custom_mesh_settings = SettingsCustom(
    StitchSeams=True,
    SimplePlanes=False,
    Refine=True,
    MinCount=16,
    MaxCount=400,
    AspectRatio=20,
    MaxDistance=0,
    MaxAngle=20,
    MinEdge="10",
    MaxEdge="10")
t_leaf_2018 = Number([-17.14444, -17.14444, -17.62523, -17.63942, -17.63942, -18.23187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])
brep_5 = Brep(<brep referenced from the Rhino model>)
radsurf = RadiationSurface(Brep=brep, Patch="5", Settings=surfset, SimType=0)
ground = GroundSurface(Brep=brep_2, Patch="5", SimType=1)  # disabled
tree = Tree(Brep=brep_3, Patch=3, Settings=treeset, SimType=2, Temp=t_leaf_2018)
vegsurf = VegetationSurface(Brep=[brep_4, brep_2], Patch="5", Material=vegset, SimType=0)
mesh = MeshBrep(Brep=brep_5, Settings=custom_mesh_settings)
uniform_flow = UniformFlow(ReferenceVelocity_m_s=5, SurfaceRoughnessHeight_m=1)

# ----
# 1. Geometry &
# Boundary Conditions
abl = ABL(WDir=Slider(24, range=0..100), Uref=5, Zref=10, Z0=1, ZGround=0)

sen = Sensor(Point=Point(0, 0, 0), Normal=Vector(0, 0, 1))
geo = Geometry([brep, brep_2, brep_3, brep_4])
set = Settings(
    ComputeReflectionsAndDiffuseRadiation=Toggle(False),
    CummulativeViewFactorCutoff=" 0.01",
    ComputeSurfaceTemperatureEnergyPlus=Toggle(False),
    ComputeLongWaveExchangeEnergyPlus=False)
panel_4 = Panel(set)

# ----
# 2. Simulation Domain
domainbox = BoxShapedDomain(Geometry=geo, BoundaryCondition=uniform_flow, BlockSize=20)  # -> Domain, Mesh

mrt = MRTSystem(
    Name="MyStudy",
    Dir="C:\Temp\Eddy3d",
    Weather="C:\Eddy3D\Weather\USA_NY_New.York-LaGuardia.AP.725030_TMY3.epw",
    RSurf=[radsurf, ground, tree, vegsurf],
    Sensors=[mesh, sen],
    Settings=set,
    Run=Button())  # -> System, Result, Settings
lrad = LoadRadiation(Path=mrt.Result, Load=Toggle(True))  # -> Result, Probes, Polys

# ----
# 4. Probing points & probing
number_slider = Slider(5, range=1..30)
brep_6 = Brep(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)
mjoin = MeshJoin(Meshes=geo)
brep_7 = Brep(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)
button = Button()

panel_5 = Panel("10")
panel_6 = Panel("6")
cluster = Cluster_4(bm=mjoin, brep=brep_7, number=number_slider)
sen_2 = Sensor(Point=cluster, Normal=Vector(0, 0, 1))
hoy = HourOfYear(Month=Slider(2, range=0..12), Day=1, Hour=Slider(17, range=0..24))
insen = InspectSensor(Sensor=lrad.Probes, Metric=1, Hour=hoy)  # -> Point, Data

c_script = CSharpScript(x=lrad.Result, si="0", Reference="C:\EDDY3D\EddyLib.dll")  # -> out, A, B; inputs si: Int32
# ---------- c_script: C# usings ----------
using EddyLib.Radiation;
# ---------- c_script: C# ----------
    MRT_Simulation_ResultProto res = (MRT_Simulation_ResultProto) x;

    var list = new List<float> ();

    list.AddRange(res.Probes[res.Probes.Count - 1].SolarGain_dMRT);


    A = list;
    B = res.Probes[res.Probes.Count - 1].Point.Value;
# ---------- end c_script ----------
gradient = GetCSGradient(Steps=0, UnitSystem=4)
bnd = Bounds(Numbers=c_script.A)
falsecolor = ConstructCSFalsecolor(GradientS=gradient, DomainS=bnd, UnitSystem=4)
plothr = CSPlotHourlyData(
    Data=c_script.A,
    Falsecolor=falsecolor,
    Input_0_Hidden=False,
    Input_0_Name="Data",
    Input_1_Hidden=False,
    Input_1_Name="Falsecolor",
    Input_2_Hidden=False,
    Input_2_Name="File Path",
    UnitSystem=4)

# ----
# comparing DDS simulation to weather file total horizontal radiation
weather = Weather(
    Location="USA_NY_New.York-LaGuardia.AP.725030_TMY3",
    Input_0_Hidden=False,
    Input_0_Name="Location",
    Output_0_Hidden=False,
    Output_0_Name="Location",
    Output_10_Hidden=False,
    Output_10_Name="DiffuseHorizontalRadiation",
    Output_11_Hidden=False,
    Output_11_Name="GlobalHorizontalRadiation",
    Output_12_Hidden=True,
    Output_12_Name="SkyCover",
    Output_13_Hidden=True,
    Output_13_Name="Precipitation",
    Output_14_Hidden=True,
    Output_14_Name="Elev",
    Output_15_Hidden=True,
    Output_15_Name="Azimuth",
    Output_16_Hidden=True,
    Output_16_Name="Vector",
    Output_17_Hidden=True,
    Output_17_Name="Illuminance",
    Output_18_Hidden=True,
    Output_18_Name="DateTime",
    Output_19_Hidden=True,
    Output_19_Name="DryBulbAverages",
    Output_1_Hidden=True,
    Output_1_Name="Latitude",
    Output_20_Hidden=True,
    Output_20_Name="DewPointAverages",
    Output_21_Hidden=True,
    Output_21_Name="DryBulbMinima"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)  # -> Location, DryBulbTemp, RelativeHumidity, DirectNormalRadiation, DiffuseHorizontalRadiation, GlobalHorizontalRadiation
c_script_2 = CSharpScript(x=lrad.Result, si="51", Reference="C:\Eddy3D\EddyLib.dll")  # -> out, A, B; inputs si: Int32
# ---------- c_script_2: C# ----------
    MRT_Simulation_ResultProto res = (MRT_Simulation_ResultProto) x;

    var list = new List<float> ();
    list.AddRange(res.Probes[si].TotalRad);

    A = list;
    B = res.Probes[si].Point.Value;
# ---------- end c_script_2 ----------
entwine = Entwine(Branch00=weather.GlobalHorizontalRadiation, Branch01=c_script_2.A, Branch02=c_script.A, FlattenInputs=True)
panel_7 = Panel("""WeatherData
Simulation
SolarGain_dMRT""")
cluster_2 = Cluster_2(doy=Slider(58, range=1..365))
subset = SubList(List=entwine, Domain=cluster_2, Wrap=True)  # -> List, Index
cluster_3 = Cluster(L=panel_7)  # -> C, R
xyplot = XYPlot(
    Type=0,
    Width=550,
    Height=450,
    Title="Radiation [W/m2]",
    X_rot=0,
    Y_data=subset.List,
    Colors=cluster_3.C,
    Names=panel_7,
    Show_xgrid=False,
    Show_ygrid=True,
    Legend=0)

bnd_2 = Bounds(Numbers=insen.Data)
inspectprobe = CSharpScript(x=lrad.Probes, si="0", Reference="C:\EDDY3D\EddyLib.dll")  # -> out, A, B, C; inputs x: list, si: Int32
# ---------- inspectprobe: C# usings ----------
using EddyLib.Radiation;
using System.Linq;
# ---------- inspectprobe: C# ----------
    EddyLib.Radiation.RProbe res = (EddyLib.Radiation.RProbe) x[si];

    var keylist = new List<string> ();

    var list = new List<double> ();

    list.AddRange(res.VFtoMaterial.Values.ToList());

    keylist.AddRange(res.VFtoMaterial.Keys.ToList());

    A = res.Point.Value;
    B = keylist;
    C = list;
# ---------- end inspectprobe ----------
dedomain = DeconstructDomain(Domain=bnd_2)  # -> Start, End
panel_8 = Panel([inspectprobe.B, inspectprobe.C])
gradient_2 = Gradient(
    LowerLimit=dedomain.Start,
    UpperLimit=dedomain.End,
    Parameter=insen.Data,
    stops=[0: RGB(0, 0, 255), 0.5: RGB(255, 255, 0), 1: RGB(255, 0, 0)])
panel_9 = Panel(bnd_2)
python = GhPythonScript()
python_2 = GhPythonScript(Season=python)
preview = CustomPreview(Geometry=insen.Point, Material=gradient_2)
date = ConstructDate(Year=2021, Month=3, Day=19, Hour=12, Minute=0, Second=0)
date_2 = ConstructDate(Year=2021, Month=3, Day=Slider(4, range=0..10), Hour=12, Minute=0, Second=0)
td = TD(F=date_2, T=date)
td_2 = TD(F=date_2, T=date)
td_3 = TD()
panel_10 = Panel(td)
as = AS(TD=td_2)
panel_11 = Panel(as)

# ----
# 3. Mesh & Simulation
panel_12 = Panel("1000")
rset = RunSettings(
    NumberOfIterations=panel_12,
    WriteInterval=20,
    NumberOfTimestepsToKeep=3,
    TurbulenceModel=1,
    RelaxationFactors=3,
    SolutionAndAlgorithmControl=0,
    PotentialFoamInitialization=False,
    AgeOfAir=False,
    NumberOfCPUs="-1",
    OperatingSystem=0)

mset = MeshSettings(AccBuilding=2, AccFeatures="3", AccBBox=0, AccGround="3", MiscSettings=1, NumberOfLayers=4, Mode=2)

simulation = Simulation(
    SimulationDomain=domainbox.Domain,
    WorkingDirectory="C:\temp\Eddy 3D\Wind",
    MeshSettings=mset,
    RunSettings=rset,
    RunMeshing=Button(),
    MakeTrees=False,
    RunSimulation=Button(),
    runWithBlueCFD=True)
residuals = Residuals(Result=simulation, X=":", Y=":", Version=1, Run=Button(), visResiduals=True)

wprobes = WProbes(Result=simulation, Sensors=sen_2, NameOfInstance="ttt")
wprobe = LoadWProbe(Path=wprobes, Load=Toggle(True))  # -> Result, Probes
comf = Comfort(MRTRes=lrad.Result, VRes=wprobe.Result, Run=Button())  # -> ComfSys, Result
lrad_2 = LoadRadiation(Path=comf.Result, Load=Toggle(True))  # -> Result, Probes, Polys

python_3 = GhPythonScript(x=lrad_2.Probes, y="0")  # -> out, a, b; inputs x: list, y: Int32
# ---------- python_3: Python ----------
__author__ = "pkastner"
__version__ = "2021.03.17"

import rhinoscriptsyntax as rs

a = x[y].UTCI
b = x[y].Point.Value
# ---------- end python_3 ----------
gradient_3 = GetCSGradient(Steps=0, UnitSystem=4)
dom = ConstructDomain(DomainStart="-40", DomainEnd="46")
swatch = ColourSwatch(SwatchColor=RGB(0, 0, 0))
falsecolor_2 = ConstructCSFalsecolor(GradientS=gradient_3, DomainS=dom, BelowColor=swatch, AboveColor=swatch, UnitSystem=4)
plothr_2 = CSPlotHourlyData(
    Data=python_3.a,
    Falsecolor=falsecolor_2,
    Input_0_Hidden=False,
    Input_0_Name="Data",
    Input_1_Hidden=False,
    Input_1_Name="Falsecolor",
    Input_2_Hidden=False,
    Input_2_Name="File Path",
    UnitSystem=4)

python_4 = GhPythonScript(x=wprobe.Result)  # -> out, flatten(a)
# ---------- python_4: Python ----------
__author__ = "pkastner"
__version__ = "2021.03.17"

import rhinoscriptsyntax as rs

a = x.U
# ---------- end python_4 ----------
c_script_3 = CSharpScript(x=python_3.a)  # -> out, A, B, C; inputs x: list of Double
# ---------- c_script_3: C# usings ----------
using System.Linq;
# ---------- c_script_3: C# ----------
    var date1 = new DateTime(2021, 6, 1, 3, 0, 0);
    var date2 = new DateTime(2021, 6, 3, 9, 0, 0);

    var date3 = new DateTime(2021, 9, 1, 11, 0, 0);
    var date4 = new DateTime(2021, 10, 3, 9, 0, 0);

    var diff1 = new TimeDiff(date2, date1);
    var diff2 = new TimeDiff(date4, date3);

    var TimeSpanList = new List<TimeDiff>(){diff1, diff2};

    var a = new AnalysisSystem(TimeSpanList);

    A = diff1.HOY;

    var hours = a.AnalysisHourBins;

    Grasshopper.DataTree<int> AS_Tree = new DataTree<int>();

    for (int i = 0; i < hours.GetLength(0); i++)
    {

      for (int j = 0; j < hours[i].GetLength(0); j++)
      {
        AS_Tree.Add(hours[i][j], new GH_Path(i));

      }
    }


    C = AS_Tree;
# ---------- c_script_3: C# additional code ----------
  public class TimeDiff{

    public TimeSpan TS {get;set;}
    public double HOY{get;set;}
    public DateTime BeginYear = new DateTime(2021, 1, 1, 1, 1, 1);

    public  TimeDiff(DateTime dt2, DateTime dt1){

      if (dt2 < dt1){
        var ts = dt1 - BeginYear;
        this.HOY = ts.TotalHours;
        this.TS = (dt1 - BeginYear) - (dt2 - BeginYear);

      }
      else{
        var ts = dt2 - BeginYear;
        this.HOY = ts.TotalHours;
        this.TS = (dt2 - BeginYear) - (dt1 - BeginYear);

      }




    }
  }

  public class AnalysisSystem{


    public int[][] AnalysisHourBins {get;set;}


    public  AnalysisSystem(List<TimeDiff> TimeSpans)
    {
      this.AnalysisHourBins = new int[TimeSpans.Count][];

      for (int i = 0; i < TimeSpans.Count;i++){

        var hoursInBin = (int) TimeSpans[i].TS.TotalHours;

        AnalysisHourBins[i] = new int[hoursInBin];


        for (int j = 0; j < hoursInBin ;j++){

          AnalysisHourBins[i][j] = (int) TimeSpans[i].HOY + j;


        }

      }

    }
  }
# ---------- end c_script_3 ----------
panel_13 = Panel(c_script_3.A)
panel_14 = Panel(c_script_3.C)

# ==== cluster Cluster
L = ClusterInput()
lng = ListLength(List=L)
series = Series(Start=0, Step=1, Count=lng)
gradient = Gradient(
    LowerLimit=0,
    UpperLimit=lng,
    Parameter=series,
    stops=[0: RGB(243, 57, 0), 0.1: RGB(236, 27, 60), 0.2: RGB(210, 0, 118), 0.3: RGB(103, 0, 120), 0.4: RGB(39, 72, 161), 0.5: RGB(1, 192, 229), 0.6: RGB(18, 178, 90), 0.7: RGB(79, 186, 8), 0.8: RGB(220, 237, 32), 0.9: RGB(247, 159, 20), 1: RGB(243, 57, 0)])
concat = Concatenate(FragmentA="Panel ", FragmentB=series)
C = ClusterOutput(gradient)
R = ClusterOutput(concat)

# ==== cluster Cluster_2
doy = ClusterInput()
md = MonthAndDay(DayOfYearIndex=doy)  # -> Month, Day
hoy = HourOfYear(Month=md.Month, Day=md.Day, Hour=1)
multiplication = Multiplication(A="24", B="7")
addition = Addition(A=hoy, B=multiplication)
dom = ConstructDomain(DomainStart=hoy, DomainEnd=addition)
I = ClusterOutput(dom)

# ==== cluster Cluster_4
brep = ClusterInput()
number = ClusterInput()
cluster = Cluster_3(brep=brep, number=number)
bm = ClusterInput()
probing = Probing(BuildingMesh=bm, GroundMesh=cluster, ConvertQuadsToTriangles=False)
demesh = DeconstructMesh(Mesh=probing)  # -> Vertices, Faces, Colours, Normals
V = ClusterOutput(demesh.Vertices)

# ==== cluster Cluster_3
number = ClusterInput()
number_2 = Number(number)
settings_custom = SettingsCustom(
    StitchSeams=True,
    SimplePlanes=False,
    Refine=True,
    MinCount=16,
    MaxCount=400,
    AspectRatio=20,
    MaxDistance=0,
    MaxAngle=20,
    MinEdge=number_2,
    MaxEdge=number_2)
brep = ClusterInput()
mesh_brep = MeshBrep(Brep=brep, Settings=settings_custom)
mesh = ClusterOutput(mesh_brep)
