# Grasshopper definition testingEddyRadSim_v4.gh (Grasshopper 1.0.7)
# plug-ins: ClimateStudioGH, Eddy3D

panel = Panel("""void plastic PlasterFloor_70
0
0
5 0.7 0.7 0.7 0 0 """)
treeset = TreeSettings()
surfset = SurfaceSettings(
    Name="BADABUM",
    Thickness=0.1,
    Conductivity=2.3,
    Density=2400,
    SpecificHeat=840,
    ThermalAbsorptance=0.9,
    SolarAbsorptance=0.7,
    VisibleAbsorptance=0.7,
    Surface=panel)
vegset = VegetationSettings(Name="bla", HeightPlants=0.5, LeafAreaIndex=5, LeafReflectivity=0.2, LeafEmissivity=0.95, MinimumStomatalResistance=180)
panel_2 = Panel(surfset)
panel_3 = Panel(vegset)

# ----
# Setup Probes
crv = Curve(<curve referenced from the Rhino model>)
qrsettings = QuadRemeshSettings(TargetCount="150", AdaptiveSize=0, AdaptiveCount=False, HardEdges=False, SeamEdges=0, Symmetry=0, GuideCurves=0)
brep = Brep(crv)
qrmesh = QuadRemesh(Mesh=brep, Settings=qrsettings)
mesh = Mesh(<mesh referenced from the Rhino model>)
volume = Volume(Geometry=mesh)  # -> Volume, Centroid
sen = Sensor(Mesh=qrmesh)
sen_2 = Sensor(Point=volume.Centroid, Normal=Vector(0, 0, 1), Mesh=mesh)
entwine = Entwine(Branch00=sen, Branch01=sen_2, FlattenInputs=True)  # -> flatten(Result)

# ----
# Setup Rad and Temperature Surfaces
brep_2 = Brep([<brep referenced from the Rhino model> x6])
brep_3 = Brep(<brep referenced from the Rhino model>)
brep_4 = Brep(<brep referenced from the Rhino model>)
brep_5 = Brep(<brep referenced from the Rhino model>)
t_leaf_2018 = Number([-17.14444, -17.14444, -17.62523, -17.63942, -17.63942, -18.23187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])
radsurf = RadiationSurface(Brep=brep_2, Patch="5", Settings=surfset, SimType=0)
ground = GroundSurface(Brep=brep_3, Patch="5", SimType=0)
tree = Tree(Brep=brep_4, Patch=3, Settings=treeset, SimType=2, Temp=t_leaf_2018)
vegsurf = VegetationSurface(Brep=brep_5, Patch="5", Material=vegset, SimType=0)
python = GhPythonScript(x=[radsurf, ground])  # -> out, a
# ---------- python: Python ----------
__author__ = "Timur"
__version__ = "2021.03.20"

import rhinoscriptsyntax as rs

a = x.HighPoly
# ---------- end python ----------

# ----
# Simulation Domain
panel_4 = Panel("""0
45
90
135
180
225
270
315""")
uniform_flow = UniformFlow(WindDirections=panel_4, ReferenceVelocity_m_s=5, SurfaceRoughnessHeight_m=1)
geo = Geometry([brep_2, brep_3, brep_4, brep_5])
domaincyl = CylindricalDomain(Geometry=geo, BoundaryCondition=uniform_flow, BlockSize=20, SizeOfOuterRadius=Slider(1000, range=0..1000))  # -> Domain, Mesh

set = Settings(
    ComputeReflectionsAndDiffuseRadiation=Toggle(False),
    CummulativeViewFactorCutoff=" 0.01",
    ComputeSurfaceTemperatureEnergyPlus=Toggle(False),
    ComputeLongWaveExchangeEnergyPlus=False)
panel_5 = Panel(set)
python_2 = GhPythonScript(x=entwine)  # -> out, simplify(a)
# ---------- python_2: Python ----------
__author__ = "pkastner"
__version__ = "2021.03.22"

import rhinoscriptsyntax as rs

a = x.Point
# ---------- end python_2 ----------
dir = Slider(1, range=0..7)
points = Data(python_2.a)

# ----
# Setting up different Analysis Bins
# 1. March-April
# 2. Winter
# 3. Spring Afternoons
number_slider = Slider(3, range=0..10)
date = ConstructDate(Year=2021, Month=Slider(4, range=0..10), Day=22, Hour=12, Minute=0, Second=0)
date_2 = ConstructDate(Year=2021, Month=number_slider, Day=22, Hour=12, Minute=0, Second=0)
abseason = AnalysisBinsSeason(Season=1)
abdaytime = AnalysisBinsDayTime(ABSeason=abseason, DayTime=3)
abseason_2 = AnalysisBinsSeason(Season=3)
abc = AnalysisBinsCustom(From=date_2, To=date)
as = AnalysisSystem(AnalysisBins=[abdaytime, abseason_2, abc])
panel_6 = Panel(as)

# ----
# Mesh & Simulation
panel_7 = Panel("C:\temp\Eddy3D\Wind")
rset = RunSettings(
    NumberOfIterations="100",
    WriteInterval=20,
    NumberOfTimestepsToKeep=3,
    TurbulenceModel=1,
    RelaxationFactors=3,
    SolutionAndAlgorithmControl=0,
    PotentialFoamInitialization=False,
    AgeOfAir=False,
    NumberOfCPUs="2",
    OperatingSystem=0)

mset = MeshSettings(AccBuilding=2, AccFeatures="3", AccBBox=0, AccGround="3", MiscSettings=1, NumberOfLayers=4, Mode=2)

simulation = Simulation(
    SimulationDomain=domaincyl.Domain,
    WorkingDirectory=panel_7,
    MeshSettings=mset,
    RunSettings=rset,
    RunMeshing=Button(),
    MakeTrees=False,
    RunSimulation=Button(),
    runWithBlueCFD=True)
residuals = Residuals(Result=simulation, X=":", Y=":", Version=1, Run=Button(), visResiduals=True)

# ----
# Probing points & probing
panel_8 = Panel("ttt")
wprobes = WProbes(Result=simulation, Sensors=entwine, NameOfInstance=panel_8, Run=Button())

loadwind = LoadWind(Path=wprobes, Load=Toggle(True))  # -> Result, Probes
mrt = MRTSystem(
    Dir="C:\Temp\Eddy3d",
    Weather="C:\Eddy3D\Weather\USA_NY_New.York-LaGuardia.AP.725030_TMY3.epw",
    RSurf=[radsurf, ground, tree, vegsurf],
    Sensors=entwine,
    Settings=set,
    CFDResult=wprobes,
    Run=Button())  # -> System, Result, Settings
lrad = LoadRadiation(Path=mrt.Result, Load=Toggle(True))  # -> Result, Probes, Polys
python_3 = GhPythonScript(x=lrad.Probes)  # -> out, simplify(a)
# ---------- python_3: Python ----------
__author__ = "pkastner"
__version__ = "2021.03.22"

import rhinoscriptsyntax as rs

a = x.WindSpeed[0]
# ---------- end python_3 ----------
vectors = Data(simplify(python_3.a))
vec = Vector(vectors)
choose_dir = TreeBranch(Tree=vec, Path=dir, MaintainPaths=True)
insen = InspectSensor(Sensor=lrad.Probes, Metric=0, Index=Slider(6, range=0..10), type="Hour")  # -> Point, Mesh, Data
cluster = Cluster_3(data=vec)  # -> S, E, data_3
panel_9 = Panel(insen.Data)
gradient = Gradient(
    LowerLimit=cluster.S,
    UpperLimit=cluster.E,
    Parameter=cluster.data_3,
    stops=[0.103: RGB(0, 0, 255), 0.22: RGB(0, 170, 255), 0.305: RGB(0, 255, 255), 0.398: RGB(0, 255, 188), 0.504: RGB(0, 255, 106), 0.605: RGB(91, 255, 0), 0.699: RGB(184, 255, 0), 0.799: RGB(255, 255, 0), 0.898: RGB(255, 170, 0)])
vdisex = VectorDisplayEx(Point=points, Vector=vec, Colour=gradient, Width=Slider(6, range=0..10))

# ----
# Explode VFs
panel_10 = Panel("0")
inspectprobe = CSharpScript(x=lrad.Probes, si=panel_10, Reference="C:\EDDY3D\EddyLib.dll")  # -> out, A, B, C; inputs x: list, si: Int32
# ---------- inspectprobe: C# usings ----------
using EddyLib.Radiation;
using System.Linq;
# ---------- inspectprobe: C# ----------
    EddyLib.Radiation.RProbe res = (EddyLib.Radiation.RProbe) x[si];

    var keylist = new List<string> ();

    var list = new List<double> ();

    list.AddRange(res.VFtoMaterial.Values.ToList());

    keylist.AddRange(res.VFtoMaterial.Keys.ToList());

    A = res.Point.Value;
    B = keylist;
    C = list;
# ---------- end inspectprobe ----------
panel_11 = Panel([inspectprobe.B, inspectprobe.C])

# ----
# Inpsect Probe Data [1 probe - full year]
panel_12 = Panel("0")
insen_2 = InspectSensor(Sensor=lrad.Probes, Metric=0, Index=panel_12, type="Sensor")  # -> Point, Mesh, Data
gradient_2 = GetCSGradient(Steps=0, UnitSystem=4)
dom = ConstructDomain(DomainStart="-40", DomainEnd="46")
swatch = ColourSwatch(SwatchColor=RGB(0, 0, 0))
falsecolor = ConstructCSFalsecolor(GradientS=gradient_2, DomainS=dom, BelowColor=swatch, AboveColor=swatch, UnitSystem=4)
plothr = CSPlotHourlyData(
    Data=insen_2.Data,
    Falsecolor=falsecolor,
    Input_0_Hidden=False,
    Input_0_Name="Data",
    Input_1_Hidden=False,
    Input_1_Name="Falsecolor",
    Input_2_Hidden=False,
    Input_2_Name="File Path",
    UnitSystem=4)

# ----
# Comparing DDS simulation to weather file total horizontal radiation
weather = Weather(
    Location="USA_NY_New.York-LaGuardia.AP.725030_TMY3",
    Input_0_Hidden=False,
    Input_0_Name="Location",
    Output_0_Hidden=False,
    Output_0_Name="Location",
    Output_10_Hidden=False,
    Output_10_Name="DiffuseHorizontalRadiation",
    Output_11_Hidden=False,
    Output_11_Name="GlobalHorizontalRadiation",
    Output_12_Hidden=True,
    Output_12_Name="SkyCover",
    Output_13_Hidden=True,
    Output_13_Name="Precipitation",
    Output_14_Hidden=True,
    Output_14_Name="Elev",
    Output_15_Hidden=True,
    Output_15_Name="Azimuth",
    Output_16_Hidden=True,
    Output_16_Name="Vector",
    Output_17_Hidden=True,
    Output_17_Name="Illuminance",
    Output_18_Hidden=True,
    Output_18_Name="DateTime",
    Output_19_Hidden=True,
    Output_19_Name="DryBulbAverages",
    Output_1_Hidden=True,
    Output_1_Name="Latitude",
    Output_20_Hidden=True,
    Output_20_Name="DewPointAverages",
    Output_21_Hidden=True,
    Output_21_Name="DryBulbMinima"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)  # -> Location, DryBulbTemp, RelativeHumidity, DirectNormalRadiation, DiffuseHorizontalRadiation, GlobalHorizontalRadiation
c_script = CSharpScript(x=lrad.Result, si="51", Reference="C:\Eddy3D\EddyLib.dll")  # -> out, A, B; inputs si: Int32
# ---------- c_script: C# usings ----------
using EddyLib.Radiation;
# ---------- c_script: C# ----------
    MRT_Simulation_ResultProto res = (MRT_Simulation_ResultProto) x;

    var list = new List<float> ();
    list.AddRange(res.Probes[si].TotalRad);

    A = list;
    B = res.Probes[si].Point.Value;
# ---------- end c_script ----------
entwine_2 = Entwine(Branch00=weather.GlobalHorizontalRadiation, Branch01=c_script.A, FlattenInputs=True)
panel_13 = Panel("""WeatherData
Simulation
SolarGain_dMRT""")
cluster_2 = Cluster_2(doy=Slider(105, range=1..365))
cluster_3 = Cluster(L=panel_13)  # -> C, R
subset = SubList(List=entwine_2, Domain=cluster_2, Wrap=True)  # -> List, Index
xyplot = XYPlot(
    Type=0,
    Width=550,
    Height=450,
    Title="Radiation [W/m2]",
    X_rot=0,
    Y_data=subset.List,
    Colors=cluster_3.C,
    Names=panel_13,
    Show_xgrid=False,
    Show_ygrid=True,
    Legend=0)

# ----
# Inpsect Probe Data [all probes - one hour]
number_slider_2 = Slider(5, range=0..12)

hoy = HourOfYear(M=number_slider_2, D=1, H=Slider(14, range=0..24))

insen_3 = InspectSensor(Sensor=lrad.Probes, Metric=6, Index=hoy, type="Hour")  # -> Point, Mesh, Data
bnd = Bounds(Numbers=insen_3.Data)
dedomain = DeconstructDomain(Domain=bnd)  # -> Start, End
gradient_3 = Gradient(
    LowerLimit=dedomain.Start,
    UpperLimit=dedomain.End,
    Parameter=insen_3.Data,
    stops=[0: RGB(0, 0, 255), 0.5: RGB(255, 255, 0), 1: RGB(255, 0, 0)])
panel_14 = Panel(bnd)
preview = CustomPreview(Geometry=insen_3.Mesh, Material=gradient_3)

# ----
# Inspect Surface Temperatures
number_slider_3 = Slider(4, range=0..12)

hoy_2 = HourOfYear(M=number_slider_3, D=1, H=Slider(16, range=0..24))

inpoly = InspectPolygon(Polygon=lrad.Polys, Metric=0, Index=hoy_2, type="Hour")  # -> Point, Mesh, Data
bnd_2 = Bounds(Numbers=inpoly.Data)
dedomain_2 = DeconstructDomain(Domain=bnd_2)  # -> Start, End
gradient_4 = Gradient(
    LowerLimit=dedomain_2.Start,
    UpperLimit=dedomain_2.End,
    Parameter=inpoly.Data,
    stops=[0: RGB(0, 0, 255), 0.5: RGB(255, 255, 0), 1: RGB(255, 0, 0)])
panel_15 = Panel(bnd_2)
tag = TextTag(Location=inpoly.Point, Text=inpoly.Data, Colour=gradient_4)
preview_2 = CustomPreview(Geometry=inpoly.Mesh, Material=gradient_4)

# ==== cluster Cluster
L = ClusterInput()
lng = ListLength(List=L)
series = Series(Start=0, Step=1, Count=lng)
gradient = Gradient(
    LowerLimit=0,
    UpperLimit=lng,
    Parameter=series,
    stops=[0: RGB(243, 57, 0), 0.1: RGB(236, 27, 60), 0.2: RGB(210, 0, 118), 0.3: RGB(103, 0, 120), 0.4: RGB(39, 72, 161), 0.5: RGB(1, 192, 229), 0.6: RGB(18, 178, 90), 0.7: RGB(79, 186, 8), 0.8: RGB(220, 237, 32), 0.9: RGB(247, 159, 20), 1: RGB(243, 57, 0)])
concat = Concatenate(FragmentA="Panel ", FragmentB=series)
C = ClusterOutput(gradient)
R = ClusterOutput(concat)

# ==== cluster Cluster_2
doy = ClusterInput()
md = MonthAndDay(DayOfYearIndex=doy)  # -> Month, Day
hoy = HourOfYear(Month=md.Month, Day=md.Day, Hour=1)
multiplication = Multiplication(A="24", B="7")
addition = Addition(A=hoy, B=multiplication)
dom = ConstructDomain(DomainStart=hoy, DomainEnd=addition)
I = ClusterOutput(dom)

# ==== cluster Cluster_3
data = ClusterInput()
data_2 = Data(data)
data_3 = ClusterOutput(data_2)
bnd = Bounds(Numbers=data_2)
dedomain = DeconstructDomain(Domain=bnd)  # -> Start, End
S = ClusterOutput(dedomain.Start)
E = ClusterOutput(dedomain.End)
