# Grasshopper definition testingEddyRadSim_v5.gh (Grasshopper 1.0.7)
# plug-ins: ClimateStudioGH, Eddy3D

panel = Panel("""void plastic PlasterFloor_70
0
0
5 0.7 0.7 0.7 0 0 """)
treeset = TreeSettings()
surfset = SurfaceSettings(
    Name="BADABUM",
    Thickness=0.1,
    Conductivity=2.3,
    Density=2400,
    SpecificHeat=840,
    ThermalAbsorptance=0.9,
    SolarAbsorptance=0.7,
    VisibleAbsorptance=0.7,
    Surface=panel)
vegset = VegetationSettings(Name="bla", HeightPlants=0.5, LeafAreaIndex=5, LeafReflectivity=0.2, LeafEmissivity=0.95, MinimumStomatalResistance=180)
panel_2 = Panel(surfset)
panel_3 = Panel(vegset)

# ----
# Setup Probes
crv = Curve(<curve referenced from the Rhino model>)
qrsettings = QuadRemeshSettings(TargetCount="150", AdaptiveSize=0, AdaptiveCount=False, HardEdges=False, SeamEdges=0, Symmetry=0, GuideCurves=0)
brep = Brep(crv)
qrmesh = QuadRemesh(Mesh=brep, Settings=qrsettings)
mesh = Mesh(<mesh referenced from the Rhino model>)
volume = Volume(Geometry=mesh)  # -> Volume, Centroid
sen = Sensor(Mesh=qrmesh)
sen_2 = Sensor(Point=volume.Centroid, Normal=Vector(0, 0, 1), Mesh=mesh)
entwine = Entwine(Branch00=sen_2, Branch01=sen, FlattenInputs=True)  # -> flatten(Result)

# ----
# Setup Rad and Temperature Surfaces
brep_2 = Brep([<brep referenced from the Rhino model> x6])
brep_3 = Brep(<brep referenced from the Rhino model>)
brep_4 = Brep(<brep referenced from the Rhino model>)
brep_5 = Brep(<brep referenced from the Rhino model>)
t_leaf_2018 = Number([-17.14444, -17.14444, -17.62523, -17.63942, -17.63942, -18.23187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])
radsurf = RadiationSurface(Brep=brep_2, Patch="5", Settings=surfset, SimType=0)
ground = GroundSurface(Brep=brep_3, Patch="5", SimType=0)
tree = Tree(Brep=brep_4, Patch=3, Settings=treeset, SimType=2, Temp=t_leaf_2018)
vegsurf = VegetationSurface(Brep=brep_5, Patch="5", Material=vegset, SimType=0)
python = GhPythonScript(x=[radsurf, ground])  # -> out, a
# ---------- python: Python ----------
__author__ = "Timur"
__version__ = "2021.03.20"

import rhinoscriptsyntax as rs

a = x.HighPoly
# ---------- end python ----------

# ----
# Simulation Domain
panel_4 = Panel("""0
45
90
135
180
225
270
315""")
uniform_flow = UniformFlow(WindDirections=panel_4, ReferenceVelocity_m_s=5, SurfaceRoughnessHeight_m=1)
geo = Geometry([brep_2, brep_3, brep_4, brep_5])
domaincyl = CylindricalDomain(Geometry=geo, BoundaryCondition=uniform_flow, BlockSize=20, SizeOfOuterRadius=Slider(1000, range=0..1000))  # -> Domain, Mesh

panel_5 = Panel("0.29")
set = Settings(
    ComputeReflectionsAndDiffuseRadiation=Toggle(False),
    CummulativeViewFactorCutoff=" 0.01",
    ComputeSurfaceTemperatureEnergyPlus=Toggle(False),
    ComputeLongWaveExchangeEnergyPlus=False,
    WindScaling=1)
panel_6 = Panel(set)
gradient = GetCSGradient(Steps=0, UnitSystem=4)
dom = ConstructDomain(DomainStart="-5", DomainEnd="5")
swatch = ColourSwatch(SwatchColor=RGB(0, 0, 0))
falsecolor = ConstructCSFalsecolor(GradientS=gradient, DomainS=dom, BelowColor=swatch, AboveColor=swatch, UnitSystem=4)

# ----
# Mesh & Simulation
panel_7 = Panel("C:\temp\Eddy3D\Wind")
rset = RunSettings(
    NumberOfIterations="100",
    WriteInterval=20,
    NumberOfTimestepsToKeep=3,
    TurbulenceModel=1,
    RelaxationFactors=3,
    SolutionAndAlgorithmControl=0,
    PotentialFoamInitialization=False,
    AgeOfAir=False,
    NumberOfCPUs="2",
    OperatingSystem=0)

mset = MeshSettings(AccBuilding=2, AccFeatures="3", AccBBox=0, AccGround="3", MiscSettings=1, NumberOfLayers=4, Mode=2)

simulation = Simulation(
    SimulationDomain=domaincyl.Domain,
    WorkingDirectory=panel_7,
    MeshSettings=mset,
    RunSettings=rset,
    RunMeshing=Button(),
    MakeTrees=False,
    RunSimulation=Button(),
    runWithBlueCFD=True)
residuals = Residuals(Result=simulation, X=":", Y=":", Version=1, Run=Button(), visResiduals=True)

# ----
# Probing points & probing
panel_8 = Panel("ttt")
wprobes = WProbes(Result=simulation, Sensors=entwine, NameOfInstance=panel_8, Run=Button())

mrt = MRTSystem(
    Dir="C:\Temp\Eddy3d",
    Weather="C:\Eddy3D\Weather\USA_NY_New.York-LaGuardia.AP.725030_TMY3.epw",
    RSurf=[radsurf, ground, tree, vegsurf],
    Sensors=entwine,
    Settings=set,
    CFDResult=wprobes,
    Run=Button())  # -> System, Result, Settings
lrad = LoadRadiation(Path=mrt.Result, Load=Toggle(True))  # -> Result, Probes, Polys

# ----
# Comparing DDS simulation to weather file total horizontal radiation
weather = Weather(
    Location="USA_NY_New.York-LaGuardia.AP.725030_TMY3",
    Input_0_Hidden=False,
    Input_0_Name="Location",
    Output_0_Hidden=False,
    Output_0_Name="Location",
    Output_10_Hidden=False,
    Output_10_Name="DiffuseHorizontalRadiation",
    Output_11_Hidden=False,
    Output_11_Name="GlobalHorizontalRadiation",
    Output_12_Hidden=True,
    Output_12_Name="SkyCover",
    Output_13_Hidden=True,
    Output_13_Name="Precipitation",
    Output_14_Hidden=True,
    Output_14_Name="Elev",
    Output_15_Hidden=True,
    Output_15_Name="Azimuth",
    Output_16_Hidden=True,
    Output_16_Name="Vector",
    Output_17_Hidden=True,
    Output_17_Name="Illuminance",
    Output_18_Hidden=True,
    Output_18_Name="DateTime",
    Output_19_Hidden=True,
    Output_19_Name="DryBulbAverages",
    Output_1_Hidden=True,
    Output_1_Name="Latitude",
    Output_20_Hidden=True,
    Output_20_Name="DewPointAverages",
    Output_21_Hidden=True,
    Output_21_Name="DryBulbMinima"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)  # -> Location, DryBulbTemp, RelativeHumidity, DirectNormalRadiation, DiffuseHorizontalRadiation, GlobalHorizontalRadiation
c_script = CSharpScript(x=lrad.Result, si="0", Reference="C:\Eddy3D\EddyLib.dll")  # -> out, A, B; inputs si: Int32
# ---------- c_script: C# usings ----------
using EddyLib.Radiation;
# ---------- c_script: C# ----------
    MRT_Simulation_ResultProto res = (MRT_Simulation_ResultProto) x;

    var list = new List<float> ();
    list.AddRange(res.Probes[si].TotalRad);

    A = list;
    B = res.Probes[si].Point.Value;
# ---------- end c_script ----------
entwine_2 = Entwine(Branch00=weather.GlobalHorizontalRadiation, Branch01=c_script.A, FlattenInputs=True)
panel_9 = Panel("""WeatherData
Simulation
SolarGain_dMRT""")
cluster = Cluster_2(doy=Slider(139, range=1..365))
cluster_2 = Cluster(L=panel_9)  # -> C, R
subset = SubList(List=entwine_2, Domain=cluster, Wrap=True)  # -> List, Index
xyplot = XYPlot(
    Type=0,
    Width=550,
    Height=450,
    Title="Radiation [W/m2]",
    X_rot=0,
    Y_data=subset.List,
    Colors=cluster_2.C,
    Names=panel_9,
    Show_xgrid=False,
    Show_ygrid=True,
    Legend=0)

# ----
# Explode VFs
panel_10 = Panel("0")
inspectprobe = CSharpScript(x=lrad.Probes, si=panel_10, Reference="C:\EDDY3D\EddyLib.dll")  # -> out, A, B, C; inputs x: list, si: Int32
# ---------- inspectprobe: C# usings ----------
using EddyLib.Radiation;
using System.Linq;
# ---------- inspectprobe: C# ----------
    EddyLib.Radiation.RProbe res = (EddyLib.Radiation.RProbe) x[si];

    var keylist = new List<string> ();

    var list = new List<double> ();

    list.AddRange(res.VFtoMaterial.Values.ToList());

    keylist.AddRange(res.VFtoMaterial.Keys.ToList());

    A = res.Point.Value;
    B = keylist;
    C = list;
# ---------- end inspectprobe ----------
panel_11 = Panel([inspectprobe.B, inspectprobe.C])

# ----
# Inpsect Probe Data [all probes - one hour]
number_slider = Slider(5, range=0..12)
hoy = HourOfYear(Month=number_slider, Day=1, Hour=Slider(14, range=0..24))
insen = InspectSensor(Sensor=lrad.Probes, Metric=6, Index=hoy, type="Hour")  # -> Point, Mesh, Data
bnd = Bounds(Numbers=insen.Data)
dedomain = DeconstructDomain(Domain=bnd)  # -> Start, End
gradient_2 = Gradient(
    LowerLimit=dedomain.Start,
    UpperLimit=dedomain.End,
    Parameter=insen.Data,
    stops=[0: RGB(0, 0, 255), 0.5: RGB(255, 255, 0), 1: RGB(255, 0, 0)])
panel_12 = Panel(bnd)
preview = CustomPreview(Geometry=insen.Mesh, Material=gradient_2)

# ----
# Inpsect Probe Data [1 probe - full year]
panel_13 = Panel("0")
insen_2 = InspectSensor(Sensor=lrad.Probes, Metric=0, Index=panel_13, type="Sensor")  # -> Point, Mesh, Data
dom_2 = ConstructDomain(DomainStart="-40", DomainEnd="46")
gradient_3 = GetCSGradient(Steps=0, UnitSystem=4)
falsecolor_2 = ConstructCSFalsecolor(
    GradientS=gradient_3,
    DomainS=dom_2,
    BelowColor=ColourSwatch(SwatchColor=RGB(255, 255, 255)),
    AboveColor=ColourSwatch(SwatchColor=RGB(0, 0, 0)),
    UnitSystem=4)
plothr = CSPlotHourlyData(
    Data=insen_2.Data,
    Falsecolor=falsecolor_2,
    Input_0_Hidden=False,
    Input_0_Name="Data",
    Input_1_Hidden=False,
    Input_1_Name="Falsecolor",
    Input_2_Hidden=False,
    Input_2_Name="File Path",
    UnitSystem=4)

# ----
# Inspect Surface Temperatures
number_slider_2 = Slider(4, range=0..12)
hoy_2 = HourOfYear(Month=number_slider_2, Day=1, Hour=Slider(16, range=0..24))
inpoly = InspectPolygon(Polygon=lrad.Polys, Metric=0, Index=hoy_2, type="Hour")  # -> Point, Mesh, Data
bnd_2 = Bounds(Numbers=inpoly.Data)
dedomain_2 = DeconstructDomain(Domain=bnd_2)  # -> Start, End
gradient_4 = Gradient(
    LowerLimit=dedomain_2.Start,
    UpperLimit=dedomain_2.End,
    Parameter=inpoly.Data,
    stops=[0: RGB(0, 0, 255), 0.5: RGB(255, 255, 0), 1: RGB(255, 0, 0)])
panel_14 = Panel(bnd_2)
tag = TextTag(Location=inpoly.Point, Text=inpoly.Data, Colour=gradient_4)
preview_2 = CustomPreview(Geometry=inpoly.Mesh, Material=gradient_4)

# ----
# UTCI Comfort Autonomy for selected hours
panel_15 = Panel("1")
utci = UTCIRating(UTCI=insen_2.Data)
abins = AnalysisBins(From=panel_15, To="365", Start="8", End="18")  # -> HOY, DateTime
item = ListItem(List=utci, Index=abins.HOY, Wrap=True)
python_2 = GhPythonScript(x=item)  # -> out, a
# ---------- python_2: Python ----------
__author__ = "Timur"
__version__ = "2021.03.31"

import rhinoscriptsyntax as rs

a = int (x<2 and x>-2)
# ---------- end python_2 ----------
lng = ListLength(List=item)
ma = MassAddition(Input=python_2.a)  # -> Result, PartialResults
division = Division(A=ma.Result, B=lng)
panel_16 = Panel(division)

plothr_2 = CSPlotHourlyData(
    Data=utci,
    Falsecolor=falsecolor,
    Input_0_Hidden=False,
    Input_0_Name="Data",
    Input_1_Hidden=False,
    Input_1_Name="Falsecolor",
    Input_2_Hidden=False,
    Input_2_Name="File Path",
    UnitSystem=4)
panel_17 = Panel(utci)

# ==== cluster Cluster
L = ClusterInput()
lng = ListLength(List=L)
series = Series(Start=0, Step=1, Count=lng)
gradient = Gradient(
    LowerLimit=0,
    UpperLimit=lng,
    Parameter=series,
    stops=[0: RGB(243, 57, 0), 0.1: RGB(236, 27, 60), 0.2: RGB(210, 0, 118), 0.3: RGB(103, 0, 120), 0.4: RGB(39, 72, 161), 0.5: RGB(1, 192, 229), 0.6: RGB(18, 178, 90), 0.7: RGB(79, 186, 8), 0.8: RGB(220, 237, 32), 0.9: RGB(247, 159, 20), 1: RGB(243, 57, 0)])
concat = Concatenate(FragmentA="Panel ", FragmentB=series)
C = ClusterOutput(gradient)
R = ClusterOutput(concat)

# ==== cluster Cluster_2
doy = ClusterInput()
md = MonthAndDay(DayOfYearIndex=doy)  # -> Month, Day
hoy = HourOfYear(Month=md.Month, Day=md.Day, Hour=1)
multiplication = Multiplication(A="24", B="7")
addition = Addition(A=hoy, B=multiplication)
dom = ConstructDomain(DomainStart=hoy, DomainEnd=addition)
I = ClusterOutput(dom)
